# Grasshopper definition 02_iaac_damage_evaluation.ghx (Grasshopper 1.0.8)
# plug-ins: MetaHopper

assembly_path = Python3Script()  # -> DATA
# ---------- assembly_path: Python ----------
import os
import getpass

username = getpass.getuser()
USER_FOLDER = os.path.abspath(os.path.join("C:/Users/", username))
DATA = os.path.abspath(os.path.join(USER_FOLDER,"workspace/projects/workshop_iaac_2026/data/assembly"))

print(USER_FOLDER)
print(DATA)
# ---------- end assembly_path ----------

# ----
# Parse Assembly file with Damage Information
# Load the Assembly File
# with Damages
panel = Panel("material_stack_1_with_damages")
assembly_path_2 = Python3Script(filename=panel)  # -> out, DATA
# ---------- assembly_path_2: Python ----------
import os
import getpass

username = getpass.getuser()
USER_FOLDER = os.path.abspath(os.path.join("C:/Users/", username))
DATA = os.path.abspath(os.path.join(USER_FOLDER,"workspace/projects/workshop_iaac_2026/data/assembly/{}.json".format(filename)))

print(USER_FOLDER)
print(DATA)
# ---------- end assembly_path_2 ----------

panel_2 = Panel(assembly_path)

# ----
# Parse the Assembly
# and extract data
# Modify the mapping to change
# the damage assessment system
custom_damage_status_mapping = Panel("""{
  "crack": 2,
  "spalling": 3,
  "material loss": 6,
  "staining": 1,
  "chipping": 4
}""")
parse_assembly_with_damages = Python3Script(json_path=assembly_path_2.DATA, damage_map=custom_damage_status_mapping)  # -> out, stack_key, T_planes, T_dims, T_ids, T_built_flag, T_damage_value, T_damage_status_int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; inputs damage_map: String
# ---------- parse_assembly_with_damages: Python ----------
import json
import Rhino.Geometry as rg
from Grasshopper import DataTree
from Grasshopper.Kernel.Data import GH_Path

# =========================
# INPUTS
# json_path : str
# damage_map : dict (optional)
# =========================

# =========================
# OUTPUTS
# T_planes
# T_dims              <-- now 3 items per branch
# T_ids
# T_damage_value      <-- padded
# T_damage_status_int <-- padded
# T_damage_status_txt
# T_damage_type
# T_damage_vertices
# T_damage_uv
# T_damage_desc
# =========================

def parse_damage_map(x):
    # x can be dict already (if you pass it as a dict), or a string from Panel
    if isinstance(x, dict):
        return {str(k).strip().lower(): int(v) for k, v in x.items()}

    if x is None:
        return None

    s = str(x).strip()
    if not s:
        return None

    # try JSON first
    try:
        d = json.loads(s)
        if isinstance(d, dict):
            return {str(k).strip().lower(): int(v) for k, v in d.items()}
    except:
        pass

    return None

DEFAULT_damage_map = {
    "crack": 2,
    "spalling": 3,
    "material loss": 5,
    "staining": 1,
    "chipping": 4
}

def _norm_status(s):
    return str(s).strip().lower()

def _safe_get(dct, path, default=None):
    cur = dct
    for k in path.split("."):
        if not isinstance(cur, dict) or k not in cur:
            return default
        cur = cur[k]
    return cur

def _sort_key(k):
    try:
        return int(k)
    except:
        return str(k)

def _pt(p):
    return rg.Point3d(float(p[0]), float(p[1]), float(p[2]))

def _vec(v):
    return rg.Vector3d(float(v[0]), float(v[1]), float(v[2]))

def frame_dict_to_plane(frame_dict):
    if not frame_dict:
        return None
    p = frame_dict.get("point", None)
    x = frame_dict.get("xaxis", None)
    y = frame_dict.get("yaxis", None)
    if p is None or x is None or y is None:
        return None

    pl = rg.Plane(_pt(p), _vec(x), _vec(y))
    if not pl.IsValid:
        xv = _vec(x); yv = _vec(y)
        xv.Unitize(); yv.Unitize()
        pl = rg.Plane(_pt(p), xv, yv)
    return pl if pl.IsValid else None

def load_json(path):
    with open(path, "r") as f:
        return json.load(f)

def add_to_tree(tree, path, item):
    tree.Add(item, path)

def main(obj, damage_map=None):

    if damage_map is None:
        damage_map = DEFAULT_damage_map

    nodes = _safe_get(obj, "data.graph.node", {}) or {}
    node_keys_sorted = sorted(nodes.keys(), key=_sort_key)

    # Output trees
    T_planes = DataTree[object]()
    T_dims = DataTree[object]()                 # 3 items per branch
    T_ids = DataTree[object]()
    T_built = DataTree[object]()

    T_damage_value = DataTree[object]()         # padded
    T_damage_status_int = DataTree[object]()    # padded

    T_damage_status_txt = DataTree[object]()
    T_damage_type = DataTree[object]()
    T_damage_vertices = DataTree[object]()
    T_damage_uv = DataTree[object]()
    T_damage_desc = DataTree[object]()

    # ============================================================
    # PASS 1: collect damage lists per brick (for padding)
    # ============================================================
    status_int_lists = []
    value_lists = []

    for node_key in node_keys_sorted:
        node = nodes[node_key] or {}
        damages_dict = node.get("damages", {}) or {}

        status_list = []
        value_list = []

        for dkey in sorted(damages_dict.keys(), key=_sort_key):
            d = damages_dict[dkey] or {}
            status_txt = d.get("status", "")
            status_int = damage_map.get(_norm_status(status_txt), 0)
            value = d.get("value", 0) or 0

            status_list.append(status_int)
            value_list.append(value)

        status_int_lists.append(status_list)
        value_lists.append(value_list)

    max_damages = max([len(lst) for lst in status_int_lists] + [0])

    # ============================================================
    # PASS 2: build trees
    # ============================================================
    for i, node_key in enumerate(node_keys_sorted):

        node = nodes[node_key] or {}
        part = node.get("part", {}) or {}
        part_data = part.get("data", {}) or {}
        part_attrs = part_data.get("attributes", {}) or {}

        path = GH_Path(i)

        # ---- Plane ----
        frame = part_data.get("frame", None) or {}
        plane = frame_dict_to_plane(frame)
        add_to_tree(T_planes, path, plane)

        # ---- Dimensions: ADD AS 3 ITEMS (x, y, z) ----
        shape = part_attrs.get("shape", None) or {}
        shape_data = shape.get("data", None) or {}
        xsize = shape_data.get("xsize", None)
        ysize = shape_data.get("ysize", None)
        zsize = shape_data.get("zsize", None)

        # Add each dimension as separate item in the same branch
        add_to_tree(T_dims, path, xsize)
        add_to_tree(T_dims, path, ysize)
        add_to_tree(T_dims, path, zsize)

        # ---- IDs (one tuple item per branch) ----
        part_key = part_data.get("key", None)
        part_guid = part.get("guid", None)
        qcode = node.get("qcode", None)
        add_to_tree(T_ids, path, (
            part_key))

        # ---- Raw damage info (existing only) ----
        damages_dict = node.get("damages", {}) or {}
        for dkey in sorted(damages_dict.keys(), key=_sort_key):
            d = damages_dict[dkey] or {}
            add_to_tree(T_damage_status_txt, path, d.get("status", ""))
            add_to_tree(T_damage_type, path, d.get("type", None))
            add_to_tree(T_damage_vertices, path, d.get("vertices", None))
            add_to_tree(T_damage_uv, path, d.get("uv", None))
            add_to_tree(T_damage_desc, path, d.get("description", None))
        
        # Add the built key
        node = nodes[node_key] or {}
        path = GH_Path(i)
        built_flag = node.get("built", None)
        add_to_tree(T_built, path, built_flag)

        # ---- PADDED damage vectors ----
        padded_status = status_int_lists[i] + [0] * (max_damages - len(status_int_lists[i]))
        padded_values = value_lists[i] + [0] * (max_damages - len(value_lists[i]))

        for val in padded_status:
            add_to_tree(T_damage_status_int, path, val)

        for val in padded_values:
            add_to_tree(T_damage_value, path, val)

    return (
        T_planes, T_dims, T_ids,
        T_built,
        T_damage_value, T_damage_status_int,
        T_damage_status_txt, T_damage_type,
        T_damage_vertices, T_damage_uv, T_damage_desc
    )

# -------- run --------
obj = load_json(json_path)

stack_key = _safe_get(obj, "data.graph.attributes.stack_key", None)

custom_map = parse_damage_map(damage_map)
(T_planes, T_dims, T_ids, T_built_flag,
 T_damage_value, T_damage_status_int,
 T_damage_status_txt, T_damage_type,
 T_damage_vertices, T_damage_uv, T_damage_desc) = main(obj, damage_map=custom_map)
# ---------- end parse_assembly_with_damages ----------

# ----
# Display the extracted data
source_brick_key = Panel(parse_assembly_with_damages.T_ids)
source_brick_built_flags = Panel(parse_assembly_with_damages.T_built_flag)
source_brick_damage_list = Panel(parse_assembly_with_damages.T_damage_status_txt)
source_brick_damage_amount = Panel(parse_assembly_with_damages.T_damage_status_int)
source_brick_damage_value = Panel(parse_assembly_with_damages.T_damage_value)

panel_3 = Panel(parse_assembly_with_damages.stack_key)

# ----
# Create a damage score for
# each brick and store in the path of every brick
multiplication = Multiplication(A=parse_assembly_with_damages.T_damage_value, B=parse_assembly_with_damages.T_damage_status_int)
ma = MassAddition(Input=multiplication)  # -> Result, PartialResults

# ----
# Sort the bricks and plane
# according to damage score.
brick_planes = FlattenTree(Tree=parse_assembly_with_damages.T_planes, Path="{0}")
damage_score = FlattenTree(Tree=ma.Result, Path="{0}")
brick_id = FlattenTree(Tree=parse_assembly_with_damages.T_ids, Path="{0}")
sort = SortList(Keys=damage_score, ValuesA=brick_planes)  # -> Keys, ValuesA
sort_2 = SortList(Keys=damage_score, ValuesA=brick_id)  # -> Keys, ValuesA

# ----
# Load the Assembly File
# with Damages
panel_4 = Panel("260223_new_assembly_")
assembly_path_3 = Python3Script(filename=panel_4)  # -> out, DATA; same code as assembly_path_2

# ----
# Name for the new Assembly file that
# will have remapped bricks
panel_5 = Panel("damage_remapped_assembly")
assembly_path_4 = Python3Script(name=panel_5)  # -> out, DATA
# ---------- assembly_path_4: Python ----------
import os
import getpass
from datetime import datetime

username = getpass.getuser()

USER_FOLDER = os.path.abspath(os.path.join("C:/Users/", username))

time_as_string = datetime.now().strftime("%H%M%S")
date_as_string = datetime.now().strftime("%y%m%d")
filename = date_as_string + "_"+ time_as_string +"_" + name

DATA = os.path.abspath(os.path.join(USER_FOLDER,"workspace/projects/workshop_iaac_2026/data/assembly/{}.json".format(filename)))

print(USER_FOLDER)
print(DATA)
# ---------- end assembly_path_4 ----------

# ----
# Preview the brick Geometry
item = ListItem(List=parse_assembly_with_damages.T_dims, Index=0, Wrap=True)  # -> Item, Item1, Item2
flatten = FlattenTree(Tree=item.Item, Path="{0}")
flatten_2 = FlattenTree(Tree=item.Item1, Path="{0}")
flatten_3 = FlattenTree(Tree=item.Item2, Path="{0}")
cset = CreateSet(List=flatten)  # -> Set, Map
cset_2 = CreateSet(List=flatten_2)  # -> Set, Map
cset_3 = CreateSet(List=flatten_3)  # -> Set, Map
cluster = Cluster(planes_of_brick=parse_assembly_with_damages.T_planes, length=cset.Set, breadth=cset_2.Set, height=cset_3.Set)
flatten_4 = FlattenTree(Tree=cluster, Path="{0}")
flatten_5 = FlattenTree(Tree=ma.Result, Path="{0}")
gradient = Gradient(
    LowerLimit="0",
    UpperLimit="350",
    Parameter=flatten_5,
    stops=[0: RGB(255, 255, 255), 0.312: RGB(255, 130, 160), 0.855: RGB(220, 0, 40)])
toggle = GroupToggle(ToggleActive=False, ToggleVisible=True)  # disabled
preview = CustomPreview(Geometry=flatten_4, Material=gradient)

# ----
# Display the damage scores
panel_6 = Panel("Damage_Score: ")
deplane = DeconstructPlane(Plane=parse_assembly_with_damages.T_planes)  # -> Origin, XAxis, YAxis, ZAxis
concat = Concatenate(FragmentA=panel_6, FragmentB=ma.Result)
move = Move(Geometry=deplane.Origin, Motion=expr("-x*.05", deplane.ZAxis))  # -> Geometry, Transform
toggle_2 = GroupToggle(ToggleActive=False, ToggleVisible=True)  # disabled
tag = TextTag3D(Location=move.Geometry, Text=concat, Size=".015", Colour=RGB(0, 0, 0), Justification=5)

# ----
# Remap damaged bricks to new assembly
# assembly.graph.node_atrribute(key,"source_stack_key", stack_key)
# assembly.graph.node_atrribute(key,"source_brick_key", brick_key)
write_json = Button()
create_new_json = BooleanToggle(True)
py3 = Python3Script(
    write_file=write_json,
    assembly_path=assembly_path_3.DATA,
    output_path=assembly_path_4.DATA,
    source_stack_key=panel_3,
    supply_brick_ids=flatten(parse_assembly_with_damages.T_ids),
    supply_damage_scores=flatten(ma.Result),
    write_to_node=create_new_json)  # -> out, assigned_count, target_node_keys, assigned_supply_ids, assigned_scores, assignements, updated_json, wrote_file; inputs write_file: Boolean, assembly_path: String, output_path: String, source_stack_key: Int32, supply_brick_ids: list of Int32, supply_damage_scores: list of Int32
# ---------- py3: Python ----------
import json
import os

# =========================
# INPUTS (Grasshopper)
# assembly_path         : str   (path to target/new assembly JSON)
# output_path           : str   (path to write updated JSON)
# source_stack_key      : int   (single integer applied to all assigned nodes)
# supply_brick_ids      : list[int] or list[str]
# supply_damage_scores  : list[float]
# write_to_node         : bool
# write_file            : bool   (ONLY when True the file is written to disk)
# =========================

# =========================
# OUTPUTS (Grasshopper)
# assigned_count
# target_node_keys
# assigned_supply_ids
# assigned_scores
# assignments
# updated_json
# wrote_file
# =========================


def _safe_get(dct, path, default=None):
    cur = dct
    for k in path.split("."):
        if not isinstance(cur, dict) or k not in cur:
            return default
        cur = cur[k]
    return cur


def _sort_key(k):
    try:
        return int(k)
    except Exception:
        return str(k)


def to_float(x, default=0.0):
    try:
        return float(x)
    except Exception:
        return default


def to_int(x):
    try:
        return int(x)
    except Exception:
        return None


def load_json(path):
    if path is None or not str(path).strip():
        raise ValueError("assembly_path is empty.")
    path = str(path).strip()
    if not os.path.exists(path):
        raise FileNotFoundError("File not found: {}".format(path))
    with open(path, "r", encoding="utf-8") as f:
        return json.load(f)


def write_json(obj, path):
    if path is None or not str(path).strip():
        raise ValueError("output_path is empty.")
    path = str(path).strip()

    out_dir = os.path.dirname(path)
    if out_dir and not os.path.exists(out_dir):
        os.makedirs(out_dir, exist_ok=True)

    with open(path, "w", encoding="utf-8") as f:
        json.dump(obj, f, ensure_ascii=False, indent=2)


def get_node_z(node):
    try:
        return float(node.get("z", 0.0))
    except Exception:
        return 0.0


# -------------------------
# Main
# -------------------------
try:
    # defaults / guards
    if write_to_node is None:
        write_to_node = True
    else:
        write_to_node = bool(write_to_node)

    # force single integer stack key
    source_stack_key_int = to_int(source_stack_key)
    if source_stack_key_int is None:
        raise ValueError("source_stack_key must be an integer (e.g., 1).")

    supply_brick_ids = supply_brick_ids or []
    supply_damage_scores = supply_damage_scores or []

    # Build supply list: (brick_id:int, score:float)
    n_supply = min(len(supply_brick_ids), len(supply_damage_scores))
    supply = []
    for i in range(n_supply):
        bid = to_int(supply_brick_ids[i])
        if bid is None:
            continue  # skip invalid id
        score = to_float(supply_damage_scores[i])
        supply.append((bid, score))

    # Sort supply by damage score (least damaged first)
    supply.sort(key=lambda t: t[1])

    # Load target assembly
    obj = load_json(assembly_path)

    # Nodes dict: obj["data"]["graph"]["node"]
    nodes = _safe_get(obj, "data.graph.node", {}) or {}
    node_keys_sorted = sorted(nodes.keys(), key=_sort_key)

    # Sort target nodes by Z ascending (lowest first)
    targets = []
    for nk in node_keys_sorted:
        node = nodes.get(nk, {}) or {}
        targets.append((nk, get_node_z(node)))
    targets.sort(key=lambda t: t[1])

    # Assign up to supply limit
    assigned_count = min(len(targets), len(supply))

    target_node_keys = []
    assigned_supply_ids = []
    assigned_scores = []
    assignments = []

    for i in range(assigned_count):
        target_key, tz = targets[i]
        brick_id, score = supply[i]

        target_node_keys.append(str(target_key))
        assigned_supply_ids.append(int(brick_id))
        assigned_scores.append(float(score))

        assignments.append(
            "{} (z={:.4f}) -> brick={} (score={:.4f}), source_stack_key={}".format(
                str(target_key), float(tz), int(brick_id), float(score), int(source_stack_key_int)
            )
        )

        if write_to_node:
            node = nodes.get(target_key, {}) or {}

            # Equivalent intent to:
            # assembly.graph.node_attribute(target_key, "source_stack_key", source_stack_key_int)
            # assembly.graph.node_attribute(target_key, "source_brick_key", brick_id)
            node["source_stack_key"] = int(source_stack_key_int)
            node["source_brick_key"] = int(brick_id)

            # optional: keep the score too (handy for debugging/filtering)
            node["source_damage_score"] = float(score)

            nodes[target_key] = node

    wrote_file = False

    if write_to_node:
        obj["data"]["graph"]["node"] = nodes
        updated_json = json.dumps(obj, ensure_ascii=False, indent=2)
    else:
        updated_json = None

    # -------- WRITE TO DISK ONLY IF BOOLEAN IS TRUE --------
    if write_file:
        if updated_json is None:
            # ensure JSON is up-to-date even if write_to_node was False
            updated_json = json.dumps(obj, ensure_ascii=False, indent=2)

        write_json(obj, output_path)
        wrote_file = True

except Exception as e:
    print("ERROR:", e)

    assigned_count = 0
    target_node_keys = []
    assigned_supply_ids = []
    assigned_scores = []
    assignments = []
    updated_json = None
    wrote_file = False
# ---------- end py3 ----------
file_exported = Panel(py3.wrote_file)

# ==== cluster Cluster
length = ClusterInput()  # Length of Brick
breadth = ClusterInput()  # Breadth of Brick
height = ClusterInput()  # Height of the Brick
planes_of_brick = ClusterInput()  # Planes for the Brick Visualization
dom = ConstructDomain(DomainStart=expr("-x/2", length), DomainEnd=expr("x/2", length))
dom_2 = ConstructDomain(DomainStart=expr("-x/2", breadth), DomainEnd=expr("x/2", breadth))
rectangle = Rectangle(Plane=planes_of_brick, XSize=dom, YSize=dom_2, Radius=0)  # -> Rectangle, Length
Z = UnitZ(Factor=height)
extr = Extrude(Base=rectangle.Rectangle, Direction=Z)
cap = CapHoles(Brep=extr)
bricks = ClusterOutput(cap)  # Visualized Brick
