# Grasshopper definition iaac_detect-damages-with-gemini.ghx (Grasshopper 1.0.8)

system_promt_setting_the_rules = Panel("""You are a deterministic damage extraction engine for a COMPAS Assembly Information Model.

Goal
Given input image or images and a GEOMETRY_CONTEXT_JSON derived from an existing Assembly JSON, detect only the clearly visible damages on the brick and output only a compact JSON payload containing the new damages to append.
Do not output the full Assembly JSON. Output only damages, you are sure about.

Inputs you may receive
1. GEOMETRY_CONTEXT_JSON: A JSON string providing bbox, frame, and dirFaces mapping directions to face indices and centroids
2. imagePathA: Primary photo, showing the top, front and right sides of the brick
3. imagePathB: Optional secondary photo of the same brick, from another angle, showing the top, back and right sides of the brick
4. userPrompt: Optional instruction, lower priority than this system message
5. referenceImagePath and referenceJson may be provided as examples, ignore unless explicitly needed
6. pdfPath may be provided, ignore unless explicitly needed

Hard output rules
1. Output must be a single valid JSON object only
2. Do not output markdown, code fences, explanations, comments, or any other text
3. Output must have exactly these top level keys:
   "nodeKey"
   "appendDamages"
4. nodeKey must be the string "0"
5. appendDamages must be an array of damage objects. If no damages are found, appendDamages must be an empty array

Damage object schema
Each element of appendDamages must follow this schema:
{
  "type": "face" | "edge" | "vertex",
  "vertices": [int],
  "status": "Chipping" | "Spalling" | Staining" | "Material Loss" |"Crack"
  "value": int,
  "uv": [u, v],
  "description": "A detailed descriptive sentence.",
  "coordinates": {
    "point": [x, y, z],
    "xaxis": [1, 0, 0],
    "yaxis": [0, 1, 0]
  }
}

Important details
1. Do not include any id field. The host script will generate ids.
2. Do not include any incremental key. The host script will assign dictionary keys.
3. value must be an integer from 0 to 5 inclusive
4. vertices meaning:
   If type is face then vertices is [face_index]
   If type is edge then vertices is [u, v] sorted ascending
   If type is vertex then vertices is [vertex_index]
5. uv is only required for type "face". For type "edge" and "vertex" omit uv.

Orientation convention
Front, Back, Right, Left, Top, Bottom are defined only by the Part frame of the Assembly.
FrontDir is frame.yaxis
RightDir is frame.xaxis
TopDir is frame.zaxis

You will receive GEOMETRY_CONTEXT_JSON.
Use GEOMETRY_CONTEXT_JSON.dirFaces to map directions to face indices and centroids.
Do not redefine front, back, right, left, top, bottom based on photo labels.
Photo labels may exist and should match the convention, but they do not override it.

Precise localization with uv
For type "face" you must provide uv = [u, v] with values from 0 to 1.
uv describes the damage center on the chosen face in the face plane.

Define u and v directions using the Part frame directions.
RightDir is frame.xaxis
FrontDir is frame.yaxis
TopDir is frame.zaxis

If the chosen face is front or back
u increases along +RightDir
v increases along +TopDir

If the chosen face is left or right
u increases along +FrontDir
v increases along +TopDir

If the chosen face is top or bottom
u increases along +RightDir
v increases along +FrontDir

u = 0 is the minimum coordinate on that face along the u direction
u = 1 is the maximum coordinate on that face along the u direction
v = 0 is the minimum coordinate on that face along the v direction
v = 1 is the maximum coordinate on that face along the v direction

Provide uv with two decimals.
For face type, coordinates.point should be your best estimate of the damage center on that face.
The host will recompute coordinates.point from uv.

Face mapping rules
1. When a damage is on a surface region, use type "face"
2. If the damage is clearly on an edge, use type "edge"
3. If the damage is clearly on a corner, use type "vertex"
4. For face type, always choose a face index that exists in GEOMETRY_CONTEXT_JSON.dirFaces

Canonical faces to use
Use these direction labels and the corresponding face indices from GEOMETRY_CONTEXT_JSON.dirFaces:
top, bottom, front, back, left, right

Photo orientation notes
If arrows and labels are visible on the photo, they are only confirmations.
They must not override the frame based convention.

Damage detection rules
1. Detect all clearly visible damages in the image or images
2. Markers such as orange dots count as damages
3. If both imagePathA and imagePathB are provided, merge detections and avoid duplicates
4. Do not hallucinate damages that are not clearly visible

Description rules
1. description must be a single sentence
2. Always reference surfaces using only these labels: top, bottom, front, back, left, right
3. These labels follow GEOMETRY_CONTEXT_JSON.dirFaces

Coordinates rules
1. coordinates.xaxis must be [1, 0, 0]
2. coordinates.yaxis must be [0, 1, 0]
3. For face type, coordinates.point should be on the chosen face. If unsure, use that face centroid from GEOMETRY_CONTEXT_JSON.dirFaces

If you cannot detect any damages
Return:
{ "nodeKey": "0", "appendDamages": [] }""")

# ----
# The most important Rules with API:
# 
# 1 Never embed API keys in GH files, scripts, screenshots, or recordings
# 
# 2 One person, one key - No shared master keys
# 
# 3 Never commit the key to Github
# 
# 4 Enforce hard daily and monthly spend caps per key
# 
# 5 Rate limit, use backoff, and cap retries. No infinite loops
# 
# 6 Cache static data in sc.sticky to avoid repeat calls
# 
# 7 Only call the API on an explicit button press, not on recompute
# 
# 8 Downscale and compress images. Send the minimum views needed
# 
# 9 Log timestamps, model, input size, output size. Never log keys
# 
# 10 Fail closed on missing key, invalid key, or quota reached
# Test the Connection by writing a Poem
panel = Panel("C:\Users\tizianrein\Desktop\GeminiKey.txt")
run = Button()
connection_test_to_vlm = Python3Script(keyPath=panel, run=run)  # -> log, haiku; inputs keyPath: String
# ---------- connection_test_to_vlm: Python ----------
# r: google-generativeai
import google.generativeai as genai
import time
import os
import scriptcontext as sc

KEY_TEXT = "gemini_last_text"
KEY_LOG = "gemini_last_log"
KEY_ERR = "gemini_last_error"
KEY_TIME = "gemini_last_time"

if KEY_TEXT not in sc.sticky:
    sc.sticky[KEY_TEXT] = ""
if KEY_LOG not in sc.sticky:
    sc.sticky[KEY_LOG] = []
if KEY_ERR not in sc.sticky:
    sc.sticky[KEY_ERR] = None
if KEY_TIME not in sc.sticky:
    sc.sticky[KEY_TIME] = None

# Read stored values first so outputs always show something
haiku = sc.sticky.get(KEY_TEXT, "")
log_list = sc.sticky.get(KEY_LOG, [])
error = sc.sticky.get(KEY_ERR, None)
executionTime = sc.sticky.get(KEY_TIME, None)

if not isinstance(log_list, list):
    log_list = [str(log_list)]

def _sanitize_key(raw):
    if raw is None:
        return ""
    k = raw

    # Remove UTF-8 BOM if present
    if len(k) > 0 and ord(k[0]) == 65279:
        k = k[1:]

    k = k.strip()

    # Remove wrapping quotes if file contains "AIza..." or 'AIza...'
    if (k.startswith('"') and k.endswith('"')) or (k.startswith("'") and k.endswith("'")):
        k = k[1:-1].strip()

    # If multiple lines, take first non-empty line
    if "\n" in k or "\r" in k:
        parts = [p.strip() for p in k.replace("\r", "\n").split("\n") if p.strip()]
        k = parts[0] if parts else ""

    return k.strip()

def mask_key(k):
    if not k:
        return ""
    if len(k) <= 8:
        return "*" * len(k)
    return k[:4] + "..." + k[-4:]

if run:
    startTime = time.time()
    log_list = []
    error = None
    executionTime = None

    log_list.append("Starting Gemini API connection test...")

    try:
        if not keyPath or not str(keyPath).strip():
            raise Exception("keyPath input is missing.")

        kp = str(keyPath).strip()
        log_list.append("Loading API key from: {}".format(kp))

        if not os.path.exists(kp):
            raise Exception("API key file not found at given path: {}".format(kp))

        with open(kp, "r") as file:
            raw = file.read()

        apiKey = _sanitize_key(raw)
        if not apiKey:
            raise Exception("API key file is empty or contains only whitespace.")

        log_list.append("API key loaded successfully.")
        log_list.append("API key preview: {}".format(mask_key(apiKey)))

        genai.configure(api_key=apiKey)
        log_list.append("API configured.")

        model = genai.GenerativeModel("gemini-2.5-flash-lite")
        log_list.append("Model initialized: gemini-2.5-flash-lite")

        prompt = "Write a haiku from the perspective of a robot."
        log_list.append('Sending prompt: "{}"'.format(prompt))

        response = model.generate_content(prompt)
        textOut = response.text or ""

        log_list.append("SUCCESS! Connection established.")
        log_list.append("Text received.")

    except Exception as e:
        error = "FAILED! Error: {}".format(e)
        log_list.append(error)

    executionTime = time.time() - startTime
    log_list.append("Execution finished in {:.3f}s".format(executionTime))

    # Store results so they remain after the button returns to False
    sc.sticky[KEY_TEXT] = textOut
    sc.sticky[KEY_LOG] = log_list
    sc.sticky[KEY_ERR] = error
    sc.sticky[KEY_TIME] = executionTime

# Output values every run
log = "\n".join(log_list)

# Suggested GH outputs:
# textOut -> panel
# error -> panel
# executionTime -> panel
# log -> panel
# ---------- end connection_test_to_vlm ----------
panel_2 = Panel(connection_test_to_vlm.log)
panel_3 = Panel(connection_test_to_vlm.haiku)

system_promt_setting_the_rules_2 = Panel("""You are a deterministic damage extraction engine for a COMPAS Assembly Information Model.

Goal
Given input image or images and a GEOMETRY_CONTEXT_JSON derived from an existing Assembly JSON, detect clearly visible damages on the brick and output only a compact JSON payload containing the new damages to append.
Do not output the full Assembly JSON.

Inputs you may receive
1. GEOMETRY_CONTEXT_JSON: A JSON string providing bbox, frame, and dirFaces mapping directions to face indices and centroids
2. imagePathA: Primary photo
3. imagePathB: Optional secondary photo of the same brick
4. userPrompt: Optional instruction, lower priority than this system message
5. referenceImagePath and referenceJson may be provided as examples, ignore unless explicitly needed
6. pdfPath may be provided, ignore unless explicitly needed

Hard output rules
1. Output must be a single valid JSON object only
2. Do not output markdown, code fences, explanations, comments, or any other text
3. Output must have exactly these top level keys:
   "nodeKey"
   "appendDamages"
4. nodeKey must be the string "0"
5. appendDamages must be an array of damage objects. If no damages are found, appendDamages must be an empty array

Damage object schema
Each element of appendDamages must follow this schema:
{
  "type": "face" | "edge" | "vertex",
  "vertices": [int],
  "status": "Chipping" | "Spalling" | "Material Loss" |"Crack"
  "value": int,
  "uv": [u, v],
  "description": "A detailed descriptive sentence.",
  "coordinates": {
    "point": [x, y, z],
    "xaxis": [1, 0, 0],
    "yaxis": [0, -1, 0]
  }
}

Important details
1. Do not include any id field. The host script will generate ids.
2. Do not include any incremental key. The host script will assign dictionary keys.
3. value must be an integer from 0 to 5 inclusive
4. vertices meaning:
   If type is face then vertices is [face_index]
   If type is edge then vertices is [u, v] sorted ascending
   If type is vertex then vertices is [vertex_index]
5. uv is only required for type "face". For type "edge" and "vertex" omit uv.

Orientation convention
Front, Back, Right, Left, Top, Bottom are defined only by the Part frame of the Assembly.
FrontDir is frame.yaxis
RightDir is frame.xaxis
TopDir is frame.zaxis

You will receive GEOMETRY_CONTEXT_JSON.
Use GEOMETRY_CONTEXT_JSON.dirFaces to map directions to face indices and centroids.
Do not redefine front, back, right, left, top, bottom based on photo labels.
Photo labels may exist and should match the convention, but they do not override it.

Precise localization with uv
For type "face" you must provide uv = [u, v] with values from 0 to 1.
uv describes the damage center on the chosen face in the face plane.

Define u and v directions using the Part frame directions.
RightDir is frame.xaxis
FrontDir is frame.yaxis
TopDir is frame.zaxis

If the chosen face is front or back
u increases along +RightDir
v increases along +TopDir

If the chosen face is left or right
u increases along +FrontDir
v increases along +TopDir

If the chosen face is top or bottom
u increases along +RightDir
v increases along +FrontDir

u = 0 is the minimum coordinate on that face along the u direction
u = 1 is the maximum coordinate on that face along the u direction
v = 0 is the minimum coordinate on that face along the v direction
v = 1 is the maximum coordinate on that face along the v direction

Provide uv with two decimals.
For face type, coordinates.point should be your best estimate of the damage center on that face.
The host will recompute coordinates.point from uv.

Face mapping rules
1. When a damage is on a surface region, use type "face"
2. If the damage is clearly on an edge, use type "edge"
3. If the damage is clearly on a corner, use type "vertex"
4. For face type, always choose a face index that exists in GEOMETRY_CONTEXT_JSON.dirFaces

Canonical faces to use
Use these direction labels and the corresponding face indices from GEOMETRY_CONTEXT_JSON.dirFaces:
top, bottom, front, back, left, right

Photo orientation notes
If arrows and labels are visible on the photo, they are only confirmations.
They must not override the frame based convention.

Damage detection rules
1. Detect all clearly visible damages in the image or images
2. Markers such as orange dots count as damages
3. If both imagePathA and imagePathB are provided, merge detections and avoid duplicates
4. Do not hallucinate damages that are not clearly visible

Description rules
1. description must be a single sentence
2. Always reference surfaces using only these labels: top, bottom, front, back, left, right
3. These labels follow GEOMETRY_CONTEXT_JSON.dirFaces

Coordinates rules
1. coordinates.xaxis must be [1, 0, 0]
2. coordinates.yaxis must be [0, -1, 0]
3. For face type, coordinates.point should be on the chosen face. If unsure, use that face centroid from GEOMETRY_CONTEXT_JSON.dirFaces

If you cannot detect any damages
Return:
{ "nodeKey": "0", "appendDamages": [] }""")
image_path_optional = Panel("C:\Users\tizianrein\workspace\projects\workshop_iaac_2026\data\images_evaluation\brick8_viewA.jpg")
image_path_optional_2 = Panel("C:\Users\tizianrein\workspace\projects\workshop_iaac_2026\data\images_evaluation\brick8_viewB.jpg")
existing_json_needed = Panel("""{
    "dtype": "assembly_information_model.assembly/Assembly",
    "data": {
        "graph": {
            "attributes": {},
            "default_node_attributes": {
                "x": 0,
                "y": 0,
                "z": 0
            },
            "default_edge_attributes": {},
            "node": {
                "0": {
                    "part": {
                        "dtype": "assembly_information_model.part/Part",
                        "data": {
                            "attributes": {
                                "name": "brick_full",
                                "mesh": {
                                    "dtype": "compas.datastructures/Mesh",
                                    "data": {
                                        "attributes": {},
                                        "default_vertex_attributes": {
                                            "x": 0,
                                            "y": 0,
                                            "z": 0
                                        },
                                        "default_edge_attributes": {},
                                        "default_face_attributes": {},
                                        "vertex": {
                                            "0": {
                                                "x": -0.125,
                                                "y": 0.06,
                                                "z": 0.0325
                                            },
                                            "1": {
                                                "x": -0.125,
                                                "y": -0.06,
                                                "z": 0.0325
                                            },
                                            "2": {
                                                "x": 0.125,
                                                "y": -0.06,
                                                "z": 0.0325
                                            },
                                            "3": {
                                                "x": 0.125,
                                                "y": 0.06,
                                                "z": 0.0325
                                            },
                                            "4": {
                                                "x": -0.125,
                                                "y": 0.06,
                                                "z": -0.0325
                                            },
                                            "5": {
                                                "x": 0.125,
                                                "y": 0.06,
                                                "z": -0.0325
                                            },
                                            "6": {
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""")
image_path_optional_3 = Panel("C:\Users\tizianrein\workspace\projects\workshop_iaac_2026\data\brick_images\IMG_4184.jpg")
image_path_optional_4 = Panel("C:\Users\tizianrein\workspace\projects\workshop_iaac_2026\data\brick_images\IMG_4182.jpeg")
existing_json_needed_2 = Panel("""{
    "dtype": "assembly_information_model.assembly/Assembly",
    "data": {
        "graph": {
            "attributes": {},
            "default_node_attributes": {
                "x": 0,
                "y": 0,
                "z": 0
            },
            "default_edge_attributes": {},
            "node": {
                "0": {
                    "part": {
                        "dtype": "assembly_information_model.part/Part",
                        "data": {
                            "attributes": {
                                "name": "brick_full",
                                "mesh": {
                                    "dtype": "compas.datastructures/Mesh",
                                    "data": {
                                        "attributes": {},
                                        "default_vertex_attributes": {
                                            "x": 0,
                                            "y": 0,
                                            "z": 0
                                        },
                                        "default_edge_attributes": {},
                                        "default_face_attributes": {},
                                        "vertex": {
                                            "0": {
                                                "x": -0.125,
                                                "y": 0.06,
                                                "z": 0.0325
                                            },
                                            "1": {
                                                "x": -0.125,
                                                "y": -0.06,
                                                "z": 0.0325
                                            },
                                            "2": {
                                                "x": 0.125,
                                                "y": -0.06,
                                                "z": 0.0325
                                            },
                                            "3": {
                                                "x": 0.125,
                                                "y": 0.06,
                                                "z": 0.0325
                                            },
                                            "4": {
                                                "x": -0.125,
                                                "y": 0.06,
                                                "z": -0.0325
                                            },
                                            "5": {
                                                "x": 0.125,
                                                "y": 0.06,
                                                "z": -0.0325
                                            },
                                            "6": {
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""")

run_the_generative_model = Button()
ai_brick_evaluation = Python3Script(
    imagePathA=image_path_optional,
    existingJson=existing_json_needed,
    keyPath=panel,
    systemPrompt=system_promt_setting_the_rules,
    run=run_the_generative_model)  # -> error, jsonOutput, model, executionTime; inputs imagePathA: String, keyPath: String
# ---------- ai_brick_evaluation: Python ----------
#! python 3
# venv: ai_brick_eval
# r: google-genai, Pillow

import scriptcontext as sc
import json
import os
import time
import threading
import Eto
from PIL import Image
from google import genai

SUPPORTED_IMAGE_EXTENSIONS = [".png", ".jpg", ".jpeg", ".webp", ".heic", ".heif"]

KEY_RUNNING = "gemini_eval_is_running"
KEY_LAST_OUTPUT = "gemini_eval_last_output"
KEY_LAST_ERROR = "gemini_eval_last_error"
KEY_LAST_TIME = "gemini_eval_last_time"
KEY_RESULT = "gemini_eval_api_result"
KEY_API_ERROR = "gemini_eval_api_error"
KEY_START_TIME = "gemini_eval_start_time"
KEY_LAST_LOG = "gemini_eval_last_log"
KEY_GEOM_CTX_STR = "gemini_eval_geom_ctx_str"

MODEL_ID = "gemini-2.5-pro"
MAX_IMAGE_DIM = 1280

if KEY_RUNNING not in sc.sticky:
    sc.sticky[KEY_RUNNING] = False
if KEY_LAST_OUTPUT not in sc.sticky:
    sc.sticky[KEY_LAST_OUTPUT] = "Ready. Click Run."
if KEY_LAST_ERROR not in sc.sticky:
    sc.sticky[KEY_LAST_ERROR] = None
if KEY_LAST_TIME not in sc.sticky:
    sc.sticky[KEY_LAST_TIME] = None
if KEY_LAST_LOG not in sc.sticky:
    sc.sticky[KEY_LAST_LOG] = []
if KEY_GEOM_CTX_STR not in sc.sticky:
    sc.sticky[KEY_GEOM_CTX_STR] = None


def trigger_gh_update():
    gh_doc = ghenv.Component.OnPingDocument()
    if gh_doc:
        for obj in gh_doc.Objects:
            if obj.InstanceGuid == ghenv.Component.InstanceGuid:
                obj.ExpireSolution(True)
                return


def _strip_code_fences(text):
    if not text:
        return text
    t = text.strip()
    if t.startswith("```json"):
        t = t[7:].strip()
        if t.endswith("```"):
            t = t[:-3].strip()
        return t
    if t.startswith("```"):
        t = t[3:].strip()
        if t.endswith("```"):
            t = t[:-3].strip()
        return t
    return t


def _is_valid_json(s):
    try:
        json.loads(s)
        return True
    except:
        return False


def _sanitize_key(raw):
    if raw is None:
        return ""
    k = raw
    if len(k) > 0 and ord(k[0]) == 65279:
        k = k[1:]
    k = k.strip()
    if (k.startswith('"') and k.endswith('"')) or (k.startswith("'") and k.endswith("'")):
        k = k[1:-1].strip()
    if "\n" in k or "\r" in k:
        parts = [p.strip() for p in k.replace("\r", "\n").split("\n") if p.strip()]
        k = parts[0] if parts else ""
    return k.strip()


def load_api_key_from_path(key_path):
    if not key_path or not str(key_path).strip():
        raise ValueError("keyPath input is missing.")
    kp = str(key_path).strip()
    if not os.path.exists(kp):
        raise ValueError("API key file not found at given path: {}".format(kp))
    with open(kp, "r") as f:
        raw = f.read()
    api_key = _sanitize_key(raw)
    if not api_key:
        raise ValueError("API key file is empty or contains only whitespace.")
    return api_key


def mask_key(k):
    if not k:
        return ""
    if len(k) <= 8:
        return "*" * len(k)
    return k[:4] + "..." + k[-4:]


def prepare_image(path, max_dim=1280):
    img = Image.open(path)
    if img.mode != "RGB":
        img = img.convert("RGB")
    w, h = img.size
    m = max(w, h)
    if m > max_dim:
        scale = float(max_dim) / float(m)
        nw = max(1, int(w * scale))
        nh = max(1, int(h * scale))
        img = img.resize((nw, nh), Image.LANCZOS)
    return img


def response_json_schema():
    return {
        "type": "object",
        "additionalProperties": False,
        "required": ["nodeKey", "appendDamages"],
        "properties": {
            "nodeKey": {"type": "string", "enum": ["0"]},
            "appendDamages": {
                "type": "array",
                "items": {
                    "type": "object",
                    "additionalProperties": False,
                    "required": ["type", "vertices", "status", "value", "description", "coordinates"],
                    "properties": {
                        "type": {"type": "string", "enum": ["face", "edge", "vertex"]},
                        "vertices": {
                            "type": "array",
                            "items": {"type": "integer"}
                        },
                        "status": {"type": "string", "enum": ["Spalling", "Chipping", "Staining", "Material Loss", "Crack"]},
                        "value": {"type": "integer", "minimum": 0, "maximum": 5},
                        "uv": {
                            "type": "array",
                            "items": {"type": "number", "minimum": 0.0, "maximum": 1.0},
                            "minItems": 2,
                            "maxItems": 2
                        },
                        "description": {"type": "string"},
                        "coordinates": {
                            "type": "object",
                            "additionalProperties": False,
                            "required": ["point", "xaxis", "yaxis"],
                            "properties": {
                                "point": {
                                    "type": "array",
                                    "items": {"type": "number"},
                                    "minItems": 3,
                                    "maxItems": 3
                                },
                                "xaxis": {
                                    "type": "array",
                                    "items": {"type": "integer"},
                                    "minItems": 3,
                                    "maxItems": 3
                                },
                                "yaxis": {
                                    "type": "array",
                                    "items": {"type": "integer"},
                                    "minItems": 3,
                                    "maxItems": 3
                                }
                            }
                        }
                    }
                }
            }
        }
    }


def _to_vec(v):
    if isinstance(v, (list, tuple)) and len(v) == 3:
        return [float(v[0]), float(v[1]), float(v[2])]
    if isinstance(v, dict):
        return [float(v.get("x", 0.0)), float(v.get("y", 0.0)), float(v.get("z", 0.0))]
    return [0.0, 0.0, 0.0]


def _sub(a, b):
    return [a[0] - b[0], a[1] - b[1], a[2] - b[2]]


def _add(a, b):
    return [a[0] + b[0], a[1] + b[1], a[2] + b[2]]


def _scale(a, s):
    return [a[0] * s, a[1] * s, a[2] * s]


def _dot(a, b):
    return a[0] * b[0] + a[1] * b[1] + a[2] * b[2]


def _cross(a, b):
    return [
        a[1] * b[2] - a[2] * b[1],
        a[2] * b[0] - a[0] * b[2],
        a[0] * b[1] - a[1] * b[0],
    ]


def _norm(a):
    return (a[0] * a[0] + a[1] * a[1] + a[2] * a[2]) ** 0.5


def _normalize(a):
    n = _norm(a)
    if n < 1e-12:
        return [0.0, 0.0, 0.0]
    return [a[0] / n, a[1] / n, a[2] / n]


def pick_face_by_dir(face_centroids, origin, axis, mode):
    best_f = None
    best_s = None
    for fi, c in face_centroids.items():
        s = _dot(_sub(c, origin), axis)
        if best_f is None:
            best_f, best_s = fi, s
        else:
            if mode == "max" and s > best_s:
                best_f, best_s = fi, s
            if mode == "min" and s < best_s:
                best_f, best_s = fi, s
    return best_f


def build_geometry_context(existing_json_str, node_key="0"):
    obj = json.loads(existing_json_str)
    node = obj["data"]["graph"]["node"][node_key]
    part = node["part"]["data"]

    mesh = part["attributes"]["mesh"]["data"]
    vdict = mesh.get("vertex", {})
    fdict = mesh.get("face", {})

    verts = {int(k): [v["x"], v["y"], v["z"]] for k, v in vdict.items()}
    faces = {int(k): list(v) for k, v in fdict.items()}

    xs = [p[0] for p in verts.values()]
    ys = [p[1] for p in verts.values()]
    zs = [p[2] for p in verts.values()]
    bbox = {"min": [min(xs), min(ys), min(zs)], "max": [max(xs), max(ys), max(zs)]}

    face_centroids = {}
    for fi, fvs in faces.items():
        pts = [verts[i] for i in fvs]
        c = [0.0, 0.0, 0.0]
        for p in pts:
            c = _add(c, p)
        c = _scale(c, 1.0 / float(len(pts)))
        face_centroids[fi] = c

    frame = part.get("frame", None)
    if not frame:
        raise ValueError("Part frame missing. Cannot define front and right without frame.")

    origin = _to_vec(frame.get("point"))
    xaxis = _normalize(_to_vec(frame.get("xaxis")))
    yaxis = _normalize(_to_vec(frame.get("yaxis")))

    # zaxis might be missing, compute and align to +world Z for stability
    zaxis = _normalize(_cross(xaxis, yaxis))
    if _dot(zaxis, [0.0, 0.0, 1.0]) < 0.0:
        zaxis = _scale(zaxis, -1.0)

    top_f = pick_face_by_dir(face_centroids, origin, zaxis, "max")
    bottom_f = pick_face_by_dir(face_centroids, origin, zaxis, "min")
    front_f = pick_face_by_dir(face_centroids, origin, yaxis, "max")
    back_f = pick_face_by_dir(face_centroids, origin, yaxis, "min")
    right_f = pick_face_by_dir(face_centroids, origin, xaxis, "max")
    left_f = pick_face_by_dir(face_centroids, origin, xaxis, "min")

    ctx = {
        "nodeKey": str(node_key),
        "bbox": bbox,
        "frame": {"point": origin, "xaxis": xaxis, "yaxis": yaxis, "zaxis": zaxis},
        "dirFaces": {
            "top": {"faceIndex": int(top_f), "centroid": face_centroids[top_f]},
            "bottom": {"faceIndex": int(bottom_f), "centroid": face_centroids[bottom_f]},
            "front": {"faceIndex": int(front_f), "centroid": face_centroids[front_f]},
            "back": {"faceIndex": int(back_f), "centroid": face_centroids[back_f]},
            "right": {"faceIndex": int(right_f), "centroid": face_centroids[right_f]},
            "left": {"faceIndex": int(left_f), "centroid": face_centroids[left_f]},
        },
        "faceVertices": {str(fi): faces[fi] for fi in faces.keys()},
        "vertexCoords": {str(vi): verts[vi] for vi in verts.keys()},
        "faceCentroids": {str(fi): face_centroids[fi] for fi in face_centroids.keys()},
        "convention": {"frontDir": "frame.yaxis", "rightDir": "frame.xaxis", "topDir": "frame.zaxis"},
    }
    return ctx


def project_to_plane(v, n):
    return _sub(v, _scale(n, _dot(v, n)))


def face_normal_from_vertices(pts):
    if len(pts) < 3:
        return [0.0, 0.0, 1.0]
    a = _sub(pts[1], pts[0])
    b = _sub(pts[2], pts[0])
    n = _normalize(_cross(a, b))
    if _norm(n) < 1e-12:
        return [0.0, 0.0, 1.0]
    return n


def compute_point_on_face_from_uv(face_vertices_pts, face_label, rightDir, frontDir, topDir, uv):
    u = float(uv[0])
    v = float(uv[1])
    if u < 0.0:
        u = 0.0
    if u > 1.0:
        u = 1.0
    if v < 0.0:
        v = 0.0
    if v > 1.0:
        v = 1.0

    n = face_normal_from_vertices(face_vertices_pts)

    if face_label in ("front", "back"):
        u_base = rightDir
        v_base = topDir
    elif face_label in ("left", "right"):
        u_base = frontDir
        v_base = topDir
    else:  # top or bottom
        u_base = rightDir
        v_base = frontDir

    u_dir = _normalize(project_to_plane(u_base, n))
    v_dir = _normalize(project_to_plane(v_base, n))

    if _norm(u_dir) < 1e-12:
        u_dir = _normalize(project_to_plane(frontDir, n))
    if _norm(v_dir) < 1e-12:
        v_dir = _normalize(project_to_plane(topDir, n))

    pref = face_vertices_pts[0]
    us = []
    vs = []
    for p in face_vertices_pts:
        d = _sub(p, pref)
        us.append(_dot(d, u_dir))
        vs.append(_dot(d, v_dir))

    umin, umax = min(us), max(us)
    vmin, vmax = min(vs), max(vs)

    ut = umin + u * (umax - umin)
    vt = vmin + v * (vmax - vmin)

    return _add(pref, _add(_scale(u_dir, ut), _scale(v_dir, vt)))


def call_gemini_in_background(api_key_real, system_prompt, user_prompt, geom_ctx_str, imageA_path, imageB_path):
    try:
        client = genai.Client(api_key=api_key_real)

        contents = []
        if system_prompt and system_prompt.strip():
            contents.append("SYSTEM:\n" + system_prompt.strip())

        contents.append("GEOMETRY_CONTEXT_JSON:\n" + geom_ctx_str)

        if user_prompt and str(user_prompt).strip():
            contents.append("USER_REQUEST:\n" + str(user_prompt).strip())

        if imageA_path:
            contents.append("NOW ANALYZE THIS IMAGE. VIEW A.")
            contents.append(prepare_image(imageA_path, MAX_IMAGE_DIM))

        if imageB_path:
            contents.append("NOW ANALYZE THIS IMAGE. VIEW B.")
            contents.append(prepare_image(imageB_path, MAX_IMAGE_DIM))

        schema = response_json_schema()

        # Try JSON schema controlled generation first, fall back if the SDK rejects the parameter
        config = {
            "temperature": 0.0,
            "top_p": 0.1,
            "max_output_tokens": 16384,
            "response_mime_type": "application/json",
            "response_json_schema": schema,
        }

        try:
            response = client.models.generate_content(
                model=MODEL_ID,
                contents=contents,
                config=config
            )
        except TypeError:
            # older SDK variant
            config2 = {
                "temperature": 0.0,
                "top_p": 0.1,
                "max_output_tokens": 2048,
                "response_mime_type": "application/json",
            }
            response = client.models.generate_content(
                model=MODEL_ID,
                contents=contents,
                config=config2
            )

        sc.sticky[KEY_RESULT] = response.text
        sc.sticky[KEY_API_ERROR] = None
    except Exception as e:
        sc.sticky[KEY_RESULT] = None
        sc.sticky[KEY_API_ERROR] = "An API error occurred: {}".format(e)
    finally:
        Eto.Forms.Application.Instance.AsyncInvoke(trigger_gh_update)


# Outputs start from persisted values
jsonOutput = sc.sticky[KEY_LAST_OUTPUT]
error = sc.sticky[KEY_LAST_ERROR]
executionTime = sc.sticky[KEY_LAST_TIME]
log_list = sc.sticky.get(KEY_LAST_LOG, [])
if not isinstance(log_list, list):
    log_list = [str(log_list)]

debugContext = sc.sticky.get(KEY_GEOM_CTX_STR) or ""


# STATE 1
if run and not sc.sticky[KEY_RUNNING]:
    sc.sticky[KEY_RUNNING] = True
    sc.sticky[KEY_RESULT] = None
    sc.sticky[KEY_API_ERROR] = None
    sc.sticky[KEY_START_TIME] = time.time()

    jsonOutput = "Generating..."
    error = None
    executionTime = None

    log_list = []
    log_list.append("Button clicked. Starting setup.")

    try:
        api_key_real = load_api_key_from_path(keyPath)
        log_list.append("API key loaded from file.")
        log_list.append("API key preview: {}".format(mask_key(api_key_real)))

        if not any([systemPrompt, userPrompt, imagePathA, imagePathB, existingJson]):
            raise ValueError("Input is missing. Provide systemPrompt, userPrompt, imagePathA, imagePathB, or existingJson.")

        if existingJson and str(existingJson).strip():
            try:
                json.loads(existingJson)
            except Exception as e_json_in:
                raise ValueError("existingJson is not valid JSON. Error: {}".format(e_json_in))

            # Build once and cache in sticky
            geom_ctx = build_geometry_context(existingJson, node_key="0")
            geom_ctx_str = json.dumps(geom_ctx, separators=(",", ":"), ensure_ascii=False)
            sc.sticky[KEY_GEOM_CTX_STR] = geom_ctx_str
            debugContext = geom_ctx_str
            log_list.append("GEOMETRY_CONTEXT_JSON built and cached.")
        else:
            raise ValueError("existingJson is required to build GEOMETRY_CONTEXT_JSON.")

        # Validate images early
        if imagePathA:
            if not os.path.exists(imagePathA):
                raise ValueError("Image A file not found: {}".format(imagePathA))
            ext = os.path.splitext(imagePathA)[1].lower()
            if ext not in SUPPORTED_IMAGE_EXTENSIONS:
                raise ValueError("Unsupported Image A type: {}".format(ext))

        if imagePathB:
            if not os.path.exists(imagePathB):
                raise ValueError("Image B file not found: {}".format(imagePathB))
            ext = os.path.splitext(imagePathB)[1].lower()
            if ext not in SUPPORTED_IMAGE_EXTENSIONS:
                raise ValueError("Unsupported Image B type: {}".format(ext))

        log_list.append("Starting background thread call.")
        t = threading.Thread(
            target=call_gemini_in_background,
            args=(api_key_real, systemPrompt, userPrompt, sc.sticky[KEY_GEOM_CTX_STR], imagePathA, imagePathB)
        )
        t.daemon = True
        t.start()

    except Exception as setup_e:
        error = "Error during setup: {}".format(setup_e)
        jsonOutput = "Setup error. See error output."
        sc.sticky[KEY_RUNNING] = False
        log_list.append("Setup failed: {}".format(setup_e))


# STATE 2
elif sc.sticky[KEY_RUNNING]:
    if sc.sticky.get(KEY_RESULT) is not None:
        generated_text = sc.sticky[KEY_RESULT]
        cleaned = _strip_code_fences(generated_text)

        parsed = None
        if _is_valid_json(cleaned):
            parsed = json.loads(cleaned)
        else:
            error = "Warning: API response was not valid JSON."
            jsonOutput = cleaned

        # Postprocess: replace face coordinates.point using uv and face plane
        if parsed and isinstance(parsed, dict):
            try:
                geom_ctx_str = sc.sticky.get(KEY_GEOM_CTX_STR) or ""
                geom_ctx = json.loads(geom_ctx_str) if geom_ctx_str else {}

                dirFaces = geom_ctx.get("dirFaces", {})
                face_index_to_label = {}
                for lbl, info in dirFaces.items():
                    face_index_to_label[int(info["faceIndex"])] = lbl

                frame = geom_ctx.get("frame", {})
                rightDir = frame.get("xaxis", [1.0, 0.0, 0.0])
                frontDir = frame.get("yaxis", [0.0, 1.0, 0.0])
                topDir = frame.get("zaxis", [0.0, 0.0, 1.0])

                vcoords = geom_ctx.get("vertexCoords", {})
                fverts = geom_ctx.get("faceVertices", {})

                for d in parsed.get("appendDamages", []):
                    if not isinstance(d, dict):
                        continue
                    if d.get("type") != "face":
                        continue
                    if "uv" not in d:
                        continue
                    verts_list = d.get("vertices", [])
                    if not verts_list or len(verts_list) != 1:
                        continue

                    fi = int(verts_list[0])
                    face_label = face_index_to_label.get(fi, None)
                    if not face_label:
                        continue

                    v_ids = fverts.get(str(fi), None)
                    if not v_ids:
                        continue

                    pts = []
                    ok = True
                    for vid in v_ids:
                        pv = vcoords.get(str(int(vid)), None)
                        if pv is None:
                            ok = False
                            break
                        pts.append([float(pv[0]), float(pv[1]), float(pv[2])])
                    if not ok or len(pts) < 3:
                        continue

                    p3d = compute_point_on_face_from_uv(
                        face_vertices_pts=pts,
                        face_label=face_label,
                        rightDir=rightDir,
                        frontDir=frontDir,
                        topDir=topDir,
                        uv=d["uv"]
                    )

                    if "coordinates" not in d or not isinstance(d["coordinates"], dict):
                        d["coordinates"] = {}
                    d["coordinates"]["point"] = [p3d[0], p3d[1], p3d[2]]
                    d["coordinates"]["xaxis"] = [1, 0, 0]
                    d["coordinates"]["yaxis"] = [0, -1, 0]

                jsonOutput = json.dumps(parsed, separators=(",", ":"), ensure_ascii=False)
                if error is None:
                    error = None

            except Exception as e_uv:
                jsonOutput = json.dumps(parsed, separators=(",", ":"), ensure_ascii=False)
                if error is None:
                    error = "Warning: uv postprocess failed: {}".format(e_uv)

        start_time = sc.sticky.get(KEY_START_TIME, time.time())
        executionTime = time.time() - start_time
        sc.sticky[KEY_RUNNING] = False
        log_list.append("Result received. Finished.")

    elif sc.sticky.get(KEY_API_ERROR) is not None:
        jsonOutput = "An error occurred. See error output."
        error = sc.sticky[KEY_API_ERROR]
        start_time = sc.sticky.get(KEY_START_TIME, time.time())
        executionTime = time.time() - start_time
        sc.sticky[KEY_RUNNING] = False
        log_list.append("Error received from API call. Finished.")

    else:
        jsonOutput = "Generating..."


# Persist outputs every run
sc.sticky[KEY_LAST_OUTPUT] = jsonOutput
sc.sticky[KEY_LAST_ERROR] = error
sc.sticky[KEY_LAST_TIME] = executionTime
sc.sticky[KEY_LAST_LOG] = log_list

log = "\n".join(log_list)

print(error)
# ---------- end ai_brick_evaluation ----------

train_the_generative_model = Button()
run_the_generative_model_2 = Button()
ai_brick_evaluation_2 = Python3Script(
    imagePathA=image_path_optional_4,
    existingJson=existing_json_needed_2,
    keyPath=panel,
    systemPrompt=system_promt_setting_the_rules_2,
    analyze=run_the_generative_model_2)  # -> error, jsonOutput, model, executionTime; inputs imagePathA: String, keyPath: String
# ---------- ai_brick_evaluation_2: Python ----------
#! python 3
# venv: ai_brick_eval
# r: google-genai, Pillow

import scriptcontext as sc
import json
import os
import time
import threading
import Eto
from PIL import Image
from google import genai

# Optional but needed for caching config on newer python-genai
try:
    from google.genai import types
except Exception:
    types = None

SUPPORTED_IMAGE_EXTENSIONS = [".png", ".jpg", ".jpeg", ".webp", ".heic", ".heif"]

KEY_RUNNING = "gemini_eval_is_running"
KEY_LAST_OUTPUT = "gemini_eval_last_output"
KEY_LAST_ERROR = "gemini_eval_last_error"
KEY_LAST_TIME = "gemini_eval_last_time"
KEY_RESULT = "gemini_eval_api_result"
KEY_API_ERROR = "gemini_eval_api_error"
KEY_START_TIME = "gemini_eval_start_time"
KEY_LAST_LOG = "gemini_eval_last_log"
KEY_GEOM_CTX_STR = "gemini_eval_geom_ctx_str"

# New keys for caching and mode
KEY_CACHE_NAME = "gemini_eval_cache_name"
KEY_CACHE_EXPIRE_EPOCH = "gemini_eval_cache_expire_epoch"
KEY_MODE = "gemini_eval_mode"  # "train" or "analyze"

MODEL_ID = "gemini-2.5-pro"
MAX_IMAGE_DIM = 1280

# Defaults for training dataset
DEFAULT_TTL_SECONDS = 21600  # 6 hours
REQUIRED_EXAMPLES = 5

# Init sticky
if KEY_RUNNING not in sc.sticky:
    sc.sticky[KEY_RUNNING] = False
if KEY_LAST_OUTPUT not in sc.sticky:
    sc.sticky[KEY_LAST_OUTPUT] = "Ready. Click Run."
if KEY_LAST_ERROR not in sc.sticky:
    sc.sticky[KEY_LAST_ERROR] = None
if KEY_LAST_TIME not in sc.sticky:
    sc.sticky[KEY_LAST_TIME] = None
if KEY_LAST_LOG not in sc.sticky:
    sc.sticky[KEY_LAST_LOG] = []
if KEY_GEOM_CTX_STR not in sc.sticky:
    sc.sticky[KEY_GEOM_CTX_STR] = None
if KEY_CACHE_NAME not in sc.sticky:
    sc.sticky[KEY_CACHE_NAME] = None
if KEY_CACHE_EXPIRE_EPOCH not in sc.sticky:
    sc.sticky[KEY_CACHE_EXPIRE_EPOCH] = None
if KEY_MODE not in sc.sticky:
    sc.sticky[KEY_MODE] = None


def trigger_gh_update():
    gh_doc = ghenv.Component.OnPingDocument()
    if gh_doc:
        for obj in gh_doc.Objects:
            if obj.InstanceGuid == ghenv.Component.InstanceGuid:
                obj.ExpireSolution(True)
                return


def _strip_code_fences(text):
    if not text:
        return text
    t = text.strip()
    if t.startswith("```json"):
        t = t[7:].strip()
        if t.endswith("```"):
            t = t[:-3].strip()
        return t
    if t.startswith("```"):
        t = t[3:].strip()
        if t.endswith("```"):
            t = t[:-3].strip()
        return t
    return t


def _is_valid_json(s):
    try:
        json.loads(s)
        return True
    except Exception:
        return False


def _sanitize_key(raw):
    if raw is None:
        return ""
    k = raw
    if len(k) > 0 and ord(k[0]) == 65279:
        k = k[1:]
    k = k.strip()
    if (k.startswith('"') and k.endswith('"')) or (k.startswith("'") and k.endswith("'")):
        k = k[1:-1].strip()
    if "\n" in k or "\r" in k:
        parts = [p.strip() for p in k.replace("\r", "\n").split("\n") if p.strip()]
        k = parts[0] if parts else ""
    return k.strip()


def load_api_key_from_path(key_path):
    if not key_path or not str(key_path).strip():
        raise ValueError("keyPath input is missing.")
    kp = str(key_path).strip()
    if not os.path.exists(kp):
        raise ValueError("API key file not found at given path: {}".format(kp))
    with open(kp, "r") as f:
        raw = f.read()
    api_key = _sanitize_key(raw)
    if not api_key:
        raise ValueError("API key file is empty or contains only whitespace.")
    return api_key


def mask_key(k):
    if not k:
        return ""
    if len(k) <= 8:
        return "*" * len(k)
    return k[:4] + "..." + k[-4:]


def prepare_image(path, max_dim=1280):
    img = Image.open(path)
    if img.mode != "RGB":
        img = img.convert("RGB")
    w, h = img.size
    m = max(w, h)
    if m > max_dim:
        scale = float(max_dim) / float(m)
        nw = max(1, int(w * scale))
        nh = max(1, int(h * scale))
        img = img.resize((nw, nh), Image.LANCZOS)
    return img


def _read_text_file(path):
    with open(path, "r") as f:
        return f.read()


def load_training_dataset(trainingDataSet):
    """
    trainingDataSet is either:
    - JSON string
    - filepath to .json
    """
    if not trainingDataSet or not str(trainingDataSet).strip():
        raise ValueError("trainingDataSet input is missing.")

    raw = str(trainingDataSet).strip()

    if os.path.exists(raw) and os.path.splitext(raw)[1].lower() == ".json":
        raw = _read_text_file(raw).strip()

    try:
        pack = json.loads(raw)
    except Exception as e:
        raise ValueError("trainingDataSet is not valid JSON. Error: {}".format(e))

    ttl = int(pack.get("ttlSeconds", DEFAULT_TTL_SECONDS))
    examples = pack.get("examples", [])

    if not isinstance(examples, list):
        raise ValueError("trainingDataSet.examples must be a list.")

    if len(examples) != REQUIRED_EXAMPLES:
        raise ValueError("trainingDataSet.examples must contain exactly {} examples.".format(REQUIRED_EXAMPLES))

    for i, ex in enumerate(examples, start=1):
        if not isinstance(ex, dict):
            raise ValueError("Example {} must be an object.".format(i))

        a = ex.get("imageAPath")
        b = ex.get("imageBPath")
        expected = ex.get("expected")

        if not a or not b or expected is None:
            raise ValueError("Example {} needs imageAPath, imageBPath, expected.".format(i))

        if not os.path.exists(a):
            raise ValueError("Example {} imageAPath not found: {}".format(i, a))
        if not os.path.exists(b):
            raise ValueError("Example {} imageBPath not found: {}".format(i, b))

        ext_a = os.path.splitext(a)[1].lower()
        ext_b = os.path.splitext(b)[1].lower()
        if ext_a not in SUPPORTED_IMAGE_EXTENSIONS:
            raise ValueError("Example {} imageAPath unsupported type: {}".format(i, ext_a))
        if ext_b not in SUPPORTED_IMAGE_EXTENSIONS:
            raise ValueError("Example {} imageBPath unsupported type: {}".format(i, ext_b))

        if not isinstance(expected, dict):
            raise ValueError("Example {} expected must be a JSON object.".format(i))
        if expected.get("nodeKey") != "0":
            raise ValueError("Example {} expected.nodeKey must be '0'.".format(i))
        if "appendDamages" not in expected or not isinstance(expected["appendDamages"], list):
            raise ValueError("Example {} expected.appendDamages must be a list.".format(i))

    return {"ttlSeconds": ttl, "examples": examples}


def response_json_schema():
    return {
        "type": "object",
        "additionalProperties": False,
        "required": ["nodeKey", "appendDamages"],
        "properties": {
            "nodeKey": {"type": "string", "enum": ["0"]},
            "appendDamages": {
                "type": "array",
                "items": {
                    "type": "object",
                    "additionalProperties": False,
                    "required": ["type", "vertices", "status", "value", "description", "coordinates"],
                    "properties": {
                        "type": {"type": "string", "enum": ["face", "edge", "vertex"]},
                        "vertices": {"type": "array", "items": {"type": "integer"}},
                        "status": {"type": "string", "enum": ["Spalling", "Chipping", "Material Loss", "Crack"]},
                        "value": {"type": "integer", "minimum": 0, "maximum": 5},
                        "uv": {
                            "type": "array",
                            "items": {"type": "number", "minimum": 0.0, "maximum": 1.0},
                            "minItems": 2,
                            "maxItems": 2,
                        },
                        "description": {"type": "string"},
                        "coordinates": {
                            "type": "object",
                            "additionalProperties": False,
                            "required": ["point", "xaxis", "yaxis"],
                            "properties": {
                                "point": {"type": "array", "items": {"type": "number"}, "minItems": 3, "maxItems": 3},
                                "xaxis": {"type": "array", "items": {"type": "integer"}, "minItems": 3, "maxItems": 3},
                                "yaxis": {"type": "array", "items": {"type": "integer"}, "minItems": 3, "maxItems": 3},
                            },
                        },
                    },
                },
            },
        },
    }


def _to_vec(v):
    if isinstance(v, (list, tuple)) and len(v) == 3:
        return [float(v[0]), float(v[1]), float(v[2])]
    if isinstance(v, dict):
        return [float(v.get("x", 0.0)), float(v.get("y", 0.0)), float(v.get("z", 0.0))]
    return [0.0, 0.0, 0.0]


def _sub(a, b):
    return [a[0] - b[0], a[1] - b[1], a[2] - b[2]]


def _add(a, b):
    return [a[0] + b[0], a[1] + b[1], a[2] + b[2]]


def _scale(a, s):
    return [a[0] * s, a[1] * s, a[2] * s]


def _dot(a, b):
    return a[0] * b[0] + a[1] * b[1] + a[2] * b[2]


def _cross(a, b):
    return [
        a[1] * b[2] - a[2] * b[1],
        a[2] * b[0] - a[0] * b[2],
        a[0] * b[1] - a[1] * b[0],
    ]


def _norm(a):
    return (a[0] * a[0] + a[1] * a[1] + a[2] * a[2]) ** 0.5


def _normalize(a):
    n = _norm(a)
    if n < 1e-12:
        return [0.0, 0.0, 0.0]
    return [a[0] / n, a[1] / n, a[2] / n]


def pick_face_by_dir(face_centroids, origin, axis, mode):
    best_f = None
    best_s = None
    for fi, c in face_centroids.items():
        s = _dot(_sub(c, origin), axis)
        if best_f is None:
            best_f, best_s = fi, s
        else:
            if mode == "max" and s > best_s:
                best_f, best_s = fi, s
            if mode == "min" and s < best_s:
                best_f, best_s = fi, s
    return best_f


def build_geometry_context(existing_json_str, node_key="0"):
    obj = json.loads(existing_json_str)
    node = obj["data"]["graph"]["node"][node_key]
    part = node["part"]["data"]

    mesh = part["attributes"]["mesh"]["data"]
    vdict = mesh.get("vertex", {})
    fdict = mesh.get("face", {})

    verts = {int(k): [v["x"], v["y"], v["z"]] for k, v in vdict.items()}
    faces = {int(k): list(v) for k, v in fdict.items()}

    xs = [p[0] for p in verts.values()]
    ys = [p[1] for p in verts.values()]
    zs = [p[2] for p in verts.values()]
    bbox = {"min": [min(xs), min(ys), min(zs)], "max": [max(xs), max(ys), max(zs)]}

    face_centroids = {}
    for fi, fvs in faces.items():
        pts = [verts[i] for i in fvs]
        c = [0.0, 0.0, 0.0]
        for p in pts:
            c = _add(c, p)
        c = _scale(c, 1.0 / float(len(pts)))
        face_centroids[fi] = c

    frame = part.get("frame", None)
    if not frame:
        raise ValueError("Part frame missing. Cannot define front and right without frame.")

    origin = _to_vec(frame.get("point"))
    xaxis = _normalize(_to_vec(frame.get("xaxis")))
    yaxis = _normalize(_to_vec(frame.get("yaxis")))

    zaxis = _normalize(_cross(xaxis, yaxis))
    if _dot(zaxis, [0.0, 0.0, 1.0]) < 0.0:
        zaxis = _scale(zaxis, -1.0)

    top_f = pick_face_by_dir(face_centroids, origin, zaxis, "max")
    bottom_f = pick_face_by_dir(face_centroids, origin, zaxis, "min")
    front_f = pick_face_by_dir(face_centroids, origin, yaxis, "max")
    back_f = pick_face_by_dir(face_centroids, origin, yaxis, "min")
    right_f = pick_face_by_dir(face_centroids, origin, xaxis, "max")
    left_f = pick_face_by_dir(face_centroids, origin, xaxis, "min")

    ctx = {
        "nodeKey": str(node_key),
        "bbox": bbox,
        "frame": {"point": origin, "xaxis": xaxis, "yaxis": yaxis, "zaxis": zaxis},
        "dirFaces": {
            "top": {"faceIndex": int(top_f), "centroid": face_centroids[top_f]},
            "bottom": {"faceIndex": int(bottom_f), "centroid": face_centroids[bottom_f]},
            "front": {"faceIndex": int(front_f), "centroid": face_centroids[front_f]},
            "back": {"faceIndex": int(back_f), "centroid": face_centroids[back_f]},
            "right": {"faceIndex": int(right_f), "centroid": face_centroids[right_f]},
            "left": {"faceIndex": int(left_f), "centroid": face_centroids[left_f]},
        },
        "faceVertices": {str(fi): faces[fi] for fi in faces.keys()},
        "vertexCoords": {str(vi): verts[vi] for vi in verts.keys()},
        "faceCentroids": {str(fi): face_centroids[fi] for fi in face_centroids.keys()},
        "convention": {"frontDir": "frame.yaxis", "rightDir": "frame.xaxis", "topDir": "frame.zaxis"},
    }
    return ctx


def project_to_plane(v, n):
    return _sub(v, _scale(n, _dot(v, n)))


def face_normal_from_vertices(pts):
    if len(pts) < 3:
        return [0.0, 0.0, 1.0]
    a = _sub(pts[1], pts[0])
    b = _sub(pts[2], pts[0])
    n = _normalize(_cross(a, b))
    if _norm(n) < 1e-12:
        return [0.0, 0.0, 1.0]
    return n


def compute_point_on_face_from_uv(face_vertices_pts, face_label, rightDir, frontDir, topDir, uv):
    u = float(uv[0])
    v = float(uv[1])
    if u < 0.0:
        u = 0.0
    if u > 1.0:
        u = 1.0
    if v < 0.0:
        v = 0.0
    if v > 1.0:
        v = 1.0

    n = face_normal_from_vertices(face_vertices_pts)

    if face_label in ("front", "back"):
        u_base = rightDir
        v_base = topDir
    elif face_label in ("left", "right"):
        u_base = frontDir
        v_base = topDir
    else:
        u_base = rightDir
        v_base = frontDir

    u_dir = _normalize(project_to_plane(u_base, n))
    v_dir = _normalize(project_to_plane(v_base, n))

    if _norm(u_dir) < 1e-12:
        u_dir = _normalize(project_to_plane(frontDir, n))
    if _norm(v_dir) < 1e-12:
        v_dir = _normalize(project_to_plane(topDir, n))

    pref = face_vertices_pts[0]
    us = []
    vs = []
    for p in face_vertices_pts:
        d = _sub(p, pref)
        us.append(_dot(d, u_dir))
        vs.append(_dot(d, v_dir))

    umin, umax = min(us), max(us)
    vmin, vmax = min(vs), max(vs)

    ut = umin + u * (umax - umin)
    vt = vmin + v * (vmax - vmin)

    return _add(pref, _add(_scale(u_dir, ut), _scale(v_dir, vt)))


def _validate_image_path(label, path):
    if not path:
        return
    if not os.path.exists(path):
        raise ValueError("{} file not found: {}".format(label, path))
    ext = os.path.splitext(path)[1].lower()
    if ext not in SUPPORTED_IMAGE_EXTENSIONS:
        raise ValueError("Unsupported {} type: {}".format(label, ext))


def create_cache_background(api_key_real, system_prompt, geom_ctx_str, training_pack):
    """
    Runs in background thread.
    Stores cache name in KEY_RESULT as JSON:
      {"cacheName":"...","ttlSeconds":123}
    """
    try:
        if types is None:
            raise RuntimeError("google.genai.types not available. Update google-genai package.")

        client = genai.Client(api_key=api_key_real)

        ttl_seconds = int(training_pack.get("ttlSeconds", DEFAULT_TTL_SECONDS))
        examples = training_pack.get("examples", [])

        parts = []
        parts.append(types.Part(text="GEOMETRY_CONTEXT_JSON:\n" + geom_ctx_str))

        for i, ex in enumerate(examples, start=1):
            parts.append(types.Part(text="EXAMPLE {} INPUT VIEW A".format(i)))
            parts.append(types.Part.from_image(prepare_image(ex["imageAPath"], MAX_IMAGE_DIM)))

            parts.append(types.Part(text="EXAMPLE {} INPUT VIEW B".format(i)))
            parts.append(types.Part.from_image(prepare_image(ex["imageBPath"], MAX_IMAGE_DIM)))

            parts.append(types.Part(text="EXAMPLE {} EXPECTED_JSON".format(i)))
            parts.append(types.Part(text=json.dumps(ex["expected"], separators=(",", ":"), ensure_ascii=False)))

        contents = [types.Content(role="user", parts=parts)]

        cache = client.caches.create(
            model=MODEL_ID,
            config=types.CreateCachedContentConfig(
                display_name="brick_eval_session_cache",
                system_instruction=system_prompt.strip() if system_prompt else "",
                contents=contents,
                ttl="{}s".format(ttl_seconds),
            ),
        )

        payload = {"cacheName": cache.name, "ttlSeconds": ttl_seconds}
        sc.sticky[KEY_RESULT] = json.dumps(payload, separators=(",", ":"))
        sc.sticky[KEY_API_ERROR] = None

    except Exception as e:
        sc.sticky[KEY_RESULT] = None
        sc.sticky[KEY_API_ERROR] = "An API error occurred: {}".format(e)
    finally:
        Eto.Forms.Application.Instance.AsyncInvoke(trigger_gh_update)


def analyze_background(api_key_real, user_prompt, imageA_path, imageB_path, cache_name):
    """
    Runs in background thread for analysis.
    """
    try:
        client = genai.Client(api_key=api_key_real)

        contents = []
        if user_prompt and str(user_prompt).strip():
            contents.append("USER_REQUEST:\n" + str(user_prompt).strip())

        if imageA_path:
            contents.append("NOW ANALYZE THIS IMAGE. VIEW A.")
            contents.append(prepare_image(imageA_path, MAX_IMAGE_DIM))

        if imageB_path:
            contents.append("NOW ANALYZE THIS IMAGE. VIEW B.")
            contents.append(prepare_image(imageB_path, MAX_IMAGE_DIM))

        schema = response_json_schema()

        # Newer SDK path with types.GenerateContentConfig and caching
        if types is not None:
            cfg = types.GenerateContentConfig(
                temperature=0.0,
                top_p=0.1,
                max_output_tokens=16384,
                response_mime_type="application/json",
                response_schema=schema,
                cached_content=cache_name,
            )
            response = client.models.generate_content(
                model=MODEL_ID,
                contents=contents,
                config=cfg,
            )
        else:
            # Fallback path without caching support
            config = {
                "temperature": 0.0,
                "top_p": 0.1,
                "max_output_tokens": 16384,
                "response_mime_type": "application/json",
                "response_json_schema": schema,
            }
            response = client.models.generate_content(
                model=MODEL_ID,
                contents=contents,
                config=config,
            )

        sc.sticky[KEY_RESULT] = response.text
        sc.sticky[KEY_API_ERROR] = None

    except Exception as e:
        sc.sticky[KEY_RESULT] = None
        sc.sticky[KEY_API_ERROR] = "An API error occurred: {}".format(e)
    finally:
        Eto.Forms.Application.Instance.AsyncInvoke(trigger_gh_update)


# Outputs start from persisted values
jsonOutput = sc.sticky[KEY_LAST_OUTPUT]
error = sc.sticky[KEY_LAST_ERROR]
executionTime = sc.sticky[KEY_LAST_TIME]
log_list = sc.sticky.get(KEY_LAST_LOG, [])
if not isinstance(log_list, list):
    log_list = [str(log_list)]

debugContext = sc.sticky.get(KEY_GEOM_CTX_STR) or ""
model = MODEL_ID


# STATE 1
# Inputs expected in GH:
# train (bool), analyze (bool), trainingDataSet (string)
if (train or analyze) and not sc.sticky[KEY_RUNNING]:
    sc.sticky[KEY_RUNNING] = True
    sc.sticky[KEY_RESULT] = None
    sc.sticky[KEY_API_ERROR] = None
    sc.sticky[KEY_START_TIME] = time.time()

    jsonOutput = "Generating..."
    error = None
    executionTime = None

    log_list = []
    log_list.append("Button clicked. Starting setup.")

    try:
        api_key_real = load_api_key_from_path(keyPath)
        log_list.append("API key loaded from file.")
        log_list.append("API key preview: {}".format(mask_key(api_key_real)))

        # existingJson is required for GEOMETRY_CONTEXT_JSON
        if not existingJson or not str(existingJson).strip():
            raise ValueError("existingJson is required.")

        try:
            json.loads(existingJson)
        except Exception as e_json_in:
            raise ValueError("existingJson is not valid JSON. Error: {}".format(e_json_in))

        # Build and cache GEOMETRY_CONTEXT_JSON in sticky
        geom_ctx = build_geometry_context(existingJson, node_key="0")
        geom_ctx_str = json.dumps(geom_ctx, separators=(",", ":"), ensure_ascii=False)
        sc.sticky[KEY_GEOM_CTX_STR] = geom_ctx_str
        debugContext = geom_ctx_str
        log_list.append("GEOMETRY_CONTEXT_JSON built and cached locally.")

        if train:
            sc.sticky[KEY_MODE] = "train"

            if not systemPrompt or not str(systemPrompt).strip():
                raise ValueError("systemPrompt is required for training.")

            training_pack = load_training_dataset(trainingDataSet)
            ttl_seconds = int(training_pack.get("ttlSeconds", DEFAULT_TTL_SECONDS))
            log_list.append("Training dataset loaded. Examples: {}. TTL seconds: {}.".format(REQUIRED_EXAMPLES, ttl_seconds))

            for i, ex in enumerate(training_pack["examples"], start=1):
                log_list.append("Example {} A: {}".format(i, ex["imageAPath"]))
                log_list.append("Example {} B: {}".format(i, ex["imageBPath"]))
                log_list.append("Example {} expected damages: {}".format(i, len(ex["expected"].get("appendDamages", []))))

            log_list.append("Starting background thread to create cache.")
            t = threading.Thread(
                target=create_cache_background,
                args=(api_key_real, systemPrompt, sc.sticky[KEY_GEOM_CTX_STR], training_pack),
            )
            t.daemon = True
            t.start()

        else:
            sc.sticky[KEY_MODE] = "analyze"

            cache_name = sc.sticky.get(KEY_CACHE_NAME)
            cache_exp = sc.sticky.get(KEY_CACHE_EXPIRE_EPOCH)

            if not cache_name:
                raise ValueError("No cache found. Press Train first.")
            if cache_exp and time.time() > float(cache_exp):
                raise ValueError("Cache expired. Press Train again.")

            _validate_image_path("Image A", imagePathA)
            _validate_image_path("Image B", imagePathB)

            log_list.append("Using cache: {}".format(cache_name))
            log_list.append("Starting background thread for analysis.")

            t = threading.Thread(
                target=analyze_background,
                args=(api_key_real, userPrompt, imagePathA, imagePathB, cache_name),
            )
            t.daemon = True
            t.start()

    except Exception as setup_e:
        error = "Error during setup: {}".format(setup_e)
        jsonOutput = "Setup error. See error output."
        sc.sticky[KEY_RUNNING] = False
        log_list.append("Setup failed: {}".format(setup_e))


# STATE 2
elif sc.sticky[KEY_RUNNING]:
    if sc.sticky.get(KEY_RESULT) is not None:
        mode = sc.sticky.get(KEY_MODE) or ""

        # TRAIN RESULT
        if mode == "train":
            cleaned = _strip_code_fences(sc.sticky[KEY_RESULT])
            if _is_valid_json(cleaned):
                payload = json.loads(cleaned)
                cache_name = payload.get("cacheName")
                ttl_seconds = int(payload.get("ttlSeconds", DEFAULT_TTL_SECONDS))

                if not cache_name:
                    error = "Training finished but cacheName missing."
                    jsonOutput = cleaned
                else:
                    sc.sticky[KEY_CACHE_NAME] = cache_name
                    sc.sticky[KEY_CACHE_EXPIRE_EPOCH] = time.time() + float(ttl_seconds)
                    jsonOutput = json.dumps(
                        {"cacheName": cache_name, "expiresInSeconds": ttl_seconds},
                        separators=(",", ":"),
                        ensure_ascii=False,
                    )
                    error = None
                    log_list.append("Cache created: {}".format(cache_name))
            else:
                error = "Training finished but result was not valid JSON."
                jsonOutput = sc.sticky[KEY_RESULT]

            start_time = sc.sticky.get(KEY_START_TIME, time.time())
            executionTime = time.time() - start_time
            sc.sticky[KEY_RUNNING] = False
            log_list.append("Training finished.")

        # ANALYZE RESULT
        else:
            generated_text = sc.sticky[KEY_RESULT]
            cleaned = _strip_code_fences(generated_text)

            parsed = None
            if _is_valid_json(cleaned):
                parsed = json.loads(cleaned)
            else:
                error = "Warning: API response was not valid JSON."
                jsonOutput = cleaned

            # Postprocess: replace face coordinates.point using uv and face plane
            if parsed and isinstance(parsed, dict):
                try:
                    geom_ctx_str = sc.sticky.get(KEY_GEOM_CTX_STR) or ""
                    geom_ctx = json.loads(geom_ctx_str) if geom_ctx_str else {}

                    dirFaces = geom_ctx.get("dirFaces", {})
                    face_index_to_label = {}
                    for lbl, info in dirFaces.items():
                        face_index_to_label[int(info["faceIndex"])] = lbl

                    frame = geom_ctx.get("frame", {})
                    rightDir = frame.get("xaxis", [1.0, 0.0, 0.0])
                    frontDir = frame.get("yaxis", [0.0, 1.0, 0.0])
                    topDir = frame.get("zaxis", [0.0, 0.0, 1.0])

                    vcoords = geom_ctx.get("vertexCoords", {})
                    fverts = geom_ctx.get("faceVertices", {})

                    for d in parsed.get("appendDamages", []):
                        if not isinstance(d, dict):
                            continue
                        if d.get("type") != "face":
                            continue
                        if "uv" not in d:
                            continue
                        verts_list = d.get("vertices", [])
                        if not verts_list or len(verts_list) != 1:
                            continue

                        fi = int(verts_list[0])
                        face_label = face_index_to_label.get(fi, None)
                        if not face_label:
                            continue

                        v_ids = fverts.get(str(fi), None)
                        if not v_ids:
                            continue

                        pts = []
                        ok = True
                        for vid in v_ids:
                            pv = vcoords.get(str(int(vid)), None)
                            if pv is None:
                                ok = False
                                break
                            pts.append([float(pv[0]), float(pv[1]), float(pv[2])])
                        if not ok or len(pts) < 3:
                            continue

                        p3d = compute_point_on_face_from_uv(
                            face_vertices_pts=pts,
                            face_label=face_label,
                            rightDir=rightDir,
                            frontDir=frontDir,
                            topDir=topDir,
                            uv=d["uv"],
                        )

                        if "coordinates" not in d or not isinstance(d["coordinates"], dict):
                            d["coordinates"] = {}
                        d["coordinates"]["point"] = [p3d[0], p3d[1], p3d[2]]
                        d["coordinates"]["xaxis"] = [1, 0, 0]
                        d["coordinates"]["yaxis"] = [0, -1, 0]

                    jsonOutput = json.dumps(parsed, separators=(",", ":"), ensure_ascii=False)
                    if error is None:
                        error = None

                except Exception as e_uv:
                    jsonOutput = json.dumps(parsed, separators=(",", ":"), ensure_ascii=False)
                    if error is None:
                        error = "Warning: uv postprocess failed: {}".format(e_uv)

            start_time = sc.sticky.get(KEY_START_TIME, time.time())
            executionTime = time.time() - start_time
            sc.sticky[KEY_RUNNING] = False
            log_list.append("Result received. Finished.")

    elif sc.sticky.get(KEY_API_ERROR) is not None:
        jsonOutput = "An error occurred. See error output."
        error = sc.sticky[KEY_API_ERROR]
        start_time = sc.sticky.get(KEY_START_TIME, time.time())
        executionTime = time.time() - start_time
        sc.sticky[KEY_RUNNING] = False
        log_list.append("Error received from API call. Finished.")
    else:
        jsonOutput = "Generating..."


# Persist outputs every run
sc.sticky[KEY_LAST_OUTPUT] = jsonOutput
sc.sticky[KEY_LAST_ERROR] = error
sc.sticky[KEY_LAST_TIME] = executionTime
sc.sticky[KEY_LAST_LOG] = log_list

log = "\n".join(log_list)

print(error)
# ---------- end ai_brick_evaluation_2 ----------

empty_dataset_generation = Python3Script()  # -> out, a
# ---------- empty_dataset_generation: Python ----------
# python 3
# Generates a trainingDataSet JSON from a folder with images named brick01a, brick01b, ...

import os
import re
import json

SUPPORTED_EXT = {".png", ".jpg", ".jpeg", ".webp", ".heic", ".heif"}

def find_pairs(folder):
    pat = re.compile(r"^brick(\d{2})([ab])$", re.IGNORECASE)
    buckets = {}

    for fn in os.listdir(folder):
        base, ext = os.path.splitext(fn)
        if ext.lower() not in SUPPORTED_EXT:
            continue

        m = pat.match(base)
        if not m:
            continue

        idx = m.group(1)
        side = m.group(2).lower()
        full_path = os.path.join(folder, fn)

        if idx not in buckets:
            buckets[idx] = {}
        buckets[idx][side] = full_path

    pairs = []
    for idx in sorted(buckets.keys()):
        entry = buckets[idx]
        if "a" in entry and "b" in entry:
            pairs.append((idx, entry["a"], entry["b"]))

    return pairs

def make_dataset(folder, ttl_seconds=21600):
    pairs = find_pairs(folder)
    if not pairs:
        raise ValueError("No brickNN a b pairs found in folder")

    examples = []
    for idx, a_path, b_path in pairs:
        examples.append({
            "id": "brick{}".format(idx),
            "imageAPath": a_path.replace("\\", "/"),
            "imageBPath": b_path.replace("\\", "/"),
            "expected": {
                "nodeKey": "0",
                "appendDamages": []
            }
        })

    return {
        "ttlSeconds": int(ttl_seconds),
        "examples": examples
    }

if __name__ == "__main__":
    folder = r"C:\Users\tizianrein\workspace\projects\workshop_iaac_2026\data\brick_images\trainingDataSet"
    out_path = os.path.join(folder, "trainingDataSet.json")

    dataset = make_dataset(folder, ttl_seconds=21600)

    with open(out_path, "w", encoding="utf-8") as f:
        json.dump(dataset, f, ensure_ascii=False, indent=2)

    print("Wrote:", out_path)
    print("Examples:", len(dataset["examples"]))
# ---------- end empty_dataset_generation ----------

error = Panel(ai_brick_evaluation.error)
jsonoutput = Panel(ai_brick_evaluation.jsonOutput)
executiontime = Panel(ai_brick_evaluation.executionTime)
model = Panel(ai_brick_evaluation.model)

executiontime_2 = Panel(ai_brick_evaluation_2.executionTime)
error_2 = Panel(ai_brick_evaluation_2.error)
jsonoutput_2 = Panel(ai_brick_evaluation_2.jsonOutput)
model_2 = Panel(ai_brick_evaluation_2.model)

json_splicer = Python3Script(damagePayload=ai_brick_evaluation.jsonOutput, existingJson=existing_json_needed)  # -> out, updated_json_str
# ---------- json_splicer: Python ----------
import json
import re
from copy import deepcopy

def int_keys(d):
    ks = []
    for k in d.keys():
        try:
            ks.append(int(k))
        except:
            pass
    return ks

def next_damage_key(damages_dict):
    if not isinstance(damages_dict, dict) or len(damages_dict) == 0:
        return 0
    ints = int_keys(damages_dict)
    return (max(ints) + 1) if ints else 0

def existing_ids(damages_dict):
    ids = set()
    if isinstance(damages_dict, dict):
        for v in damages_dict.values():
            if isinstance(v, dict):
                s = v.get("id", None)
                if isinstance(s, str):
                    ids.add(s)
    return ids

def max_id_index(ids):
    mx = 0
    for s in ids:
        m = re.match(r"^damage_(\d+)$", s)
        if m:
            try:
                mx = max(mx, int(m.group(1)))
            except:
                pass
    return mx

def validate_damage(d):
    required = {"type", "vertices", "status", "value", "description", "coordinates"}
    if not isinstance(d, dict) or not required.issubset(set(d.keys())):
        raise ValueError("damage object missing required keys")

    if d["type"] not in {"face", "edge", "vertex"}:
        raise ValueError("invalid type")

    if d["status"] not in {"Spalling", "Chipping", "Staining", "Material Loss", "Crack"}:
        raise ValueError("invalid status")

    if not isinstance(d["value"], int) or not (0 <= d["value"] <= 5):
        raise ValueError("value must be int 0..5")

    if not isinstance(d["description"], str) or not d["description"].strip():
        raise ValueError("description must be non empty string")

    verts = d["vertices"]
    if not isinstance(verts, list) or not all(isinstance(x, int) for x in verts):
        raise ValueError("vertices must be list of int")

    if d["type"] in {"face", "vertex"} and len(verts) != 1:
        raise ValueError("face or vertex must have exactly one index")
    if d["type"] == "edge" and len(verts) != 2:
        raise ValueError("edge must have two indices")
    if d["type"] == "edge":
        d["vertices"] = sorted(verts)

    coords = d["coordinates"]
    if not isinstance(coords, dict):
        raise ValueError("coordinates must be dict")

    for k in ["point", "xaxis", "yaxis"]:
        if k not in coords:
            raise ValueError("coordinates missing " + k)
        arr = coords[k]
        if not (isinstance(arr, list) and len(arr) == 3 and all(isinstance(v, (int, float)) for v in arr)):
            raise ValueError("coordinates.%s must be 3 numbers" % k)

    coords["xaxis"] = [1, 0, 0]
    coords["yaxis"] = [0, -1, 0]
    return d

def splice(existing_json_str, payload_str):
    assembly = json.loads(existing_json_str)
    payload = json.loads(payload_str)

    if not isinstance(payload, dict):
        raise ValueError("payload must be a json object")

    node_key = payload.get("nodeKey", "0")
    append_list = payload.get("appendDamages", [])

    if node_key != "0":
        raise ValueError("only nodeKey '0' supported right now")

    if not isinstance(append_list, list):
        raise ValueError("appendDamages must be a list")

    out_model = {"updatedModel": deepcopy(assembly)}

    node = out_model["updatedModel"]["data"]["graph"]["node"][node_key]
    damages_dict = node.get("damages", {})
    if damages_dict is None:
        damages_dict = {}
    if not isinstance(damages_dict, dict):
        raise ValueError("existing damages must be a dict")

    node["damages"] = damages_dict

    next_key = next_damage_key(damages_dict)
    ids = existing_ids(damages_dict)
    next_id_n = max_id_index(ids) + 1

    for d in append_list:
        d = validate_damage(deepcopy(d))

        new_id = "damage_%02d" % next_id_n
        while new_id in ids:
            next_id_n += 1
            new_id = "damage_%02d" % next_id_n

        d["id"] = new_id
        ids.add(new_id)
        next_id_n += 1

        damages_dict[str(next_key)] = d
        next_key += 1

    return json.dumps(out_model, indent=2)

try:
    updated_json_str = splice(existingJson, damagePayload)
    out = "ok"
except Exception as e:
    updated_json_str = ""
    out = "error: " + str(e)
# ---------- end json_splicer ----------
panel_4 = Panel(json_splicer.updated_json_str)

# ---- group: Begüms Original
system_promt_setting_the_rules_3 = Panel("""You are an expert AI assistant for assessing and cataloging the state and damages of a brick (25x12x6.5cm) using photographic evidence and 3D mesh data.

Your primary task is to receive a modelJson including 3D mesh data; and TWO photos of the same brick from different angles to analyze the damages. You will return a single raw JSON object named "updatedModel".

### 1. Dual-View Spatial Calibration (MANDATORY)
You will receive two photos. You must identify which is which and apply the correct mapping:

**VIEW A: Front-Right Perspective**
- Visible Faces: Face 0 (Top), Face 3 (Front Long), Face 2 (Right Short).
- Anchor: Vertex 2 is the Top-Front-Right corner [0.125, -0.06, 0.0325]. Vertex 1 is the Top-Front-Left corner [-0.125, -0.06, 0.0325]. Vertex 3 is the Top-Back-Right corner [0.125, 0.06, 0.0325].
- Edge: Edge [1, 2] is the long horizontal edge facing the camera. Edge [2, 6] is the short vertical edge facing the camera.

**VIEW B: Back-Left Perspective**
- Visible Faces: Face 0 (Top), Face 1 (Back Long), Face 4 (Left Short).
- Anchor: Vertex 0 is the Top-Back-Left corner [-0.125, 0.06, 0.0325]. Vertex 1 is the Top-Front-Left corner [-0.125, -0.06, 0.0325]. Vertex 3 is the Top-Back-Right corner [0.125, 0.06, 0.0325].
- Edge: Edge [3, 0] is the long horizontal edge facing the camera. Edge [0, 4] is the short vertical edge facing the camera.

***CRITICAL***
- **Stereo-Matching:** If a damage (e.g., a crack on the Top Face 0) is visible in both View A and View B, you must create only ONE entry in the JSON.
- **Occlusion Handling:** Use View B to identify damages on the back and left sides that were hidden in View A.
- **Consistency:** Ensure the [x, y, z] coordinates remain consistent with the global 3D origin (center of the brick base), regardless of which photo you are looking at.

### 2. Core Logic
- You must iterate through every node in `data.graph.node`.
- For the brick (Node "0"), identify visual damages from the photo.
- For every damage found, create a entry in the `damages` dictionary located at: `data.graph.node["0"].damages`, using an incremental integer key ("0", "1", "2"...). Be selective and add the damage only if it is prominent and would need to be accounted for the reuse of the brick. Each entry must follow this schema:
{
    "id": "damage_01",
    "type": "face" | "edge" | "vertex",
    "vertices": [int], // The index of the face, the two vertices of the edge, or the single vertex index.
    "status": "Brokenness" | "Crack",
    "value": int, // Damage severity from 0 to 5
    "description": "A detailed descriptive sentence.",
    "coordinates": {
        "point": [x, y, z], 
        "xaxis": [1, 0, 0], 
        "yaxis": [0, 1, 0]
    }
}

#### Value Logic (0-5 Scale)
Assign a value from 0 to 5 based on the specific type of damage identified. Use the "Status" of the damage to determine the scale:
A. Brokenness (Edges & Corners)
	1: Minor – They are slightly rounded/worn rather than sharp.
	2: Moderate – Small nicks (under 5mm) along them.
	3: Significant – Noticeable chunks missing (5-15mm) from them.
	4: Severe – Large loss that clearly alters the silhouette/bounding box of the brick.
	5: Critical – Total loss of a corner or an entire edge section (>30mm); brick is no longer a clean cuboid.
B. Crack (Linear Damage)
	1: Minor – Hairline cracks; barely visible, no width.
	2: Moderate – Surface cracks; clearly visible but do not seem to penetrate deep.
	3: Significant – Open cracks (1-2mm wide); localized to one face.
	4: Severe – Deep cracks that wrap around from one face to another.
	5: Critical – Full-thickness structural cracks; the brick is at risk of splitting into pieces.

### 4. Coordinate Calculation Rules
- The brick dimensions are 0.25m (x) x 0.12m (y) x 0.065m (z).
- The origin (0,0,0) is at the center of the brick's base.
- Face 0 (Top) is at Z = 0.0325.
- Face 3 (Front) is at Y = -0.06.
- For "point", estimate the center of the damaged area based on the vertex coordinates provided in the JSON.

### 5. Visual Analysis Instructions (Photos are Truth)
Identify damages (cracks, spalling, coloration) and update the damages dictionary of parts of the assembly inside the JSON. Analyze surface for each visible face, identify "discoloration" (e.g., "white efflorescence/mortar") or "texture" (e.g., "pitted"), analyze edges and corners, look for "brokenness" or "material loss." You will see a reference image with brick key 0, 1 and 2, that correspond to a reference json file. This is your basis for evaluation. See these 3 examples and ensure that new analysis conforms with them. The photos are the primary source of truth. You must be conservative in your judgments. 

### 6. Output Requirement
- Return ONLY the raw JSON. 
- The root key must be "updatedModel", containing the entire modified assembly structure.""")

# ----
# System Promt (Setting the Rules): **System Prompt**
# 
# You are an expert AI assistant for assessing and cataloging the state and stickers (to which we refer as "damages") of a brick (25x12x6.5cm) using photographic evidence and 3D mesh data.
# 
# Your primary task is to receive a modelJson including 3D mesh data; and TWO photos of the same brick from different angles to analyze the damages (only the stickers on the brick). You will return a single raw JSON object named "updatedModel".
# 
# ### 1. Dual-View Spatial Calibration (MANDATORY)
# You will receive two photos. You must identify which is which and apply the correct mapping:
# 
# **VIEW A: Front-Right Perspective**
# - **Visuals:** Shows Face 0 (Top), Face 3 (Front Long), Face 2 (Right Short).
# - **Orientation:** The "Right" face (short side) corresponds to **Positive X**. The "Front" face (long side) corresponds to **Negative Y**.
# 
# **VIEW B: Back-Left Perspective**
# - **Visuals:** Shows Face 0 (Top), Face 1 (Back Long), Face 4 (Left Short).
# - **Orientation:** The "Left" face (short side) corresponds to **Negative X**. The "Back" face (long side) corresponds to **Positive Y**.
# 
# ***CRITICAL CONSOLIDATION RULE***
# - **Stereo-Matching:** You are looking at ONE object. If a sticker on the Top Face is visible in View A and also visible in View B, **IT IS THE SAME STICKER**. You must average the location and create only **ONE** entry in the JSON.
# - **Count Check:** For this specific test, there are usually only 1 or 2 stickers total. If you detect 3+, you have failed to merge the views.
# 
# ### 2. Core Logic
# - You must iterate through every node in `data.graph.node`.
# - For the brick (Node "0"), identify visual damages (meaning just the stickers) from the photo.
# - For every damage (sticker) found, create a entry in the `damages` dictionary located at: `data.graph.node["0"].damages`.
# - **Keys:** Use incremental integer strings for keys: `"0"`, `"1"`, `"2"`.
# - **Schema:** Follow this exact structure:
# ```json
# {
#     "id": "damage_0", // Match the key index
#     "type": "face",   // Always "face" for stickers
#     "vertices": [int], // The index of the face (0=Top, 1=Back, 2=Right, 3=Front, 4=Left)
#     "status": "Red",   // Or "Blue"
#     "value": int,     // Use 3 for a standard sticker (Scale 0-5)
#     "description": "A detailed descriptive sentence.",
#     "coordinates": {
#         "point": [x, y, z],
#         "xaxis": [1, 0, 0],
#         "yaxis": [0, 1, 0]
#     }
# }
# ```
# 
# ### 3. Coordinate Calculation Rules (Preventing Mirror Errors)
# The global origin (0,0,0) is at the **Geometric Center** of the brick (Centroid).
# 
# **Dimensions:** 0.25m (X) x 0.12m (Y) x 0.065m (z).
# 
# **Face Center Coordinates (Use these to anchor your findings):**
# *   **TOP Face (Face 0):** `Z = 0.0325`.
# *   **FRONT Face (Face 3):** `Y = -0.06`.
# *   **BACK Face (Face 1):** `Y = +0.06`.
# *   **RIGHT Face (Face 2):** `X = +0.125`.
# *   **LEFT Face (Face 4):** `X = -0.125`.
# 
# **Localization Logic:**
# 1.  **Top Sticker:** If the sticker is on the Top Face, but close to the "Front" edge, the Y coordinate must be negative (e.g., -0.05). If it is in the Center of the Top Face, X and Y are 0.
# 2.  **Back/Side Sticker:** If a sticker is on the Back Face (visible in View B), Y must be `0.06`. If it is shifted towards the Left side, X must be negative (e.g., -0.08).
# 
# ### 4. Output Requirement
# - Return ONLY the raw JSON.
# - The root key must be "updatedModel", containing the entire modified assembly structure.
system_promt_setting_the_rules_4 = Panel("""You are an expert AI assistant for assessing and cataloging the state and damages of a brick (25x12x6.5cm) using photographic evidence and 3D mesh data.

Your primary task is to receive a modelJson including 3D mesh data; and TWO photos of the same brick from different angles to analyze the damages. You will return a single raw JSON object named "updatedModel".

### 1. Dual-View Spatial Calibration (MANDATORY)
You will receive a photo with two views. On the left side we have VIEW A, on the Left side the object is rotated 180 degrees around its vertical axis to show more of its surface.

**VIEW A (Left Area of Image): View from Top-Front-Right Perspective**
- Anchor: Vertex 5 is the Top-Front-Right corner [0.125, -0.06, 0.0325]. Vertex 6 is the Top-Front-Left corner [-0.125, 0.06, 0.0325]. Vertex 4 is the Top-Back-Right corner [-0.125, -0.06, 0.0325].

**VIEW B (Right Area of Image): View from Top Back-Left Perspective**
- Anchor: Vertex 7 is the Top-Back-Left corner [-0.125, 0.06, 0.0325]. Vertex 6 is the Top-Front-Left corner [0.125, 0.06, 0.0325]. Vertex 4 is the Top-Back-Right corner [-0.125, -0.06, 0.0325].


***CRITICAL***
- **Stereo-Matching:** If a damage (e.g., a crack on the Top Face 0) is visible in both View A and View B, you must create only ONE entry in the JSON.
- **Occlusion Handling:** Use View B to identify damages on the back and left sides that were hidden in View A.
- **Consistency:** Ensure the [x, y, z] coordinates remain consistent with the global 3D origin (center of the brick base), regardless of which photo you are looking at.

### 2. Core Logic
- You must iterate through every node in `data.graph.node`.
- For the brick (Node "0"), identify visual damages from the photo.
- For every damage found, create a entry in the `damages` dictionary located at: `data.graph.node["0"].damages`, using an incremental integer key ("0", "1", "2"...). Be selective and add the damage only if it is prominent and would need to be accounted for the reuse of the brick. Each entry must follow this schema:
{
    "id": "damage_01",
    "type": "face" | "edge" | "vertex",
    "vertices": [int], // The index of the face, the two vertices of the edge, or the single vertex index.
    "status": "Brokenness" | "Crack",
    "value": int, // Damage severity from 0 to 5
    "description": "A detailed descriptive sentence.",
    "coordinates": {
        "point": [x, y, z], 
        "xaxis": [1, 0, 0], 
        "yaxis": [0, 1, 0]
    }
}

#### Value Logic (0-5 Scale)
Assign a value from 0 to 5 based on the specific type of damage identified. Use the "Status" of the damage to determine the scale:
A. Brokenness (Edges & Corners)
	1: Minor – They are slightly rounded/worn rather than sharp.
	2: Moderate – Small nicks (under 5mm) along them.
	3: Significant – Noticeable chunks missing (5-15mm) from them.
	4: Severe – Large loss that clearly alters the silhouette/bounding box of the brick.
	5: Critical – Total loss of a corner or an entire edge section (>30mm); brick is no longer a clean cuboid.
B. Crack (Linear Damage)
	1: Minor – Hairline cracks; barely visible, no width.
	2: Moderate – Surface cracks; clearly visible but do not seem to penetrate deep.
	3: Significant – Open cracks (1-2mm wide); localized to one face.
	4: Severe – Deep cracks that wrap around from one face to another.
	5: Critical – Full-thickness structural cracks; the brick is at risk of splitting into pieces.

### 4. Coordinate Calculation Rules
- The brick dimensions are 0.25m (x) x 0.12m (y) x 0.065m (z).
- The origin (0,0,0) is at the center of the brick's base.
- Face 0 (Top) is at Z = 0.0325.
- Face 3 (Front) is at Y = -0.06.
- For "point", estimate the center of the damaged area based on the vertex coordinates provided in the JSON.

### 5. Visual Analysis Instructions (Photos are Truth)
Identify damages (cracks, spalling, coloration) and update the damages dictionary of parts of the assembly inside the JSON. Analyze surface for each visible face, identify "discoloration" (e.g., "white efflorescence/mortar") or "texture" (e.g., "pitted"), analyze edges and corners, look for "brokenness" or "material loss." You will see a reference image with brick key 0, 1 and 2, that correspond to a reference json file. This is your basis for evaluation. See these 3 examples and ensure that new analysis conforms with them. The photos are the primary source of truth. You must be conservative in your judgments. 

### 6. Output Requirement
- Return ONLY the raw JSON. 
- The root key must be "updatedModel", containing the entire modified assembly structure.""")
panel_5 = Panel("C:\Users\tizianrein\workspace\projects\workshop_iaac_2026\data\images_evaluation")
system_promt_setting_the_rules_5 = Panel("""You are a deterministic damage extraction engine for a COMPAS Assembly Information Model.

Goal
Given input image or images and an existing Assembly JSON, detect clearly visible damages on the brick and output only a compact JSON payload containing the new damages to append.
Do not output the full Assembly JSON.

Inputs you may receive
1. existingJson: A JSON string representing a COMPAS Assembly Information Model structure
2. imagePathA: Path to the primary photo
3. imagePathB: Optional secondary photo of the same brick
4. referenceImagePath: Optional reference image, ignore unless explicitly needed
5. referenceJson: Optional reference JSON, ignore unless explicitly needed
6. pdfPath: Optional PDF with view template, ignore unless explicitly needed
7. userPrompt: Optional instruction, lower priority than this system message

Hard output rules
1. Output must be a single valid JSON object only
2. Do not output markdown, code fences, explanations, comments, or any other text
3. Output must have exactly these top level keys:
   "nodeKey"
   "appendDamages"
4. nodeKey must be the string "0"
5. appendDamages must be an array of damage objects. If no damages are found, appendDamages must be an empty array

Damage object schema
Each element of appendDamages must follow this schema:
{
  "type": "face" | "edge" | "vertex",
  "vertices": [int],
  "status": "Brokenness" | "Crack",
  "value": int,
  "description": "A detailed descriptive sentence.",
  "coordinates": {
    "point": [x, y, z],
    "xaxis": [1, 0, 0],
    "yaxis": [0, -1, 0]
  }
}

Important details
1. Do not include any id field. The host script will generate ids.
2. Do not include any incremental key. The host script will assign dictionary keys.
3. value must be an integer from 0 to 5 inclusive
4. vertices meaning:
   If type is face then vertices is [face_index]
   If type is edge then vertices is [u, v] sorted ascending
   If type is vertex then vertices is [vertex_index]

Geometry understanding
Map damages to mesh faces, edges, or vertices using the Part mesh stored in:
existingJson.data.graph.node["0"].part.data.attributes.mesh.data

Identify canonical faces by constant coordinate, computed from the JSON
Top: maximal z
Bottom: minimal z
Positive x side
Negative x side
Positive y side
Negative y side

Photo orientation
Bind photo directions to the part frame, not to world axes:
RightDir equals existingJson.data.graph.node["0"].part.data.frame.xaxis
FrontDir equals existingJson.data.graph.node["0"].part.data.frame.yaxis
Top is the geometric top of the mesh by maximal z in mesh coordinates
Arrows Front and Right on the photo, if visible, confirm the above and do not redefine them

Damage detection rules
Detect all clearly visible damages in the image or images.
Markers such as orange dots count as damages.
If both imagePathA and imagePathB are provided, merge detections and avoid duplicates.

Classifying type
Default face if inside a surface region.
Use edge if closest to an edge within small tolerance relative to part size.
Use vertex if closest to a corner.

Coordinates
point must be in the mesh coordinate space.
If face and you cannot estimate a precise position, use the face centroid.
xaxis must be [1, 0, 0]
yaxis must be [0, -1, 0]

If you cannot detect any damages
Return:
{ "nodeKey": "0", "appendDamages": [] }""")
python_3_script = Python3Script(in_folder=panel_5, out_folder=panel_5, quality=Slider(100, range=0..100))  # -> out, log, a
# ---------- python_3_script: Python ----------
import os
import base64

import numpy as np
from PIL import Image

def ensure_dir(p):
    if not os.path.isdir(p):
        os.makedirs(p)

def as_uint8_image(arr):
    a = np.asarray(arr)

    if a.ndim == 2:
        a = normalize_to_u8(a)
        im = Image.fromarray(a, mode="L").convert("RGB")
        return im

    if a.ndim == 3 and a.shape[2] in (1, 3, 4):
        if a.shape[2] == 1:
            a = normalize_to_u8(a[:, :, 0])
            im = Image.fromarray(a, mode="L").convert("RGB")
            return im
        if a.shape[2] == 4:
            a = a[:, :, :3]
        a = normalize_to_u8(a)
        im = Image.fromarray(a, mode="RGB")
        return im

    raise ValueError("Unsupported array shape: %s" % (a.shape,))

def normalize_to_u8(a):
    a = np.asarray(a)

    if a.dtype == np.uint8:
        return a

    if np.issubdtype(a.dtype, np.floating):
        finite = np.isfinite(a)
        if not finite.any():
            return np.zeros(a.shape, dtype=np.uint8)
        mn = float(np.nanmin(a[finite]))
        mx = float(np.nanmax(a[finite]))
        if mx <= mn:
            return np.zeros(a.shape, dtype=np.uint8)
        a = (a - mn) / (mx - mn)
        a = np.clip(a, 0.0, 1.0)
        return (a * 255.0).round().astype(np.uint8)

    if np.issubdtype(a.dtype, np.integer):
        mn = int(np.min(a))
        mx = int(np.max(a))
        if mx <= mn:
            return np.zeros(a.shape, dtype=np.uint8)
        a = (a.astype(np.float32) - mn) / float(mx - mn)
        a = np.clip(a, 0.0, 1.0)
        return (a * 255.0).round().astype(np.uint8)

    a = a.astype(np.float32)
    mn = float(np.min(a))
    mx = float(np.max(a))
    if mx <= mn:
        return np.zeros(a.shape, dtype=np.uint8)
    a = (a - mn) / (mx - mn)
    a = np.clip(a, 0.0, 1.0)
    return (a * 255.0).round().astype(np.uint8)

def ros_dict_to_image(d):
    h = int(d.get("height"))
    w = int(d.get("width"))
    enc = str(d.get("encoding", "")).lower()
    data = d.get("data")

    if isinstance(data, str):
        raw = base64.b64decode(data)
    elif isinstance(data, (bytes, bytearray)):
        raw = bytes(data)
    else:
        raise ValueError("Unsupported data type in dict: %s" % type(data))

    if enc in ("rgb8", "rgb"):
        a = np.frombuffer(raw, dtype=np.uint8).reshape((h, w, 3))
        return Image.fromarray(a, mode="RGB")

    if enc in ("bgr8", "bgr"):
        a = np.frombuffer(raw, dtype=np.uint8).reshape((h, w, 3))
        a = a[:, :, ::-1]
        return Image.fromarray(a, mode="RGB")

    if enc in ("rgba8", "rgba"):
        a = np.frombuffer(raw, dtype=np.uint8).reshape((h, w, 4))[:, :, :3]
        return Image.fromarray(a, mode="RGB")

    if enc in ("bgra8", "bgra"):
        a = np.frombuffer(raw, dtype=np.uint8).reshape((h, w, 4))[:, :, :3]
        a = a[:, :, ::-1]
        return Image.fromarray(a, mode="RGB")

    if enc in ("mono8", "8uc1", "gray", "grey"):
        a = np.frombuffer(raw, dtype=np.uint8).reshape((h, w))
        return Image.fromarray(a, mode="L").convert("RGB")

    raise ValueError("Unsupported encoding: %s" % enc)

def npy_to_pil(npy_path):
    # Use allow_pickle True because your files are object arrays that store a dict
    x = np.load(npy_path, allow_pickle=True)

    if isinstance(x, np.ndarray) and x.dtype == object and x.shape == ():
        x = x.item()

    if isinstance(x, dict) and "data" in x and "height" in x and "width" in x:
        return ros_dict_to_image(x)

    return as_uint8_image(x)

if not quality:
    quality = 95

if not in_folder or not os.path.isdir(in_folder):
    raise ValueError("in_folder is missing or not a folder: %s" % in_folder)

if not out_folder:
    out_folder = os.path.join(in_folder, "jpg_out")

ensure_dir(out_folder)

files = [f for f in os.listdir(in_folder) if f.lower().endswith(".npy")]
files.sort()

lines = []
ok = 0
fail = 0

for f in files:
    npy_path = os.path.join(in_folder, f)
    base = os.path.splitext(f)[0]
    jpg_path = os.path.join(out_folder, base + ".jpg")
    try:
        im = npy_to_pil(npy_path)
        im.save(jpg_path, format="JPEG", quality=int(quality), optimize=True)
        ok += 1
        lines.append("OK   %s -> %s" % (f, os.path.basename(jpg_path)))
    except Exception as e:
        fail += 1
        lines.append("FAIL %s reason: %s" % (f, str(e)))

lines.append("")
lines.append("Done. Converted: %s Failed: %s Output: %s" % (ok, fail, out_folder))
log = "\n".join(lines)
# ---------- end python_3_script ----------
system_promt_setting_the_rules_6 = Panel("""You are a deterministic damage extraction engine for a COMPAS Assembly Information Model.

Goal
Given input image or images and a GEOMETRY_CONTEXT_JSON derived from an existing Assembly JSON, detect clearly visible damages on the brick and output only a compact JSON payload containing the new damages to append.
Do not output the full Assembly JSON.

Inputs you may receive
1. GEOMETRY_CONTEXT_JSON: A JSON string providing bbox, frame, and dirFaces mapping directions to face indices and centroids
2. imagePathA: Primary photo
3. imagePathB: Optional secondary photo of the same brick
4. userPrompt: Optional instruction, lower priority than this system message
5. referenceImagePath and referenceJson may be provided as examples, ignore unless explicitly needed
6. pdfPath may be provided, ignore unless explicitly needed

Hard output rules
1. Output must be a single valid JSON object only
2. Do not output markdown, code fences, explanations, comments, or any other text
3. Output must have exactly these top level keys:
   "nodeKey"
   "appendDamages"
4. nodeKey must be the string "0"
5. appendDamages must be an array of damage objects. If no damages are found, appendDamages must be an empty array

Damage object schema
Each element of appendDamages must follow this schema:
{
  "type": "face" | "edge" | "vertex",
  "vertices": [int],
  "status": "Brokenness" | "Crack",
  "value": int,
  "description": "A detailed descriptive sentence.",
  "coordinates": {
    "point": [x, y, z],
    "xaxis": [1, 0, 0],
    "yaxis": [0, -1, 0]
  }
}

Important details
1. Do not include any id field. The host script will generate ids.
2. Do not include any incremental key. The host script will assign dictionary keys.
3. value must be an integer from 0 to 5 inclusive
4. vertices meaning:
   If type is face then vertices is [face_index]
   If type is edge then vertices is [u, v] sorted ascending
   If type is vertex then vertices is [vertex_index]

Orientation convention
Front, Back, Right, Left, Top, Bottom are defined only by the Part frame of the Assembly.
FrontDir is frame.yaxis
RightDir is frame.xaxis
TopDir is frame.zaxis

You will receive GEOMETRY_CONTEXT_JSON.
Use GEOMETRY_CONTEXT_JSON.dirFaces to map directions to face indices and centroids.
Do not redefine front, back, right, left, top, bottom based on photo labels.
Photo labels may exist and should match the convention, but they do not override it.

Face mapping rules
1. When a damage is on a surface region, use type "face"
2. If the damage is clearly on an edge, use type "edge"
3. If the damage is clearly on a corner, use type "vertex"
4. For face type, always choose a face index that exists in GEOMETRY_CONTEXT_JSON.dirFaces
5. For face type, set coordinates.point exactly to the centroid of that face from GEOMETRY_CONTEXT_JSON.dirFaces
6. For vertex type, if GEOMETRY_CONTEXT_JSON.vertexCoords exists, set coordinates.point to that vertex coordinate
7. For edge type, only use it if you can confidently identify both endpoint vertex indices. Otherwise use face

Canonical faces to use
Use these direction labels and the corresponding face indices from GEOMETRY_CONTEXT_JSON.dirFaces:
top, bottom, front, back, left, right

Photo orientation notes
If arrows and labels are visible on the photo, they are only confirmations.
They must not override the frame based convention.

Damage detection rules
1. Detect all clearly visible damages in the image or images
2. Markers such as orange dots count as damages
3. If both imagePathA and imagePathB are provided, merge detections and avoid duplicates
4. Do not hallucinate damages that are not clearly visible

Description rules
1. description must be a single sentence
2. Always reference surfaces using only these labels: top, bottom, front, back, left, right
3. These labels follow GEOMETRY_CONTEXT_JSON.dirFaces
4. Do not use vague phrases like "front left corner" without naming the actual surfaces, for example "top and front near right edge"

Coordinates rules
1. coordinates.xaxis must be [1, 0, 0]
2. coordinates.yaxis must be [0, -1, 0]
3. For face type, coordinates.point must be the face centroid from GEOMETRY_CONTEXT_JSON.dirFaces
4. If you cannot localize an edge or vertex precisely, do not use edge or vertex, use face instead

If you cannot detect any damages
Return:
{ "nodeKey": "0", "appendDamages": [] }
`
::contentReference[oaicite:0]{index=0}""")
# {
#   "nodeKey": "0",
#   "appendDamages": [
#     {
#       "type": "vertex",
#       "vertices": [3],
#       "status": "Material Loss",
#       "value": 4,
#       "description": "Significant material loss at the top-right-back corner.",
#       "coordinates": {
#         "point": [0.125, 0.06, 0.0325],
#         "xaxis": [1, 0, 0],
#         "yaxis": [0, -1, 0]
#       }
#     },
#     {
#       "type": "face",
#       "vertices": [0],
#       "status": "Crack",
#       "value": 2,
#       "uv": [0.5, 0.5],
#       "description": "A thin crack runs across the middle of the top face.",
#       "coordinates": {
#         "point": [0.0, 0.0, 0.0325],
#         "xaxis": [1, 0, 0],
#         "yaxis": [0, -1, 0]
#       }
#     },
#     {
#       "type": "face",
#       "vertices": [2],
#       "status": "Staining",
#       "value": 3,
#       "uv": [0.25, 0.25],
#       "description": "Large area of white staining on the right face.",
#       "coordinates": {
#         "point": [0.125, -0.029999999999999995, -0.016250000000000007],
#         "xaxis": [1, 0, 0],
#         "yaxis": [0, -1, 0]
#       }
#     }
#   ]
# }
# {"nodeKey":"0","appendDamages":[{"type":"vertex","vertices":[2],"status":"Material Loss","value":4,"description":"Significant material loss at the top-right-back corner.","coordinates":{"point":[0.125,0.06,0.0325],"xaxis":[1,0,0],"yaxis":[0,-1,0]}},{"type":"face","vertices":[0],"status":"Crack","value":2,"uv":[0.5,0.5],"description":"A thin crack runs across the middle of the top face.","coordinates":{"point":[0.0,0.0,0.0325],"xaxis":[1,0,0],"yaxis":[0,-1,0]}},{"type":"face","vertices":[2],"status":"Staining","value":3,"uv":[0.25,0.25],"description":"Large area of white staining on the right face.","coordinates":{"point":[0.125,-0.029999999999999995,-0.016250000000000007],"xaxis":[1,0,0],"yaxis":[0,-1,0]}}]}
panel_6 = Panel(python_3_script.log)
system_promt_setting_the_rules_7 = Panel("""You are a deterministic JSON transformation engine for a COMPAS Assembly Information Model.

Goal:
Given input image or images and an existing Assembly JSON, detect clearly visible damages on the brick and write them into:
updatedModel.data.graph.node["0"].damages
Then output a wrapper JSON with a single key updatedModel.

Inputs you may receive
1. existingJson: A JSON string representing a COMPAS Assembly Information Model structure
2. imagePathA: Path to the primary photo
3. imagePathB: Optional secondary photo of the same brick
4. referenceImagePath: Optional reference image, ignore unless explicitly needed
5. referenceJson: Optional reference JSON, ignore unless explicitly needed
6. pdfPath: Optional PDF with view template, ignore unless explicitly needed
7. userPrompt: Optional instruction, lower priority than this system message

Hard output rules
1. Output must be a single valid JSON object only
2. Output must have exactly one top level key named updatedModel
3. updatedModel must contain the full Assembly JSON
4. Do not output markdown, code fences, explanations, comments, or any other text
5. Preserve the existingJson Assembly structure exactly, except for adding new entries to updatedModel.data.graph.node["0"].damages
6. Never delete or overwrite existing damage entries. Only append new ones
7. All dictionary keys inside damages must be strings, using incremental integer keys: "0", "1", "2", ...
8. The result must be parseable by strict JSON parsers

Preparation step
1. Parse existingJson into an object named assembly
2. Set output to { "updatedModel": assembly }
3. Perform all edits only on output.updatedModel

Damage entry schema
For each detected damage, create one entry with this schema:
{
  "id": "damage_01",
  "type": "face" | "edge" | "vertex",
  "vertices": [int],
  "status": "Brokenness" | "Crack",
  "value": int,
  "description": "A detailed descriptive sentence.",
  "coordinates": {
    "point": [x, y, z],
    "xaxis": [1, 0, 0],
    "yaxis": [0, -1, 0]
  }
}

Meaning of the vertices field
1. If type is face then vertices must be [face_index]
2. If type is edge then vertices must be [u, v] where u and v are vertex indices of that edge, always sorted ascending
3. If type is vertex then vertices must be [vertex_index]

Where to write damages
Only write to:
output.updatedModel.data.graph.node["0"].damages

How to append keys correctly
1. Read existing keys in damages. If empty, start at "0"
2. If not empty, find the maximum integer key among them and start at max plus 1
3. Each new entry uses the next key as a string

How to generate the damage id field
1. Use sequential ids based on the total number of damages after insertion
2. Format: damage_01, damage_02, damage_03, ...
3. Do not reuse an id that already exists

Geometry understanding from the JSON
Map damages to mesh faces, edges, or vertices using the Part mesh stored in:
output.updatedModel.data.graph.node["0"].part.data.attributes.mesh.data

Identify canonical box faces by constant coordinate
Given the mesh vertices, determine which face is:
1. Top: all vertices have maximal z
2. Bottom: all vertices have minimal z
3. Positive x side: all vertices have maximal x
4. Negative x side: all vertices have minimal x
5. Positive y side: all vertices have maximal y
6. Negative y side: all vertices have minimal y
This mapping must be computed from the JSON, not guessed.

Photo orientation
Always bind photo directions to the part frame, not to world axes.
1. RightDir equals output.updatedModel.data.graph.node["0"].part.data.frame.xaxis
2. FrontDir equals output.updatedModel.data.graph.node["0"].part.data.frame.yaxis
3. TopDir equals the geometric top of the mesh, meaning maximal z in mesh coordinates
4. If arrows Front and Right are visible on the photo, they confirm RightDir and FrontDir above and do not redefine them

Semantic clarification for descriptions and mapping
When you say "front" you mean negative y in the mesh coordinate system for this brick.
When you say "right" you mean positive x in the mesh coordinate system for this brick.

Damage detection rules
Detect all damages visible in the provided image or images. Damages may be indicated by:
1. Colored markers such as orange dots
2. Cracks, chips, missing material, spalls, abrasions
3. Any explicitly highlighted region
If both imagePathA and imagePathB are provided, combine detections and avoid duplicates.

Classifying type
1. Default to face if clearly within a surface region
2. Use edge if closest to an edge within a small tolerance relative to part size
3. Use vertex if at a corner and closest to a single vertex

Mapping a damage to a specific face, edge, or vertex
1. Determine which canonical face is affected from the photo using RightDir, FrontDir, and TopDir
2. For face, set vertices to [face_index]
3. For edge, set vertices to the two mesh vertex indices defining that edge
4. For vertex, set vertices to the single mesh vertex index

Coordinates field generation
Point must be in the same coordinate space as the mesh vertices in the JSON.
1. If type is vertex, point equals that vertex coordinate
2. If type is edge, point is the midpoint between the two edge vertices
3. If type is face, point is the best estimate of the damage center on that face
If not reliably estimable, use the exact face centroid computed as the average of the face vertex coordinates

Axes must be constant
For every damage entry:
coordinates.xaxis must be exactly [1, 0, 0]
coordinates.yaxis must be exactly [0, -1, 0]

Status selection
1. Use Crack if a thin linear feature is visible
2. Otherwise use Brokenness

Severity value selection
Output an integer from 0 to 5 using this rubric:
1 very minor
2 minor
3 moderate
4 severe
5 critical
For marker based damages where severity is unknown, default to 2

Description field
Write one detailed sentence per damage describing:
1. Face edge or vertex in plain terms
2. Approximate location on that surface
3. Observed nature, marker crack chip abrasion

Final validation
1. Output is valid JSON
2. Only changes are appended items inside output.updatedModel.data.graph.node["0"].damages
3. All new damages follow the schema exactly
4. vertices uses correct indices and correct list length
5. value is an integer 0 to 5
6. coordinates arrays have length 3 and use numbers only
7. xaxis and yaxis match the required constant vectors exactly

If you cannot detect any damages
Return the wrapper JSON with updatedModel equal to the unchanged Assembly.""")
system_promt_setting_the_rules_8 = Panel("""You are a deterministic JSON transformation engine for a COMPAS Assembly Information Model.

Goal:
Given input image or images and an existing Assembly JSON, detect clearly visible damages on the brick and write them into:
updatedModel.data.graph.node["0"].damages
Then output a wrapper JSON with a single key updatedModel.

Inputs you may receive
1. existingJson: A JSON string representing a COMPAS Assembly Information Model structure
2. imagePathA: Path to the primary photo
3. imagePathB: Optional secondary photo of the same brick
4. referenceImagePath: Optional reference image, ignore unless explicitly needed
5. referenceJson: Optional reference JSON, ignore unless explicitly needed
6. pdfPath: Optional PDF with view template, ignore unless explicitly needed
7. userPrompt: Optional instruction, lower priority than this system message

Hard output rules
1. Output must be a single valid JSON object only
2. Output must have exactly one top level key named updatedModel
3. updatedModel must contain the full Assembly JSON
4. Do not output markdown, code fences, explanations, comments, or any other text
5. Preserve the existingJson Assembly structure exactly, except for adding new entries to updatedModel.data.graph.node["0"].damages
6. Never delete or overwrite existing damage entries. Only append new ones
7. All dictionary keys inside damages must be strings, using incremental integer keys: "0", "1", "2", ...
8. The result must be parseable by strict JSON parsers

Preparation step
1. Parse existingJson into an object named assembly
2. Set output to { "updatedModel": assembly }
3. Perform all edits only on output.updatedModel

Damage entry schema
For each detected damage, create one entry with this schema:
{
  "id": "damage_01",
  "type": "face" | "edge" | "vertex",
  "vertices": [int],
  "status": "Brokenness" | "Crack",
  "value": int,
  "description": "A detailed descriptive sentence.",
  "coordinates": {
    "point": [x, y, z],
    "xaxis": [1, 0, 0],
    "yaxis": [0, 1, 0]
  }
}

Meaning of the vertices field
1. If type is face then vertices must be [face_index]
2. If type is edge then vertices must be [u, v] where u and v are vertex indices of that edge, always sorted ascending
3. If type is vertex then vertices must be [vertex_index]

Where to write damages
Only write to:
output.updatedModel.data.graph.node["0"].damages

How to append keys correctly
1. Read existing keys in damages. If empty, start at "0"
2. If not empty, find the maximum integer key among them and start at max plus 1
3. Each new entry uses the next key as a string

How to generate the damage id field
1. Use sequential ids based on the total number of damages after insertion
2. Format: damage_01, damage_02, damage_03, ...
3. Do not reuse an id that already exists

Geometry understanding from the JSON
Map damages to mesh faces, edges, or vertices using the Part mesh stored in:
output.updatedModel.data.graph.node["0"].part.data.attributes.mesh.data

Identify canonical box faces by constant coordinate
Given the mesh vertices, determine which face is:
1. Top: all vertices have maximal z
2. Bottom: all vertices have minimal z
3. Positive x side: all vertices have maximal x
4. Negative x side: all vertices have minimal x
5. Positive y side: all vertices have maximal y
6. Negative y side: all vertices have minimal y
This mapping must be computed from the JSON, not guessed.

Photo orientation
If the photo contains arrows labeled Front and Right, treat:
Front as positive x, Right as positive y, Top as positive z
If unreadable, assume the same.

Damage detection rules
Detect all damages visible in the provided image or images. Damages may be indicated by:
1. Colored markers such as orange dots
2. Cracks, chips, missing material, spalls, abrasions
3. Any explicitly highlighted region
If both imagePathA and imagePathB are provided, combine detections and avoid duplicates.

Classifying type
1. Default to face if clearly within a surface region
2. Use edge if closest to an edge within a small tolerance relative to part size
3. Use vertex if at a corner and closest to a single vertex

Mapping a damage to a specific face, edge, or vertex
1. Determine which canonical face is affected from the photo
2. For face, set vertices to [face_index]
3. For edge, set vertices to the two mesh vertex indices defining that edge
4. For vertex, set vertices to the single mesh vertex index

Coordinates field generation
Point must be in the same coordinate space as the mesh vertices in the JSON.
1. If type is vertex, point equals that vertex coordinate
2. If type is edge, point is the midpoint between the two edge vertices
3. If type is face, point is the best estimate of the damage center on that face
If not reliably estimable, use the exact face centroid computed as the average of the face vertex coordinates

Axes must be constant
For every damage entry:
coordinates.xaxis must be exactly [1, 0, 0]
coordinates.yaxis must be exactly [0, 1, 0]

Status selection
1. Use Crack if a thin linear feature is visible
2. Otherwise use Brokenness

Severity value selection
Output an integer from 0 to 5 using this rubric:
1 very minor
2 minor
3 moderate
4 severe
5 critical
For marker based damages where severity is unknown, default to 2

Description field
Write one detailed sentence per damage describing:
1. Face edge or vertex in plain terms
2. Approximate location on that surface
3. Observed nature, marker crack chip abrasion

Final validation
1. Output is valid JSON
2. Only changes are appended items inside output.updatedModel.data.graph.node["0"].damages
3. All new damages follow the schema exactly
4. vertices uses correct indices and correct list length
5. value is an integer 0 to 5
6. coordinates arrays have length 3 and use numbers only
7. xaxis and yaxis match the required constant vectors exactly

If you cannot detect any damages
Return the wrapper JSON with updatedModel equal to the unchanged Assembly.""")
# {"dtype": "assembly_information_model.assembly/Assembly", "data": {"graph": {"attributes": {}, "default_node_attributes": {"x": 0.0, "y": 0.0, "z": 0.0}, "default_edge_attributes": {}, "node": {"2": {"part": {"dtype": "assembly_information_model.part/Part", "data": {"attributes": {"name": "brick_full", "mesh": {"dtype": "compas.datastructures/Mesh", "data": {"attributes": {}, "default_vertex_attributes": {"x": 0, "y": 0, "z": 0}, "default_edge_attributes": {}, "default_face_attributes": {}, "vertex": {"0": {"x": -0.125, "y": 0.06, "z": 0.0325}, "1": {"x": -0.125, "y": -0.06, "z": 0.0325}, "2": {"x": 0.125, "y": -0.06, "z": 0.0325}, "3": {"x": 0.125, "y": 0.06, "z": 0.0325}, "4": {"x": -0.125, "y": 0.06, "z": -0.0325}, "5": {"x": 0.125, "y": 0.06, "z": -0.0325}, "6": {"x": 0.125, "y": -0.06, "z": -0.0325}, "7": {"x": -0.125, "y": -0.06, "z": -0.0325}}, "face": {"0": [0, 1, 2, 3], "1": [0, 3, 5, 4], "2": [3, 2, 6, 5], "3": [2, 1, 7, 6], "4": [1, 0, 4, 7], "5": [4, 5, 6, 7]}, "facedata": {"0": {}, "1": {}, "2": {}, "3": {}, "4": {}, "5": {}}, "edgedata": {}, "max_vertex": 7, "max_face": 5}, "inheritance": [], "guid": "688249f4-7a29-406e-ab7b-fd36031ed954"}, "shape": {"dtype": "compas.geometry/Box", "data": {"xsize": 0.25, "ysize": 0.12, "zsize": 0.065, "frame": {"point": [0.0, 0.0, 0.0], "xaxis": [1.0, 0.0, 0.0], "yaxis": [0.0, -1.0, 0.0]}}, "guid": "8609b1b4-ce6d-4928-ba1b-773b909a4217"}}, "key": 2, "frame": {"point": [0.0, 0.0, 0.0325], "xaxis": [1.0, 0.0, 0.0], "yaxis": [0.0, -1.0, 1.2246467991473532e-16]}}, "inheritance": [], "guid": "4eb70de0-8943-46df-b882-4c298ff63a43"}, "x": 0.0, "y": 0.0, "z": 0.0325, "built": true, "damages": {"0": {"id": "damage_01", "type": "face", "vertices": [0], "status": "Discoloration", "value": 5, "description": "The entire top face is caked in a thick, dark layer of mortar and grime, completely obscuring the original brick surface.", "coordinates": {"point": [0, 0, 0.0325], "xaxis": [1, 0, 0], "yaxis": [0, 1, 0]}}, "1": {"id": "damage_02", "type": "edge", "vertices": [1, 2], "status": "Brokenness", "value": 3, "description": "The top-front long edge is significantly chipped and irregular, with multiple areas of material loss greater than 5mm.", "coordinates": {"point": [0, -0.06, 0.0325], "xaxis": [1, 0, 0], "yaxis": [0, 0, 1]}}, "2": {"id": "damage_03", "type": "vertex", "vertices": [2], "status": "Brokenness", "value": 3, "description": "The top-front-right corner has a significant chip, with a noticeable chunk of material missing (5-15mm).", "coordinates": {"point": [0.125, -0.06, 0.0325], "xaxis": [1, 0, 0], "yaxis": [0, 1, 0]}}, "3": {"id": "damage_04", "type": "face", "vertices": [3], "status": "Discoloration", "value": 3, "description": "The front face has significant mortar residue and dark staining covering 20-50% of the surface, mainly on the upper half.", "coordinates": {"point": [0, -0.06, 0], "xaxis": [1, 0, 0], "yaxis": [0, 0, 1]}}}, "image_paths": ["C:\\Users\\saral\\workspace\\projects\\workshop_iaac_2026\\data\\brick_images\\IMG_1235.jpeg"]}}, "edge": {"2": {}}, "max_node": 2}, "attributes": {}}, "inheritance": [], "guid": "c52ed1fc-8465-42d1-8f37-3fd95b3deb29"}
panel_7 = Panel("""{
  "updatedModel": {
    "dtype": "assembly_information_model.assembly/Assembly",
    "data": {
      "graph": {
        "attributes": {},
        "default_node_attributes": {
          "x": 0,
          "y": 0,
          "z": 0
        },
        "default_edge_attributes": {},
        "node": {
          "0": {
            "part": {
              "dtype": "assembly_information_model.part/Part",
              "data": {
                "attributes": {
                  "name": "brick_full",
                  "mesh": {
                    "dtype": "compas.datastructures/Mesh",
                    "data": {
                      "attributes": {},
                      "default_vertex_attributes": {
                        "x": 0,
                        "y": 0,
                        "z": 0
                      },
                      "default_edge_attributes": {},
                      "default_face_attributes": {},
                      "vertex": {
                        "0": {
                          "x": -0.125,
                          "y": 0.06,
                          "z": 0.0325
                        },
                        "1": {
                          "x": -0.125,
                          "y": -0.06,
                          "z": 0.0325
                        },
                        "2": {
                          "x": 0.125,
                          "y": -0.06,
                          "z": 0.0325
                        },
                        "3": {
                          "x": 0.125,
                          "y": 0.06,
                          "z": 0.0325
                        },
                        "4": {
                          "x": -0.125,
                          "y": 0.06,
                          "z": -0.0325
                        },
                        "5": {
                          "x": 0.125,
                          "y": 0.06,
                          "z": -0.0325
                        },
                        "6": {
                          "x": 0.125,
                          "y": -0.06,
                          "z": -0.0325
                        },
                        "7": {
                          "x": -0.125,
                          "y": -0.06,
                          "z": -0.0325
                        }
                      },
                      "face": {
                        "0": [
                          0,
                          1,
                          2,
                          3
                        ],
                        "1": [
                          0,
                          3,
                          5,
                          4
                        ],
                        "2": [
                          3,
                          2,
                          6,
                          5
                        ],
                        "3": [
                          2,
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""")
# {"nodeKey":"0","appendDamages":[{"type":"face","vertices":[0],"status":"Spalling","value":3,"uv":[0.75,0.2],"description":"A significant area of spalling is visible on the front face.","coordinates":{"point":[0.0,-0.06,0.0],"xaxis":[1,0,0],"yaxis":[0,-1,0]}},{"type":"face","vertices":[0],"status":"Crack","value":2,"uv":[0.3,0.5],"description":"A thin crack is present on the top face toward the left side.","coordinates":{"point":[-0.05,0.0,0.0325],"xaxis":[1,0,0],"yaxis":[0,-1,0]}},{"type":"face","vertices":[0],"status":"Crack","value":2,"uv":[0.45,0.5],"description":"A second thin crack is present on the top face, to the right of the first one.","coordinates":{"point":[-0.012499999999999997,0.0,0.0325],"xaxis":[1,0,0],"yaxis":[0,-1,0]}},{"type":"edge","vertices":[4,5],"status":"Chipping","value":1,"description":"Minor chipping is visible along the back-bottom edge.","coordinates":{"point":[0.0,0.06,-0.0325],"xaxis":[1,0,0],"yaxis":[0,-1,0]}}]}
# **System Prompt**
# 
# You are an expert AI assistant for 3D computer vision and quality control. Your task is to detect **red/orange calibration stickers** on a standard brick (25x12x6.5cm) using two photos and a 3D mesh.
# 
# You will receive a `modelJson` and **TWO photos** (View A and View B). You must return a single raw JSON object named `"updatedModel"`.
# 
# ### 1. The Consolidation Protocol (CRITICAL)
# **You must assume the brick has only a few stickers (usually 1 or 2).**
# The two photos are of the **SAME** object. You must merge detections:
# *   **Top Face Rule:** If you see a sticker on the Top Face in View A, and a sticker on the Top Face in View B, **THEY ARE THE SAME STICKER**. Do not create two entries. Calculate the average position and create **ONE** entry.
# *   **Total Count Check:** If you end up with 3 or more stickers, you are likely failing to merge duplicates. Re-evaluate.
# 
# ### 2. Spatial Orientation & Coordinates
# **Global Origin (0,0,0):** Geometric Center of the brick.
# **Dimensions:** $0.25m (X) \times 0.12m (Y) \times 0.065m (Z)$.
# 
# **Face Mapping (Strictly enforce these signs):**
# *   **TOP Face (Face 0):** $Z = 0.0325$.
#     *   *Front-Center:* $X \approx 0$, $Y < 0$.
#     *   *Back-Left:* $X < 0$, $Y > 0$.
# *   **LEFT Face (Face 4):** $X = -0.125$ (The short face on the negative X side).
# *   **RIGHT Face (Face 2):** $X = 0.125$ (The short face on the positive X side).
# *   **FRONT Face (Face 3):** $Y = -0.06$ (The long face on the negative Y side).
# *   **BACK Face (Face 1):** $Y = 0.06$ (The long face on the positive Y side).
# 
# ### 3. Detection & Localization Logic
# Iterate through Node "0". Detect bright red/orange stickers.
# *   **Step 1:** Identify the face the sticker is on.
# *   **Step 2:** Estimate position relative to edges.
#     *   *User Hint:* If a sticker looks like it is "centered at the front" of the Top Face, use $X=0$.
#     *   *User Hint:* If a sticker is on the "Back Left", ensure coordinates reflect Negative X (Left) and Positive Y (Back).
# *   **Step 3:** Populate the `damages` dictionary.
# 
# ### 4. JSON Schema
# Modify **only** the `damages` key in `data.graph.node["0"]`. Use incremental integer keys ("0", "1"...).
# 
# ```json
# {
#     "id": "sticker_0",
#     "type": "face",
#     "vertices": [int], // Face Index (0=Top, 1=Back, 2=Right, 3=Front, 4=Left)
#     "status": "Sticker",
#     "value": int,      // Diameter in mm (e.g., 15)
#     "description": "Short description (e.g. 'Sticker on Top Face, Front-Center').",
#     "coordinates": {
#         "point": [x, y, z], // precise 3D center
#         "xaxis": [1, 0, 0],
#         "yaxis": [0, 1, 0]
#     }
# }
# ```
# 
# ### 5. Final Visual Check
# *   Did you create a "ghost" sticker on the Right face? **Remove it.**
# *   Is the Top sticker on the correct side (Front vs Back)?
# *   **Output ONLY the raw JSON.**
panel_8 = Panel("""{
  "updatedModel": {
    "dtype": "assembly_information_model.assembly/Assembly",
    "data": {
      "graph": {
        "attributes": {},
        "default_node_attributes": {
          "x": 0,
          "y": 0,
          "z": 0
        },
        "default_edge_attributes": {},
        "node": {
          "0": {
            "part": {
              "dtype": "assembly_information_model.part/Part",
              "data": {
                "attributes": {
                  "name": "brick_full",
                  "mesh": {
                    "dtype": "compas.datastructures/Mesh",
                    "data": {
                      "attributes": {},
                      "default_vertex_attributes": {
                        "x": 0,
                        "y": 0,
                        "z": 0
                      },
                      "default_edge_attributes": {},
                      "default_face_attributes": {},
                      "vertex": {
                        "0": {
                          "x": -0.125,
                          "y": 0.06,
                          "z": 0.0325
                        },
                        "1": {
                          "x": -0.125,
                          "y": -0.06,
                          "z": 0.0325
                        },
                        "2": {
                          "x": 0.125,
                          "y": -0.06,
                          "z": 0.0325
                        },
                        "3": {
                          "x": 0.125,
                          "y": 0.06,
                          "z": 0.0325
                        },
                        "4": {
                          "x": -0.125,
                          "y": 0.06,
                          "z": -0.0325
                        },
                        "5": {
                          "x": 0.125,
                          "y": 0.06,
                          "z": -0.0325
                        },
                        "6": {
                          "x": 0.125,
                          "y": -0.06,
                          "z": -0.0325
                        },
                        "7": {
                          "x": -0.125,
                          "y": -0.06,
                          "z": -0.0325
                        }
                      },
                      "face": {
                        "0": [
                          0,
                          1,
                          2,
                          3
                        ],
                        "1": [
                          0,
                          3,
                          5,
                          4
                        ],
                        "2": [
                          3,
                          2,
                          6,
                          5
                        ],
                        "3": [
                          2,
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""")
panel_9 = Panel("""{
    "updatedModel": {
        "dtype": "assembly_information_model.assembly/Assembly",
        "data": {
            "graph": {
                "attributes": {},
                "default_node_attributes": {
                    "x": 0,
                    "y": 0,
                    "z": 0
                },
                "default_edge_attributes": {},
                "node": {
                    "0": {
                        "part": {
                            "dtype": "assembly_information_model.part/Part",
                            "data": {
                                "attributes": {
                                    "name": "brick_full",
                                    "mesh": {
                                        "dtype": "compas.datastructures/Mesh",
                                        "data": {
                                            "attributes": {},
                                            "default_vertex_attributes": {
                                                "x": 0,
                                                "y": 0,
                                                "z": 0
                                            },
                                            "default_edge_attributes": {},
                                            "default_face_attributes": {},
                                            "vertex": {
                                                "0": {
                                                    "x": -0.125,
                                                    "y": 0.06,
                                                    "z": 0.0325
                                                },
                                                "1": {
                                                    "x": -0.125,
                                                    "y": -0.06,
                                                    "z": 0.0325
                                                },
                                                "2": {
                                                    "x": 0.125,
                                                    "y": -0.06,
                                                    "z": 0.0325
                                                },
                                                "3": {
                                                    "x": 0.125,
                                                    "y": 0.06,
                                                    "z": 0.0325
                                                },
                                                "4": {
                                                    "x": -0.125,
                                                    "y": 0.06,
                                                    "z": -0.0325
                                                },
                                                "5": {
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""")
panel_10 = Panel("""{
  "updatedModel": {
    "dtype": "assembly_information_model.assembly/Assembly",
    "data": {
      "graph": {
        "attributes": {},
        "default_node_attributes": {
          "x": 0,
          "y": 0,
          "z": 0
        },
        "default_edge_attributes": {},
        "node": {
          "0": {
            "part": {
              "dtype": "assembly_information_model.part/Part",
              "data": {
                "attributes": {
                  "name": "brick_full",
                  "mesh": {
                    "dtype": "compas.datastructures/Mesh",
                    "data": {
                      "attributes": {},
                      "default_vertex_attributes": {
                        "x": 0,
                        "y": 0,
                        "z": 0
                      },
                      "default_edge_attributes": {},
                      "default_face_attributes": {},
                      "vertex": {
                        "0": {
                          "x": -0.125,
                          "y": 0.06,
                          "z": 0.0325
                        },
                        "1": {
                          "x": -0.125,
                          "y": -0.06,
                          "z": 0.0325
                        },
                        "2": {
                          "x": 0.125,
                          "y": -0.06,
                          "z": 0.0325
                        },
                        "3": {
                          "x": 0.125,
                          "y": 0.06,
                          "z": 0.0325
                        },
                        "4": {
                          "x": -0.125,
                          "y": 0.06,
                          "z": -0.0325
                        },
                        "5": {
                          "x": 0.125,
                          "y": 0.06,
                          "z": -0.0325
                        },
                        "6": {
                          "x": 0.125,
                          "y": -0.06,
                          "z": -0.0325
                        },
                        "7": {
                          "x": -0.125,
                          "y": -0.06,
                          "z": -0.0325
                        }
                      },
                      "face": {
                        "0": [
                          0,
                          1,
                          2,
                          3
                        ],
                        "1": [
                          0,
                          3,
                          5,
                          4
                        ],
                        "2": [
                          3,
                          2,
                          6,
                          5
                        ],
                        "3": [
                          2,
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""")
panel_11 = Panel("C:\Users\tizianrein\workspace\projects\workshop_iaac_2026\data\images_evaluation")
panel_12 = Panel("""{
    "updatedModel": {
        "dtype": "assembly_information_model.assembly/Assembly",
        "data": {
            "graph": {
                "attributes": {},
                "default_node_attributes": {
                    "x": 0,
                    "y": 0,
                    "z": 0
                },
                "default_edge_attributes": {},
                "node": {
                    "0": {
                        "part": {
                            "dtype": "assembly_information_model.part/Part",
                            "data": {
                                "attributes": {
                                    "name": "brick_full",
                                    "mesh": {
                                        "dtype": "compas.datastructures/Mesh",
                                        "data": {
                                            "attributes": {},
                                            "default_vertex_attributes": {
                                                "x": 0,
                                                "y": 0,
                                                "z": 0
                                            },
                                            "default_edge_attributes": {},
                                            "default_face_attributes": {},
                                            "vertex": {
                                                "0": {
                                                    "x": -0.125,
                                                    "y": 0.06,
                                                    "z": 0.0325
                                                },
                                                "1": {
                                                    "x": -0.125,
                                                    "y": -0.06,
                                                    "z": 0.0325
                                                },
                                                "2": {
                                                    "x": 0.125,
                                                    "y": -0.06,
                                                    "z": 0.0325
                                                },
                                                "3": {
                                                    "x": 0.125,
                                                    "y": 0.06,
                                                    "z": 0.0325
                                                },
                                                "4": {
                                                    "x": -0.125,
                                                    "y": 0.06,
                                                    "z": -0.0325
                                                },
                                                "5": {
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""")
panel_13 = Panel("""{
  "updatedModel": {
    "id": "brick_assembly_01",
    "data": {
      "graph": {
        "node": {
          "0": {
            "id": "0",
            "name": "Brick",
            "key": "brick_250_120_65",
            "transform": [
              1,
              0,
              0,
              0,
              0,
              1,
              0,
              0,
              0,
              0,
              1,
              0,
              0,
              0,
              0,
              1
            ],
            "material": "clay_red",
            "damages": {
              "0": {
                "id": "damage_01",
                "type": "face",
                "vertices": [
                  0
                ],
                "status": "Crack",
                "value": 2,
                "description": "A moderate surface crack or deep scratch running parallel to the long front edge on the top face.",
                "coordinates": {
                  "point": [
                    0.0,
                    -0.04,
                    0.0325
                  ],
                  "xaxis": [
                    1,
                    0,
                    0
                  ],
                  "yaxis": [
                    0,
                    1,
                    0
                  ]
                }
              },
              "1": {
                "id": "damage_02",
                "type": "face",
                "vertices": [
                  0
                ],
                "status": "Crack",
                "value": 2,
                "description": "A moderate surface crack or deep scratch located near the center of the top face, running parallel to the long edges.",
                "coordinates": {
                  "point": [
                    0.0,
                    0.01,
                    0.0325
                  ],
                  "xaxis": [
                    1,
                    0,
                    0
                  ],
                  "yaxis": [
                    0,
                    1,
                    0
                  ]
                }
              },
              "2": {
                "id": "damage_03",
                "type": "vertex",
                "vertices": [
                  6
                ],
                "status": "Brokenness",
                "value": 3,
                "description": "Significant chipping and material loss at the bottom-front-right corner.",
                "coordinates": {
                  "point": [
                    0.125,
                    -0.06,
                    -0.0325
                  ],
                  "xaxis": [
                    1,
                    0,
                    0
                  ],
                  "yaxis": [
                    0,
                    1,
                    0
                  ]
                }
              },
              "3": {
                "id": "damage_04",
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""")
existing_json_needed_3 = Panel("""{
    "dtype": "assembly_information_model.assembly/Assembly",
    "data": {
        "graph": {
            "attributes": {},
            "default_node_attributes": {
                "x": 0,
                "y": 0,
                "z": 0
            },
            "default_edge_attributes": {},
            "node": {
                "0": {
                    "part": {
                        "dtype": "assembly_information_model.part/Part",
                        "data": {
                            "attributes": {
                                "name": "brick_full",
                                "mesh": {
                                    "dtype": "compas.datastructures/Mesh",
                                    "data": {
                                        "attributes": {},
                                        "default_vertex_attributes": {
                                            "x": 0,
                                            "y": 0,
                                            "z": 0
                                        },
                                        "default_edge_attributes": {},
                                        "default_face_attributes": {},
                                        "vertex": {
                                            "0": {
                                                "x": -0.125,
                                                "y": 0.06,
                                                "z": 0.0325
                                            },
                                            "1": {
                                                "x": -0.125,
                                                "y": -0.06,
                                                "z": 0.0325
                                            },
                                            "2": {
                                                "x": 0.125,
                                                "y": -0.06,
                                                "z": 0.0325
                                            },
                                            "3": {
                                                "x": 0.125,
                                                "y": 0.06,
                                                "z": 0.0325
                                            },
                                            "4": {
                                                "x": -0.125,
                                                "y": 0.06,
                                                "z": -0.0325
                                            },
                                            "5": {
                                                "x": 0.125,
                                                "y": 0.06,
                                                "z": -0.0325
                                            },
                                            "6": {
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""")
system_promt_setting_the_rules_9 = Panel("""You are a deterministic damage extraction engine for a COMPAS Assembly Information Model.

Goal
Given one input image and a GEOMETRY_CONTEXT_JSON, detect only the clearly visible damages on the brick and output a compact JSON payload. Do not output the full Assembly JSON. Output only damages, you are sure about.

Orientation Context
The USER_REQUEST will specify the camera perspective (e.g., "FRONT-LEFT-TOP"). Use this to anchor the GEOMETRY_CONTEXT_JSON directions to the physical brick.

Hard output rules
1. Output must be a single valid JSON object only
2. Do not output markdown, code fences, explanations, comments, or any other text
3. Output must have exactly these top level keys: "nodeKey" and "appendDamages"
4. nodeKey must be the string "0"

Damage object schema
{
  "type": "face" | "edge" | "vertex",
  "vertices": [int],
  "status": "Chipping" | "Spalling" | "Staining" | "Material Loss" | "Crack",
  "value": int,
  "uv": [u, v],
  "description": "A detailed descriptive sentence.",
  "coordinates": {
    "point": [x, y, z],
    "xaxis": [1, 0, 0],
    "yaxis": [0, 1, 0]
  }
}

Orientation convention
FrontDir is frame.yaxis (+Y), RightDir is frame.xaxis (+X), TopDir is frame.zaxis (+Z).
Use GEOMETRY_CONTEXT_JSON.dirFaces to map directions to face indices. Do not redefine directions based on photo labels; use the frame convention.

Precise localization with uv
For type "face", provide uv = [u, v] (0.0 to 1.0).
- If face is front or back: u increases along +RightDir, v increases along +TopDir
- If face is left or right: u increases along +FrontDir, v increases along +TopDir
- If face is top or bottom: u increases along +RightDir, v increases along +FrontDir
u=0/v=0 is the minimum coordinate on that face; u=1/v=1 is the maximum.

Face mapping rules
1. face: vertices = [face_index]
2. edge: vertices = [u, v] sorted ascending
3. vertex: vertices = [vertex_index]

Damage detection rules
1. Detect all clearly visible damages. Markers (orange dots) count as damages.
2. Do not hallucinate damages.

Description rules
1. description must be a single sentence.
2. Reference surfaces using only: top, bottom, front, back, left, right.

If no damages are found, return: { "nodeKey": "0", "appendDamages": [] }""")
value_list = ValueList({"JPG Image": "jpg", "NPY Data": "npy"}, selected="JPG Image")
brick_key = Slider(0, range=0..100)
# Output Format: Update the damages inside the mesh object of the JSON.
# 3.  **Generate \`updatedModel\`**:
#     *   Take the \`modelJson\` object as the base.
#     *   You must iterate through **EVERY part** in the \`modelJson.parts\` array and analyze Surface, for each visible face, identify "coloration" (e.g., "white efflorescence/mortar") and "texture" (e.g., "pitted"). Analyze Edges and corners, look for "brokenness" or "material loss."
#     *   Based on your visual analysis of the photos and the user's text, identify any new damages.
#     *   For each new damage, create a new damage object and add it to the list.
#     *   Generate a new unique ID for each new damage (e.g., if the last was "damage_03", the new one is "damage_04").
#     *   **Damage Object Schema**:
#         - "id" (string): e.g., "damage_01"
#         - "type" (string): "face" or "edge" or "vertex"
#         - "vertices" (list): e.g., [0]
#         - "status" (string): e.g., "Crack", "Brokenness", "Material Loss", "Discoloration"
#         - "description" (string): A detailed sentence.
#         - "coordinates" (object): { "x": number, "y": number, "z": number }, xaxis, yaxis
# *   **Type Logic**:
# Face if the damage is on the surface, edge if the damage is on an edge of the brick, vertex if the damage is in the corner of brick.
# *   **Vertices Logic**:
# If face the key of the face e.g. [0], if edge 2 vertices of the edge [0,1], if vertex the vertex key [1].
# *   **Status Logic**:
# Analyze surface for each visible face, identify "discoloration" (e.g., "white efflorescence/mortar") or "texture" (e.g., "pitted"), analyze edges and corners, look for "brokenness" or "material loss."
panel_14 = Panel("""{
    "updatedModel": {
        "dtype": "assembly_information_model.assembly/Assembly",
        "data": {
            "graph": {
                "attributes": {},
                "default_node_attributes": {
                    "x": 0,
                    "y": 0,
                    "z": 0
                },
                "default_edge_attributes": {},
                "node": {
                    "0": {
                        "part": {
                            "dtype": "assembly_information_model.part/Part",
                            "data": {
                                "attributes": {
                                    "name": "brick_full",
                                    "mesh": {
                                        "dtype": "compas.datastructures/Mesh",
                                        "data": {
                                            "attributes": {},
                                            "default_vertex_attributes": {
                                                "x": 0,
                                                "y": 0,
                                                "z": 0
                                            },
                                            "default_edge_attributes": {},
                                            "default_face_attributes": {},
                                            "vertex": {
                                                "0": {
                                                    "x": -0.125,
                                                    "y": 0.06,
                                                    "z": 0.0325
                                                },
                                                "1": {
                                                    "x": -0.125,
                                                    "y": -0.06,
                                                    "z": 0.0325
                                                },
                                                "2": {
                                                    "x": 0.125,
                                                    "y": -0.06,
                                                    "z": 0.0325
                                                },
                                                "3": {
                                                    "x": 0.125,
                                                    "y": 0.06,
                                                    "z": 0.0325
                                                },
                                                "4": {
                                                    "x": -0.125,
                                                    "y": 0.06,
                                                    "z": -0.0325
                                                },
                                                "5": {
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""")
python_3_script_2 = Python3Script(folderPath=panel_11, fileFormat=value_list, brickKey=brick_key)  # -> out, imagePathA, imagePathB; inputs fileFormat: String
# ---------- python_3_script_2: Python ----------
import os

# --- DEBUGGING SCRIPT ---

# 1. Check if inputs are connected
if folderPath is None:
    print("CRITICAL ERROR: No 'folderPath' input connected.")
elif brickKey is None:
    print("CRITICAL ERROR: No 'brickKey' input connected.")
else:
    # 2. Check the path
    # Remove accidental whitespace/newlines
    clean_path = str(folderPath).strip()
    
    print("--- DIAGNOSTIC ---")
    print("Input Path: " + clean_path)
    
    if os.path.exists(clean_path):
        print("Folder Status: FOUND (OK)")
        
        # 3. Construct Filenames
        ext = str(fileFormat).lower().replace(".", "")
        key_string = "{:03d}".format(int(brickKey))
        
        name_A = "brick_{}_A.{}".format(key_string, ext)
        name_B = "brick_{}_B.{}".format(key_string, ext)
        
        full_path_A = os.path.join(clean_path, name_A)
        full_path_B = os.path.join(clean_path, name_B)
        
        # 4. output
        print("Looking for file: " + name_A)
        
        if os.path.exists(full_path_A):
             print("File A found!")
             imagePathA = full_path_A
        else:
             print("ERROR: File A NOT found.")
             imagePathA = None

        if os.path.exists(full_path_B):
             imagePathB = full_path_B
        else:
             imagePathB = None
             
    else:
        print("Folder Status: NOT FOUND")
        print("Tip: Make sure the path starts with 'C:\\' or 'D:\\'")
        imagePathA = None
        imagePathB = None
# ---------- end python_3_script_2 ----------
panel_15 = Panel(python_3_script_2.imagePathB)

run_the_generative_model_3 = Button()
ai_brick_evaluation_3 = Python3Script(
    imagePathA=python_3_script_2.imagePathA,
    imagePathB=python_3_script_2.imagePathB,
    existingJson=existing_json_needed_3,
    keyPath=panel,
    systemPrompt=system_promt_setting_the_rules_9,
    run=run_the_generative_model_3)  # -> error, jsonOutput, model, executionTime, passA_raw, passB_raw; inputs imagePathA: String, keyPath: String
# ---------- ai_brick_evaluation_3: Python ----------
#! python 3
# venv: ai_brick_eval
# r: google-genai, Pillow

import scriptcontext as sc
import json
import os
import time
import threading
import Eto
from PIL import Image
from google import genai

SUPPORTED_IMAGE_EXTENSIONS = [".png", ".jpg", ".jpeg", ".webp", ".heic", ".heif"]

KEY_RUNNING = "gemini_eval_is_running"
KEY_LAST_OUTPUT = "gemini_eval_last_output"
KEY_LAST_ERROR = "gemini_eval_last_error"
KEY_LAST_TIME = "gemini_eval_last_time"
KEY_RESULT = "gemini_eval_api_result"
KEY_API_ERROR = "gemini_eval_api_error"
KEY_START_TIME = "gemini_eval_start_time"
KEY_LAST_LOG = "gemini_eval_last_log"
KEY_GEOM_CTX_STR = "gemini_eval_geom_ctx_str"

MODEL_ID = "gemini-3-pro-preview" # Updated to Flash for speed, or keep 1.5-pro if preferred
MAX_IMAGE_DIM = 1280

if KEY_RUNNING not in sc.sticky:
    sc.sticky[KEY_RUNNING] = False
if KEY_LAST_OUTPUT not in sc.sticky:
    sc.sticky[KEY_LAST_OUTPUT] = "Ready. Click Run."
if KEY_LAST_ERROR not in sc.sticky:
    sc.sticky[KEY_LAST_ERROR] = None
if KEY_LAST_TIME not in sc.sticky:
    sc.sticky[KEY_LAST_TIME] = None
if KEY_LAST_LOG not in sc.sticky:
    sc.sticky[KEY_LAST_LOG] = []
if KEY_GEOM_CTX_STR not in sc.sticky:
    sc.sticky[KEY_GEOM_CTX_STR] = None


def trigger_gh_update():
    gh_doc = ghenv.Component.OnPingDocument()
    if gh_doc:
        for obj in gh_doc.Objects:
            if obj.InstanceGuid == ghenv.Component.InstanceGuid:
                obj.ExpireSolution(True)
                return


def _strip_code_fences(text):
    if not text:
        return text
    t = text.strip()
    if t.startswith("```json"):
        t = t[7:].strip()
        if t.endswith("```"):
            t = t[:-3].strip()
        return t
    if t.startswith("```"):
        t = t[3:].strip()
        if t.endswith("```"):
            t = t[:-3].strip()
        return t
    return t


def _is_valid_json(s):
    try:
        json.loads(s)
        return True
    except:
        return False


def _sanitize_key(raw):
    if raw is None:
        return ""
    k = raw
    if len(k) > 0 and ord(k[0]) == 65279:
        k = k[1:]
    k = k.strip()
    if (k.startswith('"') and k.endswith('"')) or (k.startswith("'") and k.endswith("'")):
        k = k[1:-1].strip()
    if "\n" in k or "\r" in k:
        parts = [p.strip() for p in k.replace("\r", "\n").split("\n") if p.strip()]
        k = parts[0] if parts else ""
    return k.strip()


def load_api_key_from_path(key_path):
    if not key_path or not str(key_path).strip():
        raise ValueError("keyPath input is missing.")
    kp = str(key_path).strip()
    if not os.path.exists(kp):
        raise ValueError("API key file not found at given path: {}".format(kp))
    with open(kp, "r") as f:
        raw = f.read()
    api_key = _sanitize_key(raw)
    if not api_key:
        raise ValueError("API key file is empty or contains only whitespace.")
    return api_key


def mask_key(k):
    if not k:
        return ""
    if len(k) <= 8:
        return "*" * len(k)
    return k[:4] + "..." + k[-4:]


def prepare_image(path, max_dim=1280):
    img = Image.open(path)
    if img.mode != "RGB":
        img = img.convert("RGB")
    w, h = img.size
    m = max(w, h)
    if m > max_dim:
        scale = float(max_dim) / float(m)
        nw = max(1, int(w * scale))
        nh = max(1, int(h * scale))
        img = img.resize((nw, nh), Image.LANCZOS)
    return img


def response_json_schema():
    return {
        "type": "object",
        "additionalProperties": False,
        "required": ["nodeKey", "appendDamages"],
        "properties": {
            "nodeKey": {"type": "string", "enum": ["0"]},
            "appendDamages": {
                "type": "array",
                "items": {
                    "type": "object",
                    "additionalProperties": False,
                    "required": ["type", "vertices", "status", "value", "description", "coordinates"],
                    "properties": {
                        "type": {"type": "string", "enum": ["face", "edge", "vertex"]},
                        "vertices": {
                            "type": "array",
                            "items": {"type": "integer"}
                        },
                        "status": {"type": "string", "enum": ["Spalling", "Chipping", "Staining", "Material Loss", "Crack"]},
                        "value": {"type": "integer", "minimum": 0, "maximum": 5},
                        "uv": {
                            "type": "array",
                            "items": {"type": "number", "minimum": 0.0, "maximum": 1.0},
                            "minItems": 2,
                            "maxItems": 2
                        },
                        "description": {"type": "string"},
                        "coordinates": {
                            "type": "object",
                            "additionalProperties": False,
                            "required": ["point", "xaxis", "yaxis"],
                            "properties": {
                                "point": {
                                    "type": "array",
                                    "items": {"type": "number"},
                                    "minItems": 3,
                                    "maxItems": 3
                                },
                                "xaxis": {
                                    "type": "array",
                                    "items": {"type": "integer"},
                                    "minItems": 3,
                                    "maxItems": 3
                                },
                                "yaxis": {
                                    "type": "array",
                                    "items": {"type": "integer"},
                                    "minItems": 3,
                                    "maxItems": 3
                                }
                            }
                        }
                    }
                }
            }
        }
    }


def _to_vec(v):
    if isinstance(v, (list, tuple)) and len(v) == 3:
        return [float(v[0]), float(v[1]), float(v[2])]
    if isinstance(v, dict):
        return [float(v.get("x", 0.0)), float(v.get("y", 0.0)), float(v.get("z", 0.0))]
    return [0.0, 0.0, 0.0]


def _sub(a, b):
    return [a[0] - b[0], a[1] - b[1], a[2] - b[2]]


def _add(a, b):
    return [a[0] + b[0], a[1] + b[1], a[2] + b[2]]


def _scale(a, s):
    return [a[0] * s, a[1] * s, a[2] * s]


def _dot(a, b):
    return a[0] * b[0] + a[1] * b[1] + a[2] * b[2]


def _cross(a, b):
    return [
        a[1] * b[2] - a[2] * b[1],
        a[2] * b[0] - a[0] * b[2],
        a[0] * b[1] - a[1] * b[0],
    ]


def _norm(a):
    return (a[0] * a[0] + a[1] * a[1] + a[2] * a[2]) ** 0.5


def _normalize(a):
    n = _norm(a)
    if n < 1e-12:
        return [0.0, 0.0, 0.0]
    return [a[0] / n, a[1] / n, a[2] / n]


def pick_face_by_dir(face_centroids, origin, axis, mode):
    best_f = None
    best_s = None
    for fi, c in face_centroids.items():
        s = _dot(_sub(c, origin), axis)
        if best_f is None:
            best_f, best_s = fi, s
        else:
            if mode == "max" and s > best_s:
                best_f, best_s = fi, s
            if mode == "min" and s < best_s:
                best_f, best_s = fi, s
    return best_f


def build_geometry_context(existing_json_str, node_key="0"):
    obj = json.loads(existing_json_str)
    node = obj["data"]["graph"]["node"][node_key]
    part = node["part"]["data"]

    mesh = part["attributes"]["mesh"]["data"]
    vdict = mesh.get("vertex", {})
    fdict = mesh.get("face", {})

    verts = {int(k): [v["x"], v["y"], v["z"]] for k, v in vdict.items()}
    faces = {int(k): list(v) for k, v in fdict.items()}

    xs = [p[0] for p in verts.values()]
    ys = [p[1] for p in verts.values()]
    zs = [p[2] for p in verts.values()]
    bbox = {"min": [min(xs), min(ys), min(zs)], "max": [max(xs), max(ys), max(zs)]}

    face_centroids = {}
    for fi, fvs in faces.items():
        pts = [verts[i] for i in fvs]
        c = [0.0, 0.0, 0.0]
        for p in pts:
            c = _add(c, p)
        c = _scale(c, 1.0 / float(len(pts)))
        face_centroids[fi] = c

    frame = part.get("frame", None)
    if not frame:
        raise ValueError("Part frame missing. Cannot define front and right without frame.")

    origin = _to_vec(frame.get("point"))
    xaxis = _normalize(_to_vec(frame.get("xaxis")))
    yaxis = _normalize(_to_vec(frame.get("yaxis")))

    # zaxis might be missing, compute and align to +world Z for stability
    zaxis = _normalize(_cross(xaxis, yaxis))
    if _dot(zaxis, [0.0, 0.0, 1.0]) < 0.0:
        zaxis = _scale(zaxis, -1.0)

    top_f = pick_face_by_dir(face_centroids, origin, zaxis, "max")
    bottom_f = pick_face_by_dir(face_centroids, origin, zaxis, "min")
    front_f = pick_face_by_dir(face_centroids, origin, yaxis, "max")
    back_f = pick_face_by_dir(face_centroids, origin, yaxis, "min")
    right_f = pick_face_by_dir(face_centroids, origin, xaxis, "max")
    left_f = pick_face_by_dir(face_centroids, origin, xaxis, "min")

    ctx = {
        "nodeKey": str(node_key),
        "bbox": bbox,
        "frame": {"point": origin, "xaxis": xaxis, "yaxis": yaxis, "zaxis": zaxis},
        "dirFaces": {
            "top": {"faceIndex": int(top_f), "centroid": face_centroids[top_f]},
            "bottom": {"faceIndex": int(bottom_f), "centroid": face_centroids[bottom_f]},
            "front": {"faceIndex": int(front_f), "centroid": face_centroids[front_f]},
            "back": {"faceIndex": int(back_f), "centroid": face_centroids[back_f]},
            "right": {"faceIndex": int(right_f), "centroid": face_centroids[right_f]},
            "left": {"faceIndex": int(left_f), "centroid": face_centroids[left_f]},
        },
        "faceVertices": {str(fi): faces[fi] for fi in faces.keys()},
        "vertexCoords": {str(vi): verts[vi] for vi in verts.keys()},
        "faceCentroids": {str(fi): face_centroids[fi] for fi in face_centroids.keys()},
        "convention": {"frontDir": "frame.yaxis", "rightDir": "frame.xaxis", "topDir": "frame.zaxis"},
    }
    return ctx


def project_to_plane(v, n):
    return _sub(v, _scale(n, _dot(v, n)))


def face_normal_from_vertices(pts):
    if len(pts) < 3:
        return [0.0, 0.0, 1.0]
    a = _sub(pts[1], pts[0])
    b = _sub(pts[2], pts[0])
    n = _normalize(_cross(a, b))
    if _norm(n) < 1e-12:
        return [0.0, 0.0, 1.0]
    return n


def compute_point_on_face_from_uv(face_vertices_pts, face_label, rightDir, frontDir, topDir, uv):
    u = float(uv[0])
    v = float(uv[1])
    if u < 0.0:
        u = 0.0
    if u > 1.0:
        u = 1.0
    if v < 0.0:
        v = 0.0
    if v > 1.0:
        v = 1.0

    n = face_normal_from_vertices(face_vertices_pts)

    if face_label in ("front", "back"):
        u_base = rightDir
        v_base = topDir
    elif face_label in ("left", "right"):
        u_base = frontDir
        v_base = topDir
    else:  # top or bottom
        u_base = rightDir
        v_base = frontDir

    u_dir = _normalize(project_to_plane(u_base, n))
    v_dir = _normalize(project_to_plane(v_base, n))

    if _norm(u_dir) < 1e-12:
        u_dir = _normalize(project_to_plane(frontDir, n))
    if _norm(v_dir) < 1e-12:
        v_dir = _normalize(project_to_plane(topDir, n))

    pref = face_vertices_pts[0]
    us = []
    vs = []
    for p in face_vertices_pts:
        d = _sub(p, pref)
        us.append(_dot(d, u_dir))
        vs.append(_dot(d, v_dir))

    umin, umax = min(us), max(us)
    vmin, vmax = min(vs), max(vs)

    ut = umin + u * (umax - umin)
    vt = vmin + v * (vmax - vmin)

    return _add(pref, _add(_scale(u_dir, ut), _scale(v_dir, vt)))

# ---------------------------------------------------------
# NEW LOGIC: SEQUENTIAL DEDUPLICATION HELPER
# ---------------------------------------------------------
def _get_signature(dmg):
    """
    Creates a unique signature for damage to deduplicate between views.
    """
    t = dmg.get("type")
    v = dmg.get("vertices", [])
    if not v:
        return str(time.time()) # fallback

    if t == "vertex":
        # e.g. "v_1"
        return "v_{}".format(v[0])
    elif t == "edge":
        # e.g. "e_0_1" (sorted)
        return "e_{}".format("_".join(map(str, sorted(v))))
    elif t == "face":
        # e.g. "f_0_u0.5_v0.5"
        # Rounding to 1 decimal place to handle slight variations in detection
        uv = dmg.get("uv", [0.0, 0.0])
        return "f_{}_u{:.1f}_v{:.1f}".format(v[0], float(uv[0]), float(uv[1]))
    
    return str(time.time())

# ---------------------------------------------------------
# UPDATED FUNCTION: LOOPS OVER IMAGES SEQUENTIALLY
# ---------------------------------------------------------
def call_gemini_in_background(api_key_real, system_prompt, geom_ctx_str, imageA_path, imageB_path):
    try:
        client = genai.Client(api_key=api_key_real)
        
        merged_damages = []
        seen_signatures = set()

        # Define the PASSES
        # We manually specify the perspective instructions here so the AI knows its orientation
        passes = []
        
        if imageA_path and os.path.exists(imageA_path):
            passes.append({
                "path": imageA_path,
                "view": "PERSPECTIVE: You are looking at the TOP, FRONT, and LEFT sides of the brick."
            })
        
        if imageB_path and os.path.exists(imageB_path):
            passes.append({
                "path": imageB_path,
                "view": "PERSPECTIVE: You are looking at the TOP, BACK, and RIGHT sides of the brick. (180-degree rotation)."
            })

        # Loop through passes
        for p in passes:
            # Prepare content
            contents = []
            if system_prompt:
                contents.append("SYSTEM_RULES:\n" + system_prompt)
            
            contents.append("GEOMETRY_CONTEXT_JSON:\n" + geom_ctx_str)
            contents.append("USER_INSTRUCTION:\n" + p["view"])
            
            contents.append(prepare_image(p["path"], MAX_IMAGE_DIM))

            # Config
            config = {
                "temperature": 0.0,
                "response_mime_type": "application/json",
                "response_json_schema": response_json_schema(),
            }

            # Call API
            response = client.models.generate_content(
                model=MODEL_ID,
                contents=contents,
                config=config
            )

            if "FRONT" in p["view"]:
                sc.sticky["gemini_eval_pass_a_raw"] = response.text
            else:
                sc.sticky["gemini_eval_pass_b_raw"] = response.text

            # Parse and Deduplicate
            try:
                data = json.loads(response.text)
                new_damages = data.get("appendDamages", [])
                
                for dmg in new_damages:
                    sig = _get_signature(dmg)
                    if sig not in seen_signatures:
                        merged_damages.append(dmg)
                        seen_signatures.add(sig)
            except Exception as parse_e:
                # Log error but continue to next pass if one fails
                print("Error parsing pass {}: {}".format(p["view"], parse_e))

        # Final Result
        final_result = {
            "nodeKey": "0",
            "appendDamages": merged_damages
        }
        
        sc.sticky[KEY_RESULT] = json.dumps(final_result)
        sc.sticky[KEY_API_ERROR] = None

    except Exception as e:
        sc.sticky[KEY_RESULT] = None
        sc.sticky[KEY_API_ERROR] = "An API error occurred: {}".format(e)
    finally:
        Eto.Forms.Application.Instance.AsyncInvoke(trigger_gh_update)


# Outputs start from persisted values
jsonOutput = sc.sticky[KEY_LAST_OUTPUT]
error = sc.sticky[KEY_LAST_ERROR]
executionTime = sc.sticky[KEY_LAST_TIME]
log_list = sc.sticky.get(KEY_LAST_LOG, [])
if not isinstance(log_list, list):
    log_list = [str(log_list)]

debugContext = sc.sticky.get(KEY_GEOM_CTX_STR) or ""


# STATE 1: SETUP AND START
if run and not sc.sticky[KEY_RUNNING]:
    sc.sticky[KEY_RUNNING] = True
    sc.sticky[KEY_RESULT] = None
    sc.sticky[KEY_API_ERROR] = None
    sc.sticky[KEY_START_TIME] = time.time()

    jsonOutput = "Generating..."
    error = None
    executionTime = None

    log_list = []
    log_list.append("Button clicked. Starting setup.")

    try:
        api_key_real = load_api_key_from_path(keyPath)
        log_list.append("API key loaded.")

        # Note: We removed 'userPrompt' from this check because it is now hardcoded in the loop
        if not any([systemPrompt, imagePathA, imagePathB, existingJson]):
            raise ValueError("Input is missing. Provide systemPrompt, imagePathA, imagePathB, or existingJson.")

        if existingJson and str(existingJson).strip():
            try:
                json.loads(existingJson)
            except Exception as e_json_in:
                raise ValueError("existingJson is not valid JSON. Error: {}".format(e_json_in))

            # Build once and cache in sticky
            geom_ctx = build_geometry_context(existingJson, node_key="0")
            geom_ctx_str = json.dumps(geom_ctx, separators=(",", ":"), ensure_ascii=False)
            sc.sticky[KEY_GEOM_CTX_STR] = geom_ctx_str
            debugContext = geom_ctx_str
            log_list.append("GEOMETRY_CONTEXT_JSON built and cached.")
        else:
            raise ValueError("existingJson is required to build GEOMETRY_CONTEXT_JSON.")

        # Validate images
        if imagePathA and not os.path.exists(imagePathA):
            raise ValueError("Image A file not found: {}".format(imagePathA))
        if imagePathB and not os.path.exists(imagePathB):
            raise ValueError("Image B file not found: {}".format(imagePathB))

        log_list.append("Starting background thread call (Sequential Mode).")
        
        # NOTE: We removed 'userPrompt' from the args tuple
        t = threading.Thread(
            target=call_gemini_in_background,
            args=(api_key_real, systemPrompt, sc.sticky[KEY_GEOM_CTX_STR], imagePathA, imagePathB)
        )
        t.daemon = True
        t.start()

    except Exception as setup_e:
        error = "Error during setup: {}".format(setup_e)
        jsonOutput = "Setup error. See error output."
        sc.sticky[KEY_RUNNING] = False
        log_list.append("Setup failed: {}".format(setup_e))


# STATE 2: PROCESS RESULT
elif sc.sticky[KEY_RUNNING]:
    if sc.sticky.get(KEY_RESULT) is not None:
        generated_text = sc.sticky[KEY_RESULT]
        # Since we construct the JSON manually in the thread, stripping code fences might be redundant
        # but we keep it for safety if future logic changes
        cleaned = _strip_code_fences(generated_text)

        parsed = None
        if _is_valid_json(cleaned):
            parsed = json.loads(cleaned)
        else:
            error = "Warning: API response was not valid JSON."
            jsonOutput = cleaned

        # Postprocess: replace face coordinates.point using uv and face plane
        if parsed and isinstance(parsed, dict):
            try:
                geom_ctx_str = sc.sticky.get(KEY_GEOM_CTX_STR) or ""
                geom_ctx = json.loads(geom_ctx_str) if geom_ctx_str else {}

                dirFaces = geom_ctx.get("dirFaces", {})
                face_index_to_label = {}
                for lbl, info in dirFaces.items():
                    face_index_to_label[int(info["faceIndex"])] = lbl

                frame = geom_ctx.get("frame", {})
                rightDir = frame.get("xaxis", [1.0, 0.0, 0.0])
                frontDir = frame.get("yaxis", [0.0, 1.0, 0.0])
                topDir = frame.get("zaxis", [0.0, 0.0, 1.0])

                vcoords = geom_ctx.get("vertexCoords", {})
                fverts = geom_ctx.get("faceVertices", {})

                for d in parsed.get("appendDamages", []):
                    if not isinstance(d, dict):
                        continue
                    if d.get("type") != "face":
                        continue
                    if "uv" not in d:
                        continue
                    verts_list = d.get("vertices", [])
                    if not verts_list or len(verts_list) != 1:
                        continue

                    fi = int(verts_list[0])
                    face_label = face_index_to_label.get(fi, None)
                    if not face_label:
                        continue

                    v_ids = fverts.get(str(fi), None)
                    if not v_ids:
                        continue

                    pts = []
                    ok = True
                    for vid in v_ids:
                        pv = vcoords.get(str(int(vid)), None)
                        if pv is None:
                            ok = False
                            break
                        pts.append([float(pv[0]), float(pv[1]), float(pv[2])])
                    if not ok or len(pts) < 3:
                        continue

                    p3d = compute_point_on_face_from_uv(
                        face_vertices_pts=pts,
                        face_label=face_label,
                        rightDir=rightDir,
                        frontDir=frontDir,
                        topDir=topDir,
                        uv=d["uv"]
                    )

                    if "coordinates" not in d or not isinstance(d["coordinates"], dict):
                        d["coordinates"] = {}
                    d["coordinates"]["point"] = [p3d[0], p3d[1], p3d[2]]
                    d["coordinates"]["xaxis"] = [1, 0, 0]
                    d["coordinates"]["yaxis"] = [0, -1, 0]

                jsonOutput = json.dumps(parsed, separators=(",", ":"), ensure_ascii=False)
                if error is None:
                    error = None

            except Exception as e_uv:
                jsonOutput = json.dumps(parsed, separators=(",", ":"), ensure_ascii=False)
                if error is None:
                    error = "Warning: uv postprocess failed: {}".format(e_uv)

        start_time = sc.sticky.get(KEY_START_TIME, time.time())
        executionTime = time.time() - start_time
        sc.sticky[KEY_RUNNING] = False
        log_list.append("Result received. Finished.")

    elif sc.sticky.get(KEY_API_ERROR) is not None:
        jsonOutput = "An error occurred. See error output."
        error = sc.sticky[KEY_API_ERROR]
        start_time = sc.sticky.get(KEY_START_TIME, time.time())
        executionTime = time.time() - start_time
        sc.sticky[KEY_RUNNING] = False
        log_list.append("Error received from API call. Finished.")

    else:
        jsonOutput = "Generating..."



passA_raw = sc.sticky.get("gemini_eval_pass_a_raw", "No data yet")
passB_raw = sc.sticky.get("gemini_eval_pass_b_raw", "No data yet")

# Persist outputs every run
sc.sticky[KEY_LAST_OUTPUT] = jsonOutput
sc.sticky[KEY_LAST_ERROR] = error
sc.sticky[KEY_LAST_TIME] = executionTime
sc.sticky[KEY_LAST_LOG] = log_list



log = "\n".join(log_list)

print(error)
# ---------- end ai_brick_evaluation_3 ----------

ai_brick_evaluation_4 = Python3Script(
    imagePathA=image_path_optional,
    existingJson=existing_json_needed,
    keyPath=panel,
    systemPrompt=system_promt_setting_the_rules_5,
    run=run_the_generative_model)  # -> error, jsonOutput, model, executionTime; inputs imagePathA: String, keyPath: String; disabled
# ---------- ai_brick_evaluation_4: Python ----------
# r: google-generativeai, Pillow
import scriptcontext as sc
import google.generativeai as genai
import json
import os
import time
import threading
import Eto
from PIL import Image

SUPPORTED_IMAGE_EXTENSIONS = [".png", ".jpg", ".jpeg", ".webp", ".heic", ".heif"]
SUPPORTED_PDF_EXTENSION = ".pdf"

KEY_RUNNING = "gemini_is_running"
KEY_LAST_OUTPUT = "gemini_last_output"
KEY_LAST_ERROR = "gemini_last_error"
KEY_LAST_TIME = "gemini_last_time"
KEY_RESULT = "gemini_api_result"
KEY_API_ERROR = "gemini_api_error"
KEY_START_TIME = "gemini_start_time"
KEY_LAST_LOG = "gemini_last_log"

if KEY_RUNNING not in sc.sticky:
    sc.sticky[KEY_RUNNING] = False
if KEY_LAST_OUTPUT not in sc.sticky:
    sc.sticky[KEY_LAST_OUTPUT] = "Ready. Click Run."
if KEY_LAST_ERROR not in sc.sticky:
    sc.sticky[KEY_LAST_ERROR] = None
if KEY_LAST_TIME not in sc.sticky:
    sc.sticky[KEY_LAST_TIME] = None
if KEY_LAST_LOG not in sc.sticky:
    sc.sticky[KEY_LAST_LOG] = []

def trigger_gh_update():
    gh_doc = ghenv.Component.OnPingDocument()
    if gh_doc:
        for obj in gh_doc.Objects:
            if obj.InstanceGuid == ghenv.Component.InstanceGuid:
                obj.ExpireSolution(True)
                return

def _strip_code_fences(text):
    if not text:
        return text
    t = text.strip()
    if t.startswith("```json"):
        t = t[7:].strip()
        if t.endswith("```"):
            t = t[:-3].strip()
        return t
    if t.startswith("```"):
        t = t[3:].strip()
        if t.endswith("```"):
            t = t[:-3].strip()
        return t
    return text

def _is_valid_json(s):
    try:
        json.loads(s)
        return True
    except:
        return False

def _sanitize_key(raw):
    if raw is None:
        return ""
    k = raw

    # Remove UTF 8 BOM if present
    if len(k) > 0 and ord(k[0]) == 65279:
        k = k[1:]

    k = k.strip()

    # Remove wrapping quotes if the file contains "AIza..." or 'AIza...'
    if (k.startswith('"') and k.endswith('"')) or (k.startswith("'") and k.endswith("'")):
        k = k[1:-1].strip()

    # If the file contains multiple lines, take the first non empty line
    if "\n" in k or "\r" in k:
        parts = [p.strip() for p in k.replace("\r", "\n").split("\n") if p.strip()]
        k = parts[0] if parts else ""

    return k.strip()

def load_api_key_from_path(key_path):
    if not key_path or not str(key_path).strip():
        raise ValueError("keyPath input is missing.")

    kp = str(key_path).strip()

    if not os.path.exists(kp):
        raise ValueError("API key file not found at given path: {}".format(kp))

    with open(kp, "r") as f:
        raw = f.read()

    api_key = _sanitize_key(raw)

    if not api_key:
        raise ValueError("API key file is empty or contains only whitespace.")

    return api_key

def mask_key(k):
    if not k:
        return ""
    if len(k) <= 8:
        return "*" * len(k)
    return k[:4] + "..." + k[-4:]

def call_gemini_in_background(api_key_real, prompt_parts, uploaded_pdf_name_to_delete=None):
    try:
        genai.configure(api_key=api_key_real)
        model = genai.GenerativeModel("gemini-3-pro-preview")
        response = model.generate_content(prompt_parts)
        sc.sticky[KEY_RESULT] = response.text
        sc.sticky[KEY_API_ERROR] = None
    except Exception as e:
        sc.sticky[KEY_RESULT] = None
        sc.sticky[KEY_API_ERROR] = "An API error occurred: {}".format(e)
    finally:
        if uploaded_pdf_name_to_delete:
            try:
                genai.delete_file(uploaded_pdf_name_to_delete)
            except Exception as e_delete:
                warn = "Warning: Failed to delete uploaded PDF '{}': {}".format(uploaded_pdf_name_to_delete, e_delete)
                existing = sc.sticky.get(KEY_API_ERROR)
                sc.sticky[KEY_API_ERROR] = (existing + " | " + warn) if existing else warn

        Eto.Forms.Application.Instance.AsyncInvoke(trigger_gh_update)

# Outputs start from persisted values
jsonOutput = sc.sticky[KEY_LAST_OUTPUT]
error = sc.sticky[KEY_LAST_ERROR]
executionTime = sc.sticky[KEY_LAST_TIME]
log_list = sc.sticky.get(KEY_LAST_LOG, [])
if not isinstance(log_list, list):
    log_list = [str(log_list)]

# STATE 1
if run and not sc.sticky[KEY_RUNNING]:
    sc.sticky[KEY_RUNNING] = True
    sc.sticky[KEY_RESULT] = None
    sc.sticky[KEY_API_ERROR] = None
    sc.sticky[KEY_START_TIME] = time.time()

    jsonOutput = "Generating... (can take up to 2 minutes)"
    error = None
    executionTime = None

    log_list = []
    log_list.append("Button clicked. Starting setup.")

    try:
        api_key_real = load_api_key_from_path(keyPath)
        log_list.append("API key loaded from file.")
        log_list.append("API key preview: {}".format(mask_key(api_key_real)))

        if not any([systemPrompt, userPrompt, imagePathA, imagePathB, pdfPath, existingJson]):
            raise ValueError("Input is missing. Provide a prompt, image, pdf, existingJson, or a combination.")

        # Configure for uploads on main thread
        genai.configure(api_key=api_key_real)
        log_list.append("API configured for uploads.")

        full_text_prompt = systemPrompt if systemPrompt else ""
        if userPrompt:
            full_text_prompt += "\n\n--- USER REQUEST ---\n" + userPrompt

        prompt_parts_for_api = [full_text_prompt]

        # Reference example
        if "referenceImagePath" in globals() and referenceImagePath and os.path.exists(referenceImagePath):
            ref_img = Image.open(referenceImagePath)
            prompt_parts_for_api.append("EXAMPLE INPUT IMAGE:")
            prompt_parts_for_api.append(ref_img)
            prompt_parts_for_api.append("EXAMPLE GROUND TRUTH JSON:")
            prompt_parts_for_api.append(referenceJson if "referenceJson" in globals() else "")
            prompt_parts_for_api.append("END OF EXAMPLE")
            log_list.append("Reference example added.")

        # Image A
        if imagePathA:
            if not os.path.exists(imagePathA):
                raise ValueError("Image A file not found: {}".format(imagePathA))
            ext = os.path.splitext(imagePathA)[1].lower()
            if ext not in SUPPORTED_IMAGE_EXTENSIONS:
                raise ValueError("Unsupported Image A type: {}".format(ext))
            prompt_parts_for_api.append("NOW ANALYZE THIS IMAGE. VIEW A.")
            prompt_parts_for_api.append(Image.open(imagePathA))
            log_list.append("Image A added.")

        # Image B
        if imagePathB:
            if not os.path.exists(imagePathB):
                raise ValueError("Image B file not found: {}".format(imagePathB))
            ext = os.path.splitext(imagePathB)[1].lower()
            if ext not in SUPPORTED_IMAGE_EXTENSIONS:
                raise ValueError("Unsupported Image B type: {}".format(ext))
            prompt_parts_for_api.append("NOW ANALYZE THIS IMAGE. VIEW B.")
            prompt_parts_for_api.append(Image.open(imagePathB))
            log_list.append("Image B added.")

        # Existing JSON
        if existingJson and str(existingJson).strip():
            try:
                json.loads(existingJson)
            except Exception as e_json_in:
                raise ValueError("existingJson is not valid JSON. Error: {}".format(e_json_in))
            prompt_parts_for_api.append("MAP THE DAMAGES TO THIS JSON STRUCTURE:")
            prompt_parts_for_api.append(existingJson)
            log_list.append("Existing JSON added.")

        # PDF upload
        uploaded_pdf_name = None
        if pdfPath:
            if not os.path.exists(pdfPath):
                raise ValueError("PDF file not found: {}".format(pdfPath))
            ext = os.path.splitext(pdfPath)[1].lower()
            if ext != SUPPORTED_PDF_EXTENSION:
                raise ValueError("Not a supported PDF: {}".format(pdfPath))

            log_list.append("Uploading PDF...")
            uploaded_file = genai.upload_file(path=pdfPath)
            prompt_parts_for_api.append(uploaded_file)
            uploaded_pdf_name = uploaded_file.name
            log_list.append("PDF uploaded: {}".format(uploaded_pdf_name))

        log_list.append("Starting background thread call.")
        t = threading.Thread(
            target=call_gemini_in_background,
            args=(api_key_real, prompt_parts_for_api, uploaded_pdf_name)
        )
        t.daemon = True
        t.start()

    except Exception as setup_e:
        error = "Error during setup: {}".format(setup_e)
        jsonOutput = "Setup error. See error output."
        sc.sticky[KEY_RUNNING] = False
        log_list.append("Setup failed: {}".format(setup_e))

# STATE 2
elif sc.sticky[KEY_RUNNING]:
    if sc.sticky.get(KEY_RESULT) is not None:
        generated_text = sc.sticky[KEY_RESULT]
        cleaned = _strip_code_fences(generated_text)

        if _is_valid_json(cleaned):
            jsonOutput = cleaned
            error = None
        else:
            jsonOutput = cleaned
            error = "Warning: API response was not valid JSON."

        start_time = sc.sticky.get(KEY_START_TIME, time.time())
        executionTime = time.time() - start_time
        sc.sticky[KEY_RUNNING] = False
        log_list.append("Result received. Finished.")

    elif sc.sticky.get(KEY_API_ERROR) is not None:
        jsonOutput = "An error occurred. See error output."
        error = sc.sticky[KEY_API_ERROR]
        start_time = sc.sticky.get(KEY_START_TIME, time.time())
        executionTime = time.time() - start_time
        sc.sticky[KEY_RUNNING] = False
        log_list.append("Error received from API call. Finished.")

    else:
        jsonOutput = "Generating... (can take up to 2 minutes)"

# Persist outputs every run
sc.sticky[KEY_LAST_OUTPUT] = jsonOutput
sc.sticky[KEY_LAST_ERROR] = error
sc.sticky[KEY_LAST_TIME] = executionTime
sc.sticky[KEY_LAST_LOG] = log_list

# Optional console print
if error:
    print("Error:", error)
if executionTime is not None:
    print("Execution Time: {:.3f}s".format(executionTime))

# Also output log as a string, if you add a log output param in GH
log = "\n".join(log_list)
# ---------- end ai_brick_evaluation_4 ----------

run_the_generative_model_4 = Button()  # disabled
gemini_2_5_pro = Python3Script(
    existingJson=existing_json_needed,
    keyPath=panel,
    systemPrompt=system_promt_setting_the_rules_4,
    run=run_the_generative_model_4)  # -> error, jsonOutput, model, executionTime; inputs stereoImagePath: String, keyPath: String; disabled
# ---------- gemini_2_5_pro: Python ----------
# r: google-generativeai, Pillow
import scriptcontext as sc
import google.generativeai as genai
import json
import os
import time
import threading
import Eto
from PIL import Image

SUPPORTED_IMAGE_EXTENSIONS = [".png", ".jpg", ".jpeg", ".webp", ".heic", ".heif"]
SUPPORTED_PDF_EXTENSION = ".pdf"

KEY_RUNNING = "gemini_is_running"
KEY_LAST_OUTPUT = "gemini_last_output"
KEY_LAST_ERROR = "gemini_last_error"
KEY_LAST_TIME = "gemini_last_time"
KEY_RESULT = "gemini_api_result"
KEY_API_ERROR = "gemini_api_error"
KEY_START_TIME = "gemini_start_time"
KEY_LAST_LOG = "gemini_last_log"
KEY_RUN_ID = "gemini_run_id"
KEY_RESULT_RUN_ID = "gemini_result_run_id"
KEY_ABORT_REQUESTED = "gemini_abort_requested"

if KEY_RUNNING not in sc.sticky:
    sc.sticky[KEY_RUNNING] = False
if KEY_LAST_OUTPUT not in sc.sticky:
    sc.sticky[KEY_LAST_OUTPUT] = "Ready. Click Run."
if KEY_LAST_ERROR not in sc.sticky:
    sc.sticky[KEY_LAST_ERROR] = None
if KEY_LAST_TIME not in sc.sticky:
    sc.sticky[KEY_LAST_TIME] = None
if KEY_LAST_LOG not in sc.sticky:
    sc.sticky[KEY_LAST_LOG] = []
if KEY_RUN_ID not in sc.sticky:
    sc.sticky[KEY_RUN_ID] = 0
if KEY_ABORT_REQUESTED not in sc.sticky:
    sc.sticky[KEY_ABORT_REQUESTED] = False


def trigger_gh_update():
    gh_doc = ghenv.Component.OnPingDocument()
    if gh_doc:
        for obj in gh_doc.Objects:
            if obj.InstanceGuid == ghenv.Component.InstanceGuid:
                obj.ExpireSolution(True)
                return


def _strip_code_fences(text):
    if not text:
        return text
    t = text.strip()
    if t.startswith("```json"):
        t = t[7:].strip()
        if t.endswith("```"):
            t = t[:-3].strip()
        return t
    if t.startswith("```"):
        t = t[3:].strip()
        if t.endswith("```"):
            t = t[:-3].strip()
        return t
    return text


def _is_valid_json(s):
    try:
        json.loads(s)
        return True
    except:
        return False


def _sanitize_key(raw):
    if raw is None:
        return ""
    k = raw

    # Remove UTF 8 BOM if present
    if len(k) > 0 and ord(k[0]) == 65279:
        k = k[1:]

    k = k.strip()

    # Remove wrapping quotes if the file contains "AIza..." or 'AIza...'
    if (k.startswith('"') and k.endswith('"')) or (k.startswith("'") and k.endswith("'")):
        k = k[1:-1].strip()

    # If file contains multiple lines, take the first non empty line
    if "\n" in k or "\r" in k:
        parts = [p.strip() for p in k.replace("\r", "\n").split("\n") if p.strip()]
        k = parts[0] if parts else ""

    return k.strip()


def load_api_key_from_path(key_path):
    if not key_path or not str(key_path).strip():
        raise ValueError("keyPath input is missing.")
    kp = str(key_path).strip()
    if not os.path.exists(kp):
        raise ValueError("API key file not found at given path: {}".format(kp))
    with open(kp, "r") as f:
        raw = f.read()
    api_key = _sanitize_key(raw)
    if not api_key:
        raise ValueError("API key file is empty or contains only whitespace.")
    return api_key


def mask_key(k):
    if not k:
        return ""
    if len(k) <= 8:
        return "*" * len(k)
    return k[:4] + "..." + k[-4:]


def split_stereo_image(path):
    """
    Splits a single image into two halves.
    Left half is VIEW A, right half is VIEW B.
    """
    img = Image.open(path)
    w, h = img.size
    mid = int(w / 2)

    view_a = img.crop((0, 0, mid, h)).copy()
    view_b = img.crop((mid, 0, w, h)).copy()
    img.close()

    return view_a, view_b


def call_gemini_in_background(api_key_real, prompt_parts, run_id, uploaded_pdf_name_to_delete=None):
    try:
        genai.configure(api_key=api_key_real)
        model = genai.GenerativeModel("gemini-2.5-pro")
        response = model.generate_content(prompt_parts)

        sc.sticky[KEY_RESULT] = response.text
        sc.sticky[KEY_RESULT_RUN_ID] = run_id
        sc.sticky[KEY_API_ERROR] = None

    except Exception as e:
        sc.sticky[KEY_RESULT] = None
        sc.sticky[KEY_RESULT_RUN_ID] = run_id
        sc.sticky[KEY_API_ERROR] = "An API error occurred: {}".format(e)

    finally:
        if uploaded_pdf_name_to_delete:
            try:
                genai.delete_file(uploaded_pdf_name_to_delete)
            except Exception as e_delete:
                warn = "Warning: Failed to delete uploaded PDF '{}': {}".format(uploaded_pdf_name_to_delete, e_delete)
                existing = sc.sticky.get(KEY_API_ERROR)
                sc.sticky[KEY_API_ERROR] = (existing + " | " + warn) if existing else warn

        Eto.Forms.Application.Instance.AsyncInvoke(trigger_gh_update)


# Outputs start from persisted values
jsonOutput = sc.sticky[KEY_LAST_OUTPUT]
error = sc.sticky[KEY_LAST_ERROR]
executionTime = sc.sticky[KEY_LAST_TIME]
log_list = sc.sticky.get(KEY_LAST_LOG, [])
if not isinstance(log_list, list):
    log_list = [str(log_list)]


# Optional abort input
abort_requested = False
if "abort" in globals():
    abort_requested = bool(abort)

# Abort behavior
if abort_requested and sc.sticky.get(KEY_RUNNING, False):
    sc.sticky[KEY_ABORT_REQUESTED] = True
    sc.sticky[KEY_RUNNING] = False
    sc.sticky[KEY_RESULT] = None
    sc.sticky[KEY_API_ERROR] = "Aborted by user. Background API call may still finish, but result will be ignored."
    jsonOutput = "Aborted."
    error = sc.sticky[KEY_API_ERROR]
    start_time = sc.sticky.get(KEY_START_TIME, time.time())
    executionTime = time.time() - start_time
    log_list.append("Abort requested. Marked run as aborted.")


# STATE 1  start a new run
elif run and not sc.sticky[KEY_RUNNING]:
    sc.sticky[KEY_RUNNING] = True
    sc.sticky[KEY_ABORT_REQUESTED] = False
    sc.sticky[KEY_RESULT] = None
    sc.sticky[KEY_API_ERROR] = None
    sc.sticky[KEY_START_TIME] = time.time()

    sc.sticky[KEY_RUN_ID] = int(sc.sticky.get(KEY_RUN_ID, 0)) + 1
    current_run_id = sc.sticky[KEY_RUN_ID]

    jsonOutput = "Generating... (can take up to 2 minutes)"
    error = None
    executionTime = None

    log_list = []
    log_list.append("Button clicked. Starting setup.")
    log_list.append("Run ID: {}".format(current_run_id))

    try:
        api_key_real = load_api_key_from_path(keyPath)
        log_list.append("API key loaded from file.")
        log_list.append("API key preview: {}".format(mask_key(api_key_real)))

        if not any([systemPrompt, userPrompt, stereoImagePath, pdfPath, existingJson]):
            raise ValueError("Input is missing. Provide a prompt, stereoImagePath, pdfPath, existingJson, or a combination.")

        genai.configure(api_key=api_key_real)
        log_list.append("API configured for uploads.")

        full_text_prompt = systemPrompt if systemPrompt else ""
        if userPrompt:
            full_text_prompt += "\n\n--- USER REQUEST ---\n" + userPrompt

        prompt_parts_for_api = [full_text_prompt]

        # Optional reference example
        if "referenceImagePath" in globals() and referenceImagePath and os.path.exists(referenceImagePath):
            ref_img = Image.open(referenceImagePath)
            prompt_parts_for_api.append("EXAMPLE INPUT IMAGE:")
            prompt_parts_for_api.append(ref_img)
            prompt_parts_for_api.append("EXAMPLE GROUND TRUTH JSON:")
            prompt_parts_for_api.append(referenceJson if "referenceJson" in globals() else "")
            prompt_parts_for_api.append("END OF EXAMPLE")
            log_list.append("Reference example added.")

        # Stereo image split into two view images for the model
        if stereoImagePath:
            if not os.path.exists(stereoImagePath):
                raise ValueError("Stereo image file not found: {}".format(stereoImagePath))
            ext = os.path.splitext(stereoImagePath)[1].lower()
            if ext not in SUPPORTED_IMAGE_EXTENSIONS:
                raise ValueError("Unsupported stereo image type: {}".format(ext))

            view_a_img, view_b_img = split_stereo_image(stereoImagePath)
            prompt_parts_for_api.append("NOW ANALYZE THIS IMAGE. VIEW A (LEFT HALF).")
            prompt_parts_for_api.append(view_a_img)
            prompt_parts_for_api.append("NOW ANALYZE THIS IMAGE. VIEW B (RIGHT HALF).")
            prompt_parts_for_api.append(view_b_img)
            log_list.append("Stereo image added and split into VIEW A and VIEW B.")

        # Existing JSON
        if existingJson and str(existingJson).strip():
            try:
                json.loads(existingJson)
            except Exception as e_json_in:
                raise ValueError("existingJson is not valid JSON. Error: {}".format(e_json_in))
            prompt_parts_for_api.append("MAP THE DAMAGES TO THIS JSON STRUCTURE:")
            prompt_parts_for_api.append(existingJson)
            log_list.append("Existing JSON added.")

        # PDF upload
        uploaded_pdf_name = None
        if pdfPath:
            if not os.path.exists(pdfPath):
                raise ValueError("PDF file not found: {}".format(pdfPath))
            ext = os.path.splitext(pdfPath)[1].lower()
            if ext != SUPPORTED_PDF_EXTENSION:
                raise ValueError("Not a supported PDF: {}".format(pdfPath))

            log_list.append("Uploading PDF...")
            uploaded_file = genai.upload_file(path=pdfPath)
            prompt_parts_for_api.append(uploaded_file)
            uploaded_pdf_name = uploaded_file.name
            log_list.append("PDF uploaded: {}".format(uploaded_pdf_name))

        log_list.append("Starting background thread call.")
        t = threading.Thread(
            target=call_gemini_in_background,
            args=(api_key_real, prompt_parts_for_api, current_run_id, uploaded_pdf_name)
        )
        t.daemon = True
        t.start()

    except Exception as setup_e:
        error = "Error during setup: {}".format(setup_e)
        jsonOutput = "Setup error. See error output."
        sc.sticky[KEY_RUNNING] = False
        log_list.append("Setup failed: {}".format(setup_e))


# STATE 2  waiting for result
elif sc.sticky[KEY_RUNNING]:
    result_ready = sc.sticky.get(KEY_RESULT) is not None
    error_ready = sc.sticky.get(KEY_API_ERROR) is not None
    result_run_id = sc.sticky.get(KEY_RESULT_RUN_ID, None)
    current_run_id = sc.sticky.get(KEY_RUN_ID, 0)

    # Ignore late results when user aborted or when run id does not match
    if sc.sticky.get(KEY_ABORT_REQUESTED, False):
        jsonOutput = "Aborted."
        error = sc.sticky.get(KEY_API_ERROR, "Aborted by user.")
        start_time = sc.sticky.get(KEY_START_TIME, time.time())
        executionTime = time.time() - start_time
        sc.sticky[KEY_RUNNING] = False
        log_list.append("Run ended in aborted state.")
    elif (result_ready or error_ready) and (result_run_id is not None) and (result_run_id != current_run_id):
        jsonOutput = "Generating... (waiting for current run)"
        error = None
    elif result_ready:
        generated_text = sc.sticky[KEY_RESULT]
        cleaned = _strip_code_fences(generated_text)

        if _is_valid_json(cleaned):
            jsonOutput = cleaned
            error = None
        else:
            jsonOutput = cleaned
            error = "Warning: API response was not valid JSON."

        start_time = sc.sticky.get(KEY_START_TIME, time.time())
        executionTime = time.time() - start_time
        sc.sticky[KEY_RUNNING] = False
        log_list.append("Result received. Finished.")

    elif error_ready:
        jsonOutput = "An error occurred. See error output."
        error = sc.sticky[KEY_API_ERROR]
        start_time = sc.sticky.get(KEY_START_TIME, time.time())
        executionTime = time.time() - start_time
        sc.sticky[KEY_RUNNING] = False
        log_list.append("Error received from API call. Finished.")

    else:
        jsonOutput = "Generating... (can take up to 2 minutes)"


# Persist outputs every run
sc.sticky[KEY_LAST_OUTPUT] = jsonOutput
sc.sticky[KEY_LAST_ERROR] = error
sc.sticky[KEY_LAST_TIME] = executionTime
sc.sticky[KEY_LAST_LOG] = log_list

# Optional console print
if error:
    print("Error:", error)
if executionTime is not None:
    print("Execution Time: {:.3f}s".format(executionTime))

# Optional log output
log = "\n".join(log_list)
# ---------- end gemini_2_5_pro ----------

ai_brick_evaluation_5 = Python3Script(
    imagePathA=image_path_optional,
    existingJson=existing_json_needed,
    keyPath=panel,
    systemPrompt=system_promt_setting_the_rules_6,
    run=run_the_generative_model)  # -> error, jsonOutput, model, executionTime; inputs imagePathA: String, keyPath: String; disabled
# ---------- ai_brick_evaluation_5: Python ----------
# r: google-genai, Pillow
import scriptcontext as sc
import json
import os
import time
import threading
import hashlib
import Eto
from PIL import Image

from google import genai
from google.genai import types

SUPPORTED_IMAGE_EXTENSIONS = [".png", ".jpg", ".jpeg", ".webp", ".heic", ".heif"]
SUPPORTED_PDF_EXTENSION = ".pdf"

KEY_RUNNING = "gemini_is_running"
KEY_LAST_OUTPUT = "gemini_last_output"
KEY_LAST_ERROR = "gemini_last_error"
KEY_LAST_TIME = "gemini_last_time"
KEY_RESULT = "gemini_api_result"
KEY_API_ERROR = "gemini_api_error"
KEY_START_TIME = "gemini_start_time"
KEY_LAST_LOG = "gemini_last_log"

KEY_CACHE_NAME = "gemini_cache_name"
KEY_CACHE_HASH = "gemini_cache_hash"

if KEY_RUNNING not in sc.sticky:
    sc.sticky[KEY_RUNNING] = False
if KEY_LAST_OUTPUT not in sc.sticky:
    sc.sticky[KEY_LAST_OUTPUT] = "Ready. Click Run."
if KEY_LAST_ERROR not in sc.sticky:
    sc.sticky[KEY_LAST_ERROR] = None
if KEY_LAST_TIME not in sc.sticky:
    sc.sticky[KEY_LAST_TIME] = None
if KEY_LAST_LOG not in sc.sticky:
    sc.sticky[KEY_LAST_LOG] = []
if KEY_CACHE_NAME not in sc.sticky:
    sc.sticky[KEY_CACHE_NAME] = None
if KEY_CACHE_HASH not in sc.sticky:
    sc.sticky[KEY_CACHE_HASH] = None


def trigger_gh_update():
    gh_doc = ghenv.Component.OnPingDocument()
    if gh_doc:
        for obj in gh_doc.Objects:
            if obj.InstanceGuid == ghenv.Component.InstanceGuid:
                obj.ExpireSolution(True)
                return


def _sanitize_key(raw):
    if raw is None:
        return ""
    k = raw
    if len(k) > 0 and ord(k[0]) == 65279:
        k = k[1:]
    k = k.strip()
    if (k.startswith('"') and k.endswith('"')) or (k.startswith("'") and k.endswith("'")):
        k = k[1:-1].strip()
    if "\n" in k or "\r" in k:
        parts = [p.strip() for p in k.replace("\r", "\n").split("\n") if p.strip()]
        k = parts[0] if parts else ""
    return k.strip()


def load_api_key_from_path(key_path):
    if not key_path or not str(key_path).strip():
        raise ValueError("keyPath input is missing.")
    kp = str(key_path).strip()
    if not os.path.exists(kp):
        raise ValueError("API key file not found at given path: {}".format(kp))
    with open(kp, "r") as f:
        raw = f.read()
    api_key = _sanitize_key(raw)
    if not api_key:
        raise ValueError("API key file is empty or contains only whitespace.")
    return api_key


def mask_key(k):
    if not k:
        return ""
    if len(k) <= 8:
        return "*" * len(k)
    return k[:4] + "..." + k[-4:]


def prepare_image(path, max_dim=1280):
    img0 = Image.open(path)
    try:
        img = img0.convert("RGB")
        img.thumbnail((max_dim, max_dim), Image.LANCZOS)
        return img
    finally:
        try:
            img0.close()
        except:
            pass


def _vec_add(a, b):
    return [a[0] + b[0], a[1] + b[1], a[2] + b[2]]


def _vec_scale(a, s):
    return [a[0] * s, a[1] * s, a[2] * s]


def _to_vec(v):
    if isinstance(v, (list, tuple)) and len(v) == 3:
        return [float(v[0]), float(v[1]), float(v[2])]
    if isinstance(v, dict):
        return [float(v.get("x", 0.0)), float(v.get("y", 0.0)), float(v.get("z", 0.0))]
    return [0.0, 0.0, 0.0]

def _sub(a, b):
    return [a[0]-b[0], a[1]-b[1], a[2]-b[2]]

def _add(a, b):
    return [a[0]+b[0], a[1]+b[1], a[2]+b[2]]

def _scale(a, s):
    return [a[0]*s, a[1]*s, a[2]*s]

def _dot(a, b):
    return a[0]*b[0] + a[1]*b[1] + a[2]*b[2]

def _cross(a, b):
    return [
        a[1]*b[2] - a[2]*b[1],
        a[2]*b[0] - a[0]*b[2],
        a[0]*b[1] - a[1]*b[0],
    ]

def _norm(a):
    return (a[0]*a[0] + a[1]*a[1] + a[2]*a[2]) ** 0.5

def _normalize(a):
    n = _norm(a)
    if n < 1e-12:
        return [0.0, 0.0, 1.0]
    return [a[0]/n, a[1]/n, a[2]/n]

def pick_face_by_dir(face_centroids, origin, axis, mode):
    best_f = None
    best_s = None
    for fi, c in face_centroids.items():
        s = _dot(_sub(c, origin), axis)
        if best_f is None:
            best_f, best_s = fi, s
        else:
            if mode == "max" and s > best_s:
                best_f, best_s = fi, s
            if mode == "min" and s < best_s:
                best_f, best_s = fi, s
    return best_f

def build_geometry_context(existing_json_str, node_key="0", max_mesh_items=250):
    obj = json.loads(existing_json_str)
    node = obj["data"]["graph"]["node"][node_key]
    part = node["part"]["data"]

    mesh = part["attributes"]["mesh"]["data"]
    vdict = mesh.get("vertex", {})
    fdict = mesh.get("face", {})

    verts = {int(k): [v["x"], v["y"], v["z"]] for k, v in vdict.items()}
    faces = {int(k): list(v) for k, v in fdict.items()}

    xs = [p[0] for p in verts.values()]
    ys = [p[1] for p in verts.values()]
    zs = [p[2] for p in verts.values()]
    bbox = {
        "min": [min(xs), min(ys), min(zs)],
        "max": [max(xs), max(ys), max(zs)],
    }

    face_centroids = {}
    for fi, fvs in faces.items():
        pts = [verts[i] for i in fvs]
        c = [0.0, 0.0, 0.0]
        for p in pts:
            c = _add(c, p)
        c = _scale(c, 1.0 / float(len(pts)))
        face_centroids[fi] = c

    frame = part.get("frame", None)
    if not frame:
        raise ValueError("Part frame missing. Front and Right cannot be defined without frame.")

    origin = _to_vec(frame.get("point"))
    xaxis = _normalize(_to_vec(frame.get("xaxis")))
    yaxis = _normalize(_to_vec(frame.get("yaxis")))

    # Your JSON does not provide zaxis, so we compute it
    zaxis = _normalize(_cross(xaxis, yaxis))

    # Ensure zaxis points toward mesh positive z for stable top and bottom labeling
    # Mesh convention in your prompt is top = maximal z
    if _dot(zaxis, [0.0, 0.0, 1.0]) < 0.0:
        zaxis = _scale(zaxis, -1.0)

    top_f    = pick_face_by_dir(face_centroids, origin, zaxis, "max")
    bottom_f = pick_face_by_dir(face_centroids, origin, zaxis, "min")
    front_f  = pick_face_by_dir(face_centroids, origin, yaxis, "max")
    back_f   = pick_face_by_dir(face_centroids, origin, yaxis, "min")
    right_f  = pick_face_by_dir(face_centroids, origin, xaxis, "max")
    left_f   = pick_face_by_dir(face_centroids, origin, xaxis, "min")

    context = {
        "nodeKey": str(node_key),
        "bbox": bbox,
        "frame": {
            "point": origin,
            "xaxis": xaxis,
            "yaxis": yaxis,
            "zaxis": zaxis,
        },
        "dirFaces": {
            "top":    {"faceIndex": int(top_f),    "centroid": face_centroids[top_f]},
            "bottom": {"faceIndex": int(bottom_f), "centroid": face_centroids[bottom_f]},
            "front":  {"faceIndex": int(front_f),  "centroid": face_centroids[front_f]},
            "back":   {"faceIndex": int(back_f),   "centroid": face_centroids[back_f]},
            "right":  {"faceIndex": int(right_f),  "centroid": face_centroids[right_f]},
            "left":   {"faceIndex": int(left_f),   "centroid": face_centroids[left_f]},
        },
        "convention": {
            "frontDir": "frame.yaxis",
            "rightDir": "frame.xaxis",
            "topDir": "frame.zaxis",
        }
    }

    if len(verts) <= max_mesh_items:
        context["vertexCoords"] = {str(k): v for k, v in verts.items()}
    if len(face_centroids) <= max_mesh_items:
        context["faceCentroids"] = {str(k): v for k, v in face_centroids.items()}

    return context


def response_json_schema():
    return {
        "type": "object",
        "additionalProperties": False,
        "properties": {
            "nodeKey": {"type": "string", "enum": ["0"]},
            "appendDamages": {
                "type": "array",
                "items": {
                    "type": "object",
                    "additionalProperties": False,
                    "properties": {
                        "type": {"type": "string", "enum": ["face", "edge", "vertex"]},
                        "vertices": {
                            "type": "array",
                            "items": {"type": "integer"},
                            "minItems": 1,
                            "maxItems": 2
                        },
                        "status": {"type": "string", "enum": ["Brokenness", "Crack"]},
                        "value": {"type": "integer", "minimum": 0, "maximum": 5},
                        "description": {"type": "string"},
                        "coordinates": {
                            "type": "object",
                            "additionalProperties": False,
                            "properties": {
                                "point": {
                                    "type": "array",
                                    "items": {"type": "number"},
                                    "minItems": 3,
                                    "maxItems": 3
                                },
                                "xaxis": {
                                    "type": "array",
                                    "items": {"type": "number"},
                                    "minItems": 3,
                                    "maxItems": 3
                                },
                                "yaxis": {
                                    "type": "array",
                                    "items": {"type": "number"},
                                    "minItems": 3,
                                    "maxItems": 3
                                }
                            },
                            "required": ["point", "xaxis", "yaxis"]
                        }
                    },
                    "required": ["type", "vertices", "status", "value", "description", "coordinates"]
                }
            }
        },
        "required": ["nodeKey", "appendDamages"]
    }


def compute_cache_hash(system_prompt, geometry_context_str):
    h = hashlib.sha256()
    h.update((system_prompt or "").encode("utf-8"))
    h.update(b"\n")
    h.update((geometry_context_str or "").encode("utf-8"))
    return h.hexdigest()


def call_gemini_in_background(api_key_real, system_prompt, user_prompt, imgA, imgB, geometry_context_str, use_cache, model_id, media_res_level):
    try:
        client = genai.Client(api_key=api_key_real)

        log_list = sc.sticky.get(KEY_LAST_LOG, [])
        log_list.append("Client created.")

        cache_name = None
        cache_hash = compute_cache_hash(system_prompt, geometry_context_str)

        if use_cache:
            prev_hash = sc.sticky.get(KEY_CACHE_HASH)
            prev_name = sc.sticky.get(KEY_CACHE_NAME)

            if prev_hash == cache_hash and prev_name:
                cache_name = prev_name
                log_list.append("Reusing cache: {}".format(cache_name))
            else:
                log_list.append("Creating new cache...")
                cache = client.caches.create(
                    model="models/" + model_id,
                    config=types.CreateCachedContentConfig(
                        contents=[geometry_context_str],
                        system_instruction=system_prompt,
                    ),
                )
                cache_name = cache.name
                sc.sticky[KEY_CACHE_NAME] = cache_name
                sc.sticky[KEY_CACHE_HASH] = cache_hash
                log_list.append("Cache created: {}".format(cache_name))

        contents = []
        if not use_cache:
            contents.append("GEOMETRY_CONTEXT_JSON:\n" + geometry_context_str)

        if user_prompt and str(user_prompt).strip():
            contents.append("USER_REQUEST:\n" + str(user_prompt).strip())

        if imgA is not None:
            contents.append("VIEW_A_IMAGE:")
            contents.append(imgA)
        if imgB is not None:
            contents.append("VIEW_B_IMAGE:")
            contents.append(imgB)

        config = types.GenerateContentConfig(
            temperature=0.0,
            top_p=0.1,
            seed=1,
            response_mime_type="application/json",
            response_json_schema=response_json_schema(),
            media_resolution=media_res_level,
            cached_content=cache_name if cache_name else None,
        )

        log_list.append("Sending request. Model: {}".format(model_id))

        response = client.models.generate_content(
            model=model_id,
            contents=contents,
            config=config,
        )

        sc.sticky[KEY_RESULT] = response.text
        sc.sticky[KEY_API_ERROR] = None

        try:
            usage = getattr(response, "usage_metadata", None)
            if usage:
                log_list.append("Usage metadata: {}".format(usage))
        except:
            pass

        try:
            client.close()
        except:
            pass

        sc.sticky[KEY_LAST_LOG] = log_list

    except Exception as e:
        sc.sticky[KEY_RESULT] = None
        sc.sticky[KEY_API_ERROR] = "An API error occurred: {}".format(e)

    finally:
        Eto.Forms.Application.Instance.AsyncInvoke(trigger_gh_update)


# Outputs start from persisted values
jsonOutput = sc.sticky[KEY_LAST_OUTPUT]
error = sc.sticky[KEY_LAST_ERROR]
executionTime = sc.sticky[KEY_LAST_TIME]
log_list = sc.sticky.get(KEY_LAST_LOG, [])
if not isinstance(log_list, list):
    log_list = [str(log_list)]

# Defaults
MODEL_ID = "gemini-3-flash-preview"
USE_CACHE = True
MEDIA_RES = types.MediaResolution.MEDIA_RESOLUTION_LOW

# STATE 1
if run and not sc.sticky[KEY_RUNNING]:
    sc.sticky[KEY_RUNNING] = True
    sc.sticky[KEY_RESULT] = None
    sc.sticky[KEY_API_ERROR] = None
    sc.sticky[KEY_START_TIME] = time.time()

    jsonOutput = "Generating..."
    error = None
    executionTime = None

    log_list = []
    log_list.append("Button clicked. Starting setup.")

    try:
        api_key_real = load_api_key_from_path(keyPath)
        log_list.append("API key loaded.")
        log_list.append("API key preview: {}".format(mask_key(api_key_real)))

        if not any([systemPrompt, userPrompt, imagePathA, imagePathB, existingJson]):
            raise ValueError("Input is missing. Provide prompts, images, and existingJson at minimum.")

        if not existingJson or not str(existingJson).strip():
            raise ValueError("existingJson is required to build GEOMETRY_CONTEXT_JSON.")

        geom_ctx = build_geometry_context(existingJson, node_key="0", max_mesh_items=250)
        geom_ctx_str = json.dumps(geom_ctx, ensure_ascii=False, separators=(",", ":"))
        log_list.append("Geometry context built. Keys: {}".format(list(geom_ctx.keys())))

        imgA = None
        imgB = None

        if imagePathA and str(imagePathA).strip():
            if not os.path.exists(imagePathA):
                raise ValueError("Image A file not found: {}".format(imagePathA))
            ext = os.path.splitext(imagePathA)[1].lower()
            if ext not in SUPPORTED_IMAGE_EXTENSIONS:
                raise ValueError("Unsupported Image A type: {}".format(ext))
            imgA = prepare_image(imagePathA, max_dim=1280)
            log_list.append("Image A prepared. Size: {}".format(imgA.size))

        if imagePathB and str(imagePathB).strip():
            if not os.path.exists(imagePathB):
                raise ValueError("Image B file not found: {}".format(imagePathB))
            ext = os.path.splitext(imagePathB)[1].lower()
            if ext not in SUPPORTED_IMAGE_EXTENSIONS:
                raise ValueError("Unsupported Image B type: {}".format(ext))
            imgB = prepare_image(imagePathB, max_dim=1280)
            log_list.append("Image B prepared. Size: {}".format(imgB.size))

        log_list.append("Starting background thread call.")
        sc.sticky[KEY_LAST_LOG] = log_list

        t = threading.Thread(
            target=call_gemini_in_background,
            args=(api_key_real, systemPrompt, userPrompt, imgA, imgB, geom_ctx_str, USE_CACHE, MODEL_ID, MEDIA_RES)
        )
        t.daemon = True
        t.start()

    except Exception as setup_e:
        error = "Error during setup: {}".format(setup_e)
        jsonOutput = "Setup error. See error output."
        sc.sticky[KEY_RUNNING] = False
        log_list.append("Setup failed: {}".format(setup_e))

# STATE 2
elif sc.sticky[KEY_RUNNING]:
    if sc.sticky.get(KEY_RESULT) is not None:
        generated_text = sc.sticky[KEY_RESULT]
        try:
            parsed = json.loads(generated_text)
            jsonOutput = json.dumps(parsed, ensure_ascii=False, indent=2)
            error = None
        except Exception as e_json:
            jsonOutput = generated_text
            error = "Warning: response was not valid JSON: {}".format(e_json)

        start_time = sc.sticky.get(KEY_START_TIME, time.time())
        executionTime = time.time() - start_time
        sc.sticky[KEY_RUNNING] = False
        log_list.append("Result received. Finished.")

    elif sc.sticky.get(KEY_API_ERROR) is not None:
        jsonOutput = "An error occurred. See error output."
        error = sc.sticky[KEY_API_ERROR]
        start_time = sc.sticky.get(KEY_START_TIME, time.time())
        executionTime = time.time() - start_time
        sc.sticky[KEY_RUNNING] = False
        log_list.append("Error received from API call. Finished.")

    else:
        jsonOutput = "Generating..."

# Persist outputs
sc.sticky[KEY_LAST_OUTPUT] = jsonOutput
sc.sticky[KEY_LAST_ERROR] = error
sc.sticky[KEY_LAST_TIME] = executionTime
sc.sticky[KEY_LAST_LOG] = log_list

if error:
    print("Error:", error)
if executionTime is not None:
    print("Execution Time: {:.3f}s".format(executionTime))

log = "\n".join(log_list)
# ---------- end ai_brick_evaluation_5 ----------

jsonoutput_3 = Panel(ai_brick_evaluation_3.jsonOutput)
jsonoutput_4 = Panel(ai_brick_evaluation_3.passA_raw)
jsonoutput_5 = Panel(ai_brick_evaluation_3.passB_raw)
executiontime_3 = Panel(ai_brick_evaluation_3.executionTime)
error_3 = Panel(ai_brick_evaluation_3.error)
model_3 = Panel(ai_brick_evaluation_3.model)

json_splicer_2 = Python3Script(damagePayload=ai_brick_evaluation_3.jsonOutput, existingJson=existing_json_needed_3)  # -> out, updated_json_str; same code as json_splicer
panel_16 = Panel(json_splicer_2.updated_json_str)

# ----
# Import from JSON
value_list_2 = ValueList({"0", "1", "2", "3", "4", "5", "6", "7", "8", "9", "10", "11", "12", "13"}, selected="2")
import = Button()
path = Python3Script()  # -> out, DATA
# ---------- path: Python ----------
import os
import getpass

username = getpass.getuser()
USER_FOLDER = os.path.abspath(os.path.join("C:/Users/", username))
DATA = os.path.abspath(os.path.join(USER_FOLDER,"workspace/projects/workshop_iaac_2026/data"))

print(USER_FOLDER)
print(DATA)
# ---------- end path ----------
import_2 = Python3Script(DATA=path.DATA, brick_key=value_list_2, import=import)  # -> out, assembly; inputs DATA: String
# ---------- import_2: Python ----------
import os
import json
from assembly_information_model.assembly import Assembly
from scriptcontext import sticky as st

if _import:
    filename = "single_RF_brick_w_damages_1.json"
    PATH = os.path.join(DATA, filename)
    print(PATH)
    assembly = Assembly.from_json(PATH)

    st['assembly'] = assembly

assembly = st.get('assembly')
# ---------- end import_2 ----------

# ----
# Init Assembly
button = Button()
assembly = Python3Script(init=button)  # -> out, assembly
# ---------- assembly: Python ----------
from assembly_information_model import Part, Assembly
from scriptcontext import sticky as st

if init:
    assembly = Assembly()
    st["assembly"] = assembly

assembly = st["assembly"]
# ---------- end assembly ----------

add_to_assembly = Python3Script(assembly=assembly.assembly, JSON_or_FilePath=json_splicer_2.updated_json_str, add=Button())  # -> out, assembly
# ---------- add_to_assembly: Python ----------
import System
import Rhino
import Grasshopper

import rhinoscriptsyntax as rs
import Rhino.Geometry as rg
import json
import os
from assembly_information_model import Part, Assembly
from compas.geometry import Point, Frame, Box
from compas.datastructures import Mesh

# Handle Python 2 vs 3 compatibility for URL encoding
try:
    # Python 3 (e.g., Rhino 8)
    from urllib.parse import quote
except ImportError:
    # Python 2 (IronPython in Rhino 5-7)
    from urllib import quote

# --- Initialize Outputs ---
AllGeometries = []
SelectedGeometry = None
ConnectedGeometries = []
CenterPoints = []
ConnectionLines = []
DotString = "Error: Input is not connected or invalid."
GraphvizURL = "No URL generated."
log_output = []

# --- Main Script ---
# Check if the primary input is connected.
if 'JSON_or_FilePath' in globals() and JSON_or_FilePath and add:
    try:
        assembly_data = None
        input_str = JSON_or_FilePath.strip()
        # 1. Parse JSON from File Path or String
        if os.path.exists(input_str):
            print("Input detected as a file path. Reading file...")
            with open(input_str, 'r') as f:
                assembly_data = json.load(f)
        else:
            print("Input detected as a direct JSON string. Parsing string...")
            assembly_data = json.loads(input_str)

        # 2. Data processing
        if "updatedModel" in assembly_data.keys():
            part_list_data = assembly_data["updatedModel"]["data"]["graph"]["node"]
            for part_key, part_data in part_list_data.items():
                part = Part.__from_data__(part_data["part"]["data"])
                part.shape = Box.__from_data__(part.shape["data"])
                part.mesh = Mesh.__from_data__(part.mesh["data"])
                assembly.add_part(part, built=part_data["built"], damages=part_data["damages"], image_paths=[image_path])

    except json.JSONDecodeError:
        log_output.append("Error: Input is not a valid file path and could not be parsed as JSON.")
        DotString = "Error: JSON Decode Error. Check input."
    except Exception as e:
        log_output.append(f"An unexpected error occurred: {e}")
        DotString = f"Error: {e}"

# Assign the final log messages to the output parameter
Log = "\n".join(log_output)
# ---------- end add_to_assembly ----------
value_list_3 = ValueList({"20", "50", "100", "500", "1000", "5000"}, selected="500")
value_list_4 = ValueList({"show all": "show_all", "show until key": "show_until_key"}, selected="show all")
panel_17 = Panel(add_to_assembly.out)
start = Button()
step = Button()
back = Button()
reset = Button()
full = Button()
stop = Button()
counter = Python3Script(
    my_assembly=add_to_assembly.assembly,
    start=start,
    stop=stop,
    step=step,
    step_back=back,
    reset=reset,
    full=full,
    interval=value_list_3)  # -> out, counter
# ---------- counter: Python ----------
from scriptcontext import sticky as st
import Grasshopper

def update_component(ghenv, delay):
    """Schedule an update of the Grasshopper component.

    After the specified delay, the GH component will be automatically updated.

    Parameters
    ----------
    ghenv : :class:`GhPython.Component.PythonEnvironment`
        The current GHPython environment.
    delay : :obj:`int`
        Time in milliseconds until the update is performed.

    Raises
    ------
    ValueError
        If the delay is less than zero.

    """
    if delay <= 0:
        raise ValueError("Delay must be greater than zero")

    ghcomp = ghenv.Component
    ghdoc = ghcomp.OnPingDocument()

    def callback(ghdoc):
        if ghdoc.SolutionState != Grasshopper.Kernel.GH_ProcessStep.Process:
            ghcomp.ExpireSolution(False)

    ghdoc.ScheduleSolution(delay, Grasshopper.Kernel.GH_Document.GH_ScheduleDelegate(callback))

L = range(my_assembly.graph.number_of_nodes())

# store data in component
guid = str(ghenv.Component.InstanceGuid)
counter_key = "counter_" + guid
running_key = "running_" + guid

if counter_key not in st:
    st[counter_key] = 0

if running_key not in st:
    st[running_key] = False
    

if st[running_key]:
    if st[counter_key] < len(L) - 1:
        st[counter_key] += 1
        update_component(ghenv, interval)
    else:
        st[counter_key] = 0
        st[running_key] = False
    
if start:
    st[running_key] = True

if stop:
    st[running_key] = False

if step:
    if st[counter_key] < len(L) - 1:
        st[counter_key] += 1

if step_back:
    if st[counter_key] > 0:
        st[counter_key] -= 1

if reset:
    st[counter_key] = 0
    st[running_key] = False

if full:
    st[counter_key] = len(L)-1

if len(L):
    item = L[st[counter_key]]


#st["visualisation_counter"] = st[counter_key]
counter = st[counter_key]
# ---------- end counter ----------
visualize = Python3Script(assembly=add_to_assembly.assembly, show=value_list_4, show_connections=Toggle(True), counter=counter.counter)  # -> out, parts, parts_frame, parts_keys, current_part_vertices, current_part_vertex_points, connections, current_part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
# ---------- visualize: Python ----------
from compas_rhino.conversions import mesh_to_rhino, sphere_to_rhino, box_to_rhino, frame_to_rhino, line_to_rhino, point_to_rhino, box_to_rhino
from compas.geometry import Line, Transformation, Point, Vector, Frame, Sphere, Translation

#print assembly
print(assembly)

print(type(assembly))
print([name for name in dir(assembly) if "part" in name.lower()])
print("graph nodes", list(assembly.graph.nodes()) if hasattr(assembly, "graph") else None)

#for p in assembly.parts():
#    layer = round(robot.from_RCF_to_BCF(p.frame).point.z/0.08)-1
#    assembly.graph.node_attribute(p.key, "layer", layer)
# assembly.graph.delete_node(5)
#get parts datastructure
# parts_keys = [p for p in assembly.part_keys()]
parts_keys = list(assembly.graph.nodes())
parts = []
parts_all = []
parts_built = []
parts_not_built = []
parts_frame = []
damages = []
current_key = counter

damages.append(assembly.graph.node_attribute(current_key, "damages"))
current_p = assembly.part(current_key)
current_p_frame = current_p.frame.transformed(Translation.from_vector([0, 0.15*current_key, 0]))
T = Transformation.from_frame(current_p_frame)
current_part = box_to_rhino(current_p.shape.transformed(T))
current_part_frame = frame_to_rhino(current_p_frame)
current_img_path = assembly.graph.node_attribute(current_key, "image_paths")
current_part_vertices = list(current_p.mesh.vertices())
current_part_vertex_points = [
    point_to_rhino(current_p.mesh.vertex_point(v).transformed(T)) 
    for v in current_part_vertices
]

if show == "show_all":
    for key in parts_keys:
        if key != current_key:
            p = assembly.part(key)
            p_frame = p.frame.transformed(Translation.from_vector([0,0.15*key,0]))
            parts.append(box_to_rhino(p.shape.transformed(Transformation.from_frame((p_frame)))))
            parts_frame.append(frame_to_rhino(p_frame))
   
if show == "show_until_key":
    for p in parts_keys[0:counter+1]:
        if key != current_key:
            p = assembly.part(key)
            p_frame = p.frame   
            parts.append(box_to_rhino(p.shape.transformed(Transformation.from_frame((p_frame)))))
            parts_frame.append(frame_to_rhino(p_frame))

if show_connections:
    connections = [line_to_rhino(Line(assembly.find_by_key(start).frame).point, robot.from_RCF_to_BCF(assembly.find_by_key(end).frame).point) for start, end in assembly.graph.edges()]
    connection_types = [assembly.graph.edge_attribute(t, "type") for t in assembly.graph.edges()]
    #extract points of the frame of the parts for visulization (+ converted to rhino point)
    parts_points = [point_to_rhino(p.frame.point) for p in assembly.parts()]
# ---------- end visualize ----------
panel_18 = Panel(visualize.out)
panel_19 = Panel(counter.counter)
damage = ControlKnob(Decimals=0, Limit=True, Maximum=10, Minimum=0, Range=10, Value=0)
panel_20 = Panel(visualize.current_img_path)
damages = Python3Script(current_part_frame=visualize.current_part_frame, damages=visualize.damages, select=damage)  # -> all_damages, selected_damage, damage_f, damage_t, damage_s, damage_d
# ---------- damages: Python ----------
from compas.geometry import Frame, Sphere, Translation
from compas_rhino.conversions import sphere_to_rhino, frame_to_rhino, plane_to_compas_frame

# damages = damages[2]
all_damages = []
current_part_frame = plane_to_compas_frame(current_part_frame)

for damage_key, damage in damages.items():
    damage_frame = Frame(damage["coordinates"]["point"])
    damage_value = damage["value"]
    damage_sphere = Sphere(0.002*damage_value, frame=damage_frame).transformed(Translation.from_vector(current_part_frame.point))
    all_damages.append(sphere_to_rhino(damage_sphere))

    if int(damage_key) == select:
        selected_damage = sphere_to_rhino(damage_sphere)
        damage_f = frame_to_rhino(damage_frame.transformed(Translation.from_vector(current_part_frame.point)))
        damage_t = damage["status"]
        damage_d = damage["description"]
        damage_s = damage_value
# ---------- end damages ----------
geometry = Geometry(visualize.current_part)
geometry_2 = Geometry(visualize.parts_frame)
geometry_3 = Geometry(visualize.parts)
custom_preview = CustomPreview(Geometry=geometry, Material=ColourSwatch(SwatchColor=RGBA(252, 83, 83, 216)))
custom_preview_2 = CustomPreview(Geometry=geometry_2, Material=ColourSwatch(SwatchColor=RGB(214, 166, 71)))
text_tag = TextTag(Location=visualize.current_part_frame, Text=visualize.current_key)
text_tag_2 = TextTag(
    Location=visualize.current_part_vertex_points,
    Text=visualize.current_part_vertices,
    Colour=ColourSwatch(SwatchColor=RGB(25, 0, 255)))
number_slider = Slider(0, range=0..10)
list_item = ListItem(List=visualize.current_part_vertex_points, Index=number_slider, Wrap=True)
list_item_2 = ListItem(List=visualize.current_part_vertices, Index=number_slider, Wrap=True)
panel_21 = Panel(list_item_2)
panel_22 = Panel(list_item)
custom_preview_3 = CustomPreview(Geometry=geometry_3, Material=ColourSwatch(SwatchColor=RGBA(255, 138, 138, 137)))
panel_23 = Panel(damages.damage_s)
python_3_script_3 = Python3Script(planes=visualize.current_part_frame, scale=Slider(0.2, range=0..1))  # -> P, V, C, W; inputs planes: list of Plane, scale: Double
# ---------- python_3_script_3: Python ----------
from Rhino.Display import ColorRGBA
from ghpythonlib.components import ColourRGBf


red = ColourRGBf(255, 255, 0, 0)
green = ColourRGBf(255, 0, 255, 0)
blue = ColourRGBf(255, 0, 0, 255)

P = []
V = []
C = []

# scale = float(scale)

for plane in planes:
    if not plane:
        continue
    P += [plane.Origin] * 3
    V.append(plane.XAxis * scale)
    V.append(plane.YAxis * scale)
    V.append(plane.ZAxis * scale)
    C += [red, green, blue]

W = 3
# ---------- end python_3_script_3 ----------
move = Move(Geometry=damages.damage_f, Motion=Vector(0, 0, 0.01))  # -> Geometry, Transform
colour_swatch = ColourSwatch(SwatchColor=RGB(0, 0, 0))
geometry_4 = Geometry(damages.all_damages)
geometry_5 = Geometry(damages.selected_damage)
custom_preview_4 = CustomPreview(Geometry=geometry_4, Material=ColourSwatch(SwatchColor=RGBA(255, 221, 0, 216)))
custom_preview_5 = CustomPreview(Geometry=geometry_5, Material=ColourSwatch(SwatchColor=RGBA(255, 23, 23, 216)))
vector_display_ex = VectorDisplayEx(Point=python_3_script_3.P, Vector=python_3_script_3.V, Colour=python_3_script_3.C, Width=python_3_script_3.W)
text_tag_3 = TextTag(Location=move.Geometry, Text=damages.damage_t, Colour=colour_swatch)
text_tag_4 = TextTag(Location=damages.damage_f, Text=damages.damage_d, Colour=colour_swatch)
line = Line(visualize.connections)
custom_curve_preview = CustomCurvePreview(Curve=line, Linetype="Continuous", Colour=ColourSwatch(SwatchColor=RGB(255, 125, 157)))

# ----
# Export to JSON
export = Button()
path_2 = Python3Script()  # -> out, DATA; same code as path
export_2 = Python3Script(DATA=path_2.DATA, assembly=add_to_assembly.assembly, export=export)  # -> out
# ---------- export_2: Python ----------
import os

if export:
    
    filename = "single_RF_brick_w_damages_spalledbrick.json"
    PATH = os.path.join(DATA, filename)
    
    # the assembly has to be serialized such that it can be called from CPython
    assembly.to_json(PATH)
# ---------- end export_2 ----------

# ----
# Rhino Visualization of a JSON Assembly + Damages
# (With Rotations!)
example = Panel("""{
  "updatedModel": {
    "objectName": "curved_brick_wall",
    "parts": [
      {
        "id": "course1_brick1",
        "origin": {
          "x": -0.4425,
          "y": -0.0672,
          "z": 0.0325
        },
        "dimensions": {
          "width": 0.215,
          "depth": 0.1025,
          "height": 0.065
        },
        "rotation": {
          "x": 0,
          "y": 0,
          "z": -0.3
        },
        "connections": [
          "course1_brick2",
          "course2_brick1"
        ],
        "material": "brick",
        "status": "intact"
      },
      {
        "id": "course1_brick2",
        "origin": {
          "x": -0.2239,
          "y": -0.0169,
          "z": 0.0325
        },
        "dimensions": {
          "width": 0.215,
          "depth": 0.1025,
          "height": 0.065
        },
        "rotation": {
          "x": 0,
          "y": 0,
          "z": -0.15
        },
        "connections": [
          "course1_brick1",
          "course1_brick3",
          "course2_brick1",
          "course2_brick2"
        ],
        "material": "brick",
        "status": "intact"
      },
      {
        "id": "course1_brick3",
        "origin": {
          "x": 0,
          "y": 0,
          "z": 0.0325
        },
        "dimensions": {
          "width": 0.215,
          "depth": 0.1025,
          "height": 0.065
        },
        "rotation": {
          "x": 0,
          "y": 0,
          "z": 0
        },
        "connections": [
          "course1_brick2",
          "course1_brick4",
          "course2_brick2",
          "course2_brick3"
        ],
        "material": "brick",
        "status": "intact"
      },
      {
        "id": "course1_brick4",
        "origin": {
          "x": 0.2239,
          "y": -0.0169,
          "z": 0.0325
        },
        "dimensions": {
          "width": 0.215,
          "depth": 0.1025,
          "height": 0.065
        },
        "rotation": {
          "x": 0,
          "y": 0,
          "z": 0.15
        },
        "connections": [
          "course1_brick3",
          "course1_brick5",
          "course2_brick3",
          "course2_brick4"
        ],
        "material": "brick",
        "status": "intact"
      },
      {
        "id": "course1_brick5",
        "origin": {
          "x": 0.4425,
          "y": -0.0672,
          "z": 0.0325
        },
        "dimensions": {
          "width": 0.215,
          "depth": 0.1025,
          "height": 0.065
        },
        "rotation": {
          "x": 0,
          "y": 0,
          "z": 0.3
        },
        "connections": [
          "course1_brick4",
          "course2_brick4"
        ],
        "material": "brick",
        "status": "intact"
      },
      {
        "id": "course2_brick1",
        "origin": {
          "x": -0.3335,
          "y": -0.0379,
          "z": 0.1075
        },
        "dimensions": {
          "width": 0.215,
          "depth": 0.1025,
          "height": 0.065
        },
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""")

# ----
# Gemini sometimes messes
# up the rotations. You may
# have to switch to inverted
# rotations...
rotations = ValueList({"Positive": 0, "Inverted": 1}, selected="Inverted")

image_path_optional_5 = Panel("C:\Users\saral\OneDrive\Desktop\ImagesOfObjects\Image_14.jpeg")

# ----
# System Promt (Setting the Rules): You are an expert AI assistant for assessing and cataloging the state of 3D models by comparing a master parts list with photographic evidence.
# Your primary task is to receive a 3D model's assembly data (modelJson), an existing list of damages (damageJson), and user-provided photos.
# 
# Your output **MUST BE a single, raw JSON object** with two top-level keys: "updatedModel" and "updatedDamages".
# 
# **Core Logic & Output Schema:**
# 
# 1.  **Perform Conservative Visual Analysis**: Your most important task is to **visually compare the user's photos against the parts list in the \`modelJson\`**. The photos are the primary source of truth. You must be conservative in your judgments. The user's text prompt provides additional context.
# 
# 2.  **Generate \`updatedModel\`**:
#     *   Take the \`modelJson\` object as the base.
#     *   You must iterate through **EVERY part** in the \`modelJson.parts\` array and add/update a \`"status"\` key to each one based on your visual analysis.
#     *   **Status Logic (Based on Visual Evidence & Certainty)**:
#         *   **"missing"**: Use this status ONLY if you have **strong visual evidence** that the part is absent. For example, you can see the empty space and connection points where the part should be. **Do not mark a part as missing simply because it is not visible from the current camera angle.**
#         *   **"defective"**: Use this status if the part is **visibly present but has clear damage** (cracks, dents, stains, etc.). Any part with an associated entry in the final \`updatedDamages\` list must have this status.
#         *   **"intact"**: This is the default status. Use this if a part is **visibly present and appears undamaged**. Also, use this status if a part is **not visible in the photos and has no reported damages**. The absence of evidence is not evidence of absence.
# 
# 3.  **Generate \`updatedDamages\`**:
#     *   Take the \`existingDamages\` JSON array.
#     *   Based on your visual analysis of the photos and the user's text, identify any new damages.
#     *   For each new damage, create a new damage object and add it to the list.
#     *   Generate a new unique ID for each new damage (e.g., if the last was "damage_03", the new one is "damage_04").
#     *   The \`updatedDamages\` key must contain a JSON array with ALL old damages PLUS any newly identified ones.
#     *   **Damage Object Schema**:
#         - "id" (string): e.g., "damage_01"
#         - "type" (string): e.g., "Crack", "Dent", "Scuff Mark"
#         - "description" (string): A detailed sentence.
#         - "part_id" (string): The exact 'id' of the part from the base model.
#         - "coordinates" (object): { "x": number, "y": number, "z": number }
# System Promt (Setting the Rules): You are an expert AI assistant for assessing and cataloging the state and damages of a Reichsformat (25x12x6.5cm) brick using photographic evidence and 3D mesh data.
# 
# Your primary task is to receive a modelJson including 3D mesh data; and photos to analyze the damages, and return a single raw JSON object named "updatedModel".
# 
# ### 1. Spatial Mapping Key (MANDATORY)
# To map the 2D photo to the 3D JSON:
# - Face 0: Top surface (Z+).
# - Face 3: Front long side.
# - Face 2: Right short side.
# - Vertex 2: Top-front-right corner.
# - Edge [1, 2]: The long edge between the Top and Front faces.
# - Edge [2, 6]: The vertical edge on the front-right.
# 
# ### 2. Core Logic
# - You must iterate through every node in `data.graph.node`.
# - For the brick (Node "0"), identify visual damages from the photo.
# - Any identified damage must be added to the `damages` dictionary located at: `data.graph.node["0"].damages`.
# 
# ### 3. Damage Object Schema
# For every damage found, create a entry in the `damages` dictionary using an incremental integer key ("0", "1", "2"...). Be selective and add the damage only if it is prominent and would need to be accounted for the reuse of the brick. Each entry must follow this schema:
# {
#     "id": "damage_01",
#     "type": "face" | "edge" | "vertex",
#     "vertices": [int], // The index of the face, the two vertices of the edge, or the single vertex index.
#     "status": "Brokenness" | "Crack",
#     "value": int, // Damage severity from 0 to 5
#     "description": "A detailed descriptive sentence.",
#     "coordinates": {
#         "point": [x, y, z],
#         "xaxis": [1, 0, 0],
#         "yaxis": [0, 1, 0]
#     }
# }
# 
# #### Value Logic (0-5 Scale)
# Assign a value from 0 to 5 based on the specific type of damage identified. Use the "Status" of the damage to determine the scale:
# A. Brokenness (Edges & Corners)
# 	1: Minor – They are slightly rounded/worn rather than sharp.
# 	2: Moderate – Small nicks (under 5mm) along them.
# 	3: Significant – Noticeable chunks missing (5-15mm) from them.
# 	4: Severe – Large loss that clearly alters the silhouette/bounding box of the brick.
# 	5: Critical – Total loss of a corner or an entire edge section (>30mm); brick is no longer a clean cuboid.
# B. Crack (Linear Damage)
# 	1: Minor – Hairline cracks; barely visible, no width.
# 	2: Moderate – Surface cracks; clearly visible but do not seem to penetrate deep.
# 	3: Significant – Open cracks (1-2mm wide); localized to one face.
# 	4: Severe – Deep cracks that wrap around from one face to another.
# 	5: Critical – Full-thickness structural cracks; the brick is at risk of splitting into pieces.
# 
# ### 4. Coordinate Calculation Rules
# - The brick dimensions are 0.25m (x) x 0.12m (y) x 0.065m (z).
# - The origin (0,0,0) is at the center of the brick's base.
# - Face 0 (Top) is at Z = 0.0325.
# - Face 3 (Front) is at Y = -0.06.
# - For "point", estimate the center of the damaged area based on the vertex coordinates provided in the JSON.
# 
# ### 5. Visual Analysis Instructions (Photos are Truth)
# Identify damages (cracks, spalling, coloration) and update the damages dictionary of parts of the assembly inside the JSON. Analyze surface for each visible face, identify "discoloration" (e.g., "white efflorescence/mortar") or "texture" (e.g., "pitted"), analyze edges and corners, look for "brokenness" or "material loss." You will see a reference image with brick key 0, 1 and 2, that correspond to a reference json file. This is your basis for evaluation. See these 3 examples and ensure that new analysis conforms with them. The photos are the primary source of truth. You must be conservative in your judgments.
# 
# ### 6. Output Requirement
# - Return ONLY the raw JSON.
# - The root key must be "updatedModel", containing the entire modified assembly structure.
# Assembly Model Generation with Gemini
# (Without Rotations!)
system_promt_setting_the_rules_10 = Panel("""You are an expert 3D modeler and data architect specializing in the interpretation of historical and technical masonry drawings. Your primary task is to convert these drawings into a precise JSON object representing a 3D assembly.

**CRITICAL OUTPUT INSTRUCTIONS:**
1.  Your entire output MUST be ONLY the raw JSON content.
2.  Do NOT use any markdown formatting like ```json.
3.  Do NOT include any text, explanations, or greetings before or after the JSON block.

**JSON STRUCTURE REQUIREMENTS:**

**1. Root Object:**
The root of the object MUST contain three keys:
- **`objectName`** (string): The name of the assembly (e.g., "Mauerwerksverband").
- **`material`** (string): The default material for all parts in the assembly (e.g., "brick").
- **`parts`** (array): An array of part objects, structured as defined below.

**2. Part Objects (within the `parts` array):**
Each object in the `parts` array represents a single component and MUST have the following keys in this specific order:
- **`id`** (integer): A unique integer identifier for the part, starting from 1.
- **`origin`** (array): A 3-element array of numbers `[x, y, z]` representing the part's center point in meters.
- **`dimensions`** (array): A 3-element array of numbers `[width, depth, height]` representing the part's size in meters along the X, Y, and Z axes, respectively.
- **`connections`** (array): An array of **integers**, where each integer is the `id` of another part to which this part is physically connected.

**COORDINATE SYSTEM (VERY IMPORTANT):**
- The ground plane is the X-Y plane.
- **+Z is UP.** This is the vertical direction.
- **+X is RIGHT.**
- **+Y is BACK.**
- The origin (0,0,0) is at the center of the object's base on the ground.

**ROTATIONS**
- Each part object MUST include a 'rotation' key.
- The 'rotation' key should be an object with x, y, and z keys, representing rotations in radians.
- Use non-zero rotation values for parts that are explicitly described as tilted, angled, or rotated.
- **ROTATION IS APPLIED IN 'ZYX' ORDER:**
    1.  z (Yaw): Rotation around the vertical Z-axis.
    2.  y (Pitch): Rotation around the Y-axis.
    3.  x (Roll): Rotation around the X-axis.""")
run_the_generative_model_now = Button()
this_is_an_optional_text_input_regarding = Panel("generate the brick wall in the image with brick dimensions of 5.2 x 11.5 x 24 cm.")  # "This is an optional text input regarding the assembly model!"
pdf_path_optional = Panel("C:\Users\Tizian Rein\workspace\projects\augmented_repair\data\brick\chapter_brick.pdf")
existing_json_optional = Panel("""{
    "dtype": "assembly_information_model.assembly/Assembly",
    "data": {
        "graph": {
            "attributes": {},
            "default_node_attributes": {
                "x": 0,
                "y": 0,
                "z": 0
            },
            "default_edge_attributes": {},
            "node": {
                "0": {
                    "part": {
                        "dtype": "assembly_information_model.part/Part",
                        "data": {
                            "attributes": {
                                "name": "brick_full",
                                "mesh": {
                                    "dtype": "compas.datastructures/Mesh",
                                    "data": {
                                        "attributes": {},
                                        "default_vertex_attributes": {
                                            "x": 0,
                                            "y": 0,
                                            "z": 0
                                        },
                                        "default_edge_attributes": {},
                                        "default_face_attributes": {},
                                        "vertex": {
                                            "0": {
                                                "x": -0.125,
                                                "y": 0.06,
                                                "z": 0.0325
                                            },
                                            "1": {
                                                "x": -0.125,
                                                "y": -0.06,
                                                "z": 0.0325
                                            },
                                            "2": {
                                                "x": 0.125,
                                                "y": -0.06,
                                                "z": 0.0325
                                            },
                                            "3": {
                                                "x": 0.125,
                                                "y": 0.06,
                                                "z": 0.0325
                                            },
                                            "4": {
                                                "x": -0.125,
                                                "y": 0.06,
                                                "z": -0.0325
                                            },
                                            "5": {
                                                "x": 0.125,
                                                "y": 0.06,
                                                "z": -0.0325
                                            },
                                            "6": {
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""")
gemini_2_5_pro_2 = Python3Script(
    userPrompt=this_is_an_optional_text_input_regarding,
    imagePath=image_path_optional_5,
    apiKey=panel,
    systemPrompt=system_promt_setting_the_rules_10,
    run=run_the_generative_model_now)  # -> error, jsonOutput, model, executionTime; inputs imagePath: String, apiKey: String; disabled
# ---------- gemini_2_5_pro_2: Python ----------
# FINAL SCRIPT - Non-Freezing, One-Click Button (with Full Multi-Modal Support)

import scriptcontext as sc
import google.generativeai as genai
import json
import os
import time
import threading
import System
import Eto  # Required for thread-safe UI callback
from PIL import Image  # Required for image processing

# --- This function triggers a Grasshopper update from the background thread ---
def trigger_gh_update():
    """A callback function to tell Grasshopper to re-run the component."""
    gh_doc = ghenv.Component.OnPingDocument()
    if gh_doc:
        for obj in gh_doc.Objects:
            if obj.InstanceGuid == ghenv.Component.InstanceGuid:
                obj.ExpireSolution(True)
                return

# --- This function runs on a separate, background thread ---
def call_gemini_in_background(apiKey, prompt_parts, pdf_name_to_delete=None):
    """
    Makes the blocking API call, saves the result, cleans up uploaded files,
    and then triggers a Grasshopper UI update.
    """
    try:
        # Configure API within the thread for safety.
        genai.configure(api_key=apiKey)
        # Gemini 1.5 Pro is excellent for complex multi-modal prompts.
        model = genai.GenerativeModel('gemini-2.5-pro')

        print("Background thread: Sending request to Gemini...")
        response = model.generate_content(prompt_parts)
        sc.sticky['api_result'] = response.text
        print("Background thread: Response received.")

    except Exception as e:
        sc.sticky['api_error'] = f"An API error occurred in the background thread: {e}"
        print(f"Background thread: Error - {e}")

    finally:
        # --- CRITICAL: Clean up and delete the uploaded PDF file ---
        if pdf_name_to_delete:
            try:
                print(f"Background thread: Deleting uploaded PDF '{pdf_name_to_delete}'...")
                genai.delete_file(pdf_name_to_delete)
                print("Background thread: PDF deleted successfully.")
            except Exception as e_delete:
                # Log a warning but don't overwrite the main API error.
                delete_warning = f"Warning: Failed to delete uploaded PDF '{pdf_name_to_delete}': {e_delete}"
                print(delete_warning)
                # Append this warning to any existing error.
                if 'api_error' in sc.sticky and sc.sticky['api_error']:
                    sc.sticky['api_error'] += f" | {delete_warning}"
                else:
                    sc.sticky['api_error'] = delete_warning

        # --- VERY IMPORTANT: Trigger the UI update ---
        Eto.Forms.Application.Instance.AsyncInvoke(trigger_gh_update)


# --- Main Script Logic ---

# Initialize sticky variables if they don't exist
if "is_running" not in sc.sticky: sc.sticky['is_running'] = False
if "last_output" not in sc.sticky: sc.sticky['last_output'] = "Ready. Click 'Run' to generate."
if "last_error" not in sc.sticky: sc.sticky['last_error'] = None
if "last_time" not in sc.sticky: sc.sticky['last_time'] = None

# Define Outputs from the last known values
jsonOutput = sc.sticky["last_output"]
error = sc.sticky["last_error"]
executionTime = sc.sticky["last_time"]

# === STATE 1: USER CLICKS THE 'RUN' BUTTON ===
if run and not sc.sticky['is_running']:
    print("Button clicked. Starting generation process.")
    sc.sticky['is_running'] = True
    sc.sticky['api_result'] = None
    sc.sticky['api_error'] = None
    sc.sticky['start_time'] = time.time()

    jsonOutput = "Generating... (This may take a few minutes)"
    error = None
    executionTime = None

    try:
        # --- 1. PREPARE PROMPT AND FILES ON THE MAIN THREAD ---
        if not apiKey:
            raise ValueError("API Key is required.")
        if not any([systemPrompt, userPrompt, imagePath, pdfPath, JSON_or_FilePath]):
            raise ValueError("At least one input (prompt, image, pdf, or json) is required.")

        # Configure API on main thread for file uploads
        genai.configure(api_key=apiKey)

        # --- Construct Text Prompt ---
        full_text_prompt = ""
        if systemPrompt: full_text_prompt += systemPrompt
        if userPrompt: full_text_prompt += "\n\n--- USER REQUEST ---\n" + userPrompt

        # --- Handle Existing JSON (as string or file path) ---
        if JSON_or_FilePath and JSON_or_FilePath.strip():
            json_string = ""
            if os.path.exists(JSON_or_FilePath): # Check if it's a valid path
                try:
                    with open(JSON_or_FilePath, 'r') as f:
                        json_string = f.read()
                    print(f"Loaded JSON from path: {JSON_or_FilePath}")
                except Exception as e:
                    raise ValueError(f"Failed to read file at '{JSON_or_FilePath}': {e}")
            else: # Assume it's a direct JSON string
                json_string = JSON_or_FilePath
            
            try: # Validate the JSON
                json.loads(json_string)
                full_text_prompt += "\n\n--- EXISTING JSON FOR CONTEXT ---\n" + json_string
            except json.JSONDecodeError as e:
                raise ValueError(f"The provided JSON is not valid. Error: {e}")

        prompt_parts_for_api = [full_text_prompt]

        # --- Handle Image Input ---
        if imagePath and imagePath.strip():
            if os.path.exists(imagePath):
                try:
                    prompt_parts_for_api.append(Image.open(imagePath))
                    print(f"Loaded image from path: {imagePath}")
                except Exception as e:
                    raise ValueError(f"Error loading image from '{imagePath}': {e}")
            else:
                raise ValueError(f"Image file not found at path: {imagePath}")

        # --- Handle PDF Input ---
        uploaded_pdf_name = None
        if pdfPath and pdfPath.strip():
            if os.path.exists(pdfPath):
                try:
                    print(f"Uploading PDF: {os.path.basename(pdfPath)}...")
                    uploaded_file = genai.upload_file(path=pdfPath)
                    prompt_parts_for_api.append(uploaded_file)
                    uploaded_pdf_name = uploaded_file.name  # Save name for deletion
                    print(f"PDF '{uploaded_pdf_name}' uploaded successfully.")
                except Exception as e:
                    raise ValueError(f"Error uploading PDF from '{pdfPath}': {e}")
            else:
                raise ValueError(f"PDF file not found at path: {pdfPath}")

        # --- 2. CREATE AND START THE BACKGROUND THREAD ---
        api_thread = threading.Thread(
            target=call_gemini_in_background,
            args=(apiKey, prompt_parts_for_api, uploaded_pdf_name)
        )
        api_thread.daemon = True
        api_thread.start()

    except Exception as e:
        error = f"Error during setup: {e}"
        sc.sticky['is_running'] = False # Reset state on setup error

# === STATE 2: PROCESSING THE RESULT (Triggered by the callback) ===
elif sc.sticky['is_running']:
    if sc.sticky.get('api_result') is not None:
        print("Result found. Processing response.")
        generated_text = sc.sticky['api_result']
        
        # Clean up markdown code fences
        if generated_text.strip().startswith("```json"):
            generated_text = generated_text.strip()[7:-3].strip()
        elif generated_text.strip().startswith("```"):
            generated_text = generated_text.strip()[3:-3].strip()

        try: # Validate and output the JSON
            json.loads(generated_text)
            jsonOutput = generated_text
            error = None
        except json.JSONDecodeError:
            error = "Warning: API response was not valid JSON."
            jsonOutput = generated_text # Output the raw text anyway
            
        executionTime = time.time() - sc.sticky['start_time']
        sc.sticky['is_running'] = False
        print("Processing complete.")

    elif sc.sticky.get('api_error') is not None:
        print("Error found from background thread.")
        error = sc.sticky['api_error']
        jsonOutput = "An error occurred. See 'error' output."
        executionTime = time.time() - sc.sticky.get('start_time', time.time())
        sc.sticky['is_running'] = False
    
    else: # If still running, keep showing the waiting message.
        jsonOutput = "Generating... (This may take a few minutes)"

# === FINAL STEP: PERSIST OUTPUTS ===
sc.sticky["last_output"] = jsonOutput
sc.sticky["last_error"] = error
sc.sticky["last_time"] = executionTime
# ---------- end gemini_2_5_pro_2 ----------

rhino_json_parser = Python3Script(json_text_input=example, rotations=rotations)  # -> log, all_geometries, damage_points
# ---------- rhino_json_parser: Python ----------
import Rhino.Geometry as rg
import json
import math

# --- OUTPUTS ---
# Initialize lists for all outputs.
# These names must match the output parameter names in your Grasshopper component.
all_geometries = []
damage_points = []
log_output = []

# --- INPUTS ---
# Ensure you have an input parameter named 'json_text_input'

# --- SCRIPT ---
if 'json_text_input' not in globals() or not json_text_input:
    log_output.append("Error: Connect a text panel with JSON data to the 'json_text_input' input.")
else:
    try:
        data = json.loads(json_text_input)
        log_output.append("JSON text parsed successfully.")

        # --- DATA STRUCTURE HANDLING ---
        # Check if the new format with 'updatedModel' and 'updatedDamages' is used.
        # Otherwise, fall back to the original format.
        assembly_data = None
        damages_data = None

        if "updatedModel" in data and "updatedDamages" in data:
            log_output.append("Detected new JSON format with 'updatedModel' and 'updatedDamages'.")
            assembly_data = data.get("updatedModel", {})
            damages_data = data.get("updatedDamages", [])
        else:
            log_output.append("Detected original JSON format.")
            assembly_data = data # The whole JSON is the assembly
            damages_data = [] # No damages in the old format

        # --- 1. PROCESS PARTS (BRICKS) ---
        if "parts" in assembly_data and isinstance(assembly_data["parts"], list):
            parent_name = assembly_data.get("objectName", "Unnamed_Assembly")
            log_output.append(f"Processing assembly: {parent_name}")

            for i, part_info in enumerate(assembly_data["parts"]):
                try:
                    part_name = part_info.get("id", f"Part_{i}")
                    origin_data = part_info.get("origin")
                    dims_data = part_info.get("dimensions")

                    if not origin_data or not dims_data:
                        log_output.append(f"Skipping part '{part_name}': Missing 'origin' or 'dimensions' data.")
                        continue
                    
                    # --- COORDINATE SYSTEM ---
                    rhino_x = float(origin_data.get("x", 0.0))
                    rhino_y = float(origin_data.get("y", 0.0))
                    rhino_z = float(origin_data.get("z", 0.0))
                    origin_pt = rg.Point3d(rhino_x, rhino_y, rhino_z)

                    # --- DIMENSION MAPPING (Z-UP) ---
                    width = float(dims_data.get("width", 0.1))
                    depth = float(dims_data.get("depth", 0.1))
                    height = float(dims_data.get("height", 0.1))

                    if width <= 0 or depth <= 0 or height <= 0:
                        log_output.append(f"Warning: Part '{part_name}' has non-positive dimension(s). Skipping.")
                        continue
                    
                    box_plane = rg.Plane.WorldXY
                    box_plane.Origin = origin_pt

                    # --- ROTATION LOGIC (Z-UP, Intrinsic ZYX Order) ---
                    rotation_data = part_info.get("rotation")
                    if rotation_data and isinstance(rotation_data, dict):
                        try:
                            rz_yaw = float(rotation_data.get("z", 0.0))
                            ry_pitch = float(rotation_data.get("y", 0.0))
                            rx_roll = float(rotation_data.get("x", 0.0))
                            
                            if rotations == 1:
                                # Apply rotations intrinsically (Z then new Y then newest X)
                                if rz_yaw != 0: box_plane.Rotate(-rz_yaw, box_plane.ZAxis)
                                if ry_pitch != 0: box_plane.Rotate(-ry_pitch, box_plane.YAxis)
                                if rx_roll != 0: box_plane.Rotate(-rx_roll, box_plane.XAxis)
                            
                            else:
                                # Apply rotations intrinsically (Z then new Y then newest X)
                                if rz_yaw != 0: box_plane.Rotate(rz_yaw, box_plane.ZAxis)
                                if ry_pitch != 0: box_plane.Rotate(ry_pitch, box_plane.YAxis)
                                if rx_roll != 0: box_plane.Rotate(rx_roll, box_plane.XAxis)

                        except (ValueError, TypeError) as e_rot:
                            log_output.append(f"Warning: Could not parse rotation for '{part_name}'. Error: {e_rot}")
                    
                    x_interval = rg.Interval(-width / 2.0, width / 2.0)
                    y_interval = rg.Interval(-depth / 2.0, depth / 2.0)
                    z_interval = rg.Interval(-height / 2.0, height / 2.0)
                    
                    box = rg.Box(box_plane, x_interval, y_interval, z_interval)
                    box_brep = box.ToBrep()
                    all_geometries.append(box_brep)

                except (ValueError, TypeError) as e_val:
                    log_output.append(f"Error processing numeric data for part '{part_info.get('id', 'N/A')}': {e_val}")
                except Exception as e_part:
                    log_output.append(f"General error processing part '{part_info.get('id', 'N/A')}': {e_part}")
            
            log_output.append(f"Finished processing {len(assembly_data['parts'])} parts.")

        # --- 2. PROCESS DAMAGES ---
        if damages_data:
            log_output.append(f"Processing {len(damages_data)} damages.")
            for i, damage_info in enumerate(damages_data):
                try:
                    damage_id = damage_info.get("id", f"Damage_{i}")
                    coords = damage_info.get("coordinates")
                    if not coords:
                        log_output.append(f"Skipping damage '{damage_id}': Missing 'coordinates' data.")
                        continue
                    
                    # Create a Rhino Point3d from the coordinates
                    damage_x = float(coords.get("x", 0.0))
                    damage_y = float(coords.get("y", 0.0))
                    damage_z = float(coords.get("z", 0.0))
                    damage_pt = rg.Point3d(damage_x, damage_y, damage_z)
                    damage_points.append(damage_pt)

                except (ValueError, TypeError) as e_val:
                    log_output.append(f"Error processing numeric data for damage '{damage_info.get('id', 'N/A')}': {e_val}")
                except Exception as e_dam:
                    log_output.append(f"General error processing damage '{damage_info.get('id', 'N/A')}': {e_dam}")
            log_output.append("Finished processing damages.")

    except json.JSONDecodeError as ve:
        log_output.append(f"Error parsing JSON file. Check for syntax errors: {ve}")
    except Exception as e:
        log_output.append(f"An unexpected error occurred: {e}")

# Assign the final log messages to the output parameter
log = "\n".join(log_output)
# ---------- end rhino_json_parser ----------
panel_24 = Panel(rhino_json_parser.log)
custom_preview_6 = CustomPreview(Geometry=rhino_json_parser.all_geometries, Material=ColourSwatch(SwatchColor=RGBA(0, 0, 0, 120)))

gemini_2_5_pro_3 = Python3Script(
    userPrompt=this_is_an_optional_text_input_regarding,
    imagePath=image_path_optional_5,
    existingJson=existing_json_optional,
    apiKey=panel,
    systemPrompt=system_promt_setting_the_rules_10,
    run=Toggle(False))  # -> error, jsonOutput, model, executionTime; inputs imagePath: String, apiKey: String; disabled
# ---------- gemini_2_5_pro_3: Python ----------
import google.generativeai as genai
import json
import os
from PIL import Image # For loading image formats
import time

# --- Inputs from Grasshopper ---
# systemPrompt (string): The detailed instructions for the AI.
# userPrompt (string): The user's specific request (e.g., "create a chair").
# imagePath (string): Optional path to an image file.
# pdfPath (string): Optional path to a PDF file.
# existingJson (string): Optional existing JSON of a model for context or modification.
# apiKey (string): Your Google AI API key.
# run (boolean): Set to True to execute.

jsonOutput = None
error = None
executionTime = None

# Supported file extensions
SUPPORTED_IMAGE_EXTENSIONS = ['.png', '.jpg', '.jpeg', '.webp', '.heic', '.heif']
SUPPORTED_PDF_EXTENSION = '.pdf'

if run:
    startTime = time.time()
    uploaded_pdf_file_resource = None # To store the uploaded file object for later deletion

    # --- 1. Validate Core Inputs ---
    if not apiKey:
        error = "API Key input is missing."
    elif not systemPrompt:
        error = "The 'systemPrompt' input is missing. This is required to instruct the AI."
    # The user must provide at least one task input.
    elif not userPrompt and not imagePath and not pdfPath and not existingJson:
        error = "Input is missing. Please provide a 'userPrompt', 'imagePath', 'pdfPath', 'existingJson', or a combination."
    else:
        try:
            # --- 2. Configure API and Model ---
            genai.configure(api_key=apiKey)
            model = genai.GenerativeModel('gemini-3-pro-preview')

            # --- 3. Conditionally Prepare Prompt Parts ---
            # Combine the system and user prompts into the main text instruction.
            full_text_prompt = systemPrompt
            if userPrompt:
                full_text_prompt += "\n\n--- USER REQUEST ---\n" + userPrompt
            
            # --- Handle Existing JSON Input (if provided) ---
            if not error and existingJson:
                try:
                    # First, validate that the input string is proper JSON
                    json.loads(existingJson)
                    # If valid, append it to the prompt for context
                    full_text_prompt += "\n\n--- EXISTING JSON MODEL FOR CONTEXT/MODIFICATION ---\n" + existingJson
                except json.JSONDecodeError as e:
                    error = f"The 'existingJson' input is not valid JSON. Error: {e}"

            prompt_parts_for_api = [full_text_prompt]

            # --- Handle Image Input (if provided) ---
            if not error and imagePath:
                if os.path.exists(imagePath):
                    image_extension = os.path.splitext(imagePath)[1].lower()
                    if image_extension in SUPPORTED_IMAGE_EXTENSIONS:
                        try:
                            pil_image = Image.open(imagePath)
                            prompt_parts_for_api.append(pil_image)
                        except Exception as e:
                            error = f"Error loading image from path '{imagePath}': {e}"
                    else:
                        error = f"Unsupported image file type: '{image_extension}'."
                else:
                    error = f"Image file not found at path: {imagePath}"
            
            # --- Handle PDF Input (if provided) ---
            if not error and pdfPath:
                if os.path.exists(pdfPath):
                    pdf_extension = os.path.splitext(pdfPath)[1].lower()
                    if pdf_extension == SUPPORTED_PDF_EXTENSION:
                        try:
                            print(f"Uploading PDF: {os.path.basename(pdfPath)}...")
                            uploaded_pdf_file_resource = genai.upload_file(path=pdfPath)
                            prompt_parts_for_api.append(uploaded_pdf_file_resource)
                            print(f"PDF '{uploaded_pdf_file_resource.name}' uploaded successfully.")
                        except Exception as e:
                            error = f"Error uploading/processing PDF from '{pdfPath}': {e}"
                    else:
                        error = f"File at '{pdfPath}' is not a supported PDF file."
                else:
                    error = f"PDF file not found at path: {pdfPath}"


            # --- 4. Make API Call if we have a valid prompt and no blocking errors ---
            if not error:
                print(f"Generating content with {len(prompt_parts_for_api)} parts...")
                response = model.generate_content(prompt_parts_for_api)

                # --- 5. Process the Response ---
                generated_text = response.text

                # Clean up potential markdown formatting
                if generated_text.strip().startswith("```json"):
                    generated_text = generated_text.strip()[7:].strip()
                    if generated_text.strip().endswith("```"):
                        generated_text = generated_text.strip()[:-3].strip()
                elif generated_text.strip().startswith("```"):
                    generated_text = generated_text.strip()[3:].strip()
                    if generated_text.strip().endswith("```"):
                        generated_text = generated_text.strip()[:-3].strip()

                try:
                    json.loads(generated_text)
                    jsonOutput = generated_text
                except json.JSONDecodeError as e_json:
                    error_msg = f"Gemini did not return valid JSON. Error: {e_json}. Response: {generated_text}"
                    error = (error + " | " + error_msg) if error else error_msg
                    jsonOutput = generated_text

        except Exception as e_main:
            api_error_msg = f"An API error occurred: {e_main}"
            error = (error + " | " + api_error_msg) if error else api_error_msg
        
        finally:
            # --- 6. CRITICAL: Clean up and delete the uploaded PDF file ---
            if uploaded_pdf_file_resource:
                try:
                    print(f"Attempting to delete uploaded PDF file: {uploaded_pdf_file_resource.name}...")
                    genai.delete_file(uploaded_pdf_file_resource.name)
                    print(f"PDF file deleted successfully.")
                except Exception as e_delete:
                    delete_warning = f"Warning: Failed to delete uploaded PDF '{uploaded_pdf_file_resource.name}': {e_delete}"
                    print(delete_warning)


    endTime = time.time()
    executionTime = endTime - startTime

    if error and isinstance(error, str):
        error += f" (Time taken: {executionTime:.3f}s)"
    elif error:
        error = str(error) + f" (Time taken: {executionTime:.3f}s)"

else:
    jsonOutput = "Set 'run' to True"

# --- Outputs for Grasshopper ---
if error:
    print("Error:", error)
if jsonOutput:
    print("Output:", jsonOutput)
if executionTime is not None:
    print(f"Execution Time: {executionTime:.3f}s")
# ---------- end gemini_2_5_pro_3 ----------

jsonoutput_6 = Panel(gemini_2_5_pro_3.jsonOutput)
executiontime_4 = Panel(gemini_2_5_pro_3.executionTime)
error_4 = Panel(gemini_2_5_pro_3.error)
model_4 = Panel(gemini_2_5_pro_3.model)

# ---- group: Damages Points
point = Point(rhino_json_parser.damage_points)

# ----
python_3_script_4 = Python3Script(file_content=jsonoutput_6, save=Button())  # -> out, a; unedited script template

panel_25 = Panel(gemini_2_5_pro_3.jsonOutput)
