# Grasshopper definition iaac_workshop_fabrication.ghx (Grasshopper 1.0.8)
# plug-ins: RhinoCodePluginGH, MetaHopper

# ----
# IP Settings
# --> Set your IP address
# --> Set robot IP address
server_ip = ValueList({"192.168.56.45", "192.168.0.67", "192.168.10.12", "192.168.10.11", "192.168.10.10", "192.168.10.2", "127.0.0.1", "192.168.10.111", "192.168.0.45", "192.168.0.30", "10.42.0.212", "10.42.0.133"}, selected="192.168.56.45")
ur_ip = ValueList({"192.168.10.10", "192.168.10.20", "192.168.10.11", "192.168.10.12", "127.0.0.1", "192.168.10.111", "192.168.0.210", "192.168.0.211", "192.168.0.235", "192.168.0.30", "192.168.56.101"}, selected="192.168.56.101")
server_port = ValueList({"50002", "50003", "50005", "50006", "50007", "50008", "50009", "50010", "50011", "50012", "50013", "50014", "50015", "50016", "50017", "50018", "50019", "50020", "50021", "50022", "50023", "50024", "50025", "50026", "50027", "50028"}, selected="50012")
ur_port = ValueList({"30002"}, selected="30002")
globals = Python3Script(server_ip=server_ip, server_port=server_port, ur_ip=ur_ip, ur_port=ur_port, clear=Button())  # inputs server_ip: String, server_port: Int32, ur_ip: String, ur_port: Int32
# ---------- globals: Python ----------
from scriptcontext import sticky as st

st["server_ip"] = server_ip
st["server_port"] = server_port

st["ur_ip"] = ur_ip
st["ur_port"] = ur_port

if clear:
    st.clear()
# ---------- end globals ----------

# ----
# Check if UR robot
#  is available
ping = Button()
ping_2 = Python3Script(ip=ur_ip, ping=ping)  # -> out; inputs ip: String
# ---------- ping_2: Python ----------
from scriptcontext import sticky as st
from ur_fabrication_control.direct_control.utilities import is_available

guid = str(ghenv.Component.InstanceGuid)
txt_key = "txt_" + guid
if txt_key not in st:
    st[txt_key] = ""

if ping:
    
    available = is_available(ip)
    
    if available:
        st[txt_key] = "%s is up!" % ip
        trigger = True
    else:
        st[txt_key] = "%s is down!" % ip
        trigger = False

print(st[txt_key])
# ---------- end ping_2 ----------
panel = Panel(ping_2)

# ----
# ROBOT
button = Button()
py3 = Python3Script()  # -> HERE, DATA, ROBOT_DESCRIPTION
# ---------- py3: Python ----------
import os

HERE = os.path.dirname(ghdoc.Path)
DATA = os.path.abspath(os.path.join(HERE, "..", "data"))
ROBOT_DESCRIPTION = os.path.abspath(os.path.join(DATA, "robot_description"))

print(HERE)
print(DATA)
print(ROBOT_DESCRIPTION)
# ---------- end py3 ----------
reload = Python3Script(reload=button)  # -> out
# ---------- reload: Python ----------
if reload:
    from compas_rhino import unload_modules
    unload_modules("assembly_information_model")
    unload_modules('mobile_robot_control')
    unload_modules('fabrication_manager')
    unload_modules('ur_fabrication_control')
    unload_modules('spaicr')
    unload_modules('workshop_iaac_2026')
# ---------- end reload ----------

# ----
# ROS client
list = ValueList({"local": "127.0.0.1", "iaac linux station": "192.168.56.250", "linux computer": "192.168.0.250", "linux eduroam": "10.181.95.254", "linux ccnet": "192.168.0.102", "linux vmware": "192.168.199.36", "robot": "192.168.0.200", "robotAA_wifi": "192.168.0.111", "robotAB_wifi": "192.168.0.112", "robotAB_eduroam": "10.181.67.95"}, selected="iaac linux station")
connect = BooleanToggle(True)
ros = Python3Script(ip=list, port="9090", connect=connect)  # -> out, ros_client, is_connected; inputs ip: String, port: Int32, connect: Boolean
# ---------- ros: Python ----------
"""
Connect or disconnect to ROS.

COMPAS FAB v0.27.0
"""
from scriptcontext import sticky as st

from compas_fab.backends import RosClient

ros_client = None

ip = ip or '127.0.0.1'
port = port or 9090
key = "ros_client_001"
ros_client = st.get(key, None)

if ros_client:
    st[key].close()
if connect:
    st[key] = RosClient(ip, port)
    st[key].run(5)

ros_client = st.get(key, None)
is_connected = ros_client.is_connected if ros_client else False
# ---------- end ros ----------
panel_2 = Panel(ros.is_connected)

# ----
# Load robot locally
list_2 = ValueList({"rbvogui_xl_ur20", "rbvogui_xl_ur10e", "husky", "husky_ur10e"}, selected="husky_ur10e")
py3_2 = Python3Script()  # -> mobile_robot_data_path, ur_data_path
# ---------- py3_2: Python ----------
import os

"""
ASSUMING THE BELOW PACKAGES ARE STORED IN THE SAME LOCATION:
    ur_fabrication_control;
    rbvogui_common; and
    mobile_additive_manufacturing.
"""

repositories_path = os.path.abspath(os.path.join(ghdoc.Path,"../../../"))

assert os.path.exists(os.path.join(repositories_path, "ur_fabrication_control/data"))
assert os.path.exists(os.path.join(repositories_path, "mobile_robot_control/data"))

ur_data_path = os.path.abspath(os.path.join(ghdoc.Path,"../../../ur_fabrication_control/data"))
mobile_robot_data_path = os.path.abspath(os.path.join(ghdoc.Path,"../../../mobile_robot_control/data"))
# ---------- end py3_2 ----------
py3_3 = Python3Script(mobile_robot_data_path=py3_2.mobile_robot_data_path, ur_data_path=py3_2.ur_data_path, robot_type=list_2)  # -> loaders, urdf_filename, srdf_filename
# ---------- py3_3: Python ----------
import os
from compas_robots import RobotModel
from compas_robots.resources import LocalPackageMeshLoader

import compas_fab

#loaders

ur_path = os.path.join(ur_data_path, "robot_description")
ur_packages = ["ur_e_description", "ur_description"]
ur_loaders = [LocalPackageMeshLoader(ur_path, pck) for pck in ur_packages]

mobile_robot_path = os.path.join(mobile_robot_data_path, "robot_description", robot_type)
if "rbvogui" in robot_type:
    mobile_robot_packages = ["rbvogui_description", "ewellix_description", "robotnik_sensors"]
elif "husky" in robot_type:
    mobile_robot_packages = ["a200"]
mobile_robot_loaders = [LocalPackageMeshLoader(mobile_robot_path, pck) for pck in mobile_robot_packages]

loaders = ur_loaders + mobile_robot_loaders

#files
urdf_filename = os.path.join(mobile_robot_path, r"{}.urdf".format(robot_type))

if "rbvogui" in robot_type:
    srdf_filename = os.path.join(mobile_robot_path, r"rbvogui.srdf")
elif "husky" in robot_type:
    srdf_filename = os.path.join(mobile_robot_path, r"husky.srdf")

assert os.path.isfile(urdf_filename)
assert os.path.isfile(srdf_filename)
# ---------- end py3_3 ----------
units = ValueList({"m": 1, "cm": 100, "mm": 1000}, selected="m")
load = Button()
mobile_robot = Python3Script(
    robot_type=list_2,
    loaders=py3_3.loaders,
    urdf_filename=py3_3.urdf_filename,
    srdf_filename=py3_3.srdf_filename,
    scale_factor=units,
    load=load)  # -> out, mobile_robot; inputs loaders: list
# ---------- mobile_robot: Python ----------
"""
Load robot directly from ROS.

COMPAS FAB v0.27.0
"""
from mobile_robot_control.mobile_robot import MobileRobot
from mobile_robot_control.mobile_robot_client import MobileRobotClient
import compas_robots.ghpython
import compas
from compas.geometry import Rotation
import math

# from ghpythonlib.componentbase import executingcomponent as component
from scriptcontext import sticky as st
import Rhino
import scriptcontext

scriptcontext.doc = Rhino.RhinoDoc.ActiveDoc

from compas_robots import RobotModel
from compas_robots.ghpython.scene import RobotModelObject
from compas_fab.robots import RobotSemantics
from compas.scene import SceneObject

scriptcontext.doc = ghdoc

compas.PRECISION = '12f'

key = 'robot_AA'


print(key)
if load:
    # Load URDF locally
    model = RobotModel.from_urdf_file(urdf_filename)
    model.load_geometry(*loaders)
    try:
        scene_object = SceneObject(item=model)
    except:
        scene_object = RobotModelObject(model)
    semantics = RobotSemantics.from_srdf_file(srdf_filename, model)
    mobile_robot = MobileRobot(model, scene_object, semantics, client=None, offline=True)

    # I am confused!!!!!!!!!!
    
    print(mobile_robot.get_base_link())#group="ur20"
    base_link_frame = mobile_robot.get_base_frame()#group="ur20"
    base_frame = base_link_frame.transformed(Rotation.from_axis_and_angle(base_link_frame.zaxis, math.radians(180), base_link_frame.point))

    mobile_robot._update_RCF(base_frame)

    st[key] = mobile_robot

mobile_robot = st.get(key, None)
# ---------- end mobile_robot ----------
add_client = Python3Script(mobile_robot=mobile_robot.mobile_robot, ros_client=ros.ros_client)  # -> out, mobile_robot
# ---------- add_client: Python ----------
from mobile_robot_control.mobile_robot_client import MobileRobotClient

if ros_client is not None:
    mobile_robot.mobile_client = MobileRobotClient(ros_client)
    #mobile_robot.client = ros_client
# ---------- end add_client ----------

# ----
# Disassembly
# or Reassembly
disassembly = BooleanToggle(True)
import = Button()
path = Python3Script()  # -> out, DATA
# ---------- path: Python ----------
import os
import getpass

username = getpass.getuser()
USER_FOLDER = os.path.abspath(os.path.join("C:/Users/", username))
DATA = os.path.abspath(os.path.join(USER_FOLDER,"workspace/projects/workshop_iaac_2026/data/assembly"))

print(USER_FOLDER)
print(DATA)
# ---------- end path ----------

new = BooleanToggle(True)

robot = Data(add_client.mobile_robot)
info = Python3Script(robot=robot)  # -> out, main_group_name
# ---------- info: Python ----------
if robot:
    robot.info()
    main_group_name = robot.main_group_name
# ---------- end info ----------
panel_3 = Panel(info.out)

reset = Button()
reset_robot = Python3Script(robot=robot, reset=reset)  # -> out
# ---------- reset_robot: Python ----------
import os
from compas.geometry import Frame

if reset:
    # robot.BCF_slam = Frame([
    #         3.006913068852687,
    #         3.0160358483992233,
    #         -1.9073486328125e-05
    #     ],
    #     [
    #         0.9999999999989901,
    #         2.9783522909615563e-07,
    #         1.3896494410682697e-06
    #     ],
    #     [
    #         -2.978328823455311e-07,
    #         0.9999999999985297,
    #         -1.6887356034143998e-06
    #     ])

    robot.motion_enabled = False # whether the mobile robot is moving
    robot.is_aligned = False # whether the WCF_slam (okvis world) is aligned with WCF (rhino world)

    robot.WCF_slam = Frame.worldXY()  # reference (okvis) world coordinate frame in WCF (WCF_slam) 
    robot.BCF_slam = Frame.worldXY()  # (okvis) base coordinate frame in WCF_slam (BCF_slam)
    
    robot.BCF_gt = Frame.worldXY()  # ground truth IsaacSim base coordinate frame in WCF (BCF_gt) 
        
    robot._frame_log = []
    
    robot._update_BCF() # compute initial BCF
    robot._record_state("init") # record initial state


print(robot._frame_log)
# ---------- end reset_robot ----------

# ----
# Attach tool
list_3 = ValueList({"measurement tool": 0, "area gripper": 1, "parallel gripper": 2, "camera": 3, "parallel gripper iaac": 4, "camera iaac": 5}, selected="parallel gripper iaac")
show = BooleanToggle(False)
path_2 = Python3Script()  # -> DATA
# ---------- path_2: Python ----------
import os

package_path = ghdoc.Path
DATA = os.path.abspath(os.path.join(package_path,"../../data"))

print(package_path)
print(DATA)
# ---------- end path_2 ----------
tool = Python3Script(data_path=path_2, tool=list_3, show=show)  # -> tool, M, ee_plane; inputs data_path: String
# ---------- tool: Python ----------
import os, math
from compas.geometry import Frame, Rotation, Vector, Quaternion
from compas.datastructures import Mesh
from compas_rhino.conversions import mesh_to_rhino, frame_to_rhino_plane
from compas_fab.robots import Tool

tolerance = 0

if tool == 0:
    filename = 'measurement_tool_ur20_zaxis.stl'
    #ee_frame = Frame([0, 0, 0], [1, 0, 0], [0, 1, 0])
    ee_frame = Frame([0, 0, 0.122], [1, 0, 0], [0, 1, 0])

elif tool == 1:
    filename = 'vacuum_gripper_ur20_zaxis.stl'
    ee_frame = Frame([0, 0, 0.145 + tolerance], [1, 0, 0], [0, 1, 0])

elif tool == 2:
    filename = 'parallel_gripper_ur20_zaxis.stl'
    # ee_frame = Frame([0, 0, 0.166 + tolerance], [0, -1, 0], [1, 0, 0])
    ee_frame = Frame([0, 0, 0.12 + tolerance], [0, -1, 0], [1, 0, 0])

elif tool == 3:
    filename = 'parallel_gripper_ur20_zaxis.stl'
    # ee_frame = Frame.from_quaternion(Quaternion(0, 0, 0.707106, 0.707106), [0.0175, 0.0572, 0.0850])
    ee_frame = Frame.from_quaternion(Quaternion(0, 0, 0.707106, 0.707106), [0.0325, 0.0572, 0.0815])

elif tool == 4:
    filename = 'parallel_gripper_iaac_zaxis.stl'
    ee_frame = Frame([0, 0, 0.134 + tolerance], [0, -1, 0], [1, 0, 0])

elif tool == 5:
    filename = 'parallel_gripper_iaac_zaxis.stl'
    ee_frame = Frame.from_quaternion(Quaternion(0, 0, 0.707106, 0.707106), [0.0325, 0.0781, 0.0185])

data_path = os.path.join(data_path, "tool_geometry")
fullfilename = os.path.join(data_path, filename)

ee_mesh = Mesh.from_stl(fullfilename)

if show:
    M = mesh_to_rhino(ee_mesh)

tool = Tool(ee_mesh, ee_frame)
ee_plane = frame_to_rhino_plane(ee_frame)
print(ee_frame.quaternion.xyzw)
ee_framek = Frame([0.0110607,0.00809854,0.41498], [0,1,0], [1,0,0])
print(ee_framek.quaternion.xyzw)
# ---------- end tool ----------
remove = Button()
attach = Button()
mesh = Mesh(tool.M)
attach_tool = Python3Script(robot_type=list_2, robot=robot, tool=tool.tool, attach=attach, remove=remove)  # -> tool, M, ee_plane, bang
# ---------- attach_tool: Python ----------
if "husky" in robot_type:
    flange = robot.get_group_names_from_link_name("arm_0_flange")
else:
    flange = robot.get_group_names_from_link_name("robot_arm_flange")

if attach:
    for planning_group in flange:
        robot.attach_tool(tool, group=planning_group)

if remove:
    for planning_group in flange:
        robot.detach_tool(group=planning_group)
# ---------- end attach_tool ----------

# ----
# Move mobile robot base
list_4 = ValueList({"isaac_BCF": isaac, "origin", "set_to_BCF", "set_to_RCF"}, selected="origin")
angle = Slider(0, range=0..360)
origin = Point(Point(12.5, 6, 0))
plane = Python3Script(origin=origin, angle=angle)  # -> plane; inputs origin: Point3d
# ---------- plane: Python ----------
import Rhino.Geometry as rg
import math

plane = rg.Plane(origin, rg.Vector3d.XAxis, rg.Vector3d.YAxis)
plane.Rotate(math.radians(angle), rg.Vector3d.ZAxis)
# ---------- end plane ----------
set_frame = Python3Script(robot=robot, set_frame_to=list_4, target_BCF=plane, target_RCF=plane)  # -> bang; inputs target_BCF: Plane, target_RCF: Plane; disabled
# ---------- set_frame: Python ----------
from compas.geometry import Frame, Point, Vector, Transformation
from compas.datastructures import Mesh
from compas_fab.robots import CollisionMesh
from compas_rhino.conversions import plane_to_compas_frame

if set_frame_to == "set_to_BCF":
    BCF = plane_to_compas_frame(target_BCF)
elif set_frame_to == "set_to_RCF":
    RCF = plane_to_compas_frame(target_RCF)
    BCF = robot.transform_frame_from_RCF_to_BCF(RCF)
else:
    BCF = Frame.worldXY()

if robot and set_frame_to != "isaac_BCF":
    robot.BCF_slam = BCF
# ---------- end set_frame ----------

# ----
# Import Assembly
panel_4 = Panel("reassembly_structure")
import_2 = Python3Script(
    disassembly=disassembly,
    new=new,
    DATA=path.DATA,
    import=import,
    disassembly_name="260223_disassembly_structure",
    assembly_name=panel_4)  # -> out, assembly; inputs DATA: String
# ---------- import_2: Python ----------
import os
import json
from assembly_information_model.assembly import Assembly
from scriptcontext import sticky as st

if _import:
    if disassembly:
        if new:
            assembly = Assembly()
        else:
            filename = disassembly_name + ".json"
            PATH = os.path.join(DATA, filename)
            print(PATH)
            assembly = Assembly.from_json(PATH)
    else:
        filename = assembly_name + ".json"
        PATH = os.path.join(DATA, filename)
        print(PATH)
        assembly = Assembly.from_json(PATH)

    st['building_structure'] = assembly

assembly = st.get('building_structure')
# ---------- end import_2 ----------

# ----
# Import Assembly
panel_5 = Panel("260227_disassembly_stack_1")
import_3 = Python3Script(
    disassembly=disassembly,
    new=new,
    DATA=path.DATA,
    import=import,
    disassembly_name="260223_disassembly_stack_0",
    assembly_name=panel_5)  # -> out, assembly; inputs DATA: String
# ---------- import_3: Python ----------
import os
import json
from assembly_information_model.assembly import Assembly
from scriptcontext import sticky as st

if _import:
    if disassembly:
        if new:
            filename = "material_stack.json"
            PATH = os.path.join(DATA, filename)
            assembly = Assembly.from_json(PATH)
        else:
            filename = disassembly_name + ".json"
            PATH = os.path.join(DATA, filename)
            assembly = Assembly.from_json(PATH)
    else:
        filename = assembly_name + ".json"
        PATH = os.path.join(DATA, filename)
        assembly = Assembly.from_json(PATH)
    
    st['material_stack'] = assembly

assembly = st.get('material_stack')
# ---------- end import_3 ----------

# ----
# Import Assembly
panel_6 = Panel("260223_disassembly_stack_0")
import_4 = Python3Script(disassembly=disassembly, new=new, DATA=path.DATA, import=import, assembly_name=panel_6)  # -> out, assembly; inputs DATA: String
# ---------- import_4: Python ----------
import os
import json
from assembly_information_model.assembly import Assembly
from scriptcontext import sticky as st

if _import:
    if not disassembly:
        filename = assembly_name + ".json"
        PATH = os.path.join(DATA, filename)
        assembly = Assembly.from_json(PATH)  
    st['material_stack_2'] = assembly

assembly = st.get('material_stack_2')
# ---------- end import_4 ----------

# ----
# Transform
toggle = BooleanToggle(False)
pln = Plane(PlaneXY(0.02907808638, -1.103271318, 0))
transform_assembly = Python3Script(assembly=import_3.assembly, ref_plane=pln, transform=toggle)  # -> out, assembly
# ---------- transform_assembly: Python ----------
from compas.geometry import Frame, Transformation, Rotation, Translation
from compas_rhino.conversions import plane_to_compas_frame, point_to_rhino, frame_to_rhino

center_frame = Frame.worldXY()
# center_frame_new = plane_to_compas_frame(center_plane_new)

if transform:
    copy_assembly = assembly.copy()
    # stack_frame = Frame.from_quaternion([0.9659258262, 0,0,-0.2588190], [12.53473,8.91922,0.17])
    stack_frame = Frame.from_quaternion([0.9659258262, 0,0,-0.2588190], [15.7,10.15,0.17])

    # T = Transformation.from_frame_to_frame(center_frame, stack_frame)
    T = Transformation.from_frame_to_frame(center_frame, plane_to_compas_frame(ref_plane))
    

    # Here transform both the frame and planned frame of every brick.
    for key in copy_assembly.part_keys():
        p = copy_assembly.part(key)
        p.frame = p.frame.transformed(T)
        copy_assembly.graph.node_attribute(key, "planned_frame", p.frame)
        print(copy_assembly.graph.node_attribute(key, "planned_frame"))

    assembly = copy_assembly
# ---------- end transform_assembly ----------

# ----
# Transform
toggle_2 = BooleanToggle(True)
pln_2 = Plane(PlaneXY(-0.8940178792, -0.3727373775, 0))
transform_assembly_2 = Python3Script(assembly=import_2.assembly, ref_plane=pln_2, transform=toggle_2)  # -> out, assembly
# ---------- transform_assembly_2: Python ----------
from compas.geometry import Frame, Transformation, Rotation, Translation
from compas_rhino.conversions import plane_to_compas_frame, point_to_rhino, frame_to_rhino

center_frame = Frame.worldXY()
# center_frame_new = plane_to_compas_frame(center_plane_new)

if transform:
    copy_assembly = assembly.copy()
    T = Transformation.from_frame_to_frame(center_frame, Frame([-0.8,-0.3,0.0225],[1,0,0],[0,1,0]))
    #T = Transformation.from_frame_to_frame(center_frame, plane_to_compas_frame(ref_plane))

    # Here transform both the frame and planned frame of every brick.
    for key in copy_assembly.part_keys():
        p = copy_assembly.part(key)
        p.frame = p.frame.transformed(T)
        copy_assembly.graph.node_attribute(key, "planned_frame", p.frame)
        print(copy_assembly.graph.node_attribute(key, "planned_frame"))

    assembly = copy_assembly
# ---------- end transform_assembly_2 ----------

# ----
# Export to JSON
date = Python3Script()  # -> date
# ---------- date: Python ----------
import time
date = (
    str(time.localtime().tm_year)[2:] +
    f"{time.localtime().tm_mon:02d}" +
    f"{time.localtime().tm_mday:02d}"
)

print(date)
# ---------- end date ----------
export = Button()
panel_7 = Panel(date)
export_2 = Python3Script(
    DATA=path.DATA,
    disassembly=disassembly,
    building_structure=transform_assembly_2.assembly,
    material_stack=transform_assembly.assembly,
    material_stack_2=transform_assembly.assembly,
    export=export,
    date=panel_7)  # -> out; inputs date: String
# ---------- export_2: Python ----------
import os

if export: 
    if disassembly:
        type_as = "_disassembly"
    else:
        type_as = "_reassembly"

    stack_filename = date + type_as + "_stack_{}.json".format(material_stack.graph.attributes["stack_key"])
    PATH = os.path.join(DATA, stack_filename)

    # the assembly has to be serialized such that it can be called from CPython
    material_stack.to_json(PATH)

    bench_filename = date + type_as + "_structure.json"
    PATH = os.path.join(DATA, bench_filename)

    # the assembly has to be serialized such that it can be called from CPython
    building_structure.to_json(PATH)

    if material_stack_2:
        stack_filename = date + type_as + "_stack_{}.json".format(material_stack_2.graph.attributes["stack_key"])
        PATH = os.path.join(DATA, stack_filename)

        # the assembly has to be serialized such that it can be called from CPython
        material_stack.to_json(PATH)
# ---------- end export_2 ----------
exportbcflogs = Python3Script(DATA=path.DATA, robot=robot, export=export, name=panel_7)  # -> out
# ---------- exportbcflogs: Python ----------
import os
from compas.geometry import Frame

DATA = os.path.abspath(os.path.join(DATA,"../BCF/"))

if export:
    filename = name + "_BCF.json"
    PATH = os.path.join(DATA, filename)
    
    robot.export_log(PATH)
# ---------- end exportbcflogs ----------

new_2 = BooleanToggle(True)
import_bcf = Python3Script(robot=robot, new=new_2, DATA=path.DATA, import=import, name=panel_7)  # -> bang; inputs DATA: String, name: String
# ---------- import_bcf: Python ----------
import os
import json
from assembly_information_model.assembly import Assembly
from scriptcontext import sticky as st
from compas.geometry import Frame

def translate_to_frame(json_frame):
    compas_frame = Frame(json_frame["point"], json_frame["xaxis"], json_frame["yaxis"])
    return compas_frame

DATA = os.path.abspath(os.path.join(DATA,"../BCF/"))
filename = name + "_BCF.json"
PATH = os.path.join(DATA, filename)
print(PATH)

if _import:
    if not new:
        with open(PATH) as json_data:
            d = json.load(json_data)
            json_data.close()
            
            last_data = d[-1]
            print(last_data)
            # robot.motion_enabled = False # whether the mobile robot is moving
            # robot.is_aligned = False # whether the WCF_slam (okvis world) is aligned with WCF (rhino world)

            # robot.WCF_slam = translate_to_frame(last_data["WCF_slam"]) # reference (okvis) world coordinate frame in WCF (WCF_slam) 
            robot.BCF_slam = translate_to_frame(last_data["BCF_slam"]) # (okvis) base coordinate frame in WCF_slam (BCF_slam)
            # robot.BCF_gt = translate_to_frame(last_data["BCF_gt"])  # ground truth IsaacSim base coordinate frame in WCF (BCF_gt) 
                
            robot._frame_log = []
            for data in d:
                robot._frame_log.append(data)
            
            robot._update_BCF() # compute initial BCF
            # robot._record_state("init") # record initial state
    else:
        robot.BCF_slam = Frame.worldXY()
        robot._frame_log = []
    
        robot._update_BCF() # compute initial BCF
        robot._record_state("init") # record initial state
# ---------- end import_bcf ----------

# ----
# Transform
# Create snapshots
toggle_3 = BooleanToggle(False)
pln_3 = Plane(PlaneXY(0.02907808638, -1.103271318, 0))
transform_assembly_3 = Python3Script(assembly=import_4.assembly, ref_plane=pln_3, transform=toggle_3)  # -> out, assembly; same code as transform_assembly

# ----
# Configurations
unsubscribe = Button()
subscribe = Button()
trigger = Trigger(Interval=5000, TimerInterval=5000, Target=[draw, visualize_3, visualize_2])

# ----
# forward kinematics
number_slider = Slider(-90, range=-180..180)
forward_kinematics = Python3Script(
    robot=robot,
    j1=number_slider,
    j2=Slider(-90, range=-360..360),
    j3=Slider(-90, range=-180..180),
    j4=Slider(-90, range=-400..400),
    j5=Slider(90, range=-125..120),
    j6=Slider(180, range=-400..400))  # -> configuration, arm_configuration
# ---------- forward_kinematics: Python ----------
import math

from compas_robots.model import Joint
from compas_robots import Configuration


if robot:
    joint_types = robot.get_configurable_joint_types()
    joint_names = robot.get_configurable_joint_names()
    # print(joint_names)
    joint_values = [j1, j2, j3, j4, j5, j6]
    for i, joint_value in enumerate(joint_values):
        joint_values[i] = math.radians(joint_values[i])
    
    arm_joint_types = robot.get_configurable_joint_types()
    arm_joint_names = robot.get_configurable_joint_names()
    arm_configuration = Configuration(joint_values, arm_joint_types, arm_joint_names)

    # if len(robot.get_configurable_joints()) == 6:
    #     configuration = Configuration(joint_values, joint_types, joint_names)
    # else:
    #     
    configuration = Configuration(joint_values, joint_types, joint_names)
    print(arm_configuration)
# ---------- end forward_kinematics ----------

# ----
# zero configuration
zero = Python3Script(robot=robot, group=info.main_group_name)  # -> out, configuration; inputs group: String
# ---------- zero: Python ----------
configuration = robot.zero_configuration(group)
# ---------- end zero ----------

list_5 = ValueList({"0 zero_configuration": 0, "1 forward_kinematics": 1, "2 analytic_inverse_kinematics": 2, "3 inverse_kinematics": 3, "4 motion_planning": 4, "5 real_configuration": 5, "6 assembly": 6}, selected="5 real_configuration")
show_robot_collision = BooleanToggle(False)
show_rcf = BooleanToggle(True)

# ----
# Material
# Stack.1
toggle_4 = GroupToggle(ToggleActive=True, ToggleVisible=False)  # disabled

# ----
# Material
# Stack.2
toggle_5 = GroupToggle(ToggleActive=True, ToggleVisible=False)  # disabled

number_slider_2 = Slider(314, range=0..360)
number_slider_3 = Slider(75, range=0..90)
snapshot_poses = Python3Script(snap_radius=Slider(0.5, range=0..1), cam_angle_y=Slider(60, range=0..90), cam_angle_z=Slider(224, range=0..360))  # -> out, closeup_plane
# ---------- snapshot_poses: Python ----------
from compas.geometry import Frame, Translation, Rotation, Vector
from compas_rhino.conversions import frame_to_rhino_plane
import math


snap_frames = []
snap_frame = Frame([snap_radius+0.2, 0, 0], -Vector.Yaxis(), Vector.Zaxis())

snap_frame = snap_frame.transformed(Rotation.from_axis_and_angle(Vector.Yaxis(), math.radians(cam_angle_y)))
snap_frame = snap_frame.transformed(Rotation.from_axis_and_angle(Vector.Zaxis(), math.radians(cam_angle_z)))


closeup_plane = frame_to_rhino_plane(snap_frame)
# ---------- end snapshot_poses ----------

llm_closeup_snaps = Python3Script(snap_radius=Slider(0.19, range=0..1), cam_angle_y=Slider(33, range=0..90), cam_angle_z=Slider(224, range=0..360))  # -> out, closeup_plane
# ---------- llm_closeup_snaps: Python ----------
from compas.geometry import Frame, Translation, Rotation, Vector
from compas_rhino.conversions import frame_to_rhino_plane
import math


snap_frames = []
snap_frame = Frame([snap_radius+0.2, 0, 0], -Vector.Yaxis(), Vector.Zaxis())

snap_frame = snap_frame.transformed(Rotation.from_axis_and_angle(Vector.Yaxis(), math.radians(cam_angle_y)))
snap_frame = snap_frame.transformed(Rotation.from_axis_and_angle(Vector.Zaxis(), math.radians(cam_angle_z)))
snap_frame= snap_frame.transformed(Translation.from_vector(snap_frame.xaxis*0.03))

closeup_plane = frame_to_rhino_plane(snap_frame)
# ---------- end llm_closeup_snaps ----------

list_6 = ValueList({"Global marker snapshot": "global_marker_snapshot", "Stack marker snapshot": "stack_marker_snapshot", "Close-up brick snapshot": "closeup_snapshot", "Pick + Place brick": "pick_place"}, selected="Stack marker snapshot")

snapshot_poses_2 = Python3Script(
    snap_radius=Slider(0.2, range=0..1),
    snap_amount=Slider(12, range=1..12),
    snap_height=Slider(0.3, range=-0.5..1),
    cam_angle_y=Slider(50, range=0..90),
    cam_angle_z=Slider(30, range=0..90))  # -> out, snap_planes; inputs snap_amount: Int32
# ---------- snapshot_poses_2: Python ----------
from compas.geometry import Frame, Translation, Rotation, Vector
from compas_rhino.conversions import frame_to_rhino_plane
import math

snap_angle = math.radians(360 / snap_amount)
snap_frames = []
snap_frame = Frame([snap_radius, 0, 0], -Vector.Xaxis(), Vector.Yaxis())
snap_frame = snap_frame.transformed(Rotation.from_axis_and_angle(snap_frame.yaxis, math.radians(cam_angle_y), snap_frame.point))
snap_frame = snap_frame.transformed(Rotation.from_axis_and_angle(Vector.Zaxis(), math.radians(cam_angle_z), snap_frame.point))

for snap in range(snap_amount):
    R = Rotation.from_axis_and_angle(Vector.Zaxis(), snap_angle*snap)
    T = Translation.from_vector([0, 0, snap_height])
    snap_frames.append(snap_frame.transformed(T*R))

snap_planes = [frame_to_rhino_plane(f) for f in snap_frames]
# ---------- end snapshot_poses_2 ----------

temporary_place_plane = Plane(Plane(origin=(0.1027123119, 0.3738669598, 0.02416992677), x=(0.008531635442, -0.9999636049, 0), y=(-0.9999636049, -0.008531635442, 0)))
list_7 = ValueList({"left", "right"}, selected="left")
list_8 = ValueList({"left", "right"}, selected="left")
evaluate_image = Python3Script(save_msg=Button(), save_img=Button())  # -> out
# ---------- evaluate_image: Python ----------
import numpy as np
from PIL import Image
from scriptcontext import sticky as st
import os
import base64

package_path = ghdoc.Path
DATA = os.path.abspath(os.path.join(package_path, "../../../data/images_evaluation"))
DATA = os.path.abspath("C:/Users/saral/workspace/projects/workshop_iaac_2026/data/images_evaluation")
if save_msg:
    msg = st['img_msg']
    PATH = os.path.join(DATA, "img_array.npy")
    np.save(PATH, msg)

if save_img:
    filename = "stack1_brick1_viewA"
    PATH = os.path.join(DATA, filename + ".npy")
    msg = np.load(PATH, allow_pickle=True).item()


    # --- decode base64 string → bytes ---
    raw_bytes = base64.b64decode(msg['data'])

    # --- convert to numpy ---
    img = np.frombuffer(raw_bytes, dtype=np.uint8)
    img = img.reshape((msg['height'], msg['width'], 3))

    # --- encoding fix (important for RealSense) ---
    if msg['encoding'] == "bgr8":
        img = img[:, :, ::-1]

    image = Image.fromarray(img, 'RGB')
    PATH = os.path.join(DATA,  filename +".jpg")   # ← use jpg filename
    image.save(PATH, "JPEG")
# ---------- end evaluate_image ----------

# ----
# Stop
stop = Button()
stop_2 = Python3Script(stop=stop)
# ---------- stop_2: Python ----------
from scriptcontext import sticky as st
from ur_fabrication_control.direct_control.common import send_stop

ur_ip = st["ur_ip"]
ur_port = st["ur_port"]

if stop:
    send_stop(ur_ip, ur_port)
# ---------- end stop_2 ----------

# ----
# State viewer
trigger_2 = Trigger(Interval=1000, TimerInterval=1000, Target=fabrication_state)
fabrication_state = Python3Script()  # -> out, state, num_tasks, num_current_task, num_tasks_left, log_messages
# ---------- fabrication_state: Python ----------
from scriptcontext import sticky as st

fabrication = st["fabrication"]

if hasattr(fabrication, "task_thread"):
    if fabrication.task_thread.is_alive():
        state = "THREAD RUNNING"
    else:
        state = "THREAD STOPPED"
print(fabrication.current_task_key)
num_tasks = len(fabrication.tasks)
if fabrication.current_task_key is not None:
    num_current_task = fabrication.current_task_key-1
else:
    num_current_task = 0

num_tasks_left = num_tasks-num_current_task
log_messages = fabrication.log_messages

# assembly = st["assembly"]
# ---------- end fabrication_state ----------
state = Panel(fabrication_state.state)
num_current_task = Panel(fabrication_state.num_current_task)
num_tasks = Panel(fabrication_state.num_tasks)
num_tasks_left = Panel(fabrication_state.num_tasks_left)

list_9 = ValueList({"0 scene": 0, "1 object": 1}, selected="0 scene")

# ---- group: update assemblies
bang = Button()

# ----
# Draw assembly
start = Button()
stop_3 = Button()
step = Button()
back = Button()
reset_2 = Button()
full = Button()
list_10 = ValueList({"20", "50", "100", "500", "1000", "5000"}, selected="500")
list_11 = ValueList({"show all": "show_all", "show until key": "show_until_key"}, selected="show all")
counter = Python3Script(
    my_assembly=transform_assembly_3.assembly,
    start=start,
    stop=stop_3,
    step=step,
    step_back=back,
    reset=reset_2,
    full=full,
    interval=list_10)  # -> out, counter
# ---------- counter: Python ----------
from scriptcontext import sticky as st
import Grasshopper

def update_component(ghenv, delay):
    """Schedule an update of the Grasshopper component.

    After the specified delay, the GH component will be automatically updated.

    Parameters
    ----------
    ghenv : :class:`GhPython.Component.PythonEnvironment`
        The current GHPython environment.
    delay : :obj:`int`
        Time in milliseconds until the update is performed.

    Raises
    ------
    ValueError
        If the delay is less than zero.

    """
    if delay <= 0:
        raise ValueError("Delay must be greater than zero")

    ghcomp = ghenv.Component
    ghdoc = ghcomp.OnPingDocument()

    def callback(ghdoc):
        if ghdoc.SolutionState != Grasshopper.Kernel.GH_ProcessStep.Process:
            ghcomp.ExpireSolution(False)

    ghdoc.ScheduleSolution(delay, Grasshopper.Kernel.GH_Document.GH_ScheduleDelegate(callback))

L = range(my_assembly.graph.number_of_nodes())

# store data in component
guid = str(ghenv.Component.InstanceGuid)
counter_key = "counter_" + guid
running_key = "running_" + guid

if counter_key not in st:
    st[counter_key] = 0

if running_key not in st:
    st[running_key] = False
    

if st[running_key]:
    if st[counter_key] < len(L) - 1:
        st[counter_key] += 1
        update_component(ghenv, interval)
    else:
        st[counter_key] = 0
        st[running_key] = False
    
if start:
    st[running_key] = True

if stop:
    st[running_key] = False

if step:
    if st[counter_key] < len(L) - 1:
        st[counter_key] += 1

if step_back:
    if st[counter_key] > 0:
        st[counter_key] -= 1

if reset:
    st[counter_key] = 0
    st[running_key] = False

if full:
    st[counter_key] = len(L)-1

if len(L):
    item = L[st[counter_key]]


#st["visualisation_counter"] = st[counter_key]
counter = st[counter_key] +1
# ---------- end counter ----------
visualize = Python3Script(
    assembly=transform_assembly_3.assembly,
    robot=robot,
    show=list_11,
    highlight_current_part=Toggle(False),
    show_connections=Toggle(False),
    counter=counter.counter,
    bang_2=bang)  # -> out, stack_key, parts_not_built, parts_built, parts_frame, parts_keys, connections, connection_types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; inputs bang_2: list
# ---------- visualize: Python ----------
from compas_rhino.conversions import mesh_to_rhino, box_to_rhino, frame_to_rhino, line_to_rhino, point_to_rhino
from compas.geometry import Line, Transformation, Point, Vector, Frame, Translation

print(assembly)

s = set([p for p in assembly.part_keys()])
i = 1
while i in s:
    i += 1
# assembly.graph.delete_node(74)

#for p in assembly.parts():
#    layer = round(robot.from_RCF_to_BCF(p.frame).point.z/0.08)-1
#    assembly.graph.node_attribute(p.key, "layer", layer)

#get parts datastructure
parts_keys = [p for p in assembly.part_keys()]
parts = [assembly.part(p) for p in parts_keys]
parts_all = []
parts_not_built = []
parts_built = []
parts_frame = []
last_marker_frame = None

if "stack_key" in assembly.graph.attributes.keys():
    stack_key = assembly.graph.attributes["stack_key"]

if "marker_frames_WCF" in assembly.graph.attributes.keys():
    marker_frames_WCF = assembly.graph.attributes["marker_frames_WCF"]
    last_frame_key = max(marker_frames_WCF.keys())
    last_marker_frame = marker_frames_WCF[last_frame_key]
    last_marker_plane = frame_to_rhino(last_marker_frame)

if show == "show_all":
    for key in parts_keys:
        p = assembly.part(key)
        p_frame = p.frame
        if last_marker_frame is not None:
            p_frame = p_frame.transformed(Transformation.from_change_of_basis(last_marker_frame, Frame.worldXY()))
        parts_frame.append(frame_to_rhino(p_frame))
        if assembly.graph.node_attribute(p.key, "built"):
            parts_built.append(mesh_to_rhino(p.mesh.transformed(Transformation.from_frame((p_frame)))))
        else:
            parts_not_built.append(mesh_to_rhino(p.mesh.transformed(Transformation.from_frame((p_frame)))))
   
if show == "show_until_key":
    for p in parts[0:counter]:
        p_frame = p.frame
        if assembly.graph.node_attribute(p.key, "built"):
            parts_built.append(mesh_to_rhino(p.mesh.transformed(Transformation.from_frame((p_frame)))))
        else:
            parts_not_built.append(mesh_to_rhino(p.mesh.transformed(Transformation.from_frame((p_frame)))))
        parts_frame.append(frame_to_rhino(p_frame))

key = counter

if highlight_current_part:
    current_part = assembly.part(key)
    current_part_geometry = mesh_to_rhino(current_part.mesh)
    current_part_frame = frame_to_rhino(current_part.frame)

if show_connections:
    connections = [line_to_rhino(Line(assembly.find_by_key(start).frame).point, robot.from_RCF_to_BCF(assembly.find_by_key(end).frame).point) for start, end in assembly.graph.edges()]
    connection_types = [assembly.graph.edge_attribute(t, "type") for t in assembly.graph.edges()]
    #extract points of the frame of the parts for visulization (+ converted to rhino point)
    parts_points = [point_to_rhino(p.frame.point) for p in assembly.parts()]

parts_keys = [p for p in parts_keys if assembly.graph.node_attribute(p, "available")]
# ---------- end visualize ----------
panel_8 = Panel(visualize.out)
panel_9 = Panel(counter.counter)
geo = Geometry(visualize.parts_not_built)
line = Line(visualize.connections)
geo_2 = Geometry(visualize.parts_built)
pln_4 = Plane(visualize.parts_frame)
pln_5 = Plane(visualize.last_marker_plane)
preview = CustomPreview(Geometry=geo, Material=ColourSwatch(SwatchColor=RGBA(242, 204, 255, 160)))
preview_2 = CustomPreview(Geometry=geo_2, Material=ColourSwatch(SwatchColor=RGBA(210, 83, 252, 216)))
stack_key = Panel(visualize.stack_key)
tag = TextTag(Location=visualize.parts_frame, Text=visualize.parts_keys)
py3_4 = Python3Script(planes=[visualize.parts_frame, visualize.last_marker_plane], scale=Slider(0.1, range=0..1))  # -> P, V, C, W; inputs planes: list of Plane, scale: Double
# ---------- py3_4: Python ----------
from Rhino.Display import ColorRGBA
from ghpythonlib.components import ColourRGBf


red = ColourRGBf(255, 255, 0, 0)
green = ColourRGBf(255, 0, 255, 0)
blue = ColourRGBf(255, 0, 0, 255)

P = []
V = []
C = []

# scale = float(scale)

for plane in planes:
    if not plane:
        continue
    P += [plane.Origin] * 3
    V.append(plane.XAxis * scale)
    V.append(plane.YAxis * scale)
    V.append(plane.ZAxis * scale)
    C += [red, green, blue]

W = 3
# ---------- end py3_4 ----------
curve_preview = CustomCurvePreview(Curve=line, Linetype="Continuous", Colour=ColourSwatch(SwatchColor=RGB(255, 125, 157)))
vdisex = VectorDisplayEx(Point=py3_4.P, Vector=py3_4.V, Colour=py3_4.C, Width=py3_4.W)

# ----
# real robot values
subscribe_2 = Button()
unsubscribe_2 = Button()
unsubscribe_3 = Button()
send = Button()
send_2 = Button()
subscribe_3 = Button()
get_tf_frames = Python3Script(robot=robot, subscribe=subscribe_2, unsubscribe=unsubscribe_2)  # -> pose_frame
# ---------- get_tf_frames: Python ----------
from compas_fab.backends.ros.messages import Header

# header = Header()
# header = header.msg.copy()
# header.pop("seq", None)
# print(header)


from roslibpy import Service, ServiceRequest
from compas.geometry import Point, Frame, Quaternion
from scriptcontext import sticky as st


# if not hasattr(st, "pose_frame"):
#     st["pose_frame"] = None

def _receive_base_frame_callback(message):
    pose_point = Point(
        message["translation"]["x"],
        message["translation"]["y"],
        message["translation"]["z"],
    )
    pose_quaternion = Quaternion(
        message["rotation"]["w"],
        message["rotation"]["x"],
        message["rotation"]["y"],
        message["rotation"]["z"],
    )
    st["pose_frame"] = Frame.from_quaternion(pose_quaternion, pose_point)

if subscribe:
    robot.mobile_client.tf_subscribe(
                    "marker_0", #"base_camera_imu_frame",
                    "robot_base_footprint",
                    _receive_base_frame_callback,
                    timeout=5,
                )

pose_frame = st["pose_frame"]
print(pose_frame)

if unsubscribe:
    robot.mobile_client.tf_unsubscribe(
                    "marker_0", #"base_camera_imu_frame",
                    "robot_base_footprint",
                )
# ---------- end get_tf_frames ----------
get_joint_states = Python3Script(robot=robot, subscribe=subscribe, unsubscribe=unsubscribe)
# ---------- get_joint_states: Python ----------
def _receive_joint_states(message):
    print(message)
    for key, joint_name in enumerate(message.get("name")):
        robot.mobile_client.current_joint_values[joint_name] = message.get("position")[key]

def isaac_joint_states_subscribe(m):
    m.topic_subscribe(
        "/joint_states", "sensor_msgs/JointState", _receive_joint_states
    )

def isaac_joint_states_unsubscribe(m):
    m.topic_unsubscribe("/joint_states")

if subscribe:
    isaac_joint_states_subscribe(robot.mobile_client)

if unsubscribe:
    isaac_joint_states_unsubscribe(robot.mobile_client)
# ---------- end get_joint_states ----------
get_isaac_bcf = Python3Script(robot=robot, subscribe=subscribe_3, unsubscribe=unsubscribe_3)
# ---------- get_isaac_bcf: Python ----------
from compas.geometry import Point, Quaternion, Frame

def _receive_BCF(message):
    print(message)
    pose_point = Point(
            message["position"]["x"],
            message["position"]["y"],
            message["position"]["z"],
        )
    pose_quaternion = Quaternion(
        message["orientation"]["w"],
        message["orientation"]["x"],
        message["orientation"]["y"],
        message["orientation"]["z"],
    )
    BCF = Frame.from_quaternion(pose_quaternion, pose_point)
    robot.BCF = BCF

def isaac_BCF_subscribe(m):
    m.topic_subscribe(
        "/isaac_base_frame", "geometry_msgs/Pose", _receive_BCF
    )

def isaac_BCF_unsubscribe(m):
    m.topic_unsubscribe("/isaac_base_frame")

if subscribe:
    isaac_BCF_subscribe(robot.mobile_client)

if unsubscribe:
    isaac_BCF_unsubscribe(robot.mobile_client)

print(robot.BCF)

robot.mobile_client.topic_unsubscribe(
            "/robot/navigate_to_pose/_action/status")
{'position': {'x': -0.0001697540283203125, 'y': 0.025540828704833984, 'z': -2.2113323211669922e-05}, 'orientation': {'x': 3.620515724480997e-08, 'y': 9.80362316552591e-07, 'z': -1.5274385406631945e-05, 'w': 0.9999999998828654}}
# ---------- end get_isaac_bcf ----------
send_joint_values = Python3Script(robot=robot, config=forward_kinematics.configuration, send=send)  # -> out
# ---------- send_joint_values: Python ----------
import roslibpy
import time

def configuration_to_joint_state_msg(config):
    msg = {
        'name': config.joint_names,
        'position': config.joint_values,
    }
    return msg

def publish_one_time_joint_state(client, config):
    publisher = roslibpy.Topic(client, '/isaac_joint_command', 'sensor_msgs/JointState')
    publisher.publish(configuration_to_joint_state_msg(config))
    print("Published one JointState message.")
    time.sleep(0.5)
    # publisher.unadvertise()

print(config)

if send:
    publish_one_time_joint_state(robot.client, config)


# joint_names = ['robot_ewellix_lift_top_joint',
#                 'robot_arm_shoulder_pan_joint', 
#                'robot_arm_shoulder_lift_joint', 
#                'robot_arm_elbow_joint', 
#                'robot_arm_wrist_1_joint', 
#                'robot_arm_wrist_2_joint', 
#                'robot_arm_wrist_3_joint']
# joint_positions = [0.2, 0.0, 0.0, 0.0, 0.0, 5.0, 0.0]

# msg = {
#     'name': joint_names,
#     'position': joint_positions,
# }
# ---------- end send_joint_values ----------
send_nav_action = Python3Script(robot=robot, send=send_2)  # -> out
# ---------- send_nav_action: Python ----------
import roslibpy
import time


# Create the NavigateToPose action client
action_client = roslibpy.ActionClient(
    robot.mobile_client.ros_client,
    '/robot/navigate_to_pose',
    'nav2_msgs/action/NavigateToPose'
)

print(action_client)
# Create the goal message (same structure as the ROS 2 CLI)
goal = roslibpy.Goal(
    {
        'pose': {
            'header': {
                'frame_id': 'robot_map'
            },
            'pose': {
                'position': {'x': 3.0, 'y': 0.0, 'z': 0.0},
                'orientation': {'x': 0.0, 'y': 0.0, 'z': 0.0, 'w': 1.0}
            }
        }
    }
)

def result_callback(msg):
    print("Action result:" + msg)

def feedback_callback(msg):
    print(f"Action feedback: {msg['sequence']}")

def fail_callback(msg):
    print(f"Action failed: {msg}")

# goal_msg.on('feedback', feedback_callback)

if send:
    print('Sending goal...')
    action_client.send_goal(goal, result_callback, feedback_callback, fail_callback)

# # Wait for result (non-blocking versions also possible)
# result = goal_msg.wait(timeout=60)
# print('Result:', result)
# ---------- end send_nav_action ----------
unsubscribe_4 = Button()
subscribe_4 = Button()
draw = Python3Script(robot=robot, bang=bang)  # -> configuration
# ---------- draw: Python ----------
from compas_robots import Configuration

def get_current_configuration(robot):
    joint_names_ordered = [
        "shoulder_pan_joint",
        "shoulder_lift_joint",
        "elbow_joint",
        "wrist_1_joint",
        "wrist_2_joint",
        "wrist_3_joint",
    ]
    joint_values_ordered = [
        robot.mobile_client.current_joint_values.get(joint_name, 0.0)
        for joint_name in joint_names_ordered
    ]
    joint_names_ordered = ["arm_0_{}".format(joint_name) for joint_name in joint_names_ordered]
    joint_types_ordered = [0, 0, 0, 0, 0, 0]
    return Configuration(
        joint_values_ordered, joint_types_ordered, joint_names_ordered
    )

# print(robot.mobile_client.current_joint_values)
configuration = get_current_configuration(robot)
print(configuration)
# ---------- end draw ----------
panel_10 = Panel(send_nav_action)
panel_11 = Panel(send_joint_values)
panel_12 = Panel(get_tf_frames)
get_topic = Python3Script(robot=robot, subscribe=subscribe_4, unsubscribe=unsubscribe_4)  # -> out
# ---------- get_topic: Python ----------
from compas.geometry import Point, Quaternion, Frame
from scriptcontext import sticky as st


def _receive_message(message):
    print(message)
    st['img_msg'] = message

if subscribe:
    robot.mobile_client.topic_subscribe(
        "/camera/camera/color/image_raw", "sensor_msgs/msg/Image", _receive_message
    )

if unsubscribe:
    robot.mobile_client.topic_unsubscribe("/camera/camera/color/image_raw")
# ---------- end get_topic ----------

# ----
# Get Pose Joint
get = Button()
pose = Python3Script(get=get)  # -> out, configuration, pose_joints
# ---------- pose: Python ----------
from scriptcontext import sticky as st
from ur_fabrication_control.direct_control.common import get_current_pose_joints
from compas.geometry import Frame
from compas_robots import Configuration


server_ip = st["server_ip"]
server_port = st["server_port"]
ur_port = st["ur_port"]
ur_ip = st["ur_ip"]
print(ur_ip)

guid = str(ghenv.Component.InstanceGuid)
pose_joints_key = "pose_joints" + guid

if pose_joints_key not in st:
    st[pose_joints_key] = None

# retrieve the current tool frame in axis angle format
if robot.attached_tool:
    tool_angle_axis = list(robot.attached_tool.frame.point) + list(robot.attached_tool.frame.axis_angle_vector)
else:
    tool0_frame = Frame([0, 0, 0], [1, 0, 0], [0, 1, 0])
    tool_angle_axis = list(tool0_frame.point) + list(tool0_frame.axis_angle_vector)

print(tool_angle_axis)

# send script to the robot to receive the current joint configuration
if get:
    st[pose_joints_key] = get_current_pose_joints(server_ip, server_port, ur_ip, ur_port, tool_angle_axis)

if st[pose_joints_key] is not None:
    print(st[pose_joints_key])
    configuration = Configuration.from_revolute_values(st[pose_joints_key])
    pose_joints = configuration.joint_values
"""
if pose_joints_key not in st:
    configuration = Configuration.from_revolute_values([0,0,0,0,0,0])
else:
    configuration = Configuration.from_revolute_values(st[pose_joints_key])

pose_joints = configuration.values
"""
# ---------- end pose ----------
panel_13 = Panel(pose.pose_joints)

gripper = Python3Script(robot=robot, open=Toggle(True))  # -> out, urscript
# ---------- gripper: Python ----------
from ur_fabrication_control.direct_control.mixins import URScript, URScript_AreaGrip, URScript_ParallelGrip
from compas.geometry import Frame

# retrieve the current tool frame in axis angle format
if robot.attached_tool:
    tool_angle_axis = list(robot.attached_tool.frame.point) + list(robot.attached_tool.frame.axis_angle_vector)
else:
    tool0_frame = Frame([0, 0, 0], [1, 0, 0], [0, 1, 0])
    tool_angle_axis = list(tool0_frame.point) + list(tool0_frame.axis_angle_vector)

urscript = URScript_ParallelGrip()
urscript.start()
urscript.set_tcp(tool_angle_axis)

# urscript.move_tool_by_distance(y_distance=0.008)
if _open:
    urscript.parallelgrip_open()
else:
    urscript.parallelgrip_close()
urscript.end()

urscript = urscript.generate()

print(urscript)
# ---------- end gripper ----------
send_3 = Button()
ur_send = Python3Script(urscript=gripper.urscript, send=send_3)  # -> out
# ---------- ur_send: Python ----------
from scriptcontext import sticky as st
from ur_fabrication_control.direct_control import send_script

ur_ip = st["ur_ip"]
ur_port = st["ur_port"]

if send:
    send_script(urscript, ur_ip, ur_port)
# ---------- end ur_send ----------

# ----
# Draw assembly
start_2 = Button()
stop_4 = Button()
step_2 = Button()
back_2 = Button()
reset_3 = Button()
full_2 = Button()
list_12 = ValueList({"20", "50", "100", "500", "1000", "5000"}, selected="500")
list_13 = ValueList({"show all": "show_all", "show until key": "show_until_key"}, selected="show all")
counter_2 = Python3Script(
    my_assembly=transform_assembly.assembly,
    start=start_2,
    stop=stop_4,
    step=step_2,
    step_back=back_2,
    reset=reset_3,
    full=full_2,
    interval=list_12)  # -> out, counter; same code as counter
visualize_2 = Python3Script(
    assembly=transform_assembly.assembly,
    robot=robot,
    show=list_13,
    highlight_current_part=Toggle(False),
    show_connections=Toggle(False),
    counter=counter_2.counter,
    bang_2=bang)  # -> out, stack_key, parts_not_built, parts_built, parts_frame, parts_keys, connections, connection_types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; inputs bang_2: list
# ---------- visualize_2: Python ----------
from compas_rhino.conversions import mesh_to_rhino, box_to_rhino, frame_to_rhino, line_to_rhino, point_to_rhino
from compas.geometry import Line, Transformation, Point, Vector, Frame, Translation

print(assembly)

s = set([p for p in assembly.part_keys()])
i = 1
while i in s:
    i += 1
# assembly.graph.delete_node(74)

#for p in assembly.parts():
#    layer = round(robot.from_RCF_to_BCF(p.frame).point.z/0.08)-1
#    assembly.graph.node_attribute(p.key, "layer", layer)

#get parts datastructure
parts_keys = [p for p in assembly.part_keys()]
parts = [assembly.part(p) for p in parts_keys]
parts_all = []
parts_not_built = []
parts_built = []
parts_frame = []
last_marker_frame = None

if "stack_key" in assembly.graph.attributes.keys():
    stack_key = assembly.graph.attributes["stack_key"]

if "marker_frames_WCF" in assembly.graph.attributes.keys():
    marker_frames_WCF = assembly.graph.attributes["marker_frames_WCF"]
    last_frame_key = max(marker_frames_WCF.keys())
    last_marker_frame = marker_frames_WCF[last_frame_key]
    last_marker_plane = frame_to_rhino(last_marker_frame)

if show == "show_all":
    for key in parts_keys:
        p = assembly.part(key)
        p_frame = p.frame
        if last_marker_frame is not None:
            p_frame = p_frame.transformed(Transformation.from_change_of_basis(last_marker_frame, Frame.worldXY()))
        parts_frame.append(frame_to_rhino(p_frame))
        if assembly.graph.node_attribute(p.key, "built"):
            parts_built.append(mesh_to_rhino(p.mesh.transformed(Transformation.from_frame((p_frame)))))
        else:
            parts_not_built.append(mesh_to_rhino(p.mesh.transformed(Transformation.from_frame((p_frame)))))
   
if show == "show_until_key":
    for p in parts[0:counter]:
        p_frame = p.frame
        if assembly.graph.node_attribute(p.key, "built"):
            parts_built.append(mesh_to_rhino(p.mesh.transformed(Transformation.from_frame((p_frame)))))
        else:
            parts_not_built.append(mesh_to_rhino(p.mesh.transformed(Transformation.from_frame((p_frame)))))
        parts_frame.append(frame_to_rhino(p_frame))

key = counter

if highlight_current_part:
    current_part = assembly.part(key)
    current_part_geometry = mesh_to_rhino(current_part.mesh)
    current_part_frame = frame_to_rhino(current_part.frame)

if show_connections:
    connections = [line_to_rhino(Line(assembly.find_by_key(start).frame).point, robot.from_RCF_to_BCF(assembly.find_by_key(end).frame).point) for start, end in assembly.graph.edges()]
    connection_types = [assembly.graph.edge_attribute(t, "type") for t in assembly.graph.edges()]
    #extract points of the frame of the parts for visulization (+ converted to rhino point)
    parts_points = [point_to_rhino(p.frame.point) for p in assembly.parts()]
# ---------- end visualize_2 ----------
panel_14 = Panel(visualize_2.out)
geo_3 = Geometry(visualize_2.parts_not_built)
geo_4 = Geometry(visualize_2.parts_built)
line_2 = Line(visualize_2.connections)
preview_3 = CustomPreview(Geometry=geo_4, Material=ColourSwatch(SwatchColor=RGBA(210, 83, 252, 216)))
tag_2 = TextTag(Location=visualize_2.parts_frame, Text=visualize_2.parts_keys)
py3_5 = Python3Script(planes=[visualize_2.parts_frame, visualize_2.last_marker_plane], scale=Slider(0.1, range=0..1))  # -> P, V, C, W; inputs planes: list of Plane, scale: Double; same code as py3_4
curve_preview_2 = CustomCurvePreview(Curve=line_2, Linetype="Continuous", Colour=ColourSwatch(SwatchColor=RGB(255, 125, 157)))
vdisex_2 = VectorDisplayEx(Point=py3_5.P, Vector=py3_5.V, Colour=py3_5.C, Width=py3_5.W)

# ----
# Assembly
# Models
panel_15 = Panel(counter_2.counter)

pln_6 = Plane(visualize_2.last_marker_plane)
pln_7 = Plane(visualize_2.parts_frame)
stack_key_2 = Panel(visualize_2.stack_key)

preview_4 = CustomPreview(Geometry=geo_3, Material=ColourSwatch(SwatchColor=RGBA(242, 204, 255, 160)))

# ----
# Building
# Structure
# Draw assembly
start_3 = Button()
stop_5 = Button()
step_3 = Button()
back_3 = Button()
reset_4 = Button()
full_3 = Button()
list_14 = ValueList({"20", "50", "100", "500", "1000", "5000"}, selected="500")
list_15 = ValueList({"show all": "show_all", "show until key": "show_until_key"}, selected="show all")
counter_3 = Python3Script(
    my_assembly=transform_assembly_2.assembly,
    start=start_3,
    stop=stop_5,
    step=step_3,
    step_back=back_3,
    reset=reset_4,
    full=full_3,
    interval=list_14)  # -> out, counter
# ---------- counter_3: Python ----------
from scriptcontext import sticky as st
import Grasshopper

def update_component(ghenv, delay):
    """Schedule an update of the Grasshopper component.

    After the specified delay, the GH component will be automatically updated.

    Parameters
    ----------
    ghenv : :class:`GhPython.Component.PythonEnvironment`
        The current GHPython environment.
    delay : :obj:`int`
        Time in milliseconds until the update is performed.

    Raises
    ------
    ValueError
        If the delay is less than zero.

    """
    if delay <= 0:
        raise ValueError("Delay must be greater than zero")

    ghcomp = ghenv.Component
    ghdoc = ghcomp.OnPingDocument()

    def callback(ghdoc):
        if ghdoc.SolutionState != Grasshopper.Kernel.GH_ProcessStep.Process:
            ghcomp.ExpireSolution(False)

    ghdoc.ScheduleSolution(delay, Grasshopper.Kernel.GH_Document.GH_ScheduleDelegate(callback))

L = range(my_assembly.graph.number_of_nodes())

# store data in component
guid = str(ghenv.Component.InstanceGuid)
counter_key = "counter_" + guid
running_key = "running_" + guid

if counter_key not in st:
    st[counter_key] = 0

if running_key not in st:
    st[running_key] = False
    

if st[running_key]:
    if st[counter_key] < len(L) - 1:
        st[counter_key] += 1
        update_component(ghenv, interval)
    else:
        st[counter_key] = 0
        st[running_key] = False
    
if start:
    st[running_key] = True

if stop:
    st[running_key] = False

if step:
    if st[counter_key] < len(L) - 1:
        st[counter_key] += 1

if step_back:
    if st[counter_key] > 0:
        st[counter_key] -= 1

if reset:
    st[counter_key] = 0
    st[running_key] = False

if full:
    st[counter_key] = len(L)-1

if len(L):
    item = L[st[counter_key]]


#st["visualisation_counter"] = st[counter_key]
counter = st[counter_key]
# ---------- end counter_3 ----------
visualize_3 = Python3Script(
    assembly=transform_assembly_2.assembly,
    robot=robot,
    show=list_15,
    highlight_current_part=Toggle(False),
    show_connections=Toggle(False),
    counter=counter_3.counter,
    bang_2=bang)  # -> out, parts_built, parts_not_built, parts_frame, parts_keys, connections, connection_types, current_part_geometry, current_part_frame; inputs bang_2: list
# ---------- visualize_3: Python ----------
from compas_rhino.conversions import mesh_to_rhino, box_to_rhino, frame_to_rhino, line_to_rhino, point_to_rhino
from compas.geometry import Line, Transformation, Point, Vector, Frame, Translation, Rotation
import numpy as np

print(assembly)
#get parts datastructure
parts_keys = [p for p in assembly.part_keys()]
parts = [assembly.part(p) for p in parts_keys]
parts_all = []
parts_built = []
parts_not_built = []
parts_anchor = []
parts_frame = []
if show == "show_all":
    for key in parts_keys:
        p = assembly.part(key)
        p_frame = p.frame
        planned_frame = assembly.graph.node_attribute(key, "planned_frame")

        # print(planned_frame)
        if assembly.graph.node_attribute(key, "built"):
            parts_built.append(mesh_to_rhino(p.mesh.transformed(Transformation.from_frame((p_frame)))))
            parts_frame.append(frame_to_rhino(p_frame))
        elif not assembly.graph.node_attribute(key, "built"):
            parts_not_built.append(mesh_to_rhino(p.mesh.transformed(Transformation.from_frame((p_frame)))))
            parts_frame.append(frame_to_rhino(p_frame))
        
        elif planned_frame is not None:
            parts_not_built.append(mesh_to_rhino(p.mesh.transformed(Transformation.from_frame((planned_frame)))))
   
if show == "show_until_key":
    for p in parts[0:counter]:
        p_frame = p.frame
        
        if assembly.graph.node_attribute(p.key, "built"):
            parts_built.append(mesh_to_rhino(p.mesh.transformed(Transformation.from_frame((p_frame)))))
        else:
            parts_not_built.append(mesh_to_rhino(p.mesh.transformed(Transformation.from_frame((p_frame)))))

        parts_frame.append(frame_to_rhino(p_frame))

key = counter

if highlight_current_part:
    current_part = assembly.part(key)
    # print(current_part.shape)
    current_part_geometry = mesh_to_rhino(current_part.mesh)
    current_part_frame = frame_to_rhino(current_part.frame)

if show_connections:
    connections = [line_to_rhino(Line(assembly.find_by_key(start).frame).point, robot.from_RCF_to_BCF(assembly.find_by_key(end).frame).point) for start, end in assembly.graph.edges()]
    connection_types = [assembly.graph.edge_attribute(t, "type") for t in assembly.graph.edges()]
    #extract points of the frame of the parts for visulization (+ converted to rhino point)
    parts_points = [point_to_rhino(p.frame.point) for p in assembly.parts()]

# parts_keys = [p for p in parts_keys if assembly.graph.node_attribute(p, "built")]
# ---------- end visualize_3 ----------
panel_16 = Panel(visualize_3.out)
geo_5 = Geometry(visualize_3.parts_built)
geo_6 = Geometry(visualize_3.parts_not_built)
line_3 = Line(visualize_3.connections)
preview_5 = CustomPreview(Geometry=geo_6, Material=ColourSwatch(SwatchColor=RGBA(242, 145, 145, 155)))
curve_preview_3 = CustomCurvePreview(Curve=line_3, Linetype="Continuous", Colour=ColourSwatch(SwatchColor=RGB(255, 125, 157)))
tag_3 = TextTag(Location=visualize_3.parts_frame, Text=visualize_3.parts_keys)
toggle_6 = GroupToggle(ToggleActive=True, ToggleVisible=False)  # disabled

panel_17 = Panel(counter_3.counter)
pln_8 = Plane(visualize_3.current_part_frame)
py3_6 = Python3Script(planes=visualize_3.parts_frame, scale=Slider(0.1, range=0..1))  # -> P, V, C, W; inputs planes: list of Plane, scale: Double; same code as py3_4
vdisex_3 = VectorDisplayEx(Point=py3_6.P, Vector=py3_6.V, Colour=py3_6.C, Width=py3_6.W)

preview_6 = CustomPreview(Geometry=geo_5, Material=ColourSwatch(SwatchColor=RGBA(252, 45, 45, 216)))

# ----
# analytical inverse kinematics
select_configuration = Slider(5, range=0..7)
plane_2 = Plane(Plane(origin=(0.9254501075, -0.3656901399, 0.904835738), x=(-1, 0, 0), y=(0, 1, 0)))

# ----
# Move Cartesian
list_16 = ValueList({"send one cartesian position": 0, "send all cartesian positions": 1}, selected="send one cartesian position")
filter = StreamFilter(Gate=list_16, Stream0=plane_2)
radius = Slider(0, range=0..0.5)
movel = Python3Script(robot=robot, planes_WCF=filter, velocity=Slider(0.05, range=0..0.5), radius=radius)  # -> urscript; inputs planes_WCF: list of Plane
# ---------- movel: Python ----------
import Rhino.Geometry as rg
from compas.geometry import Frame
from compas.geometry import Transformation, Rotation
from compas_rhino.conversions import plane_to_compas_frame
from ur_fabrication_control import direct_control 
import math

from scriptcontext import sticky as st
from ur_fabrication_control.direct_control import URScript

# retrieve the current tool frame in axis angle format
if robot.attached_tool:
    tool_angle_axis = list(robot.attached_tool.frame.point) + list(robot.attached_tool.frame.axis_angle_vector)
else:
    tool0_frame = Frame([0, 0, 0], [1, 0, 0], [0, 1, 0])
    tool_angle_axis = list(tool0_frame.point) + list(tool0_frame.axis_angle_vector)

frames_RCF = []
for plane_WCF in planes_WCF:
    frame_WCF = plane_to_compas_frame(plane_WCF)
    frame_RCF = robot.from_WCF_to_RCF(frame_WCF)
    pose = frame_RCF.point.__data__ + frame_RCF.axis_angle_vector.__data__
    x = "p[{}, {}, {}, {}, {}, {}]".format(*pose)
    print(x)
    # Transform the frame if the robot is not at WCF. In this case, it is not necessary.
    frames_RCF.append(frame_RCF)

urscript = URScript()
urscript.start()
urscript.set_tcp(tool_angle_axis)
for frame_RCF in frames_RCF:
    urscript.move_linear(frame=frame_RCF, velocity=velocity, radius=radius)
urscript.end()

urscript = urscript.generate()

print(urscript)
# ---------- end movel ----------
send_4 = Button()
ur_send_2 = Python3Script(urscript=movel, send=send_4)  # -> out; same code as ur_send

# ----
# Visualisation
show_collision = BooleanToggle(False)
show_eef = BooleanToggle(True)
show_frames = BooleanToggle(False)
show_visual = BooleanToggle(True)
show_attached_collision = BooleanToggle(False)
show_bcf = BooleanToggle(True)

# ----
# Fabrication manager
list_17 = ValueList({"Global marker snapshot": "global_marker_snapshot", "Stack marker snapshot": "stack_marker_snapshot", "Overview brick snapshot": "overview_snapshot", "Close-up brick snapshot": "closeup_snapshot", "Pick + Place brick": "pick_place", "Receive brick images for evaluation": "receive_images", "Replace brick": "replace"}, selected="Stack marker snapshot")
init = Button()
fabrication = Python3Script(init=init)  # -> fabrication
# ---------- fabrication: Python ----------
from scriptcontext import sticky as st
from fabrication_manager.fabrication import FabricationManager
from assembly_information_model.assembly import Assembly
import os

server_ip = st["server_ip"]
server_port = st["server_port"]

if init_:
    path = os.path.abspath(os.path.join(ghdoc.Path,"../../data/2nd_experiment/fabrication_logs"))
    print(path)
    fabrication = FabricationManager((server_ip, server_port))
    fabrication.path = path
    st["fabrication"] = fabrication

fabrication = st["fabrication"]
# ---------- end fabrication ----------
disassembly_tasks = Python3Script(
    routine=list_17,
    fabrication=fabrication,
    robot=robot,
    plane_WCF=temporary_place_plane,
    snap_planes=snapshot_poses_2.snap_planes,
    closeup_plane=snapshot_poses.closeup_plane,
    ev_closeup_plane=llm_closeup_snaps.closeup_plane,
    config=forward_kinematics.arm_configuration,
    material_stack=transform_assembly.assembly,
    overview_snapshot_side=list_7,
    building_structure=transform_assembly_2.assembly)  # -> out, tasks, pick_key, place_key, target_planes, temp_brick; inputs snap_planes: list of Plane
# ---------- disassembly_tasks: Python ----------
import roslibpy
import time
from fabrication_manager.task import Task
from compas_robots import Configuration
from compas.geometry import Translation, Rotation, Frame, Box, Transformation, Point, Quaternion, Vector, distance_point_point
from compas.datastructures import Mesh
from compas_rhino.conversions import plane_to_compas_frame, frame_to_rhino_plane, box_to_rhino
import numpy as np
import math
from assembly_information_model import Part
import open3d
import random
import os
from scriptcontext import sticky as st
from mobile_robot_control import MoveJointsURdirectTask, MoveLinearURdirectTask
from workshop_iaac_2026 import ChangeToolFrameTask, PickBrickURTask, PlaceBrickURTask, UpdateAssemblyAttributes, GlobalMarkerTask, ScanStackMarkerTask
from workshop_iaac_2026 import ScanAllBricksTask, ScanSingleBrickAddNewTask, CleanBricksTask, TriggerEstimationTask, ReceiveCameraImageTask

ur_ip = st['ur_ip']
ur_port = st['ur_port']
robot_address = (ur_ip, ur_port)
# print(robot_address)

payload, CoG = 1.2, [-0.005, 0.0, 0.052]
payload_brick, CoG_brick = 3.8, [-0.005, 0.0, 0.115]

target_planes = []

box = Box(0.24,0.115,0.045, Frame.worldXY())
a_mesh = box.to_mesh()

closeup_snapshot = plane_to_compas_frame(closeup_plane)
ev_closeup_snapshot = plane_to_compas_frame(ev_closeup_plane)

# Temporary brick position.
temp_frame = plane_to_compas_frame(plane_WCF)
temp_brick = box_to_rhino(box.transformed(Transformation.from_frame(temp_frame)))

if overview_snapshot_side == "left":
    overview_marker_snap_planes = snap_planes[6:7]
else:
    overview_marker_snap_planes = snap_planes[-1:]

left_front_safe_RCF = Frame([0.7, -0.4, 0], Vector.Xaxis(), -Vector.Yaxis())
right_front_safe_RCF = Frame([-0.7, -0.4, 0], Vector.Xaxis(), -Vector.Yaxis())

if "stack_key" not in material_stack.graph.attributes:
    print("Assign new stack key!")
    # material_stack.graph.attributes["stack_key"] = 1

#### This is according to stack and temp frame location to do the robot!!!
if robot.from_WCF_to_RCF(temp_frame).point.x > 0:
    temp_side_safe_RCF = left_front_safe_RCF
else:
    temp_side_safe_RCF = right_front_safe_RCF

# Find the stack's marker's last frame.
last_marker_frame = None
if "stack_key" in material_stack.graph.attributes.keys():
    marker_frames_WCF = material_stack.graph.attributes["marker_frames_WCF"]
    last_frame_key = max(marker_frames_WCF.keys())
    last_marker_frame = marker_frames_WCF[last_frame_key]

if last_marker_frame is not None:
    if robot.from_WCF_to_RCF(last_marker_frame).point.x > 0:
        stack_side_safe_RCF = left_front_safe_RCF
    else:
        stack_side_safe_RCF = right_front_safe_RCF

tasks = []

def select_pick_brick(assembly, tolerance=0.02):
    # Get all built parts
    built_parts = assembly.graph.nodes_where({"built": True})
    if not built_parts:
        return None

    # Collect (part, z, y) triples
    part_coords = [(p, assembly.part(p).frame.point.z, assembly.part(p).frame.point.y) for p in built_parts]

    # Find the maximum z
    max_z = max(z for _, z, _ in part_coords)

    # Filter parts within tolerance of max_z
    close_parts = [(p, y) for p, z, y in part_coords if max_z - z <= tolerance]

    # Choose the one with the highest y
    selected_part = max(close_parts, key=lambda item: item[1])[0]

    return selected_part

def select_place_brick(assembly):
    available_parts = [p for p in assembly.graph.nodes_where({"available": True})]
    if not available_parts:
        return None
    return min(available_parts)

if routine == "global_marker_snapshot":
    tasks = [ChangeToolFrameTask(robot, "gripper")]
    tasks.append(MoveJointsURdirectTask(robot, robot_address, config, velocity=0.1, radius=0.01))

    for snap_plane in overview_marker_snap_planes:
        frame_RCF = plane_to_compas_frame(snap_plane)
        target_planes.append(frame_to_rhino_plane(robot.from_RCF_to_WCF(frame_RCF)))
        tasks.append(MoveLinearURdirectTask(robot, robot_address, frame_RCF, in_RCF=True, velocity=0.1, payload=payload, CoG=CoG))
        tasks.append(GlobalMarkerTask(robot))

elif routine == "stack_marker_snapshot":
    stack_key = material_stack.graph.attributes["stack_key"]
    print(stack_key)
    tasks = [ChangeToolFrameTask(robot, "gripper")]
    tasks.append(MoveJointsURdirectTask(robot, robot_address, config, velocity=0.1, radius=0.01))

    for snap_plane in overview_marker_snap_planes:
        frame_RCF = plane_to_compas_frame(snap_plane)
        target_planes.append(frame_to_rhino_plane(robot.from_RCF_to_WCF(frame_RCF)))
        tasks.append(MoveLinearURdirectTask(robot, robot_address, frame_RCF, in_RCF=True, velocity=0.1))
        tasks.append(ScanStackMarkerTask(robot, material_stack, stack_marker_id="marker_" + str(stack_key), position=0))

elif routine == "overview_snapshot":
    tasks = [ChangeToolFrameTask(robot, "gripper")]
    tasks.append(MoveJointsURdirectTask(robot, robot_address, config, velocity=0.1, radius=0.01))
    tasks.append(CleanBricksTask(robot))

    for snap_plane in snap_planes[8:9]:
        frame_RCF = plane_to_compas_frame(snap_plane)
        target_planes.append(frame_to_rhino_plane(robot.from_RCF_to_WCF(frame_RCF)))
        tasks.append(MoveLinearURdirectTask(robot, robot_address, frame_RCF, in_RCF=True, velocity=0.1))
        tasks.append(TriggerEstimationTask(robot, trigger=True, sleep=10))
        tasks.append(ScanAllBricksTask(robot, assembly=building_structure))
        tasks.append(TriggerEstimationTask(robot, trigger=False, sleep=0))

    tasks.append(TriggerEstimationTask(robot, trigger=False, cuda_off=True, sleep=0))

elif routine == "closeup_snapshot":
    pick_key = select_pick_brick(building_structure)
    pick_frame = building_structure.part(pick_key).frame
    closeup_snapshot_frame = closeup_snapshot.transformed(Transformation.from_frame(pick_frame))
    target_planes.append(frame_to_rhino_plane(closeup_snapshot_frame))

    tasks.append(ChangeToolFrameTask(robot, "camera"))
    tasks.append(CleanBricksTask(robot))
    tasks.append(MoveLinearURdirectTask(robot, robot_address, closeup_snapshot_frame, in_RCF=False, velocity=0.1))
    tasks.append(TriggerEstimationTask(robot, trigger=True, sleep=10))
    tasks.append(ScanSingleBrickAddNewTask(robot, building_structure, pick_key))
    tasks.append(TriggerEstimationTask(robot, trigger=False, sleep=0))

elif routine == "pick_place":
    pick_key = select_pick_brick(building_structure)
    place_key = select_place_brick(material_stack)

    pick_frame = building_structure.part(pick_key).frame.transformed(Translation.from_vector([0,0,0.0225]))
    safe_pick_frame = pick_frame.transformed(Translation.from_vector([0,0,0.2]))
    target_planes.append(frame_to_rhino_plane(safe_pick_frame))

    # Pick tasks.
    tasks.append(ChangeToolFrameTask(robot, "gripper"))
    tasks.append(MoveLinearURdirectTask(robot, robot_address, safe_pick_frame, in_RCF=False, velocity=0.1))
    tasks.append(PickBrickURTask(robot, robot_address, building_structure, pick_key, grip=True))
    tasks.append(MoveLinearURdirectTask(robot, robot_address, safe_pick_frame, in_RCF=False, velocity=0.1))

    target_planes.append(frame_to_rhino_plane(robot.from_RCF_to_WCF(temp_side_safe_RCF)))

    # Safety mid frame.
    tasks.append(MoveLinearURdirectTask(robot, robot_address, temp_side_safe_RCF, in_RCF=True, velocity=0.1))

    safe_temp_place_frame = temp_frame.transformed(Translation.from_vector([0,0,0.2]))
    target_planes.append(frame_to_rhino_plane(safe_temp_place_frame))

    # Place tasks.
    tasks.append(MoveLinearURdirectTask(robot, robot_address, safe_temp_place_frame, in_RCF=False, velocity=0.1))
    tasks.append(PlaceBrickURTask(robot, robot_address))
    tasks.append(MoveLinearURdirectTask(robot, robot_address, safe_temp_place_frame, in_RCF=False, velocity=0.1))

    # Update assemblies.
    tasks.append(UpdateAssemblyAttributes(building_structure, pick_key, attributes={"built":False, "available":False, "place_key":place_key}))
    tasks.append(UpdateAssemblyAttributes(material_stack, place_key, attributes={"pick_key":pick_key, "estimated_frame":pick_frame}))

elif routine == "receive_images":
    place_key = select_place_brick(material_stack)
    stack_key = material_stack.graph.attributes["stack_key"]

    safe_temp_frame = temp_frame.transformed(Translation.from_vector([0,0,0.2]))
    target_planes.append(frame_to_rhino_plane(safe_temp_frame))

    closeup_snapshot_frame = ev_closeup_snapshot.transformed(Transformation.from_frame(temp_frame))
    target_planes.append(frame_to_rhino_plane(closeup_snapshot_frame))
    closeup_snapshot_frame2 = closeup_snapshot_frame.transformed(Rotation.from_axis_and_angle(temp_frame.zaxis, math.radians(180), temp_frame.point))
    target_planes.append(frame_to_rhino_plane(closeup_snapshot_frame2))

    tasks.append(ChangeToolFrameTask(robot, "gripper"))
    tasks.append(MoveLinearURdirectTask(robot, robot_address, safe_temp_frame, in_RCF=False, velocity=0.1))

    tasks.append(ChangeToolFrameTask(robot, "camera"))
    tasks.append(MoveLinearURdirectTask(robot, robot_address, closeup_snapshot_frame, in_RCF=False, velocity=0.1))
    tasks.append(ReceiveCameraImageTask(robot, brick_key=place_key, view="A", stack_key=stack_key))

    tasks.append(ChangeToolFrameTask(robot, "gripper"))
    tasks.append(MoveLinearURdirectTask(robot, robot_address, safe_temp_frame, in_RCF=False, velocity=0.1))

    tasks.append(ChangeToolFrameTask(robot, "camera"))
    tasks.append(MoveLinearURdirectTask(robot, robot_address, closeup_snapshot_frame2, in_RCF=False, velocity=0.1))
    tasks.append(ReceiveCameraImageTask(robot, brick_key=place_key, view="B", stack_key=stack_key))

elif routine == "replace":
    # Pick from temp brick position.
    safe_temp_place_frame = temp_frame.transformed(Translation.from_vector([0,0,0.2]))
    target_planes.append(frame_to_rhino_plane(safe_temp_place_frame))

    tasks.append(ChangeToolFrameTask(robot, "gripper"))
    tasks.append(MoveLinearURdirectTask(robot, robot_address, safe_temp_place_frame, in_RCF=False, velocity=0.1))
    tasks.append(PickBrickURTask(robot, robot_address, grip=True))
    tasks.append(MoveLinearURdirectTask(robot, robot_address, safe_temp_place_frame, in_RCF=False, velocity=0.1))

    # Safety frames.
    target_planes.append(frame_to_rhino_plane(robot.from_RCF_to_WCF(temp_side_safe_RCF)))
    tasks.append(MoveLinearURdirectTask(robot, robot_address, temp_side_safe_RCF, in_RCF=True, velocity=0.1))

    target_planes.append(frame_to_rhino_plane(robot.from_RCF_to_WCF(stack_side_safe_RCF)))
    tasks.append(MoveLinearURdirectTask(robot, robot_address, stack_side_safe_RCF, in_RCF=True, velocity=0.1))

    # Place to stack, and transform place frame with the marker position.
    place_key = select_place_brick(material_stack)

    place_frame = material_stack.part(place_key).frame
    place_frame = place_frame.transformed(Transformation.from_change_of_basis(last_marker_frame, Frame.worldXY()))
    safe_place_frame = place_frame.transformed(Translation.from_vector([0,0,0.2]))
    target_planes.append(frame_to_rhino_plane(safe_place_frame))
    target_planes.append(frame_to_rhino_plane(place_frame))
    
    tasks.append(MoveLinearURdirectTask(robot, robot_address, safe_place_frame, in_RCF=False, velocity=0.1))
    tasks.append(PlaceBrickURTask(robot, robot_address))
    tasks.append(MoveLinearURdirectTask(robot, robot_address, safe_place_frame, in_RCF=False, velocity=0.1))

    # Safety frames.
    tasks.append(MoveLinearURdirectTask(robot, robot_address, stack_side_safe_RCF, in_RCF=True, velocity=0.1))

    # Update assemblies.
    tasks.append(UpdateAssemblyAttributes(material_stack, place_key, attributes={"built":True, "available":False}))
# ---------- end disassembly_tasks ----------
next_task = Button()
reset_task = Button()
prev_task = Button()
reset_5 = Button()
start_fabrication = Button()
stop_fabrication = Button()
panel_18 = Panel(fabrication_state.log_messages)
generate_tasks = Python3Script(
    routine=list_17,
    fabrication=fabrication,
    robot=robot,
    snap_planes=snapshot_poses_2.snap_planes,
    closeup_plane=snapshot_poses.closeup_plane,
    config=forward_kinematics.configuration,
    material_stack=transform_assembly.assembly,
    building_structure=transform_assembly_2.assembly)  # -> out, tasks, target_planes; inputs snap_planes: list of Plane, rotList: list, velList: list, timeInt: list of Double; disabled
# ---------- generate_tasks: Python ----------
import roslibpy
import time
from fabrication_manager.task import Task
from compas_robots import Configuration
from compas.geometry import Translation, Rotation, Frame, Box, Transformation, Point, Quaternion, Vector, distance_point_point
from compas.datastructures import Mesh
from compas_rhino.conversions import plane_to_compas_frame, frame_to_rhino_plane
import numpy as np
import math
from assembly_information_model import Part
import open3d
import random
from scipy.spatial.transform import Rotation as R
from mobile_robot_control.pointcloud_processing.icp import preprocess_point_cloud_icp, evaluate_local_registration, execute_icp_local_registration
from scriptcontext import sticky as st

start_config = Configuration((0.000, 0.000, -1.571, -1.571, -1.571, 1.571, 3.141), (2, 0, 0, 0, 0, 0, 0),
                                ('robot_ewellix_lift_top_joint', 'robot_arm_shoulder_pan_joint', 'robot_arm_shoulder_lift_joint', 'robot_arm_elbow_joint', 'robot_arm_wrist_1_joint', 'robot_arm_wrist_2_joint', 'robot_arm_wrist_3_joint'))
#Configuration((0.000, -5.694, -2.654, -2.008, -0.051, -4.711, -2.551), (2, 0, 0, 0, 0, 0, 0), ('robot_ewellix_lift_top_joint', 'robot_arm_shoulder_pan_joint', 'robot_arm_shoulder_lift_joint', 'robot_arm_elbow_joint', 'robot_arm_wrist_1_joint', 'robot_arm_wrist_2_joint', 'robot_arm_wrist_3_joint'))

# start_config = Configuration((0.000, 5.694, -1.571, -1.571, -1.571, 1.571, 3.141), (2, 0, 0, 0, 0, 0, 0), 
#                                 ('robot_ewellix_lift_top_joint', 'robot_arm_shoulder_pan_joint', 'robot_arm_shoulder_lift_joint', 'robot_arm_elbow_joint', 'robot_arm_wrist_1_joint', 'robot_arm_wrist_2_joint', 'robot_arm_wrist_3_joint'))

target_planes = []

all_zeros = [0,0,0,0]
rotation_values = [rot + all_zeros for rot in rotList]
velocity_values = [all_zeros + vel for vel in velList]

box = Box(0.1,0.1,0.1, Frame.worldXY())
a_mesh = box.to_mesh()

## Tasks ##

class SendNavigationActionTask(Task):
    def __init__(self, robot, target_frame = None, key=None):
        super(SendNavigationActionTask, self).__init__(key)
        self.robot = robot
        self.target_frame = target_frame
        self.result = None
        self.done = False
        self.success = False
        
    def _result_callback(self, msg):
        self.result = msg
        self.done = True
        self.success = True
        
    def _feedback_callback(self, msg):
        self.log(f"Distance remaining: {msg['distance_remaining']}")

    def _fail_callback(self, msg):
        self.result = msg
        self.done = True
        self.success = False
        
    def run(self, stop_thread):
        self.log("Sending target frame as navigation action.")

        action_name = '/robot/navigate_to_pose'
        if action_name not in self.robot.mobile_client.action_clients.keys():
            action_client = roslibpy.ActionClient(
                self.robot.mobile_client.ros_client,
                action_name,
                'nav2_msgs/action/NavigateToPose'
            )
        else:
            action_client = self.robot.mobile_client.action_clients[action_name]

        # Create the goal message
        goal = roslibpy.Goal(
            {
                'pose': {
                    'header': {
                        'frame_id': 'robot_map',
                        'stamp': {
                            'sec': int(time.time()),
                            'nanosec': 0
                        }
                    },
                    'pose': {
                        'position': {'x': 4.5, 'y': 0.0, 'z': 0.0},
                        'orientation': {'x': 0.0, 'y': 0.0, 'z': 0.0, 'w': 1.0}
                    }
                },
                'behavior_tree': ''
            }
        )

        # self.robot.mobile_client.topic_subscribe(
        #                         "/robot/navigate_to_pose/_action/status",
        #                         "action_msgs/msg/GoalStatusArray",
        #                         self._status_callback
        #                     )

        self.log('Sending goal...')
        goal_id = action_client.send_goal(goal, self._result_callback, self._feedback_callback, self._fail_callback)

        while not stop_thread():
            if self.success or self.done:
                break
            time.sleep(0.1)
        
        self.log(f"Action result: {self.result}")

        # self.robot.mobile_client.topic_unsubscribe(
        #     "/robot/navigate_to_pose/_action/status")

        self.is_completed = True
        return True

class TriggerEstimationTask(Task):
    def __init__(self, robot, trigger=True, cuda_off=False, sleep=0, key=None):
        super(TriggerEstimationTask, self).__init__(key)
        self.robot = robot
        self.trigger = trigger
        self.cuda_off = cuda_off
        self.sleep = sleep
        
    def run(self, stop_thread):
        self.log('Estimation is set to {}!'.format(self.trigger))
        if self.cuda_off:
            service_name = '/trigger_pose_complete'
        else:
            service_name = '/trigger_pose'

        while not stop_thread():
            if self.robot.mobile_client.is_service_available(service_name):
                result = self.robot.mobile_client.service_call(service_name, 'std_srvs/SetBool', {'data': self.trigger})
                success = result['success']
                message = result['message']
                self.log('Activation message: {}'.format(message))
                if success:
                    break
            else:
                self.log("Trigger for estimation service is not available.")
                break
            time.sleep(0.1)

        self.log("Sleeping for {} seconds...".format(str(self.sleep)))
        time.sleep(self.sleep)

        self.is_completed = True
        return True

class CleanBricksTask(Task):
    def __init__(self, robot, key=None):
        super(CleanBricksTask, self).__init__(key)
        self.robot = robot
        
    def run(self, stop_thread):
        self.log('CleanBricksTask')
        service_name = '/clean_bricks'

        while not stop_thread():
            if self.robot.mobile_client.is_service_available(service_name):
                result = self.robot.mobile_client.service_call(service_name, 'std_srvs/SetBool', {'data': True})
                success = result['success']
                message = result['message']
                self.log('Activation message: {}'.format(message))
                if success:
                    break
            else:
                self.log("Clean bricks service is not available.")
                break
            time.sleep(0.1)

        self.is_completed = True
        return True

class ScanBricksTask(Task):
    def __init__(self, robot, reference_frame_id="robot_arm_base", key=None):
        super(ScanBricksTask, self).__init__(key)
        self.robot = robot
        self.reference_frame_id = reference_frame_id

    def get_detected_bricks(self, stop_thread):
        self.log("Scanning bricks...")
        brick_dict = {}

        # Ask for estimated brick ids.
        while not stop_thread():
            self.log('Asking for the brick amount...')
            result = self.robot.mobile_client.service_call('/brick_amount', 'std_srvs/SetBool', {'data': True})
            if result['success']:
                brick_amount = int(result['message'])
                self.log("Brick amount is {}".format(brick_amount))
                break
            time.sleep(0.1)

        brick_list = [i for i in range(brick_amount)]

        # One by one get the frames of the bricks in the list.
        if len(brick_list) == 0:
            self.log('No bricks estimated.')
        else:
            for brick_id in brick_list:
                self.log('Receiving the frame for brick: {}'.format(brick_id))
                pose = None

                self.robot.mobile_client.clean_tf_frame()
                time.sleep(0.5)
                self.robot.mobile_client.tf_subscribe("brick_" + str(brick_id), self.reference_frame_id)

                time_limit = 10
                start_time = time.time()
                left_time = 10
                # Wait until pose is received.
                while not stop_thread() and left_time > 0:
                    if self.robot.mobile_client.tf_frame is not None:
                        pose = Frame(self.robot.mobile_client.tf_frame.point, 
                                        Vector(self.robot.mobile_client.tf_frame.xaxis.x,self.robot.mobile_client.tf_frame.xaxis.y),
                                        Vector(self.robot.mobile_client.tf_frame.yaxis.x, self.robot.mobile_client.tf_frame.yaxis.y)) # Correcting to the ground.
                        # Force brick frames to be same direction - xaxis to the robot.
                        if pose.xaxis.x > 0:
                            pose = pose.transformed(Rotation.from_axis_and_angle(pose.zaxis, math.radians(180), pose.point))
                        break
                    time.sleep(0.1)
                    left_time = time_limit - (time.time() - start_time)

                if pose is None:
                    self.log('For brick with id {}, could not get the frame.'.format(brick_id))
                else:
                    # Transform to BCF_slam.
                    pose = self.robot.from_RCF_to_BCF(pose)
                    brick_dict[brick_id] = pose
                    self.log('For brick with id {}, got the pose: {}'.format(brick_id, pose))
        
                self.robot.mobile_client.tf_unsubscribe("brick_" + str(brick_id), self.reference_frame_id)

        self.log("Scanning completed.")

        return brick_dict

    def run(self, stop_thread):
        brick_dict = self.get_detected_bricks(stop_thread)
        self.is_completed = True
        return True
        
class ScanAllBricksTask(ScanBricksTask):
    def __init__(self, robot, stack_assembly, structure_assembly, stack=True, key=None):
        super(ScanAllBricksTask, self).__init__(robot, key=key)
        self.stack_assembly = stack_assembly
        self.structure_assembly = structure_assembly
        self.stack = stack
        self.brick_shape = Box(xsize=0.24, ysize=0.115, zsize=0.05)

        # def check_brick_layer(self, pose):
        #     pose_BCF = self.robot.from_RCF_to_BCF(pose)
        #     layer_decimal = pose_BCF.point.z / 0.05
        #     if layer_decimal > (math.floor(layer_decimal) + 0.6):
        #         layer = math.floor(layer_decimal)
        #     else:
        #         layer = math.floor(layer_decimal) - 1
        #     return layer
    
    def find_next_available_key(self, assembly):
        s = set([p for p in assembly.part_keys()])
        i = 1
        while i in s:
            i += 1
        return i

    def run(self, stop_thread):
        time.sleep(2)
        brick_dict = self.get_detected_bricks(stop_thread)
        self.log("Registering all bricks...")

        if self.stack:
            assembly_target = self.stack_assembly
        else:
            assembly_target = self.structure_assembly

        # Make seperation if pose is in front of robot, belongs to "building structure", if behind, to "material stack".
        for brick_id, pose in brick_dict.items():
            # Decide assembly target
            # if pose.point.x > 0.4:
            #     stack = False
            #     assembly_target = self.structure_assembly
            #     self.log("This is a brick for the building structure.")
            # else:
            #     stack = True
            #     assembly_target = self.stack_assembly
            #     self.log("This is a brick for the material stack.")

            pose_BCF = pose
            pose = self.robot.from_BCF_to_WCF(pose) # Pre-alignment it is same with from_BCF_slam_to_WCF_slam() cause WCF_slam is World.XY()
            
            target_key = None
            # Compare the pose to each pose in assembly by seeing the distance.
            closest_distance = 0.05
            for key in assembly_target.graph.nodes():
                distance = distance_point_point(assembly_target.part(key).frame.point, pose.point)
                if distance < closest_distance:
                    self.log("Distance is {}".format(distance))
                    self.log("Brick {} is the same as id {}".format(key, brick_id))
                    closest_distance = distance
                    target_key = key
                    
            # Create a new element.
            if target_key is None:
                # Create *new* brick entry.
                key = self.find_next_available_key(assembly_target) #assembly_target.graph.number_of_nodes() + 2
                brick = Part()
                brick.shape = self.brick_shape
                brick.mesh = Mesh.from_shape(self.brick_shape)
                brick.frame = pose.copy()
                assembly_target.add_part(
                    brick,
                    key=key,
                    estimated_frame=pose.copy(),
                    estimated_frame_BCF=pose_BCF.copy(),
                    initial_estimated_frame=pose.copy(),
                    initial_estimated_frame_BCF=pose_BCF.copy(),
                )

                self.log("Creating a new brick key {} with frame {}".format(key, pose_BCF))

                if self.stack:
                    assembly_target.graph.node_attribute(key, 'available', True)
                    assembly_target.graph.node_attribute(key, 'built', True)
                else:
                    assembly_target.graph.node_attribute(key, 'available', False)
                    assembly_target.graph.node_attribute(key, 'built', True)
                    if not self.robot.is_aligned:
                        assembly_target.graph.node_attribute(key, 'temporary', True)

                # # Add a collision mesh.
                # if self.scene != None:
                #     pose_WCF = self.robot.from_RCF_to_BCF(pose)
                #     collision_mesh = CollisionMesh(brick.mesh.transformed(Transformation.from_frame(pose_WCF)), str(brick_key))
                #     self.scene.add_collision_mesh(collision_mesh)
                #     self.log("Added a collision mesh.")

            elif target_key is not None:
                self.log("Updating the pose of the brick key {}".format(target_key))
                # Update existing element.
                assembly_target.find_by_key(target_key).frame = pose.copy()
                assembly_target.graph.node_attribute(target_key, 'estimated_frame', pose.copy())
                assembly_target.graph.node_attribute(target_key, 'estimated_frame_BCF', pose_BCF.copy())
                assembly_target.graph.node_attribute(target_key, 'initial_estimated_frame', pose.copy())
                assembly_target.graph.node_attribute(target_key, 'initial_estimated_frame_BCF', pose_BCF.copy())

                # # Append a collision mesh.
                # if self.scene != None:
                #     pose_WCF = self.robot.from_RCF_to_BCF(pose)
                #     collision_mesh = CollisionMesh(self.assembly.find_by_key(brick_key).mesh.transformed(Transformation.from_frame(pose_WCF)), str(brick_key))
                #     self.scene.remove_collision_mesh(str(brick_key))
                #     self.scene.add_collision_mesh(collision_mesh)
                #     self.log('Updated collision mesh with key {}.'.format(brick_key))
                        
        self.log("Registered all bricks...")
        self.is_completed = True
        return True

class ScanSingleBrickAddNewTask(ScanBricksTask):
    def __init__(self, robot, assembly, brick_key_to_update, average=False, key=None):
        super(ScanSingleBrickAddNewTask, self).__init__(robot, key=key)
        self.assembly = assembly
        self.brick_key_to_update = brick_key_to_update
        self.average = average

        self.brick_shape = Box(xsize=0.24, ysize=0.115, zsize=0.05)

    def find_next_available_key(self, assembly):
        s = set([p for p in assembly.part_keys()])
        i = 1
        while i in s:
            i += 1
        return i

    def run(self, stop_thread):
        brick_dict = self.get_detected_bricks(stop_thread)

        self.log("Updating only the brick {}...".format(self.brick_key_to_update))

        for brick_id, pose in brick_dict.items():
            pose_BCF = pose
            pose = self.robot.from_BCF_to_WCF(pose) # Pre-alignment it is same with from_BCF_slam_to_WCF_slam() cause WCF_slam is World.XY()
            
            target_key = None
            # Compare the pose to each pose in assembly by seeing the distance.
            closest_distance = 0.1
            for key in self.assembly.graph.nodes():
                distance = distance_point_point(self.assembly.part(key).frame.point, pose.point)
                if distance < closest_distance:
                    self.log("Distance is {}".format(distance))
                    self.log("Brick {} is the same as id {}".format(key, brick_id))
                    closest_distance = distance
                    target_key = key
                    
            # Create a new element.
            if target_key is None:
                # Create *new* brick entry.
                key = self.find_next_available_key(self.assembly) #self.assembly.graph.number_of_nodes() + 3
                brick = Part()
                brick.shape = self.brick_shape
                brick.mesh = Mesh.from_shape(self.brick_shape)
                brick.frame = pose.copy()
                self.assembly.add_part(
                    brick,
                    key=key,
                    estimated_frame=pose.copy(),
                    estimated_frame_BCF=pose_BCF.copy(),
                    initial_estimated_frame=pose.copy(),
                    initial_estimated_frame_BCF=pose_BCF.copy(),
                    available=True,
                    built=True
                )

                self.log("Creating a new brick key {} with frame {}".format(key, pose_BCF))

            # dist = distance_point_point(self.assembly.part(self.brick_key_to_update).frame.point, pose.point)
            # if dist < closest_distance:
            #     closest_distance = dist
            #     target_key = brick_id

            elif target_key == self.brick_key_to_update:
                self.log("Updating the pose of the brick key {} with id {}".format(self.brick_key_to_update, brick_id))

                if self.average:
                    current_pose = self.assembly.part(self.brick_key_to_update).frame
                    # find average:
                    average_pose = average_frame(current_pose, pose)
                    pose = average_pose
                    pose_BCF = self.robot.from_WCF_to_BCF(pose)
                    self.log("I took average.")

                part = self.assembly.part(self.brick_key_to_update)
                part.frame = pose.copy()
                self.assembly.graph.node_attribute(self.brick_key_to_update, 'estimated_frame', pose.copy())
                self.assembly.graph.node_attribute(self.brick_key_to_update, 'estimated_frame_BCF', pose_BCF.copy())

                # # Append a collision mesh.
                # if self.scene != None:
                #     pose_WCF = self.robot.from_RCF_to_BCF(pose)
                #     collision_mesh = CollisionMesh(self.assembly.find_by_key(brick_key).mesh.transformed(Transformation.from_frame(pose_WCF)), str(brick_key))
                #     self.scene.remove_collision_mesh(str(brick_key))
                #     self.scene.add_collision_mesh(collision_mesh)
                #     self.log('Updated collision mesh with key {}.'.format(brick_key))
            else:
                self.log("Not updating existing bricks other than {}.".format(self.brick_key_to_update))
                
        self.is_completed = True
        return True

class ScanSingleBrickTask(ScanBricksTask):
    def __init__(self, robot, assembly, brick_key_to_update, frame_attribute=None, average=False, key=None):
        super(ScanSingleBrickTask, self).__init__(robot, key=key)
        self.assembly = assembly
        self.brick_key_to_update = brick_key_to_update
        self.frame_attribute = frame_attribute
        self.average = average

        self.brick_shape = Box(xsize=0.24, ysize=0.115, zsize=0.05)
    
    def slerp_quat(self, q1, q2, t):
        q1 = q1 / np.linalg.norm(q1)
        q2 = q2 / np.linalg.norm(q2)
        dot = np.dot(q1, q2)
        if dot < 0.0:
            q2 = -q2
            dot = -dot
        if dot > 0.9995:
            q = q1 + t * (q2 - q1)
            return q / np.linalg.norm(q)
        theta_0 = np.arccos(dot)
        theta = theta_0 * t
        q3 = q2 - q1 * dot
        q3 = q3 / np.linalg.norm(q3)
        return q1 * np.cos(theta) + q3 * np.sin(theta)

    def average_frame(self, frame_a, frame_b):
        # --- Average position ---
        p = Point(
            0.5 * (frame_a.point.x + frame_b.point.x),
            0.5 * (frame_a.point.y + frame_b.point.y),
            0.5 * (frame_a.point.z + frame_b.point.z),
        )

        # --- Average orientation via SLERP ---
        R_a = Rotation.from_frame(frame_a)
        R_b = Rotation.from_frame(frame_b)

        qa = np.array(R_a.quaternion)
        qb = np.array(R_b.quaternion)

        q_avg = self.slerp_quat(qa, qb, 0.5)
        R_avg = Rotation.from_quaternion(q_avg)

        # --- Build averaged frame ---
        avg_frame = Frame.from_rotation(R_avg)
        avg_frame.point = p
        return avg_frame

    def run(self, stop_thread):
        brick_dict = self.get_detected_bricks(stop_thread)

        self.log("Updating only the brick {}...".format(self.brick_key_to_update))

        # Compare the pose to each pose in assembly by seeing the distance.
        target_key = None
        closest_distance = 0.1

        for brick_id, pose in brick_dict.items():
            pose_BCF = pose
            pose = self.robot.from_BCF_to_WCF(pose) # Pre-alignment it is same with from_BCF_slam_to_WCF_slam() cause WCF_slam is World.XY()

            dist = distance_point_point(self.assembly.part(self.brick_key_to_update).frame.point, pose.point)
            if dist < closest_distance:
                closest_distance = dist
                target_key = brick_id

        if target_key is None:
            self.log(f"No match found for brick {self.brick_key_to_update}")
        # Update pose
        else:
            self.log("Updating the pose of the brick key {} with id {}".format(self.brick_key_to_update, target_key))
            pose_BCF = brick_dict[target_key]
            pose = self.robot.from_BCF_to_WCF(brick_dict[target_key])

            if self.average:
                if self.frame_attribute is not None:
                    current_pose = self.assembly.graph.node_attribute(self.brick_key_to_update, self.frame_attribute)
                else:
                    current_pose = self.assembly.part(self.brick_key_to_update).frame
                # find average:
                average_pose = self.average_frame(current_pose, pose)
                pose = average_pose
                pose_BCF = self.robot.from_WCF_to_BCF(pose)
            
            part = self.assembly.part(self.brick_key_to_update)
            part.frame = pose.copy()

            if self.frame_attribute is not None:
                self.assembly.graph.node_attribute(self.brick_key_to_update, self.frame_attribute, pose.copy())
                self.assembly.graph.node_attribute(self.brick_key_to_update, self.frame_attribute + '_BCF', pose_BCF.copy())

            # # Append a collision mesh.
            # if self.scene != None:
            #     pose_WCF = self.robot.from_RCF_to_BCF(pose)
            #     collision_mesh = CollisionMesh(self.assembly.find_by_key(brick_key).mesh.transformed(Transformation.from_frame(pose_WCF)), str(brick_key))
            #     self.scene.remove_collision_mesh(str(brick_key))
            #     self.scene.add_collision_mesh(collision_mesh)
            #     self.log('Updated collision mesh with key {}.'.format(brick_key))
                
        self.is_completed = True
        return True

class AlignmentTask(Task):
    def __init__(self, robot, structure_assembly, realignment=False, key=None):
        super(AlignmentTask, self).__init__(key)
        self.robot = robot
        self.structure_assembly = structure_assembly
        self.realignment = realignment

    def assembly_to_frames_and_points(self, assembly, key_list=[], attribute=None):
        frames = []
        points = []
        for key in key_list:
            if attribute is None:
                main_frame = assembly.part(key).frame
            else:
                main_frame = assembly.graph.node_attribute(key, attribute)
            frames.append(main_frame)
            points.append(main_frame.point)
            corners = assembly.part(key).shape.points
            for c in corners:
                points.append(c.transformed(Transformation.from_frame(main_frame)))
        return frames, points

    def slerp_quat(self, q1, q2, t):
        q1 = q1 / np.linalg.norm(q1)
        q2 = q2 / np.linalg.norm(q2)
        dot = np.dot(q1, q2)
        if dot < 0.0:
            q2 = -q2
            dot = -dot
        if dot > 0.9995:
            q = q1 + t * (q2 - q1)
            return q / np.linalg.norm(q)
        theta_0 = np.arccos(dot)
        theta = theta_0 * t
        q3 = q2 - q1 * dot
        q3 = q3 / np.linalg.norm(q3)
        return q1 * np.cos(theta) + q3 * np.sin(theta)

    def kabsch_wahba_alignment(self, frames_src, frames_tgt, w_orient=1.0):
        # if len(frames_src) != len(frames_tgt):
        #     self.log("Need ≥3 frame correspondences")
        #     return None, None, None

        positions_src, positions_tgt, quats_src, quats_tgt = [], [], [], []
        for f_src, f_tgt in zip(frames_src, frames_tgt):
            positions_src.append(f_src.point)
            positions_tgt.append(f_tgt.point)
            Rs = np.column_stack([f_src.xaxis, f_src.yaxis, f_src.zaxis])
            Rt = np.column_stack([f_tgt.xaxis, f_tgt.yaxis, f_tgt.zaxis])
            quats_src.append(R.from_matrix(Rs).as_quat())
            quats_tgt.append(R.from_matrix(Rt).as_quat())

        positions_src = np.array(positions_src)
        positions_tgt = np.array(positions_tgt)
        quats_src = np.array(quats_src)
        quats_tgt = np.array(quats_tgt)

        # 1. Position alignment
        Pc, Qc = positions_src - positions_src.mean(axis=0), positions_tgt - positions_tgt.mean(axis=0)
        H = Pc.T @ Qc
        U, _, Vt = np.linalg.svd(H)
        R_pos = Vt.T @ U.T
        if np.linalg.det(R_pos) < 0:
            Vt[-1, :] *= -1
            R_pos = Vt.T @ U.T

        # 2. Orientation alignment
        vec_src, vec_tgt = [], []
        for qs, qt in zip(quats_src, quats_tgt):
            Rs = R.from_quat(qs).as_matrix()
            Rt = R.from_quat(qt).as_matrix()
            vec_src.extend(Rs.T)
            vec_tgt.extend(Rt.T)
        vec_src, vec_tgt = np.array(vec_src), np.array(vec_tgt)
        R_orient, _ = R.align_vectors(vec_tgt, vec_src)
        
        # 3. Weighted blending
        q_pos = R.from_matrix(R_pos).as_quat()
        q_orient = R_orient.as_quat()
        q_blend = self.slerp_quat(q_pos, q_orient, np.clip(w_orient, 0.0, 1.0))
        R_combined = R.from_quat(q_blend).as_matrix()

        # 4. Translation
        t_opt = positions_tgt.mean(axis=0) - R_combined @ positions_src.mean(axis=0)

        # 5. Build 4x4 matrix
        T_mat = np.eye(4)
        T_mat[:3, :3] = R_combined
        T_mat[:3, 3] = t_opt
        
        # Convert numpy array to nested list before giving to COMPAS
        T = Transformation.from_matrix(T_mat.tolist())
        frame_result = Frame.from_transformation(T)

        self.log("Kabsch/Wahba algorithm gave the initial guess {}.".format(frame_result))
        return T, frame_result, T_mat

    def points_to_pointcloud(self, points):
        array = [[x,y,z] for x, y, z in iter(points)]
        pcd = open3d.geometry.PointCloud()
        pcd.points = open3d.utility.Vector3dVector(array)
        pcd.voxel_down_sample(0.0001)
        return pcd
    
    def icp_alignment(self, pcd_src, pcd_tgt, initial_guess, threshold=0.05):
        initial_guess_p = frame_to_rhino_plane(initial_guess)
        trans_init, evaluation = evaluate_local_registration(pcd_src, pcd_tgt, threshold, initial_guess_p)
        registration_icp = execute_icp_local_registration(pcd_src, pcd_tgt, threshold, trans_init)

        # print("Inlier Fitness: ", registration_icp.fitness)
        # print("Inlier RMSE: ", registration_icp.inlier_rmse)
        # print("Transformation: \n", registration_icp.transformation)

        # source_out = [rg.Point3d(*pt) for pt in pcd_src.points]
        # target_out = [rg.Point3d(*pt) for pt in target.points]
        T_ICP = Transformation.from_matrix(list(registration_icp.transformation))
        frame_result = Frame.worldXY().transformed(T_ICP)

        return T_ICP, frame_result

    def run(self, stop_thread):
        self.log("Computing transformation between OKVIS and Rhino worlds.")

        # Compute Tokvis_to_rhino via alignment. Source frames will be the estimated frames in BCF, target frames will be the planned frames in WCF. 
        # Result will give Tokvis_to_rhino.

        if self.realignment is False: # For the initial alignment between estimated and planned brick poses.
            temporary_keys = [127,128,129]  #[k for k in self.structure_assembly.graph.nodes_where({"temporary":True})]
            parts_keys = [p for p in self.structure_assembly.part_keys()]
            anchor_keys = [t for t in parts_keys if self.structure_assembly.graph.node_attribute(t, "anchor")]

            frames_src, points_src = self.assembly_to_frames_and_points(self.structure_assembly, temporary_keys) # temporary estimated ones
            frames_tgt, points_tgt = self.assembly_to_frames_and_points(self.structure_assembly, anchor_keys, "planned_frame") # built planned ones (in 2nd alignment, we might have to match them first and then select the keys...)

        else:
            self.log("Realignment.")

            parts_keys = [p for p in self.structure_assembly.part_keys()]
            anchor_keys = [t for t in parts_keys if self.structure_assembly.graph.node_attribute(t, "anchor")]

            frames_src, points_src = self.assembly_to_frames_and_points(self.structure_assembly, anchor_keys, "anchor_estimated_frame") # temporary estimated ones
            frames_tgt, points_tgt = self.assembly_to_frames_and_points(self.structure_assembly, anchor_keys, "planned_frame")  # built planned ones

            # final_parts = [t for t in parts_keys if self.structure_assembly.graph.node_attribute(t, "final_estimated_frame") is not None]
            # second_parts = [t for t in parts_keys if self.structure_assembly.graph.node_attribute(t, "second_estimated_frame") is not None]
            # shared_parts = [s for s in second_parts if s in final_parts]

            # frames_src, points_src = self.assembly_to_frames_and_points(self.structure_assembly, shared_parts, "second_estimated_frame_BCF")
            # frames_tgt, points_tgt = self.assembly_to_frames_and_points(self.structure_assembly, shared_parts, "final_estimated_frame")

            # # frames_src, points_src = self.assembly_to_frames_and_points(self.structure_assembly, second_parts, "second_estimated_frame_BCF")
            # # frames_tgt, points_tgt = self.assembly_to_frames_and_points(self.structure_assembly, second_parts, "planned_frame") 

        T, initial_guess, T_mat = self.kabsch_wahba_alignment(frames_src, frames_tgt)

        pcd_src = self.points_to_pointcloud(points_src)
        pcd_tgt = self.points_to_pointcloud(points_tgt)

        Tokvis_to_rhino, frame_result = self.icp_alignment(pcd_src, pcd_tgt, initial_guess)
        
        self.log("ICP computed Tokvisrhino is {}".format(Tokvis_to_rhino))
        WCF_slam = self.robot.WCF_slam
        self.robot.WCF_slam = WCF_slam.transformed(Tokvis_to_rhino)
        # self.robot.WCF_slam = Tokvis_to_rhino
        self.robot.is_aligned = True # Should be false once robot starts moving.
        self.robot._record_state("WCF_slam update")

        if self.realignment:
            #realignment
            anchor_keys = list(self.structure_assembly.graph.nodes_where({"anchor":True}))

            for a in anchor_keys:

                estimated_frame = self.structure_assembly.graph.node_attribute(a, 'anchor_estimated_frame').copy()
                estimated_frame_t = estimated_frame.transformed(Tokvis_to_rhino)
                self.structure_assembly.part(a).frame = estimated_frame_t
                self.structure_assembly.graph.node_attribute(a, 'estimated_frame', estimated_frame_t)

                estimated_frame = self.structure_assembly.graph.node_attribute(a, 'anchor_estimated_frame_BCF').copy()
                estimated_frame_t = estimated_frame.transformed(Tokvis_to_rhino)
                self.structure_assembly.graph.node_attribute(a, 'estimated_frame_BCF', estimated_frame_t)

        self.is_completed = True
        return True

class TransformAlignmentTask(Task):
    def __init__(self, robot, stack_assembly, structure_assembly, realignment=False, key=None):
        super(TransformAlignmentTask, self).__init__(key)
        self.robot = robot
        self.stack_assembly = stack_assembly
        self.structure_assembly = structure_assembly
        self.realignment = realignment

    def align_stack_from_WCF_slam_to_WCF(self):
        # Now transform all the estimated frames with Tokvisrhino, from WCF to WCF_slam then do comparison, 
        # add them to the found ones with the estimated_frame in WCF (WCFslam + BCFslam + estimated_frame_in_BCF)

        stack_keys = list(self.stack_assembly.part_keys())
        self.log(f"Applying WCF_slam→WCF transform to {len(stack_keys)} stack bricks")

        for k in stack_keys:
            # estimated_frame_in_WCF = T_okvis→rhino × estimated_frame_in_WCF_slam
            estimated_frame_in_WCF_slam = self.stack_assembly.graph.node_attribute(k, 'estimated_frame').copy()
            initial_estimated_frame_in_WCF_slam = self.stack_assembly.graph.node_attribute(k, 'initial_estimated_frame').copy()

            estimated_frame_in_WCF = estimated_frame_in_WCF_slam.transformed(self.robot.transformation_WCF_slam_WCF())
            initial_estimated_frame_in_WCF = initial_estimated_frame_in_WCF_slam.transformed(self.robot.transformation_WCF_slam_WCF())

            self.stack_assembly.part(k).frame = estimated_frame_in_WCF
            self.stack_assembly.graph.node_attribute(k, 'estimated_frame', estimated_frame_in_WCF)
            self.stack_assembly.graph.node_attribute(k, 'initial_estimated_frame', initial_estimated_frame_in_WCF)

            estimated_frame_in_BCF = self.stack_assembly.graph.node_attribute(k, 'estimated_frame_BCF').copy()
            initial_estimated_frame_in_BCF = self.stack_assembly.graph.node_attribute(k, 'initial_estimated_frame_BCF').copy()

            self.stack_assembly.graph.node_attribute(k, 'estimated_frame_BCF', estimated_frame_in_BCF)
            self.stack_assembly.graph.node_attribute(k, 'initial_estimated_frame_BCF', initial_estimated_frame_in_BCF)

    def align_structure_from_WCF_slam_to_WCF(self):
        # For the structure assembly:
        temporary_keys = [126,127,128,129] #list(self.structure_assembly.graph.nodes_where({"temporary":True}))
        self.log("Temporary keys are: {}".format(temporary_keys))

        for temporary_key in temporary_keys:
            # estimated_frame_in_WCF = T_okvis→rhino × estimated_frame_in_WCF_slam
            estimated_frame_in_WCF_slam = self.structure_assembly.graph.node_attribute(temporary_key, 'estimated_frame').copy()
            initial_estimated_frame_in_WCF_slam = self.structure_assembly.graph.node_attribute(temporary_key, 'initial_estimated_frame').copy()

            estimated_frame_in_WCF = estimated_frame_in_WCF_slam.transformed(self.robot.transformation_WCF_slam_WCF())
            initial_estimated_frame_in_WCF = initial_estimated_frame_in_WCF_slam.transformed(self.robot.transformation_WCF_slam_WCF())

            self.structure_assembly.part(temporary_key).frame = estimated_frame_in_WCF
            self.structure_assembly.graph.node_attribute(temporary_key, 'estimated_frame', estimated_frame_in_WCF)
            self.structure_assembly.graph.node_attribute(temporary_key, 'initial_estimated_frame', initial_estimated_frame_in_WCF)

            estimated_frame_in_BCF = self.structure_assembly.graph.node_attribute(temporary_key, 'estimated_frame_BCF').copy()
            initial_estimated_frame_in_BCF = self.structure_assembly.graph.node_attribute(temporary_key, 'initial_estimated_frame_BCF').copy()
            
            # Compare this frame to planned frames to match the keys:
            built_keys = [b for b in self.structure_assembly.graph.nodes_where({"anchor":True})]
            self.log("Anchor keys: {}".format(built_keys))
            target_key = None
            closest_distance = 0.1

            for built_key in built_keys:
                planned_frame_in_WCF = self.structure_assembly.graph.node_attribute(built_key, 'planned_frame')

                distance = distance_point_point(planned_frame_in_WCF.point, estimated_frame_in_WCF.point)
                self.log("Distance is {}".format(distance))
                if distance < closest_distance:
                    self.log("Temporary brick {} is the same as brick {}".format(temporary_key, built_key))
                    closest_distance = distance
                    target_key = built_key

            if target_key != None:
                self.log("Brick {} is being updated with the frame {}.".format(target_key, estimated_frame_in_WCF))
                # Add these frame attributes to the target key.
                self.structure_assembly.part(target_key).frame = estimated_frame_in_WCF
                self.structure_assembly.graph.node_attribute(target_key, 'estimated_frame', estimated_frame_in_WCF)
                self.structure_assembly.graph.node_attribute(target_key, 'initial_estimated_frame', initial_estimated_frame_in_WCF)

                self.structure_assembly.graph.node_attribute(target_key, 'estimated_frame_BCF', estimated_frame_in_BCF)
                self.structure_assembly.graph.node_attribute(target_key, 'initial_estimated_frame_BCF', initial_estimated_frame_in_BCF)

        # Delete the temporary brick.
        for temporary_key in temporary_keys:
            self.structure_assembly.graph.delete_node(temporary_key)

    def run(self, stop_thread):
        self.align_structure_from_WCF_slam_to_WCF()
        # self.align_stack_from_WCF_slam_to_WCF()

        self.is_completed = True
        return True

class ReceiveBCFgtTask(Task):
    def __init__(self, robot, fake=False, key=None):
        super(ReceiveBCFgtTask, self).__init__(key)
        self.robot = robot
        self.BCF_gt = None
        self.fake = fake
    
    def run(self, stop_thread):
        self.log("Subscribed to mobile base ground truth coordinate frame.")
        self.robot.mobile_client.clean_tf_frame()
        self.robot.mobile_client.tf_subscribe(
                    "robot_base_footprint",
                    "gt_world",
                )
        # Wait until pose is received.
        while not stop_thread():
            if self.robot.mobile_client.tf_frame is not None:
                self.BCF_gt = self.robot.mobile_client.tf_frame
                break
            time.sleep(0.1)

        # self.BCF_gt = Frame(point=Point(x=15.700, y=9.200, z=-0.000), xaxis=Vector(x=1.000, y=0.000, z=0.000), yaxis=Vector(x=-0.000, y=1.000, z=-0.000))
        if self.BCF_gt is None:
            self.log('Could not get the gt frame.')
        else:
            self.log('Got the gt frame: {}'.format(self.BCF_gt))
            self.robot.BCF_gt = self.BCF_gt
            if self.fake:
                self.robot.WCF_slam = self.BCF_gt
                self.robot.BCF_slam = Frame.worldXY()
            self.robot._record_state("BCF_gt update")

        self.robot.mobile_client.tf_unsubscribe(
                    "robot_base_footprint",
                    "gt_world",
                )
        self.log("Unsubscribed from mobile base ground truth coordinate frame.")

        self.is_completed = True
        return True

class ReceiveBCFslamTask(Task):
    def __init__(self, robot, key=None):
        super(ReceiveBCFslamTask, self).__init__(key)
        self.robot = robot
        self.BCF_slam = None
     
    def run(self, stop_thread):
        self.log("Subscribed to OKVIS mobile base coordinate frame.")
        self.robot.mobile_client.clean_tf_frame()
        self.robot.mobile_client.tf_subscribe(
                    "robot_base_footprint",
                    "robot_odom",
                )
        
        # Wait until pose is received.
        while not stop_thread():
            if self.robot.mobile_client.tf_frame is not None:
                self.BCF_slam = self.robot.mobile_client.tf_frame
                break
            time.sleep(0.1)

        if self.BCF_slam is None:
            self.log('Could not get the OKVIS frame.')
        else:
            # Note: BCF will be computed automatically via combination of BCF_slam + WCF_slam.
            self.log("BCFslam: {}".format(self.robot.BCF_slam))
            self.log("BCF: {}".format(self.robot.BCF))

            self.log('Got the OKVIS frame: {}'.format(self.BCF_slam))
            self.robot.BCF_slam = self.BCF_slam
            self.robot._update_BCF()
            self.log("BCF: {}".format(self.robot.BCF))
            self.robot._record_state("BCF_slam update")

        self.robot.mobile_client.tf_unsubscribe(
                    "robot_base_footprint",
                    "robot_odom"
                )

        self.log("Unsubscribed from OKVIS mobile base coordinate frame.")

        self.is_completed = True
        return True

class ReceiveBCFslamOnResetTask(Task):
    def __init__(self, robot, before=True, key=None):
        super(ReceiveBCFslamOnResetTask, self).__init__(key)
        self.robot = robot
        self.before = before
        self.BCF_slam = None
     
    def run(self, stop_thread):
        self.log("Subscribed to OKVIS mobile base coordinate frame.")
        self.robot.mobile_client.clean_tf_frame()
        self.robot.mobile_client.tf_subscribe(
                    "robot_base_footprint",
                    "robot_odom",
                )
        
        # Wait until pose is received.
        while not stop_thread():
            if self.robot.mobile_client.tf_frame is not None:
                self.BCF_slam = self.robot.mobile_client.tf_frame
                break
            time.sleep(0.1)

        if self.BCF_slam is None:
            self.log('Could not get the OKVIS frame.')
        else:
            # Note: BCF will be computed automatically via combination of BCF_slam + WCF_slam.
            self.log('Got the OKVIS frame: {}'.format(self.BCF_slam))

            if self.before:
                st["BCF_before"] = self.BCF_slam
                self.log("Temporary BCFslam is: {}".format(self.BCF_slam))
            else:
                BCF_before = st["BCF_before"]
                BCF_after = self.BCF_slam
                T_delta = Transformation.from_change_of_basis(Frame.worldXY(), BCF_before)
                F_delta = BCF_after.transformed(T_delta)
                BCF_old = self.robot.BCF_slam
                BCF_new = F_delta.transformed(Transformation.from_frame(BCF_old))
                self.robot.BCF_slam = BCF_new
                self.robot._update_BCF()
                self.log("BCF: {}".format(self.robot.BCF))
                self.robot._record_state("BCF_slam update")

        self.robot.mobile_client.tf_unsubscribe(
                    "robot_base_footprint",
                    "robot_odom"
                )

        self.log("Unsubscribed from OKVIS mobile base coordinate frame.")

        self.is_completed = True
        return True

class AddCollisionMeshes(Task):
    def __init__(self, robot, mesh, frame=Frame.worldXY(), mesh_id="tool_box", attached=True, key=None):
        super(AddCollisionMeshes, self).__init__(key)
        self.robot = robot
        # Convert inputs to lists if they're not already
        self.meshes = [mesh] if not isinstance(mesh, list) else mesh
        self.frames = [frame] if not isinstance(frame, list) else frame
        self.mesh_ids = [mesh_id] if not isinstance(mesh_id, list) else mesh_id
        # Validate list lengths
        if not (len(self.meshes) == len(self.frames) == len(self.mesh_ids)):
            raise ValueError("mesh, frame, and mesh_id must have the same length")
        self.attached = attached

    def compas_mesh_to_ros(self, mesh):
        """
        Convert COMPAS mesh vertices/faces to ROS Mesh format.
        - vertices: list of [x,y,z]
        - faces: list of [i,j,k]
        """
        vertices = [mesh.vertex_coordinates(i) for i in mesh.vertices()]
        faces = [mesh.face_vertices(f) for f in mesh.faces()]

        ros_vertices = []
        ros_triangles = []
        for v in vertices:
            ros_vertices.append({
                'x': float(v[0]),
                'y': float(v[1]),
                'z': float(v[2])
            })
        for f in faces:
            if len(f) == 3:
                ros_triangles.append({'vertex_indices': f})
            elif len(f) == 4:
                ros_triangles.append({'vertex_indices': [f[0], f[1], f[2]]})
                ros_triangles.append({'vertex_indices': [f[0], f[2], f[3]]})
            else:
                raise ValueError(f"Face with {len(f)} vertices not supported")
        return ros_vertices, ros_triangles

    def run(self, stop_thread):
        if self.attached:
            operation = "ATTACH"
            link_name = 'robot_arm_tool0'
        else:
            operation = "ADD"
            link_name = ''

        for mesh, frame, mesh_id in zip(self.meshes, self.frames, self.mesh_ids):
            vertices, triangles = self.compas_mesh_to_ros(mesh)
            pose = {
                'position': {
                    'x': frame.point.x,
                    'y': frame.point.y,
                    'z': frame.point.z
                },
                'orientation': {
                    'x': frame.quaternion.x,
                    'y': frame.quaternion.y,
                    'z': frame.quaternion.z,
                    'w': frame.quaternion.w
                }
            }
            msg = {
                'id': mesh_id,
                'operation': operation,
                'link_name': link_name,
                'vertices': vertices,
                'triangles': triangles,
                'pose': pose
            }

            self.log(f"Processing mesh {mesh_id}")
            while not stop_thread():
                if self.robot.mobile_client.is_service_available('/moveit/collision_mesh'):
                    result = self.robot.mobile_client.service_call(
                        '/moveit/collision_mesh',
                        'moveit_ros_interface/srv/CollisionMeshOp', 
                        msg
                    )
                    if result['success']:
                        break
                    self.log(f"Failed to add mesh {mesh_id}: {result['message']}")
                time.sleep(0.1)

        time.sleep(1)
        self.is_completed = True
        return True

class RemoveCollisionMesh(Task):
    def __init__(self, robot, frame=Frame.worldXY(), mesh_id="tool_box", key=None):
        super(RemoveCollisionMesh, self).__init__(key)
        self.robot = robot
        self.mesh_id = mesh_id
        self.frame = frame

    def run(self, stop_thread):
        pose = {'position' : {
                            'x' : self.frame.point.x,
                            'y' : self.frame.point.y,
                            'z' : self.frame.point.z},
                    'orientation' : {
                            'x' : self.frame.quaternion.x,
                            'y' : self.frame.quaternion.y,
                            'z' : self.frame.quaternion.z,
                            'w' : self.frame.quaternion.w}
                }
        msg = {
            'id': self.mesh_id,
            'operation': 'REMOVE',
            'link_name': '',      # not needed for REMOVE
            'vertices': [],       # not needed for REMOVE
            'triangles': [],      # not needed for REMOVE
            'pose': pose
        }
        self.log(f"Requesting removal of collision mesh: {self.mesh_id}")
        while not stop_thread():
            if self.robot.mobile_client.is_service_available('/moveit/collision_mesh'):
                self.log("Collision mesh service is available.")
                result = self.robot.mobile_client.service_call(
                    '/moveit/collision_mesh',
                    'moveit_ros_interface/srv/CollisionMeshOp',
                    msg
                )
                success = result['success']
                message = result['message']
                self.log(f"Service response: {success} - {message}")
                break
            else:
                self.log("Collision mesh service is not available.")
                break
            time.sleep(0.2)
        self.is_completed = True
        return True

class MoveMobileBaseTask(Task):
    def __init__(self, robot, velocity=1.0, right=True, linear=True, total_time=7, key=None):
        super(MoveMobileBaseTask, self).__init__(key)
        self.robot = robot
        self.linear = linear
        self.velocity = velocity
        self.right = right
        self.total_time = total_time
        # robot dimensions (meters)
        self.L = 0.959   # front-back - wheelbase
        self.W = 0.585   # left-right -trackwidth
    
    def compute_swerve_rotation(self, L, W, omega, x_p=0, y_p=0):
        """
        Compute wheel steering angles and wheel speeds
        for rotation about robot center.

        L: front-back distance
        W: left-right distance
        omega: angular velocity (rad/s)
        """

        # Wheel positions
        wheels = {
            "back_left":   (-L/2,  W/2),
            "front_left":  ( L/2,  W/2),
            "back_right":  (-L/2, -W/2),
            "front_right": ( L/2, -W/2),
        }

        angles = []
        speeds = []

        for (x, y) in wheels.values():
            # Velocity due to rotation
            dx = x - x_p
            dy = y - y_p

            v_x = -omega * dy
            v_y =  omega * dx


            angle = math.atan2(v_y, v_x)
            speed = math.sqrt(v_x**2 + v_y**2)

            angles.append(angle)
            speeds.append(speed)

        return angles, speeds

    def run(self, stop_thread):
        msg = {
            'data' : False
        }

        while not stop_thread():
            if self.robot.mobile_client.is_service_available('/fix_robot_service'):
                result = self.robot.mobile_client.service_call('/fix_robot_service', 'std_srvs/srv/SetBool', msg)
                success = result['success']
                message = result['message']
                self.log('Message: {}'.format(message))
                if success:
                    break
            else:
                self.log("Fix robot service is not available.")
                break
            time.sleep(0.1)
        
        if self.linear:
            if self.right:
                angle = math.radians(-90)
            else:
                angle = math.radians(90)
            position = [angle, angle, angle, angle]
            velocity = [self.velocity, self.velocity, self.velocity, self.velocity]
        else:
            if self.right:
                omega = self.velocity  # rad/s (positive = CCW)
            else:
                omega = -self.velocity
            position, velocity = self.compute_swerve_rotation(self.L, self.W, omega, x_p=2)

        client = self.robot.mobile_client.ros_client

        publisher = roslibpy.Topic(client, '/base_joint_commands', 'sensor_msgs/JointState')
        joint_names = ["robot_back_left_motor_wheel_joint", "robot_front_left_motor_wheel_joint", 
                         "robot_back_right_motor_wheel_joint",  "robot_front_right_motor_wheel_joint",]
        
        self.log("Position: {}, Velocity: {}, Total time: {}".format(str(position), str(velocity), str(self.total_time)))
        
        while not stop_thread():
            msg = {
                'header': {'stamp': {'secs': int(time.time()), 'nsecs': int((time.time() % 1) * 1e9)}},
                'name': joint_names,
                'position': position,
                'velocity': [0,0,0,0],
                }
            publisher.publish(msg)
            time.sleep(2)

            msg = {
                    'header': {'stamp': {'secs': int(time.time()), 'nsecs': int((time.time() % 1) * 1e9)}},
                    'name': joint_names,
                    'position': position,
                    'velocity': velocity
                }
            publisher.publish(msg)
            total_time = self.total_time #15 #.5m ->7 #6m -> 70 #1m -> 15 # 3m -> 40 # 0.4 -> 5
            time.sleep(total_time)

            msg = {
                'header': {'stamp': {'secs': int(time.time()), 'nsecs': int((time.time() % 1) * 1e9)}},
                'name': joint_names,
                'position': [0,0,0,0],
                'velocity': [0,0,0,0],
                }
            publisher.publish(msg)
            time.sleep(1)
            break
        
        msg = {
            'data' : True
        }
        while not stop_thread():
            if self.robot.mobile_client.is_service_available('/fix_robot_service'):
                result = self.robot.mobile_client.service_call('/fix_robot_service', 'std_srvs/srv/SetBool', msg)
                success = result['success']
                message = result['message']
                self.log('Message: {}'.format(message))
                if success:
                    break
            else:
                self.log("Fix robot service is not available.")
                break
            time.sleep(0.1)
            
        publisher.unadvertise()
        self.log("Arrived at target base frame.")
        
        self.is_completed = True
        return True

class SendMobileBaseJointStatesTask(Task):
    def __init__(self, robot, rotation_value_list=None, velocity_value_list=None, time_interval_list=None, key=None):
        super(SendMobileBaseJointStatesTask, self).__init__(key)
        self.robot = robot
        self.rotation_value_list = rotation_value_list
        self.velocity_value_list = velocity_value_list
        self.time_interval_list = time_interval_list
        
    def run(self, stop_thread):
        client = self.robot.mobile_client.ros_client

        publisher = roslibpy.Topic(client, '/base_joint_commands', 'sensor_msgs/JointState')
        joint_names = ["robot_front_left_motor_wheel_joint", "robot_front_right_motor_wheel_joint", 
                        "robot_back_left_motor_wheel_joint","robot_back_right_motor_wheel_joint", 
                        "robot_front_left_wheel_joint", "robot_front_right_wheel_joint",
                        "robot_back_left_wheel_joint", "robot_back_right_wheel_joint"]

        time_start = time.time()

        i = 0
        while client.is_connected:
            t = time.time() - time_start

            self.log("Position: {}, Velocity: {}".format(str(self.rotation_value_list[i]), str(self.velocity_value_list[i])))

            msg = {
                'header': {'stamp': {'secs': int(time.time()), 'nsecs': int((time.time() % 1) * 1e9)}},
                'name': joint_names,
                'position': self.rotation_value_list[i],
                'velocity': self.velocity_value_list[i]
            }
            publisher.publish(msg)
            # Calculate the time with velocity.
            time.sleep(self.time_interval_list[i]) #0.02*8
            i += 1
            if i == len(self.rotation_value_list):
                msg = {
                'header': {'stamp': {'secs': int(time.time()), 'nsecs': int((time.time() % 1) * 1e9)}},
                'name': joint_names,
                'position': [0,0,0,0,0,0,0,0],
                'velocity': [0,0,0,0,0,0,0,0],
                }
                publisher.publish(msg)
                break
            
        publisher.unadvertise()
        self.log("Arrived at target base frame.")
        
        self.is_completed = True
        return True

class MotionPlanExecutePose(Task):
    def __init__(self, robot, target_frame=None, frame_in_WCF=True, group="ur20", ee_link="robot_arm_tool0", execute=True, tool_constraint=False, key=None):
        super(MotionPlanExecutePose, self).__init__(key)
        self.robot = robot
        self.target_frame = target_frame
        self.frame_in_WCF = frame_in_WCF
        self.group = group
        self.ee_link = ee_link
        self.execute = execute
        self.tool_constraint = tool_constraint
    
    def run(self, stop_thread):
        if self.robot.attached_tool:
            self.target_frame = self.robot.from_tcf_to_t0cf([self.target_frame])[0]
            self.log("Attached tool.")

        if self.frame_in_WCF:
            frame_BCF = self.robot.from_WCF_to_BCF(self.target_frame)
        else:
            frame_BCF = self.target_frame

        if self.tool_constraint:
            path_constraints = {
            'name': 'keep_tool_in_xy_plane',
            'joint_constraints': [],
            'position_constraints': [],
            'orientation_constraints': [
                {
                    'header': {'frame_id': 'robot_base_footprint'},           # reference frame
                    'orientation': {'x': -0.705, 'y': 0.709, 'z': 0.0, 'w': 0.0},  # tool facing downward
                    'link_name': 'robot_arm_tool0',                # your EE link
                    'absolute_x_axis_tolerance': 3,              # allow slight tilt
                    'absolute_y_axis_tolerance': 3,
                    'absolute_z_axis_tolerance': 6.283,            # free rotation around Z
                    'weight': 1.0
                }
            ],
            'visibility_constraints': []
        }
        else:
            path_constraints = {
                'name': '',
                'joint_constraints': [],
                'position_constraints': [],
                'orientation_constraints': [],
                'visibility_constraints': []
            }

        msg = {
            'pose' : {
                'header' : {'frame_id' : 'robot_base_footprint'},
                'pose' : {
                    'position' : {
                            'x' : frame_BCF.point.x,
                            'y' : frame_BCF.point.y,
                            'z' : frame_BCF.point.z},
                    'orientation' : {
                            'x' : frame_BCF.quaternion.x,
                            'y' : frame_BCF.quaternion.y,
                            'z' : frame_BCF.quaternion.z,
                            'w' : frame_BCF.quaternion.w}
                }
            },
            'group' : self.group,
            'ee_link' : self.ee_link,
            'execute' : self.execute,
            'path_constraints': path_constraints
        }
        # self.log(msg)

        while not stop_thread():
            if self.robot.mobile_client.is_service_available('/moveit/plan_execute_pose'):
                self.log("Motion planning for pose service is available.")
                result = self.robot.mobile_client.service_call('/moveit/plan_execute_pose', 'moveit_ros_interface/srv/PlanExecutePose', msg)
                success = result['success']
                message = result['message']
                trajectory = result['trajectory']
                # self.log('Trajectory: {}'.format(trajectory))
                if success:
                    break
            else:
                self.log("Motion planning for pose service is not available.")
                break
            time.sleep(0.1)
        
        time.sleep(0.1)
        self.is_completed = True
        return True

class MotionPlanExecuteJoints(Task):
    def __init__(self, robot, configuration=None, group="ur20", execute=True, key=None):
        super(MotionPlanExecuteJoints, self).__init__(key)
        self.robot = robot
        self.configuration = configuration
        self.group = group
        self.execute = execute
    
    def run(self, stop_thread):
        msg = {
            'group' : self.group,
            'names' : self.configuration.joint_names,
            'positions' : self.configuration.joint_values,
            'execute' : self.execute
        }
        self.log(msg)

        while not stop_thread():
            if self.robot.mobile_client.is_service_available('/moveit/plan_execute_joints'):
                self.log("Motion planning for joints service is available.")
                result = self.robot.mobile_client.service_call('/moveit/plan_execute_joints', 'moveit_ros_interface/srv/PlanExecuteJoints', msg)
                success = result['success']
                message = result['message']
                trajectory = result['trajectory']
                #self.log('Trajectory: {}'.format(trajectory))
                if success:
                    break
            else:
                self.log("Motion planning for joints service is not available.")
                break
            time.sleep(0.1)
        
        time.sleep(1)
        self.is_completed = True
        return True

class GripperControlTask(Task):
    def __init__(self, robot, open_grip=True, key=None):
        super(GripperControlTask, self).__init__(key)
        self.robot = robot
        self.open_grip = open_grip
    
    def run(self, stop_thread):
        msg = {
            'data' : self.open_grip
        }

        time.sleep(1)
        while not stop_thread():
            if self.robot.mobile_client.is_service_available('/gripper_service'):
                result = self.robot.mobile_client.service_call('/gripper_service', 'std_srvs/srv/SetBool', msg)
                success = result['success']
                message = result['message']
                self.log('Message: {}'.format(message))
                if success:
                    break
            else:
                self.log("Gripper service is not available.")
                break
            time.sleep(0.1)
        time.sleep(1)
        self.is_completed = True
        return True

class ChangeToolFrameTask(Task):
    def __init__(self, robot, tool_name='gripper', key=None):
        super(ChangeToolFrameTask, self).__init__(key)
        self.robot = robot
        self.tool_name = tool_name
        gripper_frame = Frame([0, 0, 0.166], [0, -1, 0], [1, 0, 0])
        camera_frame = Frame([-0.0327, 0.0572, 0.0815], [-1, 0, 0], [0, 0, 1])
        if tool_name == 'gripper':
            self.tool_frame = gripper_frame
        else:
            self.tool_frame = camera_frame
        
    def run(self, stop_thread):
        self.log("ChangeToolTask")
        self.log('Changing the tool frame to {}.'.format(self.tool_name))
        self.robot.attached_tools['ur20'].frame = self.tool_frame
        self.robot.attached_tools['ur20_and_liftkit'].frame = self.tool_frame
        self.is_completed = True
        return True

class UpdateAssemblyAttributes(Task):
    def __init__(self, material_stack, building_structure, pick_key, place_key, key=None):
        super(UpdateAssemblyAttributes, self).__init__(key)
        self.material_stack = material_stack
        self.building_structure = building_structure
        self.pick_key = pick_key
        self.place_key = place_key
    
    def update_neighbor_availability(self, assembly, part_key=None):
        updated_keys = []
        # Determine which parts to check
        part_keys = (
            assembly.graph.neighbors_out(part_key)
            if part_key is not None
            else assembly.part_keys()
        )
        for key in part_keys:
            below = assembly.graph.neighbors_in(key)
            below_built = all(
                bool(assembly.graph.node_attribute(n, "built")) for n in below
            )

            if below_built and not assembly.graph.node_attribute(key, "available"):
                assembly.graph.node_attribute(key, "available", True)
                updated_keys.append(key)
        return updated_keys

    def run(self, stop_thread):
        # Change brick attributes:
        self.material_stack.graph.node_attribute(self.pick_key, "built", False)
        self.material_stack.graph.node_attribute(self.pick_key, "available", False)
        self.building_structure.graph.node_attribute(self.place_key, "built", True)
        self.building_structure.graph.node_attribute(self.place_key, "available", False)
        self.building_structure.graph.node_attribute(self.place_key, "pick_key", self.pick_key)
        self.update_neighbor_availability(self.building_structure, self.place_key)

        self.is_completed = True
        return True


def select_pick_brick(assembly, z_tol=0.01):
    available = list(assembly.graph.nodes_where({"available": True}))
    if not available:
        return None

    # --- estimate stack yaw (ignore 90°-rotated bricks) ---
    yaws = []
    for k in available:
        xaxis = assembly.part(k).frame.xaxis
        yaw = math.atan2(xaxis.y, xaxis.x)
        yaws.append(yaw % (math.pi / 2))

    stack_yaw = sorted(yaws)[len(yaws) // 2]  # median
    print(f"Estimated stack yaw: {math.degrees(stack_yaw):.2f}°")

    c = math.cos(-stack_yaw)
    s = math.sin(-stack_yaw)

    # --- rotate positions into stack frame ---
    bricks = []
    for k in available:
        p = assembly.part(k).frame.point
        rx = c * p.x - s * p.y
        rz = p.z
        bricks.append((k, rx, rz))

    # --- select top layer ---
    max_z = max(b[2] for b in bricks)
    top = [b for b in bricks if abs(b[2] - max_z) < z_tol]

    # --- select most right ---
    best = max(top, key=lambda b: b[1])

    return best[0]

def select_place_brick(assembly):
    available_nodes = assembly.graph.nodes_where({"built":False, "available":True})
    max_key = max(
        available_nodes,
        key=lambda n: assembly.graph.node_attribute(n, 'planned_frame').point.y
    )
    return max_key

def slerp_quat(q1, q2, t):
    q1 = q1 / np.linalg.norm(q1)
    q2 = q2 / np.linalg.norm(q2)
    dot = np.dot(q1, q2)
    if dot < 0.0:
        q2 = -q2
        dot = -dot
    if dot > 0.9995:
        q = q1 + t * (q2 - q1)
        return q / np.linalg.norm(q)
    theta_0 = np.arccos(dot)
    theta = theta_0 * t
    q3 = q2 - q1 * dot
    q3 = q3 / np.linalg.norm(q3)
    return q1 * np.cos(theta) + q3 * np.sin(theta)

def average_frame(frame_a, frame_b):
    # --- Average position ---
    p = Point(
        0.5 * (frame_a.point.x + frame_b.point.x),
        0.5 * (frame_a.point.y + frame_b.point.y),
        0.5 * (frame_a.point.z + frame_b.point.z),
    )

    # --- Average orientation via SLERP ---
    R_a = Rotation.from_frame(frame_a)
    R_b = Rotation.from_frame(frame_b)

    qa = np.array(R_a.quaternion)
    qb = np.array(R_b.quaternion)

    q_avg = slerp_quat(qa, qb, 0.5)
    R_avg = Rotation.from_quaternion(q_avg)

    # --- Build averaged frame ---
    avg_frame = Frame.from_rotation(R_avg)
    avg_frame.point = p
    return avg_frame

if routine == "receive_bcf":
    tasks = [
                # ReceiveBCFslamTask(robot),
                ReceiveBCFgtTask(robot)]

elif routine == "general_snapshot":
    tasks = [ChangeToolFrameTask(robot, "gripper")]
    # tasks.append(MotionPlanExecuteJoints(robot, start_config))
    # tasks = []
    first = True
    for snap_plane in snap_planes[0:1]: #[:5]
        frame_BCF = plane_to_compas_frame(snap_plane).transformed(Translation.from_vector([0,-0.05,0]))
        target_planes.append(frame_to_rhino_plane(robot.from_BCF_to_WCF(frame_BCF)))
        tasks.append(CleanBricksTask(robot))
        tasks.append(MotionPlanExecutePose(robot, frame_BCF, frame_in_WCF=False))
        # if first:
        #     addition = 20
        # else:
        #     addition = 0
        # tasks.append(TriggerEstimationTask(robot, trigger=True, sleep=20+addition))
        # tasks.append(TriggerEstimationTask(robot, trigger=False, sleep=0))
        # first=False

    # tasks.append(ScanAllBricksTask(robot, stack_assembly=material_stack, structure_assembly=building_structure, stack=False))
    # tasks.append(TriggerEstimationTask(robot, trigger=False, cuda_off=True, sleep=0))
    # tasks.append(MotionPlanExecuteJoints(robot, start_config))

elif routine == "closeup_snapshot":
    tasks = [ChangeToolFrameTask(robot, "camera")]
    tasks.append(MotionPlanExecuteJoints(robot, start_config))

    temporary_keys = list(building_structure.graph.nodes_where({"temporary":True}))
    print(temporary_keys)
    first = True

    for temporary_key in temporary_keys:
        estimated_frame_BCF = building_structure.graph.node_attribute(temporary_key, 'estimated_frame_BCF')
        closeup_snapshot = plane_to_compas_frame(closeup_plane)
        snapshot_frame_BCF = closeup_snapshot.transformed(Transformation.from_frame(estimated_frame_BCF))

        target_planes.append(frame_to_rhino_plane(robot.from_BCF_to_WCF(snapshot_frame_BCF)))
        # closeup_snapshot = Frame(point=Point(x=0.390, y=-0.298, z=-0.325), xaxis=Vector(x=-0.471, y=-0.879, z=0.076), yaxis=Vector(x=0.570, y=-0.238, z=0.786))
        # snapshot_frame_BCF = closeup_snapshot.transformed(Transformation.from_frame(estimated_frame_BCF))

        target_planes.append(frame_to_rhino_plane(robot.from_BCF_to_WCF(snapshot_frame_BCF)))

        tasks.append(CleanBricksTask(robot))
        tasks.append(MotionPlanExecutePose(robot, snapshot_frame_BCF, frame_in_WCF=False))
        if first:
            addition = 20
        else:
            addition = 0
        tasks.append(TriggerEstimationTask(robot, trigger=True, sleep=20+addition))
        tasks.append(ScanSingleBrickTask(robot, assembly=building_structure, brick_key_to_update=temporary_key))
        tasks.append(TriggerEstimationTask(robot, trigger=False, sleep=0))
        first = False

    tasks.append(TriggerEstimationTask(robot, trigger=False, cuda_off=True, sleep=0))
    tasks.append(MotionPlanExecuteJoints(robot, start_config))

elif routine == "alignment":
    tasks = []
    tasks.append(AlignmentTask(robot, structure_assembly=building_structure))
    # tasks.append(TransformAlignmentTask(robot, stack_assembly=material_stack, structure_assembly=building_structure))

elif routine == "gt_alignment":
    tasks = []
    tasks.append(ReceiveBCFgtTask(robot, fake=True))
    tasks.append(TransformAlignmentTask(robot, stack_assembly=material_stack, structure_assembly=building_structure))

elif routine == "general_snapshot_before_pick":
    tasks = [ChangeToolFrameTask(robot, "gripper")]
    tasks.append(MotionPlanExecuteJoints(robot, start_config))

    snap_frames = [plane_to_compas_frame(snap_plane) for snap_plane in snap_planes[2:3]]
    left_stack = True
    if left_stack:
        snap_frames = [s.transformed(Rotation.from_axis_and_angle(
                                                Vector.Zaxis(), math.radians(180), robot.RCF.point)) for s in snap_frames]
    first = True
    for frame_BCF in snap_frames: #[:5]
        target_planes.append(frame_to_rhino_plane(robot.from_BCF_to_WCF(frame_BCF)))
        tasks.append(MotionPlanExecutePose(robot, frame_BCF, frame_in_WCF=False))
        if first:
            addition = 20
        else:
            addition = 0
        tasks.append(TriggerEstimationTask(robot, trigger=True, sleep=20+addition))
        # tasks.append(TriggerEstimationTask(robot, trigger=False, sleep=0))
        first=False

    tasks.append(ScanAllBricksTask(robot, stack_assembly=material_stack, structure_assembly=building_structure))
    tasks.append(TriggerEstimationTask(robot, trigger=False, cuda_off=True, sleep=0))
    #tasks.append(MotionPlanExecuteJoints(robot, start_config))

elif routine == "closeup_snapshot_pick":
    pick_key = 70 #select_pick_brick(material_stack)
    print(pick_key)
    pick_estimated_frame_BCF = material_stack.graph.node_attribute(pick_key, 'estimated_frame_BCF')

    closeup_snapshot = Frame(point=Point(x=0.390, y=-0.298, z=-0.325), xaxis=Vector(x=-0.471, y=-0.879, z=0.076), yaxis=Vector(x=0.570, y=-0.238, z=0.786))
    planned_snapshot_frame_BCF = closeup_snapshot.transformed(Transformation.from_frame(pick_estimated_frame_BCF))
    planned_snapshot_frame_BCF = planned_snapshot_frame_BCF.transformed(Rotation.from_axis_and_angle(pick_estimated_frame_BCF.zaxis, math.radians(180), pick_estimated_frame_BCF.point))

    # closeup_snapshot = plane_to_compas_frame(closeup_plane)
    # planned_snapshot_frame_BCF = closeup_snapshot.transformed(Transformation.from_frame(pick_estimated_frame_BCF))
    # planned_snapshot_frame_BCF = planned_snapshot_frame_BCF.transformed(Rotation.from_axis_and_angle(pick_estimated_frame_BCF.zaxis, math.radians(0), pick_estimated_frame_BCF.point))

    target_planes.append(frame_to_rhino_plane(robot.from_BCF_to_WCF(planned_snapshot_frame_BCF)))

    tasks = [ChangeToolFrameTask(robot, "camera")]
    # tasks.append(MotionPlanExecuteJoints(robot, start_config))
    tasks.append(CleanBricksTask(robot))
    tasks.append(MotionPlanExecutePose(robot, planned_snapshot_frame_BCF, frame_in_WCF=False))
    tasks.append(TriggerEstimationTask(robot, trigger=True, sleep=40))
    tasks.append(ScanSingleBrickAddNewTask(robot, assembly=material_stack, brick_key_to_update=pick_key, average=True))
    tasks.append(TriggerEstimationTask(robot, trigger=False, sleep=0))

elif routine in ["pick", "place", "pick_place"]:   
    pick_key = 70
    print(pick_key)

    #pick_estimated_frame_BCF = material_stack.graph.node_attribute(pick_key, 'estimated_frame_BCF').transformed(Translation.from_vector([0,0,0.03]))
    pick_estimated_frame_BCF = robot.from_WCF_to_BCF(material_stack.part(pick_key).frame.transformed(Translation.from_vector([0,0,0.04])))
    mid_estimated_frame_BCF = pick_estimated_frame_BCF.transformed(Translation.from_vector([0,0,0.04]))
    safe_pick_estimated_frame_BCF = pick_estimated_frame_BCF.transformed(Translation.from_vector([0,0,0.15]))

    target_planes.append(frame_to_rhino_plane(robot.from_BCF_to_WCF(safe_pick_estimated_frame_BCF)))
    target_planes.append(frame_to_rhino_plane(robot.from_BCF_to_WCF(pick_estimated_frame_BCF)))

    front_frame_BCF = Frame([1, 0, 1], xaxis=Vector.Xaxis(), yaxis=-Vector.Yaxis())
    # target_planes.append(frame_to_rhino_plane(robot.from_BCF_to_WCF(front_frame_BCF)))

    place_key = select_place_brick(building_structure)
    print(place_key)

    place_planned_frame = building_structure.graph.node_attribute(place_key, 'planned_frame').transformed(
                                                                Translation.from_vector([0,0,0.038]))
    mid_place_planned_frame = place_planned_frame.transformed(Translation.from_vector([0,0,0.15]))
    safe_place_planned_frame = place_planned_frame.transformed(Translation.from_vector([0,0,0.5]))

    target_planes.append(frame_to_rhino_plane((safe_place_planned_frame)))
    target_planes.append(frame_to_rhino_plane((place_planned_frame)))

    pick_tasks = [ChangeToolFrameTask(robot, "gripper"),
                # MotionPlanExecuteJoints(robot, start_config),
                MotionPlanExecutePose(robot, safe_pick_estimated_frame_BCF, frame_in_WCF=False),
                GripperControlTask(robot, open_grip=True),
                MotionPlanExecutePose(robot, mid_estimated_frame_BCF, frame_in_WCF=False, tool_constraint=True),
                MotionPlanExecutePose(robot, pick_estimated_frame_BCF, frame_in_WCF=False, tool_constraint=True),
                GripperControlTask(robot, open_grip=False),
                MotionPlanExecutePose(robot, safe_pick_estimated_frame_BCF, frame_in_WCF=False, tool_constraint=True)]

    place_tasks = [ChangeToolFrameTask(robot, "gripper"),
                # MotionPlanExecuteJoints(robot, start_config),
                MotionPlanExecutePose(robot, safe_place_planned_frame, frame_in_WCF=True, tool_constraint=True),
                MotionPlanExecutePose(robot, mid_place_planned_frame, frame_in_WCF=True, tool_constraint=True),
                MotionPlanExecutePose(robot, place_planned_frame, frame_in_WCF=True, tool_constraint=True),
                GripperControlTask(robot, open_grip=True),
                MotionPlanExecutePose(robot, mid_place_planned_frame, frame_in_WCF=True, tool_constraint=True),
                MotionPlanExecutePose(robot, safe_place_planned_frame, frame_in_WCF=True, tool_constraint=True),
                GripperControlTask(robot, open_grip=False),
                UpdateAssemblyAttributes(material_stack, building_structure, pick_key, place_key)]

    if routine == "pick":
        tasks = pick_tasks
    elif routine == "place":
        tasks = place_tasks
    else:
        tasks =  pick_tasks + place_tasks

elif routine in ["closeup_for_later", "closeup_realignment"]:
    if routine == "closeup_for_later":
        frame_attribute = "final_estimated_frame"
    else:
        frame_attribute = "second_estimated_frame"
    parts_keys = [p for p in building_structure.part_keys()]
    parts_keys = [p for p in parts_keys if building_structure.graph.node_attribute(p, "built")]
    top_parts = [
    p for p in parts_keys
    if all(
        not building_structure.graph.node_attribute(n, "built")
        for n in building_structure.graph.neighbors_out(p)
    )
    ]
    tasks = [ChangeToolFrameTask(robot, "camera")]
    for p in top_parts:
        planned_frame_WCF = building_structure.graph.node_attribute(p, 'planned_frame')
        closeup_snapshot = plane_to_compas_frame(closeup_plane)
        # closeup_snapshot = Frame(point=Point(x=0.390, y=-0.298, z=-0.325), xaxis=Vector(x=-0.471, y=-0.879, z=0.076), yaxis=Vector(x=0.570, y=-0.238, z=0.786))
        planned_snapshot_frame_WCF = closeup_snapshot.transformed(Transformation.from_frame(planned_frame_WCF))
        planned_snapshot_frame_WCF = planned_snapshot_frame_WCF.transformed(Rotation.from_axis_and_angle(planned_frame_WCF.zaxis, math.radians(0), planned_frame_WCF.point))

        target_planes.append(frame_to_rhino_plane(planned_snapshot_frame_WCF))

        tasks.append(MotionPlanExecuteJoints(robot, start_config))
        tasks.append(CleanBricksTask(robot))
        tasks.append(MotionPlanExecutePose(robot, planned_snapshot_frame_WCF, frame_in_WCF=True))
        tasks.append(TriggerEstimationTask(robot, trigger=True, sleep=30))
        tasks.append(ScanSingleBrickTask(robot, assembly=building_structure, brick_key_to_update=p, frame_attribute=frame_attribute))
        tasks.append(TriggerEstimationTask(robot, trigger=False, sleep=0))

elif routine == "move_base":
    #tasks = [SendMobileBaseJointStatesTask(robot, rotation_values, velocity_values, timeInt)]
    # tasks = [SendNavigationActionTask(robot)]
    tasks = [
                ReceiveBCFslamOnResetTask(robot, before=True),
                MoveMobileBaseTask(robot, linear=False, total_time=16),
                ReceiveBCFslamOnResetTask(robot, before=False),
                # ReceiveBCFslamTask(robot,),
                ReceiveBCFgtTask(robot),
                ]

elif routine == "closeup_reanchor":
    frame_attribute = "anchor_estimated_frame"
    parts_keys = [p for p in building_structure.part_keys()]
    anchor_keys = [p for p in parts_keys if building_structure.graph.node_attribute(p, "anchor")]
    print(anchor_keys)
    tasks = [ChangeToolFrameTask(robot, "camera")]
    # tasks.append(MotionPlanExecuteJoints(robot, start_config))
    
    for p in anchor_keys:
        planned_frame_WCF = building_structure.graph.node_attribute(p, 'planned_frame')
        closeup_snapshot = plane_to_compas_frame(closeup_plane)
        # closeup_snapshot = Frame(point=Point(x=0.390, y=-0.298, z=-0.325), xaxis=Vector(x=-0.471, y=-0.879, z=0.076), yaxis=Vector(x=0.570, y=-0.238, z=0.786))
        planned_snapshot_frame_WCF = closeup_snapshot.transformed(Transformation.from_frame(planned_frame_WCF))
        planned_snapshot_frame_WCF = planned_snapshot_frame_WCF.transformed(Rotation.from_axis_and_angle(planned_frame_WCF.zaxis, math.radians(0), planned_frame_WCF.point))

        target_planes.append(frame_to_rhino_plane(planned_snapshot_frame_WCF))
        tasks.append(CleanBricksTask(robot))
        tasks.append(MotionPlanExecutePose(robot, planned_snapshot_frame_WCF, frame_in_WCF=True))
        tasks.append(TriggerEstimationTask(robot, trigger=True, sleep=30))
        tasks.append(ScanSingleBrickTask(robot, assembly=building_structure, brick_key_to_update=p, frame_attribute=frame_attribute, average=False))
        tasks.append(TriggerEstimationTask(robot, trigger=False, sleep=0))


elif routine == "realignment":
    tasks = []
    tasks.append(AlignmentTask(robot, structure_assembly=building_structure, realignment=True))

elif routine == "correct_last":
    p = 7
    frame_attribute = "estimated_frame"
    planned_frame_WCF = building_structure.graph.node_attribute(p, 'planned_frame')
    closeup_snapshot = plane_to_compas_frame(closeup_plane)
    # closeup_snapshot = Frame(point=Point(x=0.390, y=-0.298, z=-0.325), xaxis=Vector(x=-0.471, y=-0.879, z=0.076), yaxis=Vector(x=0.570, y=-0.238, z=0.786))
    planned_snapshot_frame_WCF = closeup_snapshot.transformed(Transformation.from_frame(planned_frame_WCF))
    planned_snapshot_frame_WCF = planned_snapshot_frame_WCF.transformed(Rotation.from_axis_and_angle(planned_frame_WCF.zaxis, math.radians(0), planned_frame_WCF.point))
    # target_planes.append(frame_to_rhino_plane(planned_snapshot_frame_WCF))

    # tasks = [ChangeToolFrameTask(robot, "camera")]
    # tasks.append(CleanBricksTask(robot))
    # tasks.append(MotionPlanExecutePose(robot, planned_snapshot_frame_WCF, frame_in_WCF=True))
    # tasks.append(TriggerEstimationTask(robot, trigger=True, sleep=30))
    # tasks.append(ScanSingleBrickTask(robot, assembly=building_structure, brick_key_to_update=p, frame_attribute=frame_attribute, average=True))
    # tasks.append(TriggerEstimationTask(robot, trigger=False, sleep=0))

    ########

    pick_estimated_frame_BCF = building_structure.graph.node_attribute(p, 'estimated_frame_BCF').transformed(Translation.from_vector([0,0,0.04]))
    mid_estimated_frame_BCF = pick_estimated_frame_BCF.transformed(Translation.from_vector([0,0,0.04]))
    safe_pick_estimated_frame_BCF = pick_estimated_frame_BCF.transformed(Translation.from_vector([0,0,0.15]))

    target_planes.append(frame_to_rhino_plane(robot.from_BCF_to_WCF(safe_pick_estimated_frame_BCF)))
    target_planes.append(frame_to_rhino_plane(robot.from_BCF_to_WCF(pick_estimated_frame_BCF)))
    
    estimated_frame = building_structure.graph.node_attribute(p, 'estimated_frame')
    planned_frame = building_structure.graph.node_attribute(p, 'planned_frame')

    av_frame = average_frame(planned_frame, estimated_frame)
    # building_structure.part(p).frame = av_frame

    print(av_frame)
    place_planned_frame = av_frame.transformed(Translation.from_vector([0,0,0.04]))
    mid_place_planned_frame = place_planned_frame.transformed(Translation.from_vector([0,0,0.04]))
    safe_place_planned_frame = place_planned_frame.transformed(Translation.from_vector([0,0,0.15]))

    target_planes.append(frame_to_rhino_plane((safe_place_planned_frame)))
    target_planes.append(frame_to_rhino_plane((place_planned_frame)))

    # tasks = [ChangeToolFrameTask(robot, "gripper"),
    #             MotionPlanExecutePose(robot, safe_pick_estimated_frame_BCF, frame_in_WCF=False),
    #             GripperControlTask(robot, open_grip=True),
    #             MotionPlanExecutePose(robot, mid_estimated_frame_BCF, frame_in_WCF=False, tool_constraint=True),
    #             MotionPlanExecutePose(robot, pick_estimated_frame_BCF, frame_in_WCF=False, tool_constraint=True),
    #             GripperControlTask(robot, open_grip=False),
    #             MotionPlanExecutePose(robot, safe_pick_estimated_frame_BCF, frame_in_WCF=False, tool_constraint=True)]

    tasks = [ChangeToolFrameTask(robot, "gripper"),
                MotionPlanExecutePose(robot, safe_place_planned_frame, frame_in_WCF=True, tool_constraint=False),
                MotionPlanExecutePose(robot, mid_place_planned_frame, frame_in_WCF=True, tool_constraint=True),
                MotionPlanExecutePose(robot, place_planned_frame, frame_in_WCF=True, tool_constraint=True),
                GripperControlTask(robot, open_grip=True),
                MotionPlanExecutePose(robot, mid_place_planned_frame, frame_in_WCF=True, tool_constraint=True),
                MotionPlanExecutePose(robot, safe_place_planned_frame, frame_in_WCF=True, tool_constraint=True),
                GripperControlTask(robot, open_grip=False)]

elif routine == "attach_meshes":
    if material_stack is not None:
        material_stack_t = material_stack.transformed(robot.transformation_WCF_BCF())
        meshes = []
        mesh_ids = []
        frames = []
        for key in material_stack_t.part_keys():
            part_mesh = material_stack_t.part(key).mesh
            meshes.append(part_mesh)
            vertices = [part_mesh.vertex_coordinates(i) for i in part_mesh.vertices()]
            mesh_id = "brick_"+str(key)
            mesh_ids.append(mesh_id)
            frames.append(Frame.worldXY())
        tasks = [AddCollisionMeshes(robot, meshes, frames, mesh_ids, attached=False)]

    # if assemblies[0] is not None:
    #     stack_assembly = assemblies[0]
    #     t_stack_assembly = stack_assembly.transformed(robot.transformation_WCF_BCF())
    #     tasks = []
    #     for key in t_stack_assembly.part_keys():
    #         part_mesh = t_stack_assembly.part(key).mesh
    #         vertices = [part_mesh.vertex_coordinates(i) for i in part_mesh.vertices()]
    #         tasks.append(AddCollisionMesh(robot, mesh=part_mesh, mesh_id="brick_"+str(key), attached=False))
    # tasks = [AddCollisionMesh(robot, mesh = a_mesh, mesh_id="thing", attached=False)]
    # tasks = [RemoveCollisionMesh(robot, mesh_id="thing")]

#target_plane = frame_to_rhino_plane(frame_WCF)

print(tasks)
# ---------- end generate_tasks ----------
reassembly_tasks = Python3Script(
    routine=list_6,
    fabrication=fabrication,
    robot=robot,
    snap_planes=snapshot_poses_2.snap_planes,
    closeup_plane=llm_closeup_snaps.closeup_plane,
    config=forward_kinematics.arm_configuration,
    material_stack_1=transform_assembly.assembly,
    material_stack_2=transform_assembly_3.assembly,
    overview_snapshot_side=list_8,
    building_structure=transform_assembly_2.assembly)  # -> out, tasks, place_key, source_stack_key, source_brick_key, target_planes; inputs snap_planes: list of Plane
# ---------- reassembly_tasks: Python ----------
import roslibpy
import time
from fabrication_manager.task import Task
from compas_robots import Configuration
from compas.geometry import Translation, Rotation, Frame, Box, Transformation, Point, Quaternion, Vector, distance_point_point
from compas.datastructures import Mesh
from compas_rhino.conversions import plane_to_compas_frame, frame_to_rhino_plane
import numpy as np
import math
from assembly_information_model import Part
import open3d
import random
from scipy.spatial.transform import Rotation as R
from mobile_robot_control.pointcloud_processing.icp import preprocess_point_cloud_icp, evaluate_local_registration, execute_icp_local_registration
from scriptcontext import sticky as st
from mobile_robot_control import MoveJointsURdirectTask, MoveLinearURdirectTask
from workshop_iaac_2026 import ChangeToolFrameTask, PickBrickURTask, PlaceBrickURTask, UpdateAssemblyAttributes, ScanStackMarkerTask, GlobalMarkerTask, CleanBricksTask, TriggerEstimationTask, ScanSingleBrickTask
from ur_fabrication_control.direct_control.fabrication import URTask
from fabrication_manager.task import Task
from ur_fabrication_control.direct_control import URScript
from ur_fabrication_control.direct_control.common import send_stop
from ur_fabrication_control.direct_control.mixins import URScript, URScript_AreaGrip, URScript_ParallelGrip

ur_ip = st['ur_ip']
ur_port = st['ur_port']
robot_address = (ur_ip, ur_port)

target_planes = []

box = Box(0.1,0.1,0.1, Frame.worldXY())
a_mesh = box.to_mesh()

closeup_snapshot = plane_to_compas_frame(closeup_plane)

if overview_snapshot_side == "left":
    overview_marker_snap_planes = snap_planes[6:7]
else:
    overview_marker_snap_planes = snap_planes[-1:]

left_front_safe_RCF = Frame([0.7, -0.4, 0], Vector.Xaxis(), -Vector.Yaxis())
right_front_safe_RCF = Frame([-0.7, -0.4, 0], Vector.Xaxis(), -Vector.Yaxis())

tasks = []

material_stack_dict = {material_stack_1.graph.attributes["stack_key"]:material_stack_1,
                        material_stack_2.graph.attributes["stack_key"]:material_stack_2}

def select_place_brick(assembly):
    available_parts = [p for p in assembly.graph.nodes_where({"built": False})]
    if not available_parts:
        return None
    return min(available_parts)

if routine == "global_marker_snapshot":
    tasks = [ChangeToolFrameTask(robot, "gripper")]
    tasks.append(MoveJointsURdirectTask(robot, robot_address, config, velocity=0.1, radius=0.01))

    for snap_plane in overview_marker_snap_planes:
        frame_RCF = plane_to_compas_frame(snap_plane)
        target_planes.append(frame_to_rhino_plane(robot.from_RCF_to_WCF(frame_RCF)))
        tasks.append(MoveLinearURdirectTask(robot, robot_address, frame_RCF, in_RCF=True, velocity=0.1, payload=payload, CoG=CoG))
        tasks.append(GlobalMarkerTask(robot))

elif routine == "stack_marker_snapshot":
    material_stack = material_stack_dict[0]
    stack_key = material_stack.graph.attributes["stack_key"]
    print(stack_key)
    tasks = [ChangeToolFrameTask(robot, "gripper")]
    tasks.append(MoveJointsURdirectTask(robot, robot_address, config, velocity=0.1, radius=0.01))

    for snap_plane in overview_marker_snap_planes:
        frame_RCF = plane_to_compas_frame(snap_plane)
        target_planes.append(frame_to_rhino_plane(robot.from_RCF_to_WCF(frame_RCF)))
        tasks.append(MoveLinearURdirectTask(robot, robot_address, frame_RCF, in_RCF=True, velocity=0.1))
        tasks.append(ScanStackMarkerTask(robot, material_stack, stack_marker_id="marker_" + str(stack_key), position=0))

elif routine == "closeup_snapshot":
    place_key = select_place_brick(building_structure) # selecting the smallest brick key in the structure
    print("Place key: {}".format(place_key))
    place_frame = building_structure.part(place_key).frame
    # place_frame = place_frame.transformed(Rotation.from_axis_and_angle(place_frame.xaxis, math.radians(180), place_frame.point))

    source_stack_key = building_structure.graph.node_attribute(place_key, 'source_stack_key') 
    material_stack = material_stack_dict[source_stack_key]
    source_brick_key = building_structure.graph.node_attribute(place_key, 'source_brick_key')
    print("Source stack key: {}".format(source_stack_key))
    print("Source brick key: {}".format(source_brick_key))

    pick_frame = material_stack.part(source_brick_key).frame

    closeup_snapshot_frame = closeup_snapshot.transformed(Transformation.from_frame(pick_frame))
    target_planes.append(frame_to_rhino_plane(closeup_snapshot_frame))

    tasks.append(ChangeToolFrameTask(robot, "camera"))
    tasks.append(CleanBricksTask(robot))
    tasks.append(MoveLinearURdirectTask(robot, robot_address, closeup_snapshot_frame, in_RCF=False, velocity=0.1))
    tasks.append(TriggerEstimationTask(robot, trigger=True, sleep=10))
    tasks.append(ScanSingleBrickTask(robot, material_stack, source_brick_key))
    tasks.append(TriggerEstimationTask(robot, trigger=False, sleep=0))

elif routine == "pick_place":
    place_key = select_place_brick(building_structure) # selecting the smallest brick key in the structure
    print("Place key: {}".format(place_key))
    place_frame = building_structure.part(place_key).frame
    # place_frame = place_frame.transformed(Rotation.from_axis_and_angle(place_frame.xaxis, math.radians(180), place_frame.point))

    source_stack_key = building_structure.graph.node_attribute(place_key, 'source_stack_key') 
    material_stack = material_stack_dict[source_stack_key]
    source_brick_key = building_structure.graph.node_attribute(place_key, 'source_brick_key')
    print("Source stack key: {}".format(source_stack_key))
    print("Source brick key: {}".format(source_brick_key))

    pick_frame = material_stack.part(source_brick_key).frame

    # Transform with the marker position.
    last_marker_frame = None
    if "stack_key" in material_stack.graph.attributes.keys():
        marker_frames_WCF = material_stack.graph.attributes["marker_frames_WCF"]
        last_frame_key = max(marker_frames_WCF.keys())
        last_marker_frame = marker_frames_WCF[last_frame_key]
    if last_marker_frame is not None:
        pick_frame = pick_frame.transformed(Transformation.from_change_of_basis(last_marker_frame, Frame.worldXY()))

    # Find the safe frame:
    if last_marker_frame is not None:
        if robot.from_WCF_to_RCF(last_marker_frame).point.x > 0:
            stack_side_safe_RCF = left_front_safe_RCF
        else:
            stack_side_safe_RCF = right_front_safe_RCF

    target_planes.append(frame_to_rhino_plane(robot.from_RCF_to_WCF(stack_side_safe_RCF)))

    safe_pick_frame = pick_frame.transformed(Translation.from_vector([0,0,0.2]))
    target_planes.append(frame_to_rhino_plane(pick_frame))
    target_planes.append(frame_to_rhino_plane(safe_pick_frame))

    safe_place_frame = place_frame.transformed(Translation.from_vector([0,0,0.2]))
    target_planes.append(frame_to_rhino_plane(place_frame))
    target_planes.append(frame_to_rhino_plane(safe_place_frame))

    # Safety frames.
    tasks.append(ChangeToolFrameTask(robot, "gripper"))
    tasks.append(MoveLinearURdirectTask(robot, robot_address, stack_side_safe_RCF, in_RCF=True, velocity=0.1))

    # Pick frames on stack.
    tasks.append(MoveLinearURdirectTask(robot, robot_address, safe_pick_frame, in_RCF=False, velocity=0.1))
    tasks.append(PickBrickURTask(robot, robot_address, grip=True))
    tasks.append(MoveLinearURdirectTask(robot, robot_address, safe_pick_frame, in_RCF=False, velocity=0.1))

    # Safety frames.
    tasks.append(MoveLinearURdirectTask(robot, robot_address, stack_side_safe_RCF, in_RCF=True, velocity=0.1))

    # Place frames on structure.
    tasks.append(MoveLinearURdirectTask(robot, robot_address, safe_place_frame, in_RCF=False, velocity=0.1))
    tasks.append(PlaceBrickURTask(robot, robot_address))
    tasks.append(MoveLinearURdirectTask(robot, robot_address, safe_place_frame, in_RCF=False, velocity=0.1))

    # Safety frames.
    tasks.append(MoveLinearURdirectTask(robot, robot_address, stack_side_safe_RCF, in_RCF=True, velocity=0.1))

    # Update assemblies.
    tasks.append(UpdateAssemblyAttributes(material_stack, source_brick_key, attributes={"built":False, "available":False}))
    tasks.append(UpdateAssemblyAttributes(building_structure, place_key, attributes={"built":True, "available":False}))
# ---------- end reassembly_tasks ----------
pln_9 = Plane(disassembly_tasks.target_planes)

analytic_inverse = Python3Script(robot=robot, plane=pln_9, idx=select_configuration, robot_type=list_2)  # -> out, plane_RCF, configuration; inputs plane: list of Plane, idx: Int32
# ---------- analytic_inverse: Python ----------
import Rhino.Geometry as rg
import math
from compas.geometry import Frame, Transformation, Rotation
from compas_robots import Configuration
from ur_fabrication_control.kinematics.ur_kinematics import inverse_kinematics
from ur_fabrication_control.kinematics.ur_params import ur_params
from compas_rhino.conversions import plane_to_compas_frame

plane = plane[0]
# transform frame to robot coordinate system
frame_WCF = plane_to_compas_frame(plane)
frame_RCF = robot.from_WCF_to_RCF(frame_WCF)

if robot.attached_tool:
    tool0_RCF = robot.from_tcf_to_t0cf([frame_RCF])[0]
else:
    tool0_RCF = frame_RCF

# calculate solutions to frame
if "ur10e" in robot_type:
    ur_params = ur_params["ur10e"] 
else:
    ur_params = ur_params["ur20"] # get the parameters according to the robot model

# print ur_params
solutions = inverse_kinematics(tool0_RCF, ur_params)
print(solutions)
# print solutions

if not len(solutions):
    joint_values = [0, 0, 0, 0, 0, 0]
else:
    joint_values = solutions[idx]

if len(robot.get_configurable_joints()) == 6:
    configuration = Configuration.from_revolute_values(joint_values)
else:
    configuration = Configuration.from_prismatic_and_revolute_values([lift], joint_values)

print(configuration)
# ---------- end analytic_inverse ----------

panel_19 = Panel(disassembly_tasks.pick_key)
panel_20 = Panel(disassembly_tasks.place_key)
geo_7 = Geometry(disassembly_tasks.temp_brick)
panel_21 = Panel(reassembly_tasks.place_key)
panel_22 = Panel(reassembly_tasks.source_stack_key)
panel_23 = Panel(reassembly_tasks.source_brick_key)

pln_10 = Plane(reassembly_tasks.target_planes)
fabrication_manager = Python3Script(
    tasks=reassembly_tasks.tasks,
    fabrication=fabrication,
    set_tasks=Toggle(True),
    start=start_fabrication,
    stop=stop_fabrication,
    reset=reset_5,
    next_task=next_task,
    reset_task=reset_task,
    prev_task=prev_task)  # -> out, server; inputs tasks: list
# ---------- fabrication_manager: Python ----------
def task_state_set(state, t):
    t.is_completed = state
    t.is_running = False
    
if set_tasks:
    print("setting tasks")   
    fabrication.clear_tasks()
    fabrication.set_tasks(tasks)

if start:
    #if robot.is_connected(): #and arduino.is_connected():
    print("starting process")
    fabrication.start()

if stop:
    print("stopping process")
    fabrication.stop()
    
if reset:
    print("resetting process")
    fabrication.reset()

if next_task:
    t = fabrication.get_next_task()
    task_state_set(True, t)
    
if reset_task:
    t = fabrication.get_next_task()
    task_state_set(False, t)

if prev_task:
    t = fabrication.get_next_task()
    task_state_set(False, t)
    t = fabrication.tasks[fabrication.current_task_key-1]
    task_state_set(False, t)
    fabrication.get_next_task()
# ---------- end fabrication_manager ----------

# ----
# Move Joints
list_18 = ValueList({"send ik configuration": 0, "send one motion configuration": 1, "send all motion configurations": 2}, selected="send one motion configuration")
filter_2 = StreamFilter(
    Gate=list_18,
    Stream0=forward_kinematics.configuration,
    Stream1=forward_kinematics.arm_configuration,
    Stream2=analytic_inverse.configuration)
movej = Python3Script(configurations=filter_2, velocity=Slider(0.168, range=0..0.5))  # -> urscript, lift, values; inputs configurations: list
# ---------- movej: Python ----------
from ur_fabrication_control.direct_control import URScript
from compas_robots import Configuration
import math

urscript = URScript()
urscript.start()
for configuration in configurations:
    joint_configuration = Configuration.from_revolute_values(configuration.revolute_values)
    print(joint_configuration)
    lift = configuration
    urscript.move_joint(joint_configuration, velocity)
urscript.end()

urscript = urscript.generate()

print(urscript)
# ---------- end movej ----------
send_5 = Button()
ur_send_3 = Python3Script(urscript=movej.urscript, send=send_5)  # -> out
# ---------- ur_send_3: Python ----------
from scriptcontext import sticky as st
from ur_fabrication_control.direct_control import send_script

ur_ip = st["ur_ip"]
ur_port = st["ur_port"]

print(urscript)

if send:
    send_script(urscript, ur_ip, ur_port)
# ---------- end ur_send_3 ----------

disassembly_tasks_2 = Python3Script(
    routine=list_17,
    fabrication=fabrication,
    robot=robot,
    plane_WCF=temporary_place_plane,
    snap_planes=snapshot_poses_2.snap_planes,
    closeup_plane=snapshot_poses.closeup_plane,
    ev_closeup_plane=llm_closeup_snaps.closeup_plane,
    config=forward_kinematics.arm_configuration,
    material_stack=transform_assembly.assembly,
    stack_side=list_7,
    building_structure=transform_assembly_2.assembly)  # -> out, tasks, pick_key, place_key, target_planes, temp_brick; inputs snap_planes: list of Plane; disabled
# ---------- disassembly_tasks_2: Python ----------
import roslibpy
import time
from fabrication_manager.task import Task
from compas_robots import Configuration
from compas.geometry import Translation, Rotation, Frame, Box, Transformation, Point, Quaternion, Vector, distance_point_point
from compas.datastructures import Mesh
from compas_rhino.conversions import plane_to_compas_frame, frame_to_rhino_plane, box_to_rhino
import numpy as np
import math
from assembly_information_model import Part
import open3d
import random
import os
from scipy.spatial.transform import Rotation as R
from mobile_robot_control.pointcloud_processing.icp import preprocess_point_cloud_icp, evaluate_local_registration, execute_icp_local_registration
from scriptcontext import sticky as st
from mobile_robot_control import MoveJointsURdirectTask, MoveLinearURdirectTask
from ur_fabrication_control.direct_control.fabrication import URTask
from ur_fabrication_control.direct_control import URScript
from ur_fabrication_control.direct_control.common import send_stop
from ur_fabrication_control.direct_control.mixins import URScript, URScript_AreaGrip, URScript_ParallelGrip

ur_ip = st['ur_ip']
ur_port = st['ur_port']
robot_address = (ur_ip, ur_port)
# print(robot_address)

payload, CoG = 1.2, [-0.005, 0.0, 0.052]
payload_brick, CoG_brick = 3.8, [-0.005, 0.0, 0.115]

target_planes = []

box = Box(0.24,0.115,0.045, Frame.worldXY())
a_mesh = box.to_mesh()

closeup_snapshot = plane_to_compas_frame(closeup_plane)
ev_closeup_snapshot = plane_to_compas_frame(ev_closeup_plane)

# Temporary brick position.
temp_frame = plane_to_compas_frame(plane_WCF)
temp_brick = box_to_rhino(box.transformed(Transformation.from_frame(temp_frame)))

if stack_side == "left":
    marker_snap_planes = snap_planes[6:7]
else:
    marker_snap_planes = snap_planes[-1:]

left_front_safe_RCF = Frame([0.7, -0.4, 0], Vector.Xaxis(), -Vector.Yaxis())
right_front_safe_RCF = Frame([-0.7, -0.4, 0], Vector.Xaxis(), -Vector.Yaxis())

#### This is according to stack and temp frame location to do the robot!!!
if robot.from_WCF_to_RCF(temp_frame).point.x > 0:
    temp_side_safe_RCF = left_front_safe_RCF
else:
    temp_side_safe_RCF = right_front_safe_RCF

# Find the stack's marker's last frame.
last_marker_frame = None
if "stack_key" in material_stack.graph.attributes.keys():
    marker_frames_WCF = material_stack.graph.attributes["marker_frames_WCF"]
    last_frame_key = max(marker_frames_WCF.keys())
    last_marker_frame = marker_frames_WCF[last_frame_key]

if last_marker_frame is not None:
    if robot.from_WCF_to_RCF(last_marker_frame).point.x > 0:
        stack_side_safe_RCF = left_front_safe_RCF
    else:
        stack_side_safe_RCF = right_front_safe_RCF

tasks = []

def select_pick_brick(assembly, tolerance=0.02):
    # Get all built parts
    built_parts = assembly.graph.nodes_where({"built": True})
    if not built_parts:
        return None

    # Collect (part, z, y) triples
    part_coords = [(p, assembly.part(p).frame.point.z, assembly.part(p).frame.point.y) for p in built_parts]

    # Find the maximum z
    max_z = max(z for _, z, _ in part_coords)

    # Filter parts within tolerance of max_z
    close_parts = [(p, y) for p, z, y in part_coords if max_z - z <= tolerance]

    # Choose the one with the highest y
    selected_part = max(close_parts, key=lambda item: item[1])[0]

    return selected_part

def select_place_brick(assembly):
    available_parts = [p for p in assembly.graph.nodes_where({"available": True})]
    if not available_parts:
        return None
    return min(available_parts)

def slerp_quat(q1, q2, t):
    q1 = q1 / np.linalg.norm(q1)
    q2 = q2 / np.linalg.norm(q2)
    dot = np.dot(q1, q2)
    if dot < 0.0:
        q2 = -q2
        dot = -dot
    if dot > 0.9995:
        q = q1 + t * (q2 - q1)
        return q / np.linalg.norm(q)
    theta_0 = np.arccos(dot)
    theta = theta_0 * t
    q3 = q2 - q1 * dot
    q3 = q3 / np.linalg.norm(q3)
    return q1 * np.cos(theta) + q3 * np.sin(theta)

def average_frame(frame_a, frame_b):
    # --- Average position ---
    p = Point(
        0.5 * (frame_a.point.x + frame_b.point.x),
        0.5 * (frame_a.point.y + frame_b.point.y),
        0.5 * (frame_a.point.z + frame_b.point.z),
    )

    # --- Average orientation via SLERP ---
    R_a = Rotation.from_frame(frame_a)
    R_b = Rotation.from_frame(frame_b)

    qa = np.array(R_a.quaternion)
    qb = np.array(R_b.quaternion)

    q_avg = slerp_quat(qa, qb, 0.5)
    R_avg = Rotation.from_quaternion(q_avg)

    # --- Build averaged frame ---
    avg_frame = Frame.from_rotation(R_avg)
    avg_frame.point = p
    return avg_frame

class ChangeToolFrameTask(Task):
    def __init__(self, robot, tool_name='gripper', key=None):
        super(ChangeToolFrameTask, self).__init__(key)
        self.robot = robot
        self.tool_name = tool_name
        gripper_frame = Frame([0, 0, 0.134], [0, -1, 0], [1, 0, 0])
        camera_frame = Frame.from_quaternion(Quaternion(0, 0, 0.707106, 0.707106), [0.0325, 0.0781, 0.0185])
        if tool_name == 'gripper':
            self.tool_frame = gripper_frame
        else:
            self.tool_frame = camera_frame
        
    def run(self, stop_thread):
        self.log("ChangeToolTask")
        self.log('Changing the tool frame to {}.'.format(self.tool_name))
        self.robot.attached_tools['arm_0'].frame = self.tool_frame
        self.is_completed = True
        return True

class ReceiveCameraImageTask(Task):
    def __init__(self, robot, brick_key=0, view="A", stack_key=0, data_path="C:/Users/saral/workspace/projects/workshop_iaac_2026/data/images_evaluation", key=None):
        super(ReceiveCameraImageTask, self).__init__(key)
        self.robot = robot
        self.brick_key = brick_key
        self.view = view
        self.data_path = data_path
        self.stack_key = stack_key
        self.img_msg = None
    
    def _receive_message(self, message):
        if self.img_msg is None:
            self.img_msg = message
            self.log("Received image msg.")

    def run(self, stop_thread):
        self.log('Receiving the view {} for brick {}!'.format(self.view, self.brick_key))
        self.log("Sleeping for 4 seconds.")
        time.sleep(4)

        while not stop_thread():
            self.robot.mobile_client.topic_subscribe(
                "/camera/camera/color/image_raw", "sensor_msgs/msg/Image", self._receive_message
            )
            if self.img_msg is not None:
                break
            time.sleep(0.1)

        self.robot.mobile_client.topic_unsubscribe("/camera/camera/color/image_raw")

        DATA = os.path.abspath(self.data_path)
        PATH = os.path.join(DATA, "stack{}_brick{}_view{}.npy".format(self.stack_key, self.brick_key, self.view))
        self.log(PATH)
        np.save(PATH, self.img_msg)
        self.log("Saved image msg.")

        self.is_completed = True
        return True

class PickBrickURTask(URTask):
    def __init__(self, robot, robot_address, assembly=None, brick_key=None, grip=True, key=None):
        super(PickBrickURTask, self).__init__(robot, robot_address, key)
        self.robot = robot
        self.robot_address = robot_address
        self.assembly = assembly
        self.brick_key = brick_key
        self.grip = grip

    def urscript_fabrication_header(self):
        ## Initialize instance
        self.urscript = URScript_ParallelGrip(*self.robot_address)
        self.urscript.start()
        
        if self.robot:
            ## Set tool
            tool = self.robot.attached_tool
            self.urscript.set_tcp(list(tool.frame.point)+list(tool.frame.axis_angle_vector))
        self.urscript.textmessage(">> Starting TASK {}.".format(self.key), string=True)
        
        if self.server:
            self.urscript.set_socket(self.server.ip, self.server.port, self.server.name)
            self.urscript.socket_open(self.server.name)
            ## Send script received msg
            self.urscript.socket_send_line_string(self.rec_msg, self.server.name)
    
    def create_urscript(self):
        self.log("Picking started!")
        self.urscript.set_payload(1.2, [-0.005, 0.0, 0.052])
        self.urscript.parallelgrip_open()

        # Move down 1st try.
        self.urscript.move_force_mode(force_z=20.0, speed_z=0.015)
        self.urscript.stop_by_force(15.0)

        if self.assembly is not None:
            brick_frame = self.robot.from_WCF_to_RCF(self.assembly.part(self.brick_key).frame.transformed(Translation.from_vector(Vector.Zaxis()*0.0225)))
            brick_pose = brick_frame.point.__data__ + brick_frame.axis_angle_vector.__data__
            # Check the x force.
            self.urscript.add_line("complete_force = get_tcp_force()")
            self.urscript.add_line("x_force = complete_force[3]")
            self.urscript.add_lines(["textmsg(complete_force)"])
            self.urscript.add_lines(["textmsg(x_force)"])
            self.urscript.add_line("brick_pose = p[{}, {}, {}, {}, {}, {}]".format(*brick_pose))
            self.urscript.add_line("distance_taken = 0.001")
            # self.urscript.add_line("textmsg(brick_pose)")
            self.urscript.add_line("current_tcp_pose = get_actual_tcp_pose()")
            # self.urscript.add_line("textmsg(current_tcp_pose)")
            # self.urscript.add_line("textmsg(norm(brick_pose[2] - current_tcp_pose[2]))")
            self.urscript.add_line("last_move = 0")
            # # Check if in close 3 cm (in z axis), if not move around and try again.
            self.urscript.add_line("while norm(brick_pose[2] - current_tcp_pose[2]) > 0.037:", indent=1) # or distance_taken > 0.01
            # self.urscript.add_line("textmsg(norm(brick_pose[2] - current_tcp_pose[2]))", indent=2)

            self.urscript.add_line("pose_new = get_actual_tcp_pose()", indent=2)
            self.urscript.move_tool_by_distance(z_distance=-0.004, indent=2)
            self.urscript.add_line("sleep({})".format(1.0), indent=2)

            self.urscript.add_line("if x_force > 0:", indent=2)
            self.urscript.move_tool_by_distance(y_distance=-0.008, indent=3)
            self.urscript.add_line("last_move = -1", indent=3)
            self.urscript.add_line("else:", indent=2)
            self.urscript.move_tool_by_distance(y_distance=0.008, indent=3)
            self.urscript.add_line("last_move = 1", indent=3)
            self.urscript.add_line("end", indent=2)

            # Move down again.
            self.urscript.add_line("sleep({})".format(1.0), indent=2)
            self.urscript.move_force_mode(force_z=20.0, speed_z=0.015, indent=2)
            self.urscript.stop_by_force(15.0, indent=2)
            self.urscript.add_line("complete_force = get_tcp_force()",indent=2)
            self.urscript.add_line("x_force = complete_force[3]",indent=2)
            self.urscript.add_lines(["textmsg(complete_force)"], indent=2)
            self.urscript.add_lines(["textmsg(x_force)"], indent=2)

            self.urscript.add_line("pose_new_low = get_actual_tcp_pose()", indent=2)
            self.urscript.add_line("distance_taken = pose_dist(pose_new, pose_new_low)", indent=2)
            self.urscript.add_line("current_tcp_pose = get_actual_tcp_pose()", indent=2)

            self.urscript.add_line("end", indent=1)

        self.urscript.textmessage("Got the brick.", string=True)

        # Move up a little.
        self.urscript.move_tool_by_distance(z_distance=-0.003)
        self.urscript.add_line("sleep({})".format(2.0))

        if self.assembly is not None:
            # Move further in y direction.
            self.urscript.add_line("if last_move < 0:")
            self.urscript.move_tool_by_distance(y_distance=-0.008, indent=1)
            self.urscript.add_line("elif last_move > 0:")
            self.urscript.move_tool_by_distance(y_distance=0.008, indent=1)
            self.urscript.add_line("end", indent=1)

        # # Go in x to get a mid point.
        # self.urscript.move_force_mode(force_y=-10.0, speed_y=0.010)
        # self.urscript.stop_by_force(15.0)

        # # Go to middle.
        # self.urscript.add_line("sleep({})".format(1.0))
        # self.urscript.move_tool_by_distance(x_distance=0.0075)
        # self.urscript.add_line("sleep({})".format(1.0))

        # # Move down.
        # self.urscript.move_force_mode(force_z=15.0, speed_z=0.010)
        # self.urscript.stop_by_force(15.0)

        if self.grip:
            self.urscript.parallelgrip_close()

class PlaceBrickURTask(URTask):
    def __init__(self, robot, robot_address, release=True, key=None):
        super(PlaceBrickURTask, self).__init__(robot, robot_address, key)
        self.robot = robot
        self.robot_address = robot_address
        self.release = release

    def urscript_fabrication_header(self):
        ## Initialize instance
        self.urscript = URScript_ParallelGrip(*self.robot_address)
        self.urscript.start()
        
        if self.robot:
            ## Set tool
            tool = self.robot.attached_tool
            self.urscript.set_tcp(list(tool.frame.point)+list(tool.frame.axis_angle_vector))
        self.urscript.textmessage(">> TASK {}".format(self.key), string=True)
        
        if self.server:
            self.urscript.set_socket(self.server.ip, self.server.port, self.server.name)
            self.urscript.socket_open(self.server.name)
            ## Send script received msg
            self.urscript.socket_send_line_string(self.rec_msg, self.server.name)
                
    def create_urscript(self):
        self.log("Placing started!")
        self.urscript.set_payload(3.8, [-0.005, 0.0, 0.115])

        self.urscript.parallelgrip_close()

        self.urscript.add_line("\tsleep({})".format(1.0))

        self.urscript.move_force_mode(force_z=50.0, speed_z=0.03)
        self.urscript.stop_by_force(20.0)

        if self.release:
            self.urscript.parallelgrip_open()
        
        self.urscript.set_payload(1.2, [-0.005, 0.0, 0.052])
        self.urscript.move_tool_by_distance(z_distance=-0.1, velocity=0.1, radius=0.01)
        self.urscript.parallelgrip_close()

class UpdateAssemblyAttributes(Task):
    def __init__(self, assembly, brick_key, attributes={"built":False, "pick_key":0}, key=None):
        super(UpdateAssemblyAttributes, self).__init__(key)
        self.assembly = assembly
        self.brick_key = brick_key
        self.attributes = attributes
    
    def update_neighbor_availability(self, assembly, part_key=None):
        updated_keys = []
        # Determine which parts to check
        part_keys = (
            assembly.graph.neighbors_out(part_key)
            if part_key is not None
            else assembly.part_keys()
        )
        for key in part_keys:
            below = assembly.graph.neighbors_in(key)
            below_built = all(
                bool(assembly.graph.node_attribute(n, "built")) for n in below
            )

            if below_built and not assembly.graph.node_attribute(key, "available"):
                assembly.graph.node_attribute(key, "available", True)
                updated_keys.append(key)
        return updated_keys

    def run(self, stop_thread):
        # Change brick attributes:
        for attribute, value in self.attributes.items():
            self.assembly.graph.node_attribute(self.brick_key, attribute, value)
        self.is_completed = True
        return True

class TriggerEstimationTask(Task):
    def __init__(self, robot, trigger=True, cuda_off=False, sleep=0, key=None):
        super(TriggerEstimationTask, self).__init__(key)
        self.robot = robot
        self.trigger = trigger
        self.cuda_off = cuda_off
        self.sleep = sleep
        
    def run(self, stop_thread):
        self.log('Estimation is set to {}!'.format(self.trigger))
        if self.cuda_off:
            service_name = '/trigger_pose_complete'
        else:
            service_name = '/trigger_pose'

        while not stop_thread():
            if self.robot.mobile_client.is_service_available(service_name):
                result = self.robot.mobile_client.service_call(service_name, 'std_srvs/SetBool', {'data': self.trigger})
                success = result['success']
                message = result['message']
                self.log('Activation message: {}'.format(message))
                if success:
                    break
            else:
                self.log("Trigger for estimation service is not available.")
                break
            time.sleep(0.1)

        self.log("Sleeping for {} seconds...".format(str(self.sleep)))
        time.sleep(self.sleep)

        self.is_completed = True
        return True

class CleanBricksTask(Task):
    def __init__(self, robot, key=None):
        super(CleanBricksTask, self).__init__(key)
        self.robot = robot
        
    def run(self, stop_thread):
        self.log('CleanBricksTask')
        service_name = '/clean_bricks'

        while not stop_thread():
            if self.robot.mobile_client.is_service_available(service_name):
                result = self.robot.mobile_client.service_call(service_name, 'std_srvs/SetBool', {'data': True})
                success = result['success']
                message = result['message']
                self.log('Activation message: {}'.format(message))
                if success:
                    break
            else:
                self.log("Clean bricks service is not available.")
                break
            time.sleep(0.1)

        self.is_completed = True
        return True

class ScanMarkersTask(Task):
    def __init__(self, robot, marker_ids=["marker_0"], reference_frame_id="base", key=None):
        super(ScanMarkersTask, self).__init__(key)
        self.robot = robot
        self.marker_ids = marker_ids
        self.reference_frame_id = reference_frame_id

    def get_detected_markers(self, stop_thread):
        self.log("Scanning markers...")
        marker_dict = {}

        for marker_id in self.marker_ids:
            self.log('Receiving the frame for marker: {}'.format(marker_id))
            pose = None

            self.robot.mobile_client.clean_tf_frame()
            time.sleep(0.5)
            self.robot.mobile_client.tf_subscribe(str(marker_id), self.reference_frame_id)

            time_limit = 10
            start_time = time.time()
            left_time = 10
            # Wait until pose is received.
            while not stop_thread() and left_time > 0:
                if self.robot.mobile_client.tf_frame is not None:
                    pose = Frame(self.robot.mobile_client.tf_frame.point, 
                                    Vector(self.robot.mobile_client.tf_frame.xaxis.x,self.robot.mobile_client.tf_frame.xaxis.y),
                                    Vector(self.robot.mobile_client.tf_frame.yaxis.x, self.robot.mobile_client.tf_frame.yaxis.y)) # Correcting to the ground.
                    break
                time.sleep(0.1)
                left_time = time_limit - (time.time() - start_time)

            if pose is None:
                self.log('For marker with id {}, could not get the frame.'.format(marker_id))
            else:
                marker_dict[marker_id] = pose
                self.log('For marker with id {}, got the pose: {}'.format(marker_id, pose))
    
            self.robot.mobile_client.tf_unsubscribe(str(marker_id), self.reference_frame_id)

        self.log("Scanning completed.")

        return marker_dict

    def run(self, stop_thread):
        marker_dict = self.get_detected_markers(stop_thread)
        self.log(marker_dict)
        self.is_completed = True
        return True

class ScanStackMarkerTask(ScanMarkersTask):
    def __init__(self, robot, assembly, stack_marker_id="marker_1", position=0, key=None):
        super(ScanStackMarkerTask, self).__init__(robot, marker_ids=[stack_marker_id], reference_frame_id="base", key=key)
        self.robot = robot
        self.assembly = assembly
        self.stack_marker_id = stack_marker_id
        self.position = 0

    def run(self, stop_thread):
        marker_dict = self.get_detected_markers(stop_thread)
        marker_frame = marker_dict[self.stack_marker_id]
        marker_frame_WCF = self.robot.from_RCF_to_WCF(marker_frame)

        if "marker_frames_WCF" not in self.assembly.graph.attributes:
            self.assembly.graph.attributes["marker_frames_WCF"] = {}

        self.assembly.graph.attributes["marker_frames_WCF"][str(self.position)] = marker_frame_WCF

        self.is_completed = True
        return True

class GlobalMarkerTask(ScanMarkersTask):
    def __init__(self, robot, key=None):
        super(GlobalMarkerTask, self).__init__(robot, marker_ids=["marker_0"], reference_frame_id="base", key=key)
        self.robot = robot

    def run(self, stop_thread):
        marker_dict = self.get_detected_markers(stop_thread)
        marker_frame = marker_dict["marker_0"]
        marker_frame_BCF = self.robot.from_RCF_to_BCF(marker_frame)
        BCF_in_marker = Frame.from_transformation(
                Transformation.from_frame(marker_frame_BCF).inverted()
            )
        self.log(BCF_in_marker)

        self.robot.BCF_slam = BCF_in_marker
        self.robot._record_state("BCF_slam")

        self.is_completed = True
        return True

class ScanBricksTask(Task):
    def __init__(self, robot, reference_frame_id="base", key=None):
        super(ScanBricksTask, self).__init__(key)
        self.robot = robot
        self.reference_frame_id = reference_frame_id

    def get_detected_bricks(self, stop_thread):
        self.log("Scanning bricks...")
        brick_dict = {}

        # Ask for estimated brick ids.
        while not stop_thread():
            self.log('Asking for the brick amount...')
            result = self.robot.mobile_client.service_call('/brick_amount', 'std_srvs/SetBool', {'data': True})
            if result['success']:
                brick_amount = int(result['message'])
                self.log("Brick amount is {}".format(brick_amount))
                break
            time.sleep(0.1)

        brick_list = [i for i in range(brick_amount)]

        # One by one get the frames of the bricks in the list.
        if len(brick_list) == 0:
            self.log('No bricks estimated.')
        else:
            for brick_id in brick_list:
                self.log('Receiving the frame for brick: {}'.format(brick_id))
                pose = None

                self.robot.mobile_client.clean_tf_frame()
                time.sleep(0.5)
                self.robot.mobile_client.tf_subscribe("brick_" + str(brick_id), self.reference_frame_id)

                time_limit = 10
                start_time = time.time()
                left_time = 10
                # Wait until pose is received.
                while not stop_thread() and left_time > 0:
                    if self.robot.mobile_client.tf_frame is not None:
                        pose = Frame(self.robot.mobile_client.tf_frame.point, 
                                        Vector(self.robot.mobile_client.tf_frame.xaxis.x,self.robot.mobile_client.tf_frame.xaxis.y),
                                        Vector(self.robot.mobile_client.tf_frame.yaxis.x, self.robot.mobile_client.tf_frame.yaxis.y)) # Correcting to the ground.
                        # Force brick frames to be same direction - xaxis to the robot.
                        if pose.zaxis.z > 0:
                            pose = pose.transformed(Rotation.from_axis_and_angle(pose.yaxis, math.radians(180), pose.point))
                        if pose.yaxis.x > 0:
                            pose = pose.transformed(Rotation.from_axis_and_angle(pose.zaxis, math.radians(180), pose.point))
                        break
                    time.sleep(0.1)
                    left_time = time_limit - (time.time() - start_time)

                if pose is None:
                    self.log('For brick with id {}, could not get the frame.'.format(brick_id))
                else:
                    # Transform to BCF_slam.
                    brick_dict[brick_id] = pose
                    self.log('For brick with id {}, got the pose: {}'.format(brick_id, pose))
        
                self.robot.mobile_client.tf_unsubscribe("brick_" + str(brick_id), self.reference_frame_id)

        self.log("Scanning completed.")

        return brick_dict

    def run(self, stop_thread):
        brick_dict = self.get_detected_bricks(stop_thread)
        self.is_completed = True
        return True
    
class ScanSingleBrickAddNewTask(ScanBricksTask):
    def __init__(self, robot, assembly, brick_key_to_update, average=False, key=None):
        super(ScanSingleBrickAddNewTask, self).__init__(robot, key=key)
        self.assembly = assembly
        self.brick_key_to_update = brick_key_to_update
        self.average = average

        self.brick_shape = Box(xsize=0.24, ysize=0.115, zsize=0.045)

    def find_next_available_key(self, assembly):
        s = set([p for p in assembly.part_keys()])
        i = 1
        while i in s:
            i += 1
        return i

    def run(self, stop_thread):
        brick_dict = self.get_detected_bricks(stop_thread)

        self.log("Updating only the brick {}...".format(self.brick_key_to_update))

        for brick_id, pose in brick_dict.items():
            pose = self.robot.from_RCF_to_WCF(pose) 
            
            target_key = None
            # Compare the pose to each pose in assembly by seeing the distance.
            closest_distance = 0.1
            for key in self.assembly.graph.nodes_where({"built": True}):
                distance = distance_point_point(self.assembly.part(key).frame.point, pose.point)
                if distance < closest_distance:
                    self.log("Distance is {}".format(distance))
                    self.log("Brick {} is the same as id {}".format(key, brick_id))
                    closest_distance = distance
                    target_key = key
                    
            # Create a new element.
            if target_key is None:
                # Create *new* brick entry.
                key = self.find_next_available_key(self.assembly) 
                brick = Part()
                brick.shape = self.brick_shape
                brick.mesh = Mesh.from_shape(self.brick_shape)
                brick.frame = pose.copy()
                self.assembly.add_part(
                    brick,
                    key=key,
                    estimated_frame=pose.copy(),
                    initial_estimated_frame=pose.copy(),
                    available=True,
                    built=True
                )

                self.log("Creating a new brick key {} with frame {}".format(key, pose))

            # dist = distance_point_point(self.assembly.part(self.brick_key_to_update).frame.point, pose.point)
            # if dist < closest_distance:
            #     closest_distance = dist
            #     target_key = brick_id

            elif target_key == self.brick_key_to_update:
                self.log("Updating the pose of the brick key {} with id {}".format(self.brick_key_to_update, brick_id))

                if self.average:
                    current_pose = self.assembly.part(self.brick_key_to_update).frame
                    # find average:
                    average_pose = average_frame(current_pose, pose)
                    pose = average_pose
                    pose_BCF = self.robot.from_WCF_to_BCF(pose)
                    self.log("I took average.")

                part = self.assembly.part(self.brick_key_to_update)
                part.frame = pose.copy()
                self.assembly.graph.node_attribute(self.brick_key_to_update, 'estimated_frame', pose.copy())
            else:
                self.log("Not updating existing bricks other than {}.".format(self.brick_key_to_update))
                
        self.is_completed = True
        return True

class ScanAllBricksTask(ScanBricksTask):
    def __init__(self, robot, assembly, key=None):
        super(ScanAllBricksTask, self).__init__(robot, key=key)
        self.assembly = assembly
        self.brick_shape = Box(xsize=0.24, ysize=0.115, zsize=0.045)
    
    def find_next_available_key(self, assembly):
        s = set([p for p in assembly.part_keys()])
        i = 0
        while i in s:
            i += 1
        return i

    def run(self, stop_thread):
        time.sleep(2)
        brick_dict = self.get_detected_bricks(stop_thread)
        self.log("Registering all bricks...")

        for brick_id, pose in brick_dict.items():
            pose = self.robot.from_RCF_to_WCF(pose) 
            target_key = None
            # Compare the pose to each pose in assembly by seeing the distance.
            closest_distance = 0.05
            for key in self.assembly.graph.nodes():
                distance = distance_point_point(self.assembly.part(key).frame.point, pose.point)
                if distance < closest_distance:
                    self.log("Distance is {}".format(distance))
                    self.log("Brick {} is the same as id {}".format(key, brick_id))
                    closest_distance = distance
                    target_key = key
                    
            # Create a new element.
            if target_key is None:
                # Create *new* brick entry.
                key = self.find_next_available_key(self.assembly)
                brick = Part()
                brick.shape = self.brick_shape
                brick.mesh = Mesh.from_shape(self.brick_shape)
                brick.frame = pose.copy()
                self.assembly.add_part(
                    brick,
                    key=key,
                    estimated_frame=pose.copy(),
                    initial_estimated_frame=pose.copy(),
                )

                self.log("Creating a new brick key {} with frame {}".format(key, pose))
                self.assembly.graph.node_attribute(key, 'available', True)
                self.assembly.graph.node_attribute(key, 'built', True)

            elif target_key is not None:
                self.log("Updating the pose of the brick key {}".format(target_key))
                # Update existing element.
                self.assembly.find_by_key(target_key).frame = pose.copy()
                self.assembly.graph.node_attribute(target_key, 'estimated_frame', pose.copy())
                self.assembly.graph.node_attribute(target_key, 'initial_estimated_frame', pose.copy())
                        
        self.log("Registered all bricks...")
        self.is_completed = True
        return True

if routine == "global_marker_snapshot":
    tasks = [ChangeToolFrameTask(robot, "gripper")]
    # tasks.append(MoveJointsURdirectTask(robot, robot_address, config, velocity=0.1, radius=0.01))

    for snap_plane in marker_snap_planes:
        frame_RCF = plane_to_compas_frame(snap_plane)
        target_planes.append(frame_to_rhino_plane(robot.from_RCF_to_WCF(frame_RCF)))
        tasks.append(MoveLinearURdirectTask(robot, robot_address, frame_RCF, in_RCF=True, velocity=0.1, payload=payload, CoG=CoG))
        tasks.append(GlobalMarkerTask(robot))

elif routine == "stack_marker_snapshot":
    if "stack_key" not in material_stack.graph.attributes:
        print("Assign new stack key!")
        # material_stack.graph.attributes["stack_key"] = 1

    stack_key = material_stack.graph.attributes["stack_key"]
    print(stack_key)
    tasks = [ChangeToolFrameTask(robot, "gripper")]
    tasks.append(MoveJointsURdirectTask(robot, robot_address, config, velocity=0.1, radius=0.01))

    for snap_plane in marker_snap_planes:
        frame_RCF = plane_to_compas_frame(snap_plane)
        target_planes.append(frame_to_rhino_plane(robot.from_RCF_to_WCF(frame_RCF)))
        tasks.append(MoveLinearURdirectTask(robot, robot_address, frame_RCF, in_RCF=True, velocity=0.1))
        tasks.append(ScanStackMarkerTask(robot, material_stack, stack_marker_id="marker_" + str(stack_key), position=0))

elif routine == "overview_snapshot":
    tasks = [ChangeToolFrameTask(robot, "gripper")]
    tasks.append(MoveJointsURdirectTask(robot, robot_address, config, velocity=0.1, radius=0.01))
    tasks.append(CleanBricksTask(robot))

    for snap_plane in snap_planes[8:9]: #[:5]
        frame_RCF = plane_to_compas_frame(snap_plane)
        target_planes.append(frame_to_rhino_plane(robot.from_RCF_to_WCF(frame_RCF)))
        tasks.append(MoveLinearURdirectTask(robot, robot_address, frame_RCF, in_RCF=True, velocity=0.1))
        tasks.append(TriggerEstimationTask(robot, trigger=True, sleep=10))
        tasks.append(ScanAllBricksTask(robot, assembly=building_structure))
        tasks.append(TriggerEstimationTask(robot, trigger=False, sleep=0))

    tasks.append(TriggerEstimationTask(robot, trigger=False, cuda_off=True, sleep=0))

elif routine == "closeup_snapshot":
    pick_key = select_pick_brick(building_structure)
    pick_frame = building_structure.part(pick_key).frame
    closeup_snapshot_frame = closeup_snapshot.transformed(Transformation.from_frame(pick_frame))
    target_planes.append(frame_to_rhino_plane(closeup_snapshot_frame))

    tasks.append(ChangeToolFrameTask(robot, "camera"))
    tasks.append(CleanBricksTask(robot))
    tasks.append(MoveLinearURdirectTask(robot, robot_address, closeup_snapshot_frame, in_RCF=False, velocity=0.1))
    tasks.append(TriggerEstimationTask(robot, trigger=True, sleep=10))
    tasks.append(ScanSingleBrickAddNewTask(robot, building_structure, pick_key))
    tasks.append(TriggerEstimationTask(robot, trigger=False, sleep=0))

elif routine == "pick_place":
    pick_key = select_pick_brick(building_structure)
    place_key = select_place_brick(material_stack)

    pick_frame = building_structure.part(pick_key).frame.transformed(Translation.from_vector([0,0,0.0225]))
    safe_pick_frame = pick_frame.transformed(Translation.from_vector([0,0,0.2]))
    target_planes.append(frame_to_rhino_plane(safe_pick_frame))

    # Pick tasks.
    tasks.append(ChangeToolFrameTask(robot, "gripper"))
    tasks.append(MoveLinearURdirectTask(robot, robot_address, safe_pick_frame, in_RCF=False, velocity=0.1))
    tasks.append(PickBrickURTask(robot, robot_address, building_structure, pick_key, grip=True))
    tasks.append(MoveLinearURdirectTask(robot, robot_address, safe_pick_frame, in_RCF=False, velocity=0.1))

    target_planes.append(frame_to_rhino_plane(robot.from_RCF_to_WCF(temp_side_safe_RCF)))

    # Safety mid frame.
    tasks.append(MoveLinearURdirectTask(robot, robot_address, temp_side_safe_RCF, in_RCF=True, velocity=0.1))

    safe_temp_place_frame = temp_frame.transformed(Translation.from_vector([0,0,0.2]))
    target_planes.append(frame_to_rhino_plane(safe_temp_place_frame))

    # Place tasks.
    tasks.append(MoveLinearURdirectTask(robot, robot_address, safe_temp_place_frame, in_RCF=False, velocity=0.1))
    tasks.append(PlaceBrickURTask(robot, robot_address))
    tasks.append(MoveLinearURdirectTask(robot, robot_address, safe_temp_place_frame, in_RCF=False, velocity=0.1))

    # Update assemblies.
    tasks.append(UpdateAssemblyAttributes(building_structure, pick_key, attributes={"built":False, "available":False, "place_key":place_key}))
    tasks.append(UpdateAssemblyAttributes(material_stack, place_key, attributes={"pick_key":pick_key, "estimated_frame":pick_frame}))

elif routine == "receive_images":
    place_key = select_place_brick(material_stack)
    stack_key = material_stack.graph.attributes["stack_key"]

    safe_temp_frame = temp_frame.transformed(Translation.from_vector([0,0,0.2]))
    target_planes.append(frame_to_rhino_plane(safe_temp_frame))

    closeup_snapshot_frame = ev_closeup_snapshot.transformed(Transformation.from_frame(temp_frame))
    target_planes.append(frame_to_rhino_plane(closeup_snapshot_frame))
    closeup_snapshot_frame2 = closeup_snapshot_frame.transformed(Rotation.from_axis_and_angle(temp_frame.zaxis, math.radians(180), temp_frame.point))
    target_planes.append(frame_to_rhino_plane(closeup_snapshot_frame2))

    tasks.append(ChangeToolFrameTask(robot, "gripper"))
    tasks.append(MoveLinearURdirectTask(robot, robot_address, safe_temp_frame, in_RCF=False, velocity=0.1))

    tasks.append(ChangeToolFrameTask(robot, "camera"))
    tasks.append(MoveLinearURdirectTask(robot, robot_address, closeup_snapshot_frame, in_RCF=False, velocity=0.1))
    tasks.append(ReceiveCameraImageTask(robot, brick_key=place_key, view="A", stack_key=stack_key))

    tasks.append(ChangeToolFrameTask(robot, "gripper"))
    tasks.append(MoveLinearURdirectTask(robot, robot_address, safe_temp_frame, in_RCF=False, velocity=0.1))

    tasks.append(ChangeToolFrameTask(robot, "camera"))
    tasks.append(MoveLinearURdirectTask(robot, robot_address, closeup_snapshot_frame2, in_RCF=False, velocity=0.1))
    tasks.append(ReceiveCameraImageTask(robot, brick_key=place_key, view="B", stack_key=stack_key))

elif routine == "replace":
    # Pick from temp brick position.
    safe_temp_place_frame = temp_frame.transformed(Translation.from_vector([0,0,0.2]))
    target_planes.append(frame_to_rhino_plane(safe_temp_place_frame))

    tasks.append(ChangeToolFrameTask(robot, "gripper"))
    tasks.append(MoveLinearURdirectTask(robot, robot_address, safe_temp_place_frame, in_RCF=False, velocity=0.1))
    tasks.append(PickBrickURTask(robot, robot_address, grip=True))
    tasks.append(MoveLinearURdirectTask(robot, robot_address, safe_temp_place_frame, in_RCF=False, velocity=0.1))

    # Safety frames.
    target_planes.append(frame_to_rhino_plane(robot.from_RCF_to_WCF(temp_side_safe_RCF)))
    tasks.append(MoveLinearURdirectTask(robot, robot_address, temp_side_safe_RCF, in_RCF=True, velocity=0.1))

    target_planes.append(frame_to_rhino_plane(robot.from_RCF_to_WCF(stack_side_safe_RCF)))
    tasks.append(MoveLinearURdirectTask(robot, robot_address, stack_side_safe_RCF, in_RCF=True, velocity=0.1))

    # Place to stack, and transform place frame with the marker position.
    place_key = select_place_brick(material_stack)

    place_frame = material_stack.part(place_key).frame
    place_frame = place_frame.transformed(Transformation.from_change_of_basis(last_marker_frame, Frame.worldXY()))
    safe_place_frame = place_frame.transformed(Translation.from_vector([0,0,0.2]))
    target_planes.append(frame_to_rhino_plane(safe_place_frame))
    target_planes.append(frame_to_rhino_plane(place_frame))
    
    tasks.append(MoveLinearURdirectTask(robot, robot_address, safe_place_frame, in_RCF=False, velocity=0.1))
    tasks.append(PlaceBrickURTask(robot, robot_address))
    tasks.append(MoveLinearURdirectTask(robot, robot_address, safe_place_frame, in_RCF=False, velocity=0.1))

    # Safety frames.
    tasks.append(MoveLinearURdirectTask(robot, robot_address, stack_side_safe_RCF, in_RCF=True, velocity=0.1))

    # Update assemblies.
    tasks.append(UpdateAssemblyAttributes(material_stack, place_key, attributes={"built":True, "available":False}))
# ---------- end disassembly_tasks_2 ----------

filter_3 = StreamFilter(
    Gate=list_5,
    Stream0=zero.configuration,
    Stream1=forward_kinematics.configuration,
    Stream2=analytic_inverse.configuration,
    Stream5=draw)
visualise = Python3Script(
    robot=robot,
    configuration=filter_3,
    show_frames=show_frames,
    show_visual_meshes=show_visual,
    show_robot_collision_meshes=show_robot_collision,
    show_collision_meshes=show_collision,
    show_attached_collision_meshes=show_attached_collision,
    show_BCF=show_bcf,
    show_RCF=show_rcf,
    show_EEF=show_eef,
    bang=import_bcf)  # -> out, joint_planes, visual_meshes, robot_collision_meshes, collision_meshes, attached_meshes, BCF, RCF, EEF, EEF_in_RCF; inputs bang: list
# ---------- visualise: Python ----------
from scriptcontext import sticky as st
import time
from compas_ghpython import create_id
from compas.geometry import Frame
from compas.geometry import Transformation
from compas_rhino.conversions import frame_to_rhino, mesh_to_compas, mesh_to_rhino, frame_to_rhino_plane
from compas.scene import SceneObject
from compas_fab.robots import PlanningScene
import Rhino.Geometry as rg
import ghpythonlib.components as ghcomp

robot.update(configuration)
print(configuration)

if show_visual_meshes == True:
    visual_meshes = robot.draw_visual()
    # orient the robot to its base plane:
    robot_BCF = frame_to_rhino_plane(robot.BCF) 
    init_robot_plane = rg.Plane.WorldXY
    #visual_meshes = ghcomp.Orient(visual_meshes, init_robot_plane, robot_BCF)[0]

if show_frames == True: 
    joint_frames = robot.model.transformed_frames(configuration)
    joint_planes = [frame_to_rhino(a) for a in joint_frames]

if show_BCF:
    BCF = frame_to_rhino(robot.BCF)

if show_RCF:
    RCF = frame_to_rhino(robot.from_BCF_to_WCF(robot.RCF))

if show_EEF:
    # EEF_in_RCF = frame_to_rhino(robot.from_BCF_to_RCF(robot.forward_kinematics(
    #     configuration, options=dict())))
    EEF = frame_to_rhino(robot.from_BCF_to_WCF(robot.forward_kinematics(
        configuration, options=dict())))
    print(EEF)


if show_robot_collision_meshes == True:
    robot_collision_meshes = robot.draw_collision()

cached_scene_key = "cached_scene"

if show_collision_meshes or show_attached_collision_meshes:
    cached_scene = st.get(cached_scene_key)
    if not cached_scene:
        cached_scene = {"time": 0}

    update_scene = True

    if update_scene:
        scene = PlanningScene(robot)
        scene = robot.client.get_planning_scene()

    if update_scene and show_collision_meshes:
        collision_meshes = []

        for co in scene.world.collision_objects:
            print(co)
            header = co.header
            frame_id = header.frame_id
            cms = co.to_collision_meshes()

            for cm in cms:
                if cm.frame != Frame.worldXY():
                    t = Transformation.from_frame(cm.frame)
                    mesh = cm.mesh.transformed(t)
                else:
                    mesh = cm.mesh
                collision_meshes.extend(SceneObject(item=mesh).draw())

        cached_scene["cm"] = collision_meshes

        collision_meshes = cached_scene.get("cm", [])

    if update_scene and show_attached_collision_meshes:
        attached_meshes = []

        for aco in scene.robot_state.attached_collision_objects:
            for acm in aco.to_attached_collision_meshes():
                print(acm)
                frame_id = aco.object["header"]["frame_id"]
                frame = robot.forward_kinematics(configuration, options=dict(link=frame_id))
                t = Transformation.from_frame(frame)

                # Local CM frame
                if acm.collision_mesh.frame and acm.collision_mesh.frame != Frame.worldXY():
                    t = t * Transformation.from_frame(acm.collision_mesh.frame)

                mesh = acm.collision_mesh.mesh.transformed(t)

                attached_meshes.extend(SceneObject(item=mesh).draw())

        cached_scene["acm"] = attached_meshes

        attached_meshes = cached_scene.get("acm", [])
    
    cached_scene["time"] = time.time()
    st[cached_scene_key] = cached_scene
# ---------- end visualise ----------
pln_11 = Plane(visualise.joint_planes)
mesh_2 = Mesh(visualise.collision_meshes)
mesh_3 = Mesh(visualise.visual_meshes)
py3_7 = Python3Script(planes=[visualise.EEF, visualise.RCF, visualise.BCF], scale=Slider(0.3, range=0..1))  # -> P, V, C, W; inputs planes: list of Plane, scale: Double; same code as py3_4
orient = Orient(Geometry=mesh_3, Source=PlaneXY(0, 0, 0), Target=visualise.BCF)  # -> Geometry, Transform
vdisex_4 = VectorDisplayEx(Point=py3_7.P, Vector=py3_7.V, Colour=py3_7.C, Width=py3_7.W)

mesh_4 = Mesh(visualise.robot_collision_meshes)
mesh_5 = Mesh(visualise.attached_meshes)
eef_in_rcf = Plane(visualise.EEF_in_RCF)
eef = Plane(visualise.EEF)
mcol = MeshColours(Mesh=orient.Geometry, Colours=ColourSwatch(SwatchColor=RGB(160, 147, 199)))
mcol_2 = MeshColours(Mesh=orient.Geometry, Colours=ColourSwatch(SwatchColor=RGB(212, 140, 140)))
filter_4 = StreamFilter(Gate=list_9, Stream0=mcol, Stream1=mcol_2)

preview_7 = CustomPreview(Geometry=filter_4, Material=ColourSwatch(SwatchColor=RGB(61, 61, 61)))

# ----
# Get Pose Cartesian
get_2 = Button()
pose_2 = Python3Script(get=get_2)  # -> out, pose_cartesian
# ---------- pose_2: Python ----------
from scriptcontext import sticky as st
#from ur_fabrication_control.online_control.ur_direct import get_current_pose_cartesian

from ur_fabrication_control.direct_control.common import get_current_pose_cartesian
from compas.geometry import Frame
from compas_ghpython import draw_frame


server_ip = st["server_ip"]
server_port = st["server_port"]
ur_port = st["ur_port"]
ur_ip = st["ur_ip"]
pose_cartesian_meter = []

# retrieve the current tool frame in axis angle format
if robot.attached_tool:
    print("attached")
    tool_angle_axis = list(robot.attached_tool.frame.point) + list(robot.attached_tool.frame.axis_angle_vector)
    
else:
    tool0_frame = Frame([0, 0, 0], [1, 0, 0], [0, 1, 0])
    tool_angle_axis = list(tool0_frame.point) + list(tool0_frame.axis_angle_vector)

guid = str(ghenv.Component.InstanceGuid)
pose_cartesian_key = "pose_cartesian" + guid

if pose_cartesian_key not in st:
    st[pose_cartesian_key] = None

if get:
    print("getting pose")
    st[pose_cartesian_key] = get_current_pose_cartesian(tool_angle_axis, server_ip, server_port, ur_ip, ur_port, send=True)
    
pose_cartesian = st[pose_cartesian_key]
# ---------- end pose_2 ----------
python = Python3Script(pose=pose_2.pose_cartesian)  # -> out, plane
# ---------- python: Python ----------
__author__ = "Gido"
__version__ = "2023.07.05"

import rhinoscriptsyntax as rs
from compas.geometry import Frame
from compas_ghpython import draw_frame

if pose is not None:
    frame_RCS = Frame.from_axis_angle_vector(pose[3:6], pose[0:3])
    T = Transformation.from_change_of_basis(robot.RCF, Frame.worldXY())
    frame_WCS = frame_RCS.transformed(T)
    plane = draw_frame(frame_WCS)
# ---------- end python ----------

# ----
# Direct UR control
rec = DataRecorder(pose_2.out, DataLimit=-10, RecordData=True)

panel_24 = Panel(rec)
